# Grasshopper definition furniture pieces exportable.gh (Grasshopper 1.0.8)
# plug-ins: Human

apartment_type = Data()
apartment_type_2 = Data(Slider(3, range=0..10))
equals = Equality(FirstNumber=apartment_type_2, SecondNumber="1")  # -> Equality, Inequality
equals_2 = Equality(FirstNumber=apartment_type_2, SecondNumber="3")  # -> Equality, Inequality
equals_3 = Equality(FirstNumber=apartment_type_2, SecondNumber="2")  # -> Equality, Inequality
larger = LargerThan(FirstNumber=apartment_type_2, SecondNumber="4")  # -> LargerThan, OrEqualTo
placementint = Panel("""0
2
3""")
program = Panel("Kitchen")
placementint_2 = Panel("""2
3""")
importance = Panel("1")
score = Panel("20")
placementint_3 = Panel("2")
program_2 = Panel("Dining")
placementint_4 = Panel("""1
2
3""")
importance_2 = Panel("1")
score_2 = Panel("20")
program_3 = Panel("Bed_StorageThree")
importance_3 = Panel("2")
score_3 = Panel("3")
program_4 = Panel("Bed_StorageTwo")
placementint_5 = Panel("2")
placementint_6 = Panel("2")
importance_4 = Panel("2")
program_5 = Panel("Kitchen")
placementint_7 = Panel("3")
importance_5 = Panel("1")
importance_6 = Panel("2")
score_4 = Panel("2")
program_6 = Panel("Bed_StorageOne")
score_5 = Panel("1")
score_6 = Panel("20")
program_7 = Panel("Kitchen")
placementint_8 = Panel("""0
1""")
importance_7 = Panel("1")
score_7 = Panel("20")
program_8 = Panel("Kitchen")
placementint_9 = Panel("""2
3""")
importance_8 = Panel("1")
score_8 = Panel("20")
geo = Geometry(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)
program_9 = Panel("Bed")
placementint_10 = Panel("""2
3""")
importance_9 = Panel("1")
score_9 = Panel("20")
placementint_11 = Panel("2")
program_10 = Panel("Bed_StorageThree")
importance_10 = Panel("2")
score_10 = Panel("3")
program_11 = Panel("Bed_StorageTwo")
placementint_12 = Panel("2")
placementint_13 = Panel("2")
importance_11 = Panel("2")
importance_12 = Panel("2")
score_11 = Panel("2")
program_12 = Panel("Bed_StorageOne")
score_12 = Panel("1")
program_13 = Panel("Bath")
placementint_14 = Panel("2")
importance_13 = Panel("1")
program_14 = Panel("Bed")
placementint_15 = Panel("""1
2
3""")
importance_14 = Panel("1")
program_15 = Panel("Bed")
placementint_16 = Panel("""2
3""")
importance_15 = Panel("1")
score_13 = Panel("20")
program_16 = Panel("Bath")
placementint_17 = Panel("2")
importance_16 = Panel("1")
score_14 = Panel("20")
score_15 = Panel("20")
score_16 = Panel("20")
program_17 = Panel("Bath")
placementint_18 = Panel("2")
importance_17 = Panel("1")
program_18 = Panel("Kitchen")
placementint_19 = Panel("""2
3""")
importance_18 = Panel("1")
score_17 = Panel("20")
program_19 = Panel("Bed")
placementint_20 = Panel("""2
3""")
importance_19 = Panel("1")
score_18 = Panel("20")
placementint_21 = Panel("2")
program_20 = Panel("Sofa")
placementint_22 = Panel("2")
importance_20 = Panel("1")
score_19 = Panel("20")
score_20 = Panel("20")
program_21 = Panel("Kitchen")
placementint_23 = Panel("""0
1""")
importance_21 = Panel("1")
score_21 = Panel("20")
program_22 = Panel("Kitchen")
placementint_24 = Panel("""1
2""")
importance_22 = Panel("1")
program_23 = Panel("Bed_StorageThree")
importance_23 = Panel("2")
score_22 = Panel("3")
area = Area(Geometry=geo)  # -> Area, Centroid
score_23 = Panel("20")
program_24 = Panel("Bed_StorageTwo")
placementint_25 = Panel("2")
placementint_26 = Panel("2")
importance_24 = Panel("2")
program_25 = Panel("Bed_StorageTwo")
placementint_27 = Panel("2")
placementint_28 = Panel("2")
importance_25 = Panel("2")
importance_26 = Panel("2")
score_24 = Panel("2")
program_26 = Panel("Bed_StorageOne")
score_25 = Panel("1")
importance_27 = Panel("2")
score_26 = Panel("2")
program_27 = Panel("Bed_StorageOne")
score_27 = Panel("1")
program_28 = Panel("Bath")
placementint_29 = Panel("2")
importance_28 = Panel("1")
program_29 = Panel("Bed")
placementint_30 = Panel("""1
2
3""")
importance_29 = Panel("1")
score_28 = Panel("20")
program_30 = Panel("Bath")
placementint_31 = Panel("2")
importance_30 = Panel("1")
score_29 = Panel("20")
score_30 = Panel("20")
program_31 = Panel("Bed")
placementint_32 = Panel("""2
3""")
importance_31 = Panel("1")
score_31 = Panel("20")
program_32 = Panel("Bath")
placementint_33 = Panel("2")
importance_32 = Panel("1")
program_33 = Panel("Bed")
placementint_34 = Panel("""2
3""")
importance_33 = Panel("1")
score_32 = Panel("20")
score_33 = Panel("20")
program_34 = Panel("Living")
placementint_35 = Panel("0")
importance_34 = Panel("1")
score_34 = Panel("20")
program_35 = Panel("Bed_StorageTwo")
placementint_36 = Panel("2")
placementint_37 = Panel("2")
importance_35 = Panel("2")
program_36 = Panel("Dining")
placementint_38 = Panel("""1
2
3""")
importance_36 = Panel("1")
importance_37 = Panel("2")
score_35 = Panel("2")
program_37 = Panel("Bed_StorageOne")
score_36 = Panel("1")
score_37 = Panel("20")
program_38 = Panel("Bath")
placementint_39 = Panel("2")
importance_38 = Panel("1")
program_39 = Panel("Bed")
placementint_40 = Panel("""1
2
3""")
importance_39 = Panel("1")
program_40 = Panel("Bed")
placementint_41 = Panel("""2
3""")
importance_40 = Panel("1")
score_38 = Panel("20")
program_41 = Panel("Bath")
placementint_42 = Panel("2")
importance_41 = Panel("1")
score_39 = Panel("20")
score_40 = Panel("20")
score_41 = Panel("20")
program_42 = Panel("Bath")
placementint_43 = Panel("2")
importance_42 = Panel("1")
program_43 = Panel("Living")
program_44 = Panel("Living")
placementint_44 = Panel("""0
1
2
3""")
importance_43 = Panel("1")
score_42 = Panel("20")
program_45 = Panel("Living")
placementint_45 = Panel("""0
1
2
3""")
importance_44 = Panel("1")
score_43 = Panel("20")
placementint_46 = Panel("""0
1
2
3""")
importance_45 = Panel("1")
score_44 = Panel("20")
score_45 = Panel("20")
program_46 = Panel("Bath")
placementint_47 = Panel("2")
importance_46 = Panel("1")
program_47 = Panel("Bed")
placementint_48 = Panel("""1
2
3""")
importance_47 = Panel("1")
program_48 = Panel("Bed")
placementint_49 = Panel("""1
2
3""")
importance_48 = Panel("1")
score_46 = Panel("20")
program_49 = Panel("Bed")
placementint_50 = Panel("""0
1
2
3""")
importance_49 = Panel("1")
program_50 = Panel("Bed")
placementint_51 = Panel("2")
importance_50 = Panel("1")
score_47 = Panel("20")
score_48 = Panel("20")
program_51 = Panel("Bath")
placementint_52 = Panel("2")
importance_51 = Panel("1")
score_49 = Panel("20")
score_50 = Panel("20")
score_51 = Panel("20")
program_52 = Panel("Dining")
placementint_53 = Panel("""0
1
2
3""")
importance_52 = Panel("1")
score_52 = Panel("20")
program_53 = Panel("Bath")
placementint_54 = Panel("2")
importance_53 = Panel("1")
program_54 = Panel("Bed")
score_53 = Panel("20")
placementint_55 = Panel("2")
importance_54 = Panel("1")
score_54 = Panel("20")
program_55 = Panel("Living")
placementint_56 = Panel("""0
1
2
3""")
importance_55 = Panel("1")
score_55 = Panel("20")
program_56 = Panel("Living")
placementint_57 = Panel("""0
1
2
3""")
importance_56 = Panel("1")
score_56 = Panel("20")
program_57 = Panel("Bed")
placementint_58 = Panel("""0
3""")
importance_57 = Panel("1")
program_58 = Panel("Bed")
placementint_59 = Panel("""0
3""")
importance_58 = Panel("1")
score_57 = Panel("20")
score_58 = Panel("20")
program_59 = Panel("Dining")
placementint_60 = Panel("""1
2
3""")
importance_59 = Panel("1")
score_59 = Panel("20")
program_60 = Panel("Kitchen")
placementint_61 = Panel("""0
1""")
importance_60 = Panel("1")
score_60 = Panel("20")
program_61 = Panel("Kitchen")
placementint_62 = Panel("""2
3""")
importance_61 = Panel("1")
score_61 = Panel("20")
program_62 = Panel("Kitchen")
placementint_63 = Panel("""1
2""")
importance_62 = Panel("1")
score_62 = Panel("20")
scale = Scale(Geometry=geo, Center=area.Centroid, Factor=Slider(0.97, range=0..1))  # -> Geometry, Transform

# ---- group: Prepare and Sort
txt_name = Text(program)
int_placement = Integer(placementint_2)
geo_2 = Geometry(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)
geo_3 = Geometry([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])
geo_4 = Geometry(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)

# ----
int_importance = Integer(importance)
num_score = Number(score)

# ---- group: Prepare and Sort
txt_name_2 = Text(program_2)
int_placement_2 = Integer(placementint_4)
geo_5 = Geometry(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)
geo_6 = Geometry(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)
geo_7 = Geometry([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])

txt_name_3 = Text(program_5)
int_placement_3 = Integer(placementint_9)
geo_8 = Geometry(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)
geo_9 = Geometry([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])
geo_10 = Geometry(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)

# ----
int_importance_2 = Integer(importance_2)

# ---- group: Prepare and Sort
txt_name_4 = Text(program_7)
int_placement_4 = Integer(placementint_8)
geo_11 = Geometry(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)
geo_12 = Geometry(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)
geo_13 = Geometry([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])

txt_name_5 = Text(program_8)
int_placement_5 = Integer(placementint_9)
geo_14 = Geometry(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)
geo_15 = Geometry(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)
geo_16 = Geometry([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])

# ----
int_importance_3 = Integer(importance_5)
int_importance_4 = Integer(importance_7)
int_importance_5 = Integer(importance_8)

# ---- group: Prepare and Sort
txt_name_6 = Text(program_9)
int_placement_6 = Integer(placementint_10)
geo_17 = Geometry(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)
geo_18 = Geometry(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)
geo_19 = Geometry([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])

# ----
int_importance_6 = Integer(importance_9)
num_score_2 = Number(score_2)

# ---- group: Prepare and Sort
txt_name_7 = Text(program_13)
int_placement_7 = Integer(placementint_14)
geo_20 = Geometry(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)
geo_21 = Geometry([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])
geo_22 = Geometry(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)

txt_name_8 = Text(program_14)
int_placement_8 = Integer(placementint_15)
geo_23 = Geometry(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)
geo_24 = Geometry([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])
geo_25 = Geometry(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)

txt_name_9 = Text(program_15)
int_placement_9 = Integer(placementint_16)
geo_26 = Geometry(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)
geo_27 = Geometry([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])
geo_28 = Geometry(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)

txt_name_10 = Text(program_16)
int_placement_10 = Integer(placementint_17)
geo_29 = Geometry(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)
geo_30 = Geometry(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)
geo_31 = Geometry([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])

# ----
num_score_3 = Number(score_6)
int_importance_7 = Integer(importance_13)
int_importance_8 = Integer(importance_14)
int_importance_9 = Integer(importance_15)
int_importance_10 = Integer(importance_16)
num_score_4 = Number(score_7)
num_score_5 = Number(score_8)

# ---- group: Prepare and Sort
txt_name_11 = Text(program_17)
int_placement_11 = Integer(placementint_18)
geo_32 = Geometry(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)
geo_33 = Geometry([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])
geo_34 = Geometry(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)

txt_name_12 = Text(program_18)
int_placement_12 = Integer(placementint_19)
geo_35 = Geometry(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)
geo_36 = Geometry([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])
geo_37 = Geometry(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)

txt_name_13 = Text(program_20)
int_placement_13 = Integer(placementint_22)
geo_38 = Geometry(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)
geo_39 = Geometry(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)
geo_40 = Geometry([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])

txt_name_14 = Text(program_19)
int_placement_14 = Integer(placementint_20)
geo_41 = Geometry(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)
geo_42 = Geometry([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])
geo_43 = Geometry(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)

txt_name_15 = Text(program_21)
int_placement_15 = Integer(placementint_23)
geo_44 = Geometry(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)
geo_45 = Geometry(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)
geo_46 = Geometry([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])

# ----
int_importance_11 = Integer(importance_17)

# ---- group: Prepare and Sort
txt_name_16 = Text(program_22)
int_placement_16 = Integer(placementint_24)
geo_47 = Geometry(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)
geo_48 = Geometry([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])
geo_49 = Geometry(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)

# ----
int_importance_12 = Integer(importance_18)
int_importance_13 = Integer(importance_19)
num_score_6 = Number(score_9)
int_importance_14 = Integer(importance_20)
int_importance_15 = Integer(importance_21)
int_importance_16 = Integer(importance_22)

# ---- group: Prepare and Sort
txt_name_17 = Text(program_28)
int_placement_17 = Integer(placementint_29)
geo_50 = Geometry(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)
geo_51 = Geometry([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])
geo_52 = Geometry(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)

txt_name_18 = Text(program_29)
int_placement_18 = Integer(placementint_30)
geo_53 = Geometry(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)
geo_54 = Geometry([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])
geo_55 = Geometry(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)

txt_name_19 = Text(program_31)
int_placement_19 = Integer(placementint_32)
geo_56 = Geometry(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)
geo_57 = Geometry(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)
geo_58 = Geometry([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])

txt_name_20 = Text(program_30)
int_placement_20 = Integer(placementint_31)
geo_59 = Geometry(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)
geo_60 = Geometry(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)
geo_61 = Geometry([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])

# ----
int_importance_17 = Integer(importance_28)
int_importance_18 = Integer(importance_29)
int_importance_19 = Integer(importance_30)
num_score_7 = Number(score_13)
num_score_8 = Number(score_14)
int_importance_20 = Integer(importance_31)
num_score_9 = Number(score_15)
num_score_10 = Number(score_16)

# ---- group: Prepare and Sort
txt_name_21 = Text(program_32)
int_placement_21 = Integer(placementint_33)
geo_62 = Geometry(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)
geo_63 = Geometry([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])
geo_64 = Geometry(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)

txt_name_22 = Text(program_33)
int_placement_22 = Integer(placementint_34)
geo_65 = Geometry(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)
geo_66 = Geometry([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])
geo_67 = Geometry(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)

txt_name_23 = Text(program_34)
int_placement_23 = Integer(placementint_35)
geo_68 = Geometry(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)
geo_69 = Geometry(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)
geo_70 = Geometry([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])

txt_name_24 = Text(program_3)
int_placement_24 = Integer(placementint_3)
geo_71 = Geometry([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])
geo_72 = Geometry(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)
geo_73 = Geometry(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)

# ----
int_importance_21 = Integer(importance_32)
int_importance_22 = Integer(importance_33)
num_score_11 = Number(score_17)
num_score_12 = Number(score_20)

# ---- group: Prepare and Sort
txt_name_25 = Text(program_4)
int_placement_25 = Integer(placementint_5)
geo_74 = Geometry([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])
geo_75 = Geometry(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)
geo_76 = Geometry(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)

# ----
int_importance_23 = Integer(importance_34)

# ---- group: Prepare and Sort
txt_name_26 = Text(program_36)
int_placement_26 = Integer(placementint_38)
geo_77 = Geometry(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)
geo_78 = Geometry([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])
geo_79 = Geometry(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)

# ----
num_score_13 = Number(score_18)
num_score_14 = Number(score_19)

# ---- group: Prepare and Sort
txt_name_27 = Text(program_6)
int_placement_27 = Integer(placementint_6)
geo_80 = Geometry(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)
geo_81 = Geometry(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)
geo_82 = Geometry([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])

# ----
importance_63 = Integer(importance_4)
num_score_15 = Number(score_5)
num_score_16 = Number(score_21)
int_importance_24 = Integer(importance_43)

# ---- group: Prepare and Sort
txt_name_28 = Text(program_38)
int_placement_28 = Integer(placementint_39)
geo_83 = Geometry(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)
geo_84 = Geometry([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])
geo_85 = Geometry(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)

txt_name_29 = Text(program_39)
int_placement_29 = Integer(placementint_40)
geo_86 = Geometry(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)
geo_87 = Geometry(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)
geo_88 = Geometry([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])

# ----
int_importance_25 = Integer(importance_39)
num_score_17 = Number(score_40)

# ---- group: Prepare and Sort
txt_name_30 = Text(program_40)
int_placement_30 = Integer(placementint_41)
geo_89 = Geometry(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)
geo_90 = Geometry([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])
geo_91 = Geometry(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)

txt_name_31 = Text(program_10)
int_placement_31 = Integer(placementint_11)
geo_92 = Geometry(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)
geo_93 = Geometry(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)
geo_94 = Geometry([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])

# ----
importance_64 = Integer(importance_10)
num_score_18 = Number(score_10)

# ---- group: Prepare and Sort
txt_name_32 = Text(program_11)
int_placement_32 = Integer(placementint_12)
geo_95 = Geometry(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)
geo_96 = Geometry(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)
geo_97 = Geometry([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])

# ----
int_importance_26 = Integer(importance_12)
num_score_19 = Number(score_11)

# ---- group: Prepare and Sort
txt_name_33 = Text(program_12)
int_placement_33 = Integer(placementint_13)
geo_98 = Geometry(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)
geo_99 = Geometry(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)
geo_100 = Geometry([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])

# ----
importance_65 = Integer(importance_11)
num_score_20 = Number(score_12)

# ---- group: Prepare and Sort
txt_name_34 = Text(program_45)
int_placement_34 = Integer(placementint_45)
geo_101 = Geometry(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)
geo_102 = Geometry(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)
geo_103 = Geometry([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])

# ----
int_importance_27 = Integer(importance_44)
num_score_21 = Number(score_43)

# ---- group: Prepare and Sort
txt_name_35 = Text(program_43)
int_placement_35 = Integer(placementint_46)
geo_104 = Geometry(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)
geo_105 = Geometry(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)
geo_106 = Geometry([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])

# ----
int_importance_28 = Integer(importance_45)
num_score_22 = Number(score_44)

# ---- group: Prepare and Sort
txt_name_36 = Text(program_44)
int_placement_36 = Integer(placementint_44)
geo_107 = Geometry(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)
geo_108 = Geometry(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)
geo_109 = Geometry([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])

# ----
num_score_23 = Number(score_45)

# ---- group: Prepare and Sort
txt_name_37 = Text(program_41)
int_placement_37 = Integer(placementint_42)
geo_110 = Geometry(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)
geo_111 = Geometry(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)
geo_112 = Geometry([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])

# ----
num_score_24 = Number(score_4)
int_importance_29 = Integer(importance_36)
int_importance_30 = Integer(importance_38)
num_score_25 = Number(score_3)
int_importance_31 = Integer(importance_40)
int_importance_32 = Integer(importance_41)
num_score_26 = Number(score_23)
num_score_27 = Number(score_28)
num_score_28 = Number(score_29)
num_score_29 = Number(score_30)
num_score_30 = Number(score_31)

# ---- group: Prepare and Sort
txt_name_38 = Text(program_42)
int_placement_38 = Integer(placementint_43)
geo_113 = Geometry(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)
geo_114 = Geometry([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])
geo_115 = Geometry(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)

# ----
int_importance_33 = Integer(importance_6)
importance_66 = Integer(importance_3)
int_importance_34 = Integer(importance_42)
num_score_31 = Number(score_32)
num_score_32 = Number(score_33)
num_score_33 = Number(score_34)
num_score_34 = Number(score_46)

# ---- group: Prepare and Sort
geo_116 = Geometry(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)
txt_name_39 = Text(program_48)
int_placement_39 = Integer(placementint_49)
geo_117 = Geometry(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)
geo_118 = Geometry([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])

txt_name_40 = Text(program_46)
int_placement_40 = Integer(placementint_47)
geo_119 = Geometry(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)
geo_120 = Geometry([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])
geo_121 = Geometry(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)

txt_name_41 = Text(program_47)
int_placement_41 = Integer(placementint_48)
geo_122 = Geometry(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)
geo_123 = Geometry(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)
geo_124 = Geometry([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])

# ----
int_importance_35 = Integer(importance_47)
num_score_35 = Number(score_50)
int_importance_36 = Integer(importance_48)

# ---- group: Prepare and Sort
txt_name_42 = Text(program_24)
int_placement_42 = Integer(placementint_25)
geo_125 = Geometry(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)
geo_126 = Geometry(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)
geo_127 = Geometry([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])

# ----
int_importance_37 = Integer(importance_26)
num_score_36 = Number(score_24)

# ---- group: Prepare and Sort
txt_name_43 = Text(program_26)
int_placement_43 = Integer(placementint_26)
geo_128 = Geometry(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)
geo_129 = Geometry(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)
geo_130 = Geometry([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])

# ----
importance_67 = Integer(importance_24)
num_score_37 = Number(score_25)

# ---- group: Prepare and Sort
txt_name_44 = Text(program_49)
int_placement_44 = Integer(placementint_50)
geo_131 = Geometry(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)
geo_132 = Geometry(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)
geo_133 = Geometry([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])

# ----
int_importance_38 = Integer(importance_49)
num_score_38 = Number(score_51)

# ---- group: Prepare and Sort
txt_name_45 = Text(program_50)
int_placement_45 = Integer(placementint_51)
geo_134 = Geometry(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)
geo_135 = Geometry(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)
geo_136 = Geometry([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])

txt_name_46 = Text(program_23)
int_placement_46 = Integer(placementint_21)
geo_137 = Geometry(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)
geo_138 = Geometry(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)
geo_139 = Geometry([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])

# ----
importance_68 = Integer(importance_23)
num_score_39 = Number(score_22)

# ---- group: Prepare and Sort
txt_name_47 = Text(program_25)
int_placement_47 = Integer(placementint_27)
geo_140 = Geometry(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)
geo_141 = Geometry(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)
geo_142 = Geometry([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])

# ----
int_importance_39 = Integer(importance_27)
num_score_40 = Number(score_26)

# ---- group: Prepare and Sort
txt_name_48 = Text(program_27)
int_placement_48 = Integer(placementint_28)
geo_143 = Geometry(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)
geo_144 = Geometry(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)
geo_145 = Geometry([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])

# ----
importance_69 = Integer(importance_25)
num_score_41 = Number(score_27)

# ---- group: Prepare and Sort
txt_name_49 = Text(program_55)
int_placement_49 = Integer(placementint_56)
geo_146 = Geometry(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)
geo_147 = Geometry(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)
geo_148 = Geometry([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])

# ----
int_importance_40 = Integer(importance_55)
num_score_42 = Number(score_55)
geo_149 = Geometry(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)
int_importance_41 = Integer(importance_56)
num_score_43 = Number(score_56)

# ---- group: Prepare and Sort
geo_150 = Geometry(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)
geo_151 = Geometry([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])
txt_name_50 = Text(program_56)
int_placement_50 = Integer(placementint_57)
geo_152 = Geometry(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)

# ----
int_importance_42 = Integer(importance_46)
num_score_44 = Number(score_37)
int_importance_43 = Integer(importance_50)
int_importance_44 = Integer(importance_51)
num_score_45 = Number(score_38)
num_score_46 = Number(score_39)

# ---- group: Prepare and Sort
txt_name_51 = Text(program_52)
int_placement_51 = Integer(placementint_53)
geo_153 = Geometry(scale.Geometry)
geo_154 = Geometry([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])
geo_155 = Geometry(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)

# ----
num_score_47 = Number(score_41)

# ---- group: Prepare and Sort
txt_name_52 = Text(program_53)
int_placement_52 = Integer(placementint_54)
geo_156 = Geometry(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)
geo_157 = Geometry([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])
geo_158 = Geometry(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)

# ----
explode = Explode(Curve=geo_156, Recursive=True)  # -> Segments, Vertices
item = ListItem(List=explode.Segments, Index=Slider(2, range=0..10), Wrap=True)
curvepoint = PointOnCurve(item, parameter=0.5)
scale_nu = ScaleNU(Geometry=geo_156, Plane=curvepoint, ScaleX=1, ScaleY=Slider(0.89, range=0..1), ScaleZ=1)  # -> Geometry, Transform

# ---- group: Prepare and Sort
txt_name_53 = Text(program_54)
int_placement_53 = Integer(placementint_55)
geo_159 = Geometry(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)
geo_160 = Geometry(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)
geo_161 = Geometry([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])

# ----
int_importance_45 = Integer(importance_52)
int_importance_46 = Integer(importance_53)
num_score_48 = Number(score_42)
int_importance_47 = Integer(importance_54)
num_score_49 = Number(score_57)

# ---- group: Prepare and Sort
geo_162 = Geometry(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)
txt_name_54 = Text(program_58)
int_placement_54 = Integer(placementint_59)
geo_163 = Geometry(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)
geo_164 = Geometry([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])

txt_name_55 = Text(program_57)
int_placement_55 = Integer(placementint_58)
geo_165 = Geometry(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)
geo_166 = Geometry(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)
geo_167 = Geometry([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])

# ----
int_importance_48 = Integer(importance_57)
num_score_50 = Number(score_58)
int_importance_49 = Integer(importance_58)

# ---- group: Prepare and Sort
txt_name_56 = Text(program_35)
int_placement_56 = Integer(placementint_36)
geo_168 = Geometry(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)
geo_169 = Geometry(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)
geo_170 = Geometry([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])

# ----
int_importance_50 = Integer(importance_37)
num_score_51 = Number(score_35)

# ---- group: Prepare and Sort
txt_name_57 = Text(program_37)
int_placement_57 = Integer(placementint_37)
geo_171 = Geometry(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)
geo_172 = Geometry(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)
geo_173 = Geometry([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])

# ----
importance_70 = Integer(importance_35)
num_score_52 = Number(score_36)
num_score_53 = Number(score_47)
num_score_54 = Number(score_48)
num_score_55 = Number(score_49)
num_score_56 = Number(score_52)
num_score_57 = Number(score_53)
num_score_58 = Number(score_54)

# ---- group: Prepare and Sort
txt_name_58 = Text(program_59)
int_placement_58 = Integer(placementint_60)
geo_174 = Geometry(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)
geo_175 = Geometry(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)
geo_176 = Geometry([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])

txt_name_59 = Text(program_60)
int_placement_59 = Integer(placementint_61)
geo_177 = Geometry(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)
geo_178 = Geometry(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)
geo_179 = Geometry([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])

# ----
int_importance_51 = Integer(importance_59)
int_importance_52 = Integer(importance_60)

# ---- group: Prepare and Sort
txt_name_60 = Text(program_61)
int_placement_60 = Integer(placementint_62)
geo_180 = Geometry(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)
geo_181 = Geometry(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)
geo_182 = Geometry([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])

txt_name_61 = Text(program_62)
int_placement_61 = Integer(placementint_63)
geo_183 = Geometry(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)
geo_184 = Geometry([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])
geo_185 = Geometry(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)

# ----
int_importance_53 = Integer(importance_61)
int_importance_54 = Integer(importance_62)
num_score_59 = Number(score_59)
num_score_60 = Number(score_60)
num_score_61 = Number(score_61)
num_score_62 = Number(score_62)
explode_2 = Explode(Curve=geo_4, Recursive=True)  # -> Segments, Vertices
explode_3 = Explode(Curve=geo_5, Recursive=True)  # -> Segments, Vertices
explode_4 = Explode(Curve=geo_8, Recursive=True)  # -> Segments, Vertices
explode_5 = Explode(Curve=geo_14, Recursive=True)  # -> Segments, Vertices

# ---- group: Prepare and Sort
explode_6 = Explode(Curve=geo_72, Recursive=True)  # -> Segments, Vertices
item_2 = ListItem(List=explode_6.Segments, Index=int_placement_24, Wrap=True)
previewlw = CustomPreviewLineweights(Geometry=item_2, Shader=ColourSwatch(SwatchColor=RGB(33, 33, 33)), Thickness=Slider(6, range=0..10), Absolute=False)

explode_7 = Explode(Curve=geo_75, Recursive=True)  # -> Segments, Vertices
item_3 = ListItem(List=explode_7.Segments, Index=int_placement_25, Wrap=True)
previewlw_2 = CustomPreviewLineweights(Geometry=item_3, Shader=ColourSwatch(SwatchColor=RGB(33, 33, 33)), Thickness=Slider(6, range=0..10), Absolute=False)

# ----
explode_8 = Explode(Curve=geo_17, Recursive=True)  # -> Segments, Vertices

# ---- group: Prepare and Sort
explode_9 = Explode(Curve=geo_80, Recursive=True)  # -> Segments, Vertices
item_4 = ListItem(List=explode_9.Segments, Index=int_placement_27, Wrap=True)
previewlw_3 = CustomPreviewLineweights(Geometry=item_4, Shader=ColourSwatch(SwatchColor=RGB(33, 33, 33)), Thickness=Slider(6, range=0..10), Absolute=False)

# ----
explode_10 = Explode(Curve=geo_20, Recursive=True)  # -> Segments, Vertices
explode_11 = Explode(Curve=geo_29, Recursive=True)  # -> Segments, Vertices
explode_12 = Explode(Curve=geo_26, Recursive=True)  # -> Segments, Vertices

# ---- group: Prepare and Sort
explode_13 = Explode(Curve=geo_92, Recursive=True)  # -> Segments, Vertices
item_5 = ListItem(List=explode_13.Segments, Index=int_placement_31, Wrap=True)
# 3
previewlw_4 = CustomPreviewLineweights(Geometry=item_5, Shader=ColourSwatch(SwatchColor=RGB(33, 33, 33)), Thickness=Slider(6, range=0..10), Absolute=False)

# ----
explode_14 = Explode(Curve=geo_23, Recursive=True)  # -> Segments, Vertices

# ---- group: Prepare and Sort
explode_15 = Explode(Curve=geo_95, Recursive=True)  # -> Segments, Vertices
item_6 = ListItem(List=explode_15.Segments, Index=int_placement_32, Wrap=True)
previewlw_5 = CustomPreviewLineweights(Geometry=item_6, Shader=ColourSwatch(SwatchColor=RGB(33, 33, 33)), Thickness=Slider(6, range=0..10), Absolute=False)

# ----
number_slider = Slider(6, range=0..10)
explode_16 = Explode(Curve=geo_32, Recursive=True)  # -> Segments, Vertices
explode_17 = Explode(Curve=geo_35, Recursive=True)  # -> Segments, Vertices
explode_18 = Explode(Curve=geo_41, Recursive=True)  # -> Segments, Vertices
explode_19 = Explode(Curve=geo_44, Recursive=True)  # -> Segments, Vertices
explode_20 = Explode(Curve=geo_47, Recursive=True)  # -> Segments, Vertices

# ---- group: Prepare and Sort
explode_21 = Explode(Curve=geo_98, Recursive=True)  # -> Segments, Vertices
item_7 = ListItem(List=explode_21.Segments, Index=int_placement_33, Wrap=True)
previewlw_6 = CustomPreviewLineweights(Geometry=item_7, Shader=ColourSwatch(SwatchColor=RGB(33, 33, 33)), Thickness=Slider(6, range=0..10), Absolute=False)

# ----
explode_22 = Explode(Curve=geo_38, Recursive=True)  # -> Segments, Vertices
explode_23 = Explode(Curve=geo_50, Recursive=True)  # -> Segments, Vertices
explode_24 = Explode(Curve=geo_59, Recursive=True)  # -> Segments, Vertices

# ---- group: Prepare and Sort
explode_25 = Explode(Curve=geo_137, Recursive=True)  # -> Segments, Vertices
item_8 = ListItem(List=explode_25.Segments, Index=int_placement_46, Wrap=True)
previewlw_7 = CustomPreviewLineweights(Geometry=item_8, Shader=ColourSwatch(SwatchColor=RGB(33, 33, 33)), Thickness=Slider(6, range=0..10), Absolute=False)

# ----
explode_26 = Explode(Curve=geo_53, Recursive=True)  # -> Segments, Vertices
explode_27 = Explode(Curve=geo_56, Recursive=True)  # -> Segments, Vertices
explode_28 = Explode(Curve=geo_65, Recursive=True)  # -> Segments, Vertices

# ---- group: Prepare and Sort
explode_29 = Explode(Curve=geo_125, Recursive=True)  # -> Segments, Vertices
item_9 = ListItem(List=explode_29.Segments, Index=int_placement_42, Wrap=True)
previewlw_8 = CustomPreviewLineweights(Geometry=item_9, Shader=ColourSwatch(SwatchColor=RGB(33, 33, 33)), Thickness=Slider(6, range=0..10), Absolute=False)

explode_30 = Explode(Curve=geo_140, Recursive=True)  # -> Segments, Vertices
item_10 = ListItem(List=explode_30.Segments, Index=int_placement_47, Wrap=True)
previewlw_9 = CustomPreviewLineweights(Geometry=item_10, Shader=ColourSwatch(SwatchColor=RGB(33, 33, 33)), Thickness=Slider(6, range=0..10), Absolute=False)

explode_31 = Explode(Curve=geo_128, Recursive=True)  # -> Segments, Vertices
item_11 = ListItem(List=explode_31.Segments, Index=int_placement_43, Wrap=True)
previewlw_10 = CustomPreviewLineweights(Geometry=item_11, Shader=ColourSwatch(SwatchColor=RGB(33, 33, 33)), Thickness=Slider(6, range=0..10), Absolute=False)

explode_32 = Explode(Curve=geo_143, Recursive=True)  # -> Segments, Vertices
item_12 = ListItem(List=explode_32.Segments, Index=int_placement_48, Wrap=True)
previewlw_11 = CustomPreviewLineweights(Geometry=item_12, Shader=ColourSwatch(SwatchColor=RGB(33, 33, 33)), Thickness=Slider(6, range=0..10), Absolute=False)

# ----
explode_33 = Explode(Curve=geo_68, Recursive=True)  # -> Segments, Vertices
explode_34 = Explode(Curve=geo_77, Recursive=True)  # -> Segments, Vertices
explode_35 = Explode(Curve=geo_89, Recursive=True)  # -> Segments, Vertices
explode_36 = Explode(Curve=geo_83, Recursive=True)  # -> Segments, Vertices
explode_37 = Explode(Curve=geo_110, Recursive=True)  # -> Segments, Vertices
number_slider_2 = Slider(6, range=0..10)
explode_38 = Explode(Curve=geo_86, Recursive=True)  # -> Segments, Vertices

# ---- group: Prepare and Sort
explode_39 = Explode(Curve=geo_168, Recursive=True)  # -> Segments, Vertices
item_13 = ListItem(List=explode_39.Segments, Index=int_placement_56, Wrap=True)
previewlw_12 = CustomPreviewLineweights(Geometry=item_13, Shader=ColourSwatch(SwatchColor=RGB(33, 33, 33)), Thickness=Slider(6, range=0..10), Absolute=False)

# ----
explode_40 = Explode(Curve=geo_113, Recursive=True)  # -> Segments, Vertices
explode_41 = Explode(Curve=geo_107, Recursive=True)  # -> Segments, Vertices
explode_42 = Explode(Curve=geo_104, Recursive=True)  # -> Segments, Vertices

# ---- group: Prepare and Sort
explode_43 = Explode(Curve=geo_171, Recursive=True)  # -> Segments, Vertices
item_14 = ListItem(List=explode_43.Segments, Index=int_placement_57, Wrap=True)
previewlw_13 = CustomPreviewLineweights(Geometry=item_14, Shader=ColourSwatch(SwatchColor=RGB(33, 33, 33)), Thickness=Slider(6, range=0..10), Absolute=False)

# ----
explode_44 = Explode(Curve=geo_101, Recursive=True)  # -> Segments, Vertices
explode_45 = Explode(Curve=geo_134, Recursive=True)  # -> Segments, Vertices
explode_46 = Explode(Curve=geo_119, Recursive=True)  # -> Segments, Vertices
explode_47 = Explode(Curve=geo_62, Recursive=True)  # -> Segments, Vertices
explode_48 = Explode(Curve=geo_117, Recursive=True)  # -> Segments, Vertices
explode_49 = Explode(Curve=geo_122, Recursive=True)  # -> Segments, Vertices
explode_50 = Explode(Curve=geo_131, Recursive=True)  # -> Segments, Vertices
explode_51 = Explode(Curve=geo_159, Recursive=True)  # -> Segments, Vertices
explode_52 = Explode(Curve=geo_153, Recursive=True)  # -> Segments, Vertices
explode_53 = Explode(Curve=geo_156, Recursive=True)  # -> Segments, Vertices
explode_54 = Explode(Curve=geo_146, Recursive=True)  # -> Segments, Vertices
explode_55 = Explode(Curve=geo_152, Recursive=True)  # -> Segments, Vertices
explode_56 = Explode(Curve=geo_163, Recursive=True)  # -> Segments, Vertices
item_15 = ListItem(List=explode_2.Segments, Index=int_placement, Wrap=True)
explode_57 = Explode(Curve=geo_165, Recursive=True)  # -> Segments, Vertices
explode_58 = Explode(Curve=geo_174, Recursive=True)  # -> Segments, Vertices
explode_59 = Explode(Curve=geo_177, Recursive=True)  # -> Segments, Vertices
explode_60 = Explode(Curve=geo_180, Recursive=True)  # -> Segments, Vertices
explode_61 = Explode(Curve=geo_183, Recursive=True)  # -> Segments, Vertices
item_16 = ListItem(List=explode_3.Segments, Index=int_placement_2, Wrap=True)
item_17 = ListItem(List=explode_4.Segments, Index=int_placement_3, Wrap=True)
explode_62 = Explode(Curve=geo_11, Recursive=True)  # -> Segments, Vertices
item_18 = ListItem(List=explode_5.Segments, Index=int_placement_5, Wrap=True)
item_19 = ListItem(List=explode_8.Segments, Index=int_placement_6, Wrap=True)
item_20 = ListItem(List=explode_10.Segments, Index=int_placement_7, Wrap=True)
item_21 = ListItem(List=explode_11.Segments, Index=int_placement_10, Wrap=True)
item_22 = ListItem(List=explode_12.Segments, Index=int_placement_9, Wrap=True)
item_23 = ListItem(List=explode_14.Segments, Index=int_placement_8, Wrap=True)
item_24 = ListItem(List=explode_16.Segments, Index=int_placement_11, Wrap=True)
swatch = ColourSwatch(SwatchColor=RGB(33, 33, 33))
item_25 = ListItem(List=explode_18.Segments, Index=int_placement_14, Wrap=True)
item_26 = ListItem(List=explode_19.Segments, Index=int_placement_15, Wrap=True)
item_27 = ListItem(List=explode_17.Segments, Index=int_placement_12, Wrap=True)
item_28 = ListItem(List=explode_22.Segments, Index=int_placement_13, Wrap=True)
item_29 = ListItem(List=explode_20.Segments, Index=int_placement_16, Wrap=True)
item_30 = ListItem(List=explode_23.Segments, Index=int_placement_17, Wrap=True)
item_31 = ListItem(List=explode_24.Segments, Index=int_placement_20, Wrap=True)
item_32 = ListItem(List=explode_26.Segments, Index=int_placement_18, Wrap=True)
item_33 = ListItem(List=explode_27.Segments, Index=int_placement_19, Wrap=True)
item_34 = ListItem(List=explode_28.Segments, Index=int_placement_22, Wrap=True)
item_35 = ListItem(List=explode_33.Segments, Index=int_placement_23, Wrap=True)
item_36 = ListItem(List=explode_34.Segments, Index=int_placement_26, Wrap=True)
item_37 = ListItem(List=explode_35.Segments, Index=int_placement_30, Wrap=True)
item_38 = ListItem(List=explode_36.Segments, Index=int_placement_28, Wrap=True)
item_39 = ListItem(List=explode_37.Segments, Index=int_placement_37, Wrap=True)
swatch_2 = ColourSwatch(SwatchColor=RGB(33, 33, 33))
item_40 = ListItem(List=explode_38.Segments, Index=int_placement_29, Wrap=True)
item_41 = ListItem(List=explode_40.Segments, Index=int_placement_38, Wrap=True)
item_42 = ListItem(List=explode_41.Segments, Index=int_placement_36, Wrap=True)
item_43 = ListItem(List=explode_42.Segments, Index=int_placement_35, Wrap=True)
item_44 = ListItem(List=explode_44.Segments, Index=int_placement_34, Wrap=True)
item_45 = ListItem(List=explode_45.Segments, Index=int_placement_45, Wrap=True)
scale_2 = Scale(Center=Point(0, 0, 0), Factor=0.5)  # -> Geometry, Transform
item_46 = ListItem(List=explode_46.Segments, Index=int_placement_40, Wrap=True)
item_47 = ListItem(List=explode_47.Segments, Index=int_placement_21, Wrap=True)
item_48 = ListItem(List=explode_48.Segments, Index=int_placement_39, Wrap=True)
item_49 = ListItem(List=explode_49.Segments, Index=int_placement_41, Wrap=True)
item_50 = ListItem(List=explode_50.Segments, Index=int_placement_44, Wrap=True)
item_51 = ListItem(List=explode_51.Segments, Index=int_placement_53, Wrap=True)
item_52 = ListItem(List=explode_52.Segments, Index=int_placement_51, Wrap=True)
item_53 = ListItem(List=explode_53.Segments, Index=int_placement_52, Wrap=True)
item_54 = ListItem(List=explode_54.Segments, Index=int_placement_49, Wrap=True)
item_55 = ListItem(List=explode_59.Segments, Index=int_placement_59, Wrap=True)
item_56 = ListItem(List=explode_55.Segments, Index=int_placement_50, Wrap=True)
item_57 = ListItem(List=explode_56.Segments, Index=int_placement_54, Wrap=True)
item_58 = ListItem(List=explode_57.Segments, Index=int_placement_55, Wrap=True)
item_59 = ListItem(List=explode_58.Segments, Index=int_placement_58, Wrap=True)
item_60 = ListItem(List=explode_61.Segments, Index=int_placement_61, Wrap=True)
item_61 = ListItem(List=explode_60.Segments, Index=int_placement_60, Wrap=True)
previewlw_14 = CustomPreviewLineweights(Geometry=item_15, Shader=ColourSwatch(SwatchColor=RGB(33, 33, 33)), Thickness=Slider(6, range=0..10), Absolute=False)
item_62 = ListItem(List=explode_62.Segments, Index=int_placement_4, Wrap=True)
previewlw_15 = CustomPreviewLineweights(Geometry=item_16, Shader=ColourSwatch(SwatchColor=RGB(33, 33, 33)), Thickness=Slider(6, range=0..10), Absolute=False)
previewlw_16 = CustomPreviewLineweights(Geometry=item_17, Shader=ColourSwatch(SwatchColor=RGB(33, 33, 33)), Thickness=Slider(6, range=0..10), Absolute=False)
previewlw_17 = CustomPreviewLineweights(Geometry=item_18, Shader=ColourSwatch(SwatchColor=RGB(33, 33, 33)), Thickness=Slider(6, range=0..10), Absolute=False)
previewlw_18 = CustomPreviewLineweights(Geometry=item_19, Shader=ColourSwatch(SwatchColor=RGB(33, 33, 33)), Thickness=Slider(6, range=0..10), Absolute=False)
previewlw_19 = CustomPreviewLineweights(Geometry=item_20, Shader=ColourSwatch(SwatchColor=RGB(33, 33, 33)), Thickness=Slider(6, range=0..10), Absolute=False)
previewlw_20 = CustomPreviewLineweights(Geometry=item_21, Shader=ColourSwatch(SwatchColor=RGB(33, 33, 33)), Thickness=Slider(6, range=0..10), Absolute=False)
previewlw_21 = CustomPreviewLineweights(Geometry=item_22, Shader=ColourSwatch(SwatchColor=RGB(33, 33, 33)), Thickness=Slider(6, range=0..10), Absolute=False)
previewlw_22 = CustomPreviewLineweights(Geometry=item_23, Shader=ColourSwatch(SwatchColor=RGB(33, 33, 33)), Thickness=Slider(6, range=0..10), Absolute=False)
previewlw_23 = CustomPreviewLineweights(Geometry=item_24, Shader=ColourSwatch(SwatchColor=RGB(33, 33, 33)), Thickness=Slider(6, range=0..10), Absolute=False)
previewlw_24 = CustomPreviewLineweights(Geometry=item_27, Shader=ColourSwatch(SwatchColor=RGB(33, 33, 33)), Thickness=Slider(6, range=0..10), Absolute=False)
previewlw_25 = CustomPreviewLineweights(Geometry=item_25, Shader=ColourSwatch(SwatchColor=RGB(33, 33, 33)), Thickness=Slider(6, range=0..10), Absolute=False)
previewlw_26 = CustomPreviewLineweights(Geometry=item_26, Shader=ColourSwatch(SwatchColor=RGB(33, 33, 33)), Thickness=Slider(6, range=0..10), Absolute=False)
previewlw_27 = CustomPreviewLineweights(Geometry=item_29, Shader=ColourSwatch(SwatchColor=RGB(33, 33, 33)), Thickness=Slider(6, range=0..10), Absolute=False)
previewlw_28 = CustomPreviewLineweights(Geometry=item_28, Shader=ColourSwatch(SwatchColor=RGB(33, 33, 33)), Thickness=Slider(6, range=0..10), Absolute=False)
previewlw_29 = CustomPreviewLineweights(Geometry=item_30, Shader=ColourSwatch(SwatchColor=RGB(33, 33, 33)), Thickness=Slider(6, range=0..10), Absolute=False)
previewlw_30 = CustomPreviewLineweights(Geometry=item_31, Shader=ColourSwatch(SwatchColor=RGB(33, 33, 33)), Thickness=Slider(6, range=0..10), Absolute=False)
previewlw_31 = CustomPreviewLineweights(Geometry=item_32, Shader=ColourSwatch(SwatchColor=RGB(33, 33, 33)), Thickness=Slider(6, range=0..10), Absolute=False)
previewlw_32 = CustomPreviewLineweights(Geometry=item_33, Shader=ColourSwatch(SwatchColor=RGB(33, 33, 33)), Thickness=Slider(6, range=0..10), Absolute=False)
previewlw_33 = CustomPreviewLineweights(Geometry=item_37, Shader=ColourSwatch(SwatchColor=RGB(33, 33, 33)), Thickness=Slider(6, range=0..10), Absolute=False)
previewlw_34 = CustomPreviewLineweights(Geometry=item_47, Shader=ColourSwatch(SwatchColor=RGB(33, 33, 33)), Thickness=Slider(6, range=0..10), Absolute=False)
previewlw_35 = CustomPreviewLineweights(Geometry=item_35, Shader=ColourSwatch(SwatchColor=RGB(33, 33, 33)), Thickness=Slider(6, range=0..10), Absolute=False)
previewlw_36 = CustomPreviewLineweights(Geometry=item_36, Shader=ColourSwatch(SwatchColor=RGB(33, 33, 33)), Thickness=Slider(6, range=0..10), Absolute=False)
previewlw_37 = CustomPreviewLineweights(Geometry=item_38, Shader=ColourSwatch(SwatchColor=RGB(33, 33, 33)), Thickness=Slider(6, range=0..10), Absolute=False)
previewlw_38 = CustomPreviewLineweights(Geometry=item_39, Shader=ColourSwatch(SwatchColor=RGB(33, 33, 33)), Thickness=Slider(6, range=0..10), Absolute=False)
previewlw_39 = CustomPreviewLineweights(Geometry=item_40, Shader=ColourSwatch(SwatchColor=RGB(33, 33, 33)), Thickness=Slider(6, range=0..10), Absolute=False)
previewlw_40 = CustomPreviewLineweights(Geometry=item_41, Shader=ColourSwatch(SwatchColor=RGB(33, 33, 33)), Thickness=Slider(6, range=0..10), Absolute=False)
previewlw_41 = CustomPreviewLineweights(Geometry=item_42, Shader=ColourSwatch(SwatchColor=RGB(33, 33, 33)), Thickness=Slider(6, range=0..10), Absolute=False)
previewlw_42 = CustomPreviewLineweights(Geometry=item_43, Shader=ColourSwatch(SwatchColor=RGB(33, 33, 33)), Thickness=Slider(6, range=0..10), Absolute=False)
previewlw_43 = CustomPreviewLineweights(Geometry=item_44, Shader=ColourSwatch(SwatchColor=RGB(33, 33, 33)), Thickness=Slider(6, range=0..10), Absolute=False)
previewlw_44 = CustomPreviewLineweights(
    Geometry=[item_51, item_45],
    Shader=ColourSwatch(SwatchColor=RGB(33, 33, 33)),
    Thickness=Slider(6, range=0..10),
    Absolute=False)
previewlw_45 = CustomPreviewLineweights(Geometry=item_46, Shader=ColourSwatch(SwatchColor=RGB(33, 33, 33)), Thickness=Slider(6, range=0..10), Absolute=False)
previewlw_46 = CustomPreviewLineweights(Geometry=item_48, Shader=ColourSwatch(SwatchColor=RGB(33, 33, 33)), Thickness=Slider(6, range=0..10), Absolute=False)
previewlw_47 = CustomPreviewLineweights(Geometry=item_49, Shader=ColourSwatch(SwatchColor=RGB(33, 33, 33)), Thickness=Slider(6, range=0..10), Absolute=False)
previewlw_48 = CustomPreviewLineweights(Geometry=item_50, Shader=ColourSwatch(SwatchColor=RGB(33, 33, 33)), Thickness=Slider(6, range=0..10), Absolute=False)
previewlw_49 = CustomPreviewLineweights(Geometry=item_52, Shader=ColourSwatch(SwatchColor=RGB(33, 33, 33)), Thickness=Slider(6, range=0..10), Absolute=False)
previewlw_50 = CustomPreviewLineweights(Geometry=item_53, Shader=ColourSwatch(SwatchColor=RGB(33, 33, 33)), Thickness=Slider(6, range=0..10), Absolute=False)
previewlw_51 = CustomPreviewLineweights(Geometry=item_54, Shader=ColourSwatch(SwatchColor=RGB(33, 33, 33)), Thickness=Slider(6, range=0..10), Absolute=False)
previewlw_52 = CustomPreviewLineweights(Geometry=item_56, Shader=ColourSwatch(SwatchColor=RGB(33, 33, 33)), Thickness=Slider(6, range=0..10), Absolute=False)
previewlw_53 = CustomPreviewLineweights(Geometry=item_57, Shader=ColourSwatch(SwatchColor=RGB(33, 33, 33)), Thickness=Slider(6, range=0..10), Absolute=False)
previewlw_54 = CustomPreviewLineweights(Geometry=item_58, Shader=ColourSwatch(SwatchColor=RGB(33, 33, 33)), Thickness=Slider(6, range=0..10), Absolute=False)
previewlw_55 = CustomPreviewLineweights(Geometry=item_59, Shader=ColourSwatch(SwatchColor=RGB(33, 33, 33)), Thickness=Slider(6, range=0..10), Absolute=False)
previewlw_56 = CustomPreviewLineweights(Geometry=item_55, Shader=ColourSwatch(SwatchColor=RGB(33, 33, 33)), Thickness=Slider(6, range=0..10), Absolute=False)
previewlw_57 = CustomPreviewLineweights(Geometry=item_61, Shader=ColourSwatch(SwatchColor=RGB(33, 33, 33)), Thickness=Slider(6, range=0..10), Absolute=False)
previewlw_58 = CustomPreviewLineweights(Geometry=item_60, Shader=ColourSwatch(SwatchColor=RGB(33, 33, 33)), Thickness=Slider(6, range=0..10), Absolute=False)
previewlw_59 = CustomPreviewLineweights(Geometry=item_62, Shader=ColourSwatch(SwatchColor=RGB(33, 33, 33)), Thickness=Slider(6, range=0..10), Absolute=False)
int_importance_55 = Integer(int_importance_49)
int_placement_62 = Integer(int_placement_54)
num_score_63 = Number(num_score_49)
txt_name_62 = Text(txt_name_54)
geo_186 = Geometry(geo_164)
geo_187 = Geometry(geo_163)
geo_188 = Geometry(geo_162)
explode_63 = Explode(Curve=geo_187, Recursive=True)  # -> Segments, Vertices
int_importance_56 = Integer(int_importance)
int_placement_63 = Integer(int_placement)
num_score_64 = Number(num_score)
txt_name_63 = Text(txt_name)
geo_189 = Geometry(geo_3)
geo_190 = Geometry(geo_4)
geo_191 = Geometry(geo_2)
item_63 = ListItem(List=explode_63.Segments, Index=int_placement_62, Wrap=True)
int_importance_57 = Integer(int_importance_48)
int_placement_64 = Integer(int_placement_55)
num_score_65 = Number(num_score_50)
txt_name_64 = Text(txt_name_55)
geo_192 = Geometry(geo_167)
geo_193 = Geometry(geo_165)
geo_194 = Geometry(geo_166)
int_importance_58 = Integer(int_importance_45)
group = Group(Geometry=geo_186)
int_placement_65 = Integer(int_placement_51)
int_importance_59 = Integer(int_importance_14)
num_score_66 = Number(num_score_56)
int_placement_66 = Integer(int_placement_13)
txt_name_65 = Text(txt_name_51)
int_importance_60 = Integer(int_importance_45)
int_placement_67 = Integer(int_placement_51)
int_importance_61 = Integer(int_importance_2)
geo_195 = Geometry(geo_153)
geo_196 = Geometry(geo_155)
geo_197 = Geometry(geo_154)
int_placement_68 = Integer(int_placement_2)
num_score_67 = Number(num_score_14)
int_importance_62 = Integer(int_importance_50)
num_score_68 = Number(num_score_56)
txt_name_66 = Text(txt_name_13)
explode_64 = Explode(Curve=geo_191, Recursive=True)  # -> Segments, Vertices
int_placement_69 = Integer(int_placement_56)
num_score_69 = Number(num_score_2)
txt_name_67 = Text(txt_name_51)
geo_198 = Geometry(geo_40)
geo_199 = Geometry(geo_38)
geo_200 = Geometry(geo_39)
txt_name_68 = Text(txt_name_2)
num_score_70 = Number(num_score_51)
geo_201 = Geometry(geo_154)
geo_202 = Geometry(geo_153)
geo_203 = Geometry(geo_155)
txt_name_69 = Text(txt_name_56)
geo_204 = Geometry(geo_5)
geo_205 = Geometry(geo_6)
geo_206 = Geometry(geo_7)
geo_207 = Geometry(geo_170)
int_importance_63 = Integer(int_importance_41)
geo_208 = Geometry(geo_168)
geo_209 = Geometry(geo_169)
int_importance_64 = Integer(int_importance_40)
int_placement_70 = Integer(int_placement_49)
int_placement_71 = Integer(int_placement_50)
int_importance_65 = Integer(int_importance_38)
join = JoinCurves(Curves=item_63, Preserve=False)
int_placement_72 = Integer(int_placement_44)
merge = Merge()  # -> flatten(Result)
num_score_71 = Number(num_score_43)
num_score_72 = Number(num_score_42)
num_score_73 = Number(num_score_38)
txt_name_70 = Text(txt_name_49)
txt_name_71 = Text(txt_name_50)
txt_name_72 = Text(txt_name_44)
geo_210 = Geometry(geo_151)
int_importance_66 = Integer(int_importance_23)
geo_211 = Geometry(geo_146)
geo_212 = Geometry(geo_147)
geo_213 = Geometry(geo_148)
geo_214 = Geometry(geo_152)
geo_215 = Geometry(geo_150)
int_placement_73 = Integer(int_placement_23)
geo_216 = Geometry(geo_131)
geo_217 = Geometry(geo_132)
geo_218 = Geometry(geo_133)
int_importance_67 = Integer(int_importance_47)
int_importance_68 = Integer(int_importance_43)
int_importance_69 = Integer(importance_70)
int_importance_70 = Integer(int_importance_29)
int_placement_74 = Integer(int_placement_53)
int_placement_75 = Integer(int_placement_45)
int_placement_76 = Integer(int_placement_57)
int_placement_77 = Integer(int_placement_26)
num_score_74 = Number(num_score_33)
merge_2 = Merge()  # -> flatten(Result)
txt_name_73 = Text(txt_name_23)
num_score_75 = Number(num_score_58)
num_score_76 = Number(num_score_9)
num_score_77 = Number(num_score_52)
num_score_78 = Number(num_score_44)
txt_name_74 = Text(txt_name_53)
txt_name_75 = Text(txt_name_45)
geo_219 = Geometry(geo_70)
txt_name_76 = Text(txt_name_57)
geo_220 = Geometry(geo_68)
geo_221 = Geometry(geo_69)
txt_name_77 = Text(txt_name_26)
geo_222 = Geometry(geo_159)
geo_223 = Geometry(geo_160)
geo_224 = Geometry(geo_161)
geo_225 = Geometry(geo_134)
geo_226 = Geometry(geo_135)
geo_227 = Geometry(geo_136)
geo_228 = Geometry(geo_173)
geo_229 = Geometry(geo_78)
geo_230 = Geometry(geo_171)
geo_231 = Geometry(geo_172)
int_importance_71 = Integer(int_importance_46)
int_importance_72 = Integer(int_importance_42)
geo_232 = Geometry(geo_77)
geo_233 = Geometry(geo_79)
int_placement_78 = Integer(int_placement_52)
int_placement_79 = Integer(int_placement_40)
merge_3 = Merge()  # -> flatten(Result)
num_score_79 = Number(num_score_57)
num_score_80 = Number(num_score_54)
int_importance_73 = Integer(int_importance_44)
txt_name_78 = Text(txt_name_52)
txt_name_79 = Text(txt_name_40)
geo_234 = Geometry(geo_157)
geo_235 = Geometry(geo_120)
geo_236 = Geometry(scale_nu.Geometry)
geo_237 = Geometry(geo_158)
geo_238 = Geometry(geo_119)
geo_239 = Geometry(geo_121)
num_score_81 = Number(num_score_55)
explode_65 = Explode(Curve=geo_193, Recursive=True)  # -> Segments, Vertices
int_importance_74 = Integer(int_importance_53)
int_importance_75 = Integer(int_importance_54)
int_importance_76 = Integer(int_importance_11)
int_importance_77 = Integer(int_importance_7)
int_placement_80 = Integer(int_placement_60)
int_placement_81 = Integer(int_placement_61)
int_placement_82 = Integer(int_placement_11)
int_placement_83 = Integer(int_placement_7)
num_score_82 = Number(num_score_61)
num_score_83 = Number(num_score_62)
int_importance_78 = Integer(int_importance_52)
int_importance_79 = Integer(int_importance_10)
int_placement_84 = Integer(int_placement_59)
num_score_84 = Number(num_score_11)
num_score_85 = Number(num_score_7)
txt_name_80 = Text(txt_name_60)
txt_name_81 = Text(txt_name_61)
int_placement_85 = Integer(int_placement_10)
txt_name_82 = Text(txt_name_11)
txt_name_83 = Text(txt_name_7)
item_64 = ListItem(List=explode_64.Segments, Index=int_placement_63, Wrap=True)
geo_240 = Geometry(geo_182)
geo_241 = Geometry(geo_184)
explode_66 = Explode(Curve=geo_195, Recursive=True)  # -> Segments, Vertices
geo_242 = Geometry(geo_180)
geo_243 = Geometry(geo_181)
geo_244 = Geometry(geo_183)
geo_245 = Geometry(geo_185)
num_score_86 = Number(num_score_60)
geo_246 = Geometry(geo_33)
geo_247 = Geometry(geo_21)
geo_248 = Geometry(geo_32)
geo_249 = Geometry(geo_34)
geo_250 = Geometry(geo_20)
geo_251 = Geometry(geo_22)
num_score_87 = Number(num_score_8)
txt_name_84 = Text(txt_name_59)
txt_name_85 = Text(txt_name_10)
geo_252 = Geometry(geo_179)
geo_253 = Geometry(geo_177)
geo_254 = Geometry(geo_178)
explode_67 = Explode(Curve=geo_199, Recursive=True)  # -> Segments, Vertices
geo_255 = Geometry(geo_31)
geo_256 = Geometry(geo_29)
geo_257 = Geometry(geo_30)
explode_68 = Explode(Curve=geo_202, Recursive=True)  # -> Segments, Vertices
explode_69 = Explode(Curve=geo_204, Recursive=True)  # -> Segments, Vertices
explode_70 = Explode(Curve=geo_208, Recursive=True)  # -> Segments, Vertices
merge_4 = Merge(
    Data1=txt_name_62,
    Data2=flatten(join),
    Data3=int_importance_55,
    Data4=num_score_63,
    Data5=geo_187,
    Data6=geo_188,
    Data7=group)
number_slider_3 = Slider(3, range=0..10)
explode_71 = Explode(Curve=geo_211, Recursive=True)  # -> Segments, Vertices
explode_72 = Explode(Curve=geo_214, Recursive=True)  # -> Segments, Vertices
explode_73 = Explode(Curve=geo_216, Recursive=True)  # -> Segments, Vertices
group_2 = Group(Geometry=geo_189)
explode_74 = Explode(Curve=geo_220, Recursive=True)  # -> Segments, Vertices
explode_75 = Explode(Curve=geo_232, Recursive=True)  # -> Segments, Vertices
explode_76 = Explode(Curve=geo_230, Recursive=True)  # -> Segments, Vertices
explode_77 = Explode(Curve=geo_222, Recursive=True)  # -> Segments, Vertices
panel = Panel("""2
3""")
explode_78 = Explode(Curve=geo_225, Recursive=True)  # -> Segments, Vertices
panel_2 = Panel("""2
3""")
item_65 = ListItem(List=explode_65.Segments, Index=int_placement_64, Wrap=True)
explode_79 = Explode(Curve=geo_236, Recursive=True)  # -> Segments, Vertices
explode_80 = Explode(Curve=geo_238, Recursive=True)  # -> Segments, Vertices
item_66 = ListItem(List=explode_66.Segments, Index=Slider(0, range=0..3), Wrap=True)
join_2 = JoinCurves(Curves=item_64, Preserve=False)
explode_81 = Explode(Curve=geo_242, Recursive=True)  # -> Segments, Vertices
explode_82 = Explode(Curve=geo_244, Recursive=True)  # -> Segments, Vertices
explode_83 = Explode(Curve=geo_248, Recursive=True)  # -> Segments, Vertices
explode_84 = Explode(Curve=geo_250, Recursive=True)  # -> Segments, Vertices
relay = Relay()
item_67 = ListItem(List=explode_67.Segments, Index=int_placement_66, Wrap=True)
item_68 = ListItem(List=explode_68.Segments, Index=Slider(1, range=0..3), Wrap=True)
item_69 = ListItem(List=explode_69.Segments, Index=Slider(2, range=0..10), Wrap=True)
explode_85 = Explode(Curve=geo_253, Recursive=True)  # -> Segments, Vertices
explode_86 = Explode(Curve=geo_256, Recursive=True)  # -> Segments, Vertices
explode_87 = Explode(Curve=geo_254, Recursive=True)  # -> Segments, Vertices
item_70 = ListItem(List=explode_70.Segments, Index=int_placement_69, Wrap=True)
int_importance_80 = Integer(importance_68)
int_placement_86 = Integer(int_placement_46)
group_3 = Group(Geometry=geo_192)
item_71 = ListItem(List=explode_71.Segments, Index=Slider(0, range=0..3), Wrap=True)
item_72 = ListItem(List=explode_72.Segments, Index=Slider(0, range=0..3), Wrap=True)
num_score_88 = Number(num_score_39)
txt_name_86 = Text(txt_name_46)
geo_258 = Geometry(geo_137)
geo_259 = Geometry(geo_138)
geo_260 = Geometry(geo_139)
int_importance_81 = Integer(int_importance_39)
int_importance_82 = Integer(importance_69)
item_73 = ListItem(List=explode_73.Segments, Index=Slider(1, range=0..10), Wrap=True)
int_placement_87 = Integer(int_placement_47)
int_placement_88 = Integer(int_placement_48)
group_4 = Group(Geometry=geo_197)
item_74 = ListItem(List=explode_74.Segments, Index=int_placement_73, Wrap=True)
item_75 = ListItem(List=explode_75.Segments, Index=Slider(2, range=0..10), Wrap=True)
num_score_89 = Number(num_score_40)
num_score_90 = Number(num_score_41)
int_importance_83 = Integer(int_importance_28)
item_76 = ListItem(List=explode_76.Segments, Index=int_placement_76, Wrap=True)
int_importance_84 = Integer(int_importance_27)
int_placement_89 = Integer(int_placement_35)
txt_name_87 = Text(txt_name_47)
txt_name_88 = Text(txt_name_48)
group_5 = Group(Geometry=geo_198)
int_placement_90 = Integer(int_placement_34)
group_6 = Group(Geometry=geo_201)
group_7 = Group(Geometry=geo_206)
geo_261 = Geometry(geo_142)
geo_262 = Geometry(geo_145)
geo_263 = Geometry(geo_140)
geo_264 = Geometry(geo_141)
geo_265 = Geometry(geo_143)
geo_266 = Geometry(geo_144)
num_score_91 = Number(num_score_22)
int_importance_85 = Integer(int_importance_24)
num_score_92 = Number(num_score_21)
txt_name_89 = Text(txt_name_35)
int_placement_91 = Integer(int_placement_36)
txt_name_90 = Text(txt_name_34)
join_3 = JoinCurves(Curves=item_65, Preserve=False)
group_8 = Group(Geometry=geo_207)
item_77 = ListItem(List=explode_79.Segments, Index=int_placement_78, Wrap=True)
item_78 = ListItem(List=explode_80.Segments, Index=int_placement_79, Wrap=True)
geo_267 = Geometry(geo_104)
geo_268 = Geometry(geo_105)
geo_269 = Geometry(geo_106)
geo_270 = Geometry(geo_101)
geo_271 = Geometry(geo_102)
geo_272 = Geometry(geo_103)
num_score_93 = Number(num_score_23)
txt_name_91 = Text(txt_name_36)
geo_273 = Geometry(geo_109)
geo_274 = Geometry(geo_107)
geo_275 = Geometry(geo_108)
group_9 = Group(Geometry=geo_213)
group_10 = Group(Geometry=geo_210)
join_4 = JoinCurves(Curves=item_66, Preserve=False)
merge_5 = Merge(
    Data1=txt_name_63,
    Data2=flatten(join_2),
    Data3=int_importance_56,
    Data4=num_score_64,
    Data5=geo_190,
    Data6=geo_191,
    Data7=group_2)
item_79 = ListItem(List=explode_81.Segments, Index=int_placement_80, Wrap=True)
item_80 = ListItem(List=explode_82.Segments, Index=int_placement_81, Wrap=True)
item_81 = ListItem(List=explode_83.Segments, Index=int_placement_82, Wrap=True)
item_82 = ListItem(List=explode_84.Segments, Index=int_placement_83, Wrap=True)
group_11 = Group(Geometry=geo_218)
join_5 = JoinCurves(Curves=item_67, Preserve=False)
join_6 = JoinCurves(Curves=item_68, Preserve=False)
item_83 = ListItem(List=explode_85.Segments, Index=int_placement_84, Wrap=True)
join_7 = JoinCurves(Curves=item_69, Preserve=False)
item_84 = ListItem(List=explode_86.Segments, Index=int_placement_85, Wrap=True)
item_85 = ListItem(List=explode_87.Segments, Index=int_placement_84, Wrap=True)
group_12 = Group(Geometry=geo_219)
group_13 = Group(Geometry=geo_229)
join_8 = JoinCurves(Curves=item_70, Preserve=False)
group_14 = Group(Geometry=geo_228)
item_86 = ListItem(List=explode_77.Segments, Index=panel, Wrap=True)
item_87 = ListItem(List=explode_78.Segments, Index=int_placement_75, Wrap=True)
int_importance_86 = Integer(int_importance_15)
int_importance_87 = Integer(int_importance_16)
int_placement_92 = Integer(int_placement_15)
int_placement_93 = Integer(int_placement_16)
group_15 = Group(Geometry=geo_234)
group_16 = Group(Geometry=geo_235)
join_9 = JoinCurves(Curves=item_71, Preserve=False)
join_10 = JoinCurves(Curves=item_72, Preserve=False)
int_importance_88 = Integer(int_importance_12)
num_score_94 = Number(num_score_16)
num_score_95 = Number(num_score_26)
join_11 = JoinCurves(Curves=item_73, Preserve=False)
int_placement_94 = Integer(int_placement_12)
txt_name_92 = Text(txt_name_15)
txt_name_93 = Text(txt_name_16)
geo_276 = Geometry(geo_46)
geo_277 = Geometry(geo_48)
geo_278 = Geometry(geo_44)
geo_279 = Geometry(geo_45)
geo_280 = Geometry(geo_47)
geo_281 = Geometry(geo_49)
num_score_96 = Number(num_score_13)
join_12 = JoinCurves(Curves=item_74, Preserve=False)
txt_name_94 = Text(txt_name_12)
explode_88 = Explode(Curve=geo_258, Recursive=True)  # -> Segments, Vertices
group_17 = Group(Geometry=geo_240)
group_18 = Group(Geometry=geo_241)
join_13 = JoinCurves(Curves=item_75, Preserve=False)
group_19 = Group(Geometry=geo_246)
group_20 = Group(Geometry=geo_247)
geo_282 = Geometry(geo_36)
geo_283 = Geometry(geo_35)
geo_284 = Geometry(geo_37)
join_14 = JoinCurves(Curves=item_76, Preserve=False)
group_21 = Group(Geometry=geo_252)
group_22 = Group(Geometry=geo_255)
merge_6 = Merge(
    Data1=txt_name_64,
    Data2=flatten(join_3),
    Data3=int_importance_57,
    Data4=num_score_65,
    Data5=geo_193,
    Data6=geo_194,
    Data7=group_3)
explode_89 = Explode(Curve=geo_263, Recursive=True)  # -> Segments, Vertices
explode_90 = Explode(Curve=geo_265, Recursive=True)  # -> Segments, Vertices
join_15 = JoinCurves(Curves=item_77, Preserve=False)
join_16 = JoinCurves(Curves=item_78, Preserve=False)
int_importance_89 = Integer(int_importance_4)
int_importance_90 = Integer(int_importance_5)
group_23 = Group(Geometry=geo_224)
explode_91 = Explode(Curve=geo_270, Recursive=True)  # -> Segments, Vertices
explode_92 = Explode(Curve=geo_267, Recursive=True)  # -> Segments, Vertices
int_placement_95 = Integer(int_placement_4)
int_placement_96 = Integer(int_placement_5)
num_score_97 = Number(num_score_4)
num_score_98 = Number(num_score_5)
int_importance_91 = Integer(int_importance_3)
explode_93 = Explode(Curve=geo_274, Recursive=True)  # -> Segments, Vertices
int_placement_97 = Integer(int_placement_3)
txt_name_95 = Text(txt_name_4)
txt_name_96 = Text(txt_name_5)
merge_7 = Merge(
    Data1=txt_name_65,
    Data2=flatten(join_4),
    Data3=int_importance_58,
    Data4=num_score_66,
    Data5=geo_195,
    Data6=geo_196,
    Data7=group_4)
join_17 = JoinCurves(Curves=item_79, Preserve=False)
join_18 = JoinCurves(Curves=item_80, Preserve=False)
join_19 = JoinCurves(Curves=item_81, Preserve=False)
join_20 = JoinCurves(Curves=item_82, Preserve=False)
geo_285 = Geometry(geo_11)
geo_286 = Geometry(geo_12)
geo_287 = Geometry(geo_13)
geo_288 = Geometry(geo_14)
geo_289 = Geometry(geo_15)
geo_290 = Geometry(geo_16)
num_score_99 = Number(num_score_3)
merge_8 = Merge(
    Data1=txt_name_66,
    Data2=flatten(join_5),
    Data3=int_importance_59,
    Data4=num_score_67,
    Data5=geo_199,
    Data6=geo_200,
    Data7=group_5)
txt_name_97 = Text(txt_name_3)
join_21 = JoinCurves(Curves=item_83, Preserve=False)
join_22 = JoinCurves(Curves=item_84, Preserve=False)
join_23 = JoinCurves(Curves=item_85, Preserve=False)
geo_291 = Geometry(geo_8)
geo_292 = Geometry(geo_10)
geo_293 = Geometry(geo_9)
merge_9 = Merge(
    Data1=txt_name_67,
    Data2=flatten(join_6),
    Data3=int_importance_60,
    Data4=num_score_68,
    Data5=geo_202,
    Data6=geo_203,
    Data7=group_6)
merge_10 = Merge(
    Data1=txt_name_68,
    Data2=flatten(join_7),
    Data3=int_importance_61,
    Data4=num_score_69,
    Data5=geo_204,
    Data6=geo_205,
    Data7=group_7)
group_24 = Group(Geometry=geo_227)
merge_11 = Merge(
    Data1=txt_name_69,
    Data2=flatten(join_8),
    Data3=int_importance_62,
    Data4=num_score_70,
    Data5=geo_208,
    Data6=geo_209,
    Data7=group_8)
join_24 = JoinCurves(Curves=item_86, Preserve=False)
merge_12 = Merge(
    Data1=txt_name_70,
    Data2=flatten(join_9),
    Data3=int_importance_64,
    Data4=num_score_72,
    Data5=geo_211,
    Data6=geo_212,
    Data7=group_9)
merge_13 = Merge(
    Data1=txt_name_71,
    Data2=flatten(join_10),
    Data3=int_importance_63,
    Data4=num_score_71,
    Data5=geo_214,
    Data6=geo_215,
    Data7=group_10)
merge_14 = Merge(
    Data1=txt_name_72,
    Data2=flatten(join_11),
    Data3=int_importance_65,
    Data4=num_score_73,
    Data5=geo_216,
    Data6=geo_217,
    Data7=group_11)
explode_94 = Explode(Curve=geo_278, Recursive=True)  # -> Segments, Vertices
explode_95 = Explode(Curve=geo_280, Recursive=True)  # -> Segments, Vertices
item_88 = ListItem(List=explode_88.Segments, Index=int_placement_86, Wrap=True)
join_25 = JoinCurves(Curves=item_87, Preserve=False)
merge_15 = Merge(
    Data1=txt_name_73,
    Data2=flatten(join_12),
    Data3=int_importance_66,
    Data4=num_score_74,
    Data5=geo_220,
    Data6=geo_221,
    Data7=group_12)
merge_16 = Merge(
    Data1=txt_name_77,
    Data2=flatten(join_13),
    Data3=int_importance_70,
    Data4=num_score_78,
    Data5=geo_232,
    Data6=geo_233,
    Data7=group_13)
explode_96 = Explode(Curve=geo_284, Recursive=True)  # -> Segments, Vertices
merge_17 = Merge(
    Data1=txt_name_76,
    Data2=flatten(join_14),
    Data3=int_importance_69,
    Data4=num_score_77,
    Data5=geo_230,
    Data6=geo_231,
    Data7=group_14)
item_89 = ListItem(List=explode_89.Segments, Index=int_placement_87, Wrap=True)
item_90 = ListItem(List=explode_90.Segments, Index=int_placement_88, Wrap=True)
merge_18 = Merge(
    Data1=flatten(txt_name_78),
    Data2=flatten(join_15),
    Data3=flatten(int_importance_71),
    Data4=flatten(num_score_79),
    Data5=flatten(geo_236),
    Data6=flatten(geo_237),
    Data7=flatten(group_15))
merge_19 = Merge(
    Data1=txt_name_79,
    Data2=flatten(join_16),
    Data3=int_importance_72,
    Data4=num_score_80,
    Data5=geo_238,
    Data6=geo_239,
    Data7=group_16)
item_91 = ListItem(List=explode_91.Segments, Index=Slider(0, range=0..3), Wrap=True)
item_92 = ListItem(List=explode_92.Segments, Index=Slider(3, range=0..3), Wrap=True)
item_93 = ListItem(List=explode_93.Segments, Index=Slider(3, range=0..3), Wrap=True)
merge_20 = Merge(
    Data1=txt_name_80,
    Data2=flatten(join_17),
    Data3=int_importance_74,
    Data4=num_score_82,
    Data5=geo_242,
    Data6=geo_243,
    Data7=group_17)
merge_21 = Merge(
    Data1=txt_name_81,
    Data2=flatten(join_18),
    Data3=int_importance_75,
    Data4=num_score_83,
    Data5=geo_244,
    Data6=geo_245,
    Data7=group_18)
merge_22 = Merge(
    Data1=txt_name_82,
    Data2=flatten(join_19),
    Data3=int_importance_76,
    Data4=num_score_84,
    Data5=geo_248,
    Data6=geo_249,
    Data7=group_19)
explode_97 = Explode(Curve=geo_285, Recursive=True)  # -> Segments, Vertices
explode_98 = Explode(Curve=geo_288, Recursive=True)  # -> Segments, Vertices
merge_23 = Merge(
    Data1=txt_name_84,
    Data2=flatten(join_23),
    Data3=int_importance_78,
    Data4=num_score_86,
    Data5=geo_253,
    Data6=geo_254,
    Data7=group_21)
group_25 = Group(Geometry=geo_260)
merge_24 = Merge(
    Data1=txt_name_85,
    Data2=flatten(join_22),
    Data3=int_importance_79,
    Data4=num_score_87,
    Data5=geo_256,
    Data6=geo_257,
    Data7=group_22)
explode_99 = Explode(Curve=geo_292, Recursive=True)  # -> Segments, Vertices
int_importance_92 = Integer(int_importance_51)
int_placement_98 = Integer(int_placement_58)
int_importance_93 = Integer(int_importance_48)
int_placement_99 = Integer(int_placement_55)
num_score_100 = Number(num_score_59)
merge_25 = Merge(
    Data1=txt_name_74,
    Data2=flatten(join_24),
    Data3=int_importance_67,
    Data4=num_score_75,
    Data5=geo_222,
    Data6=geo_223,
    Data7=group_23)
txt_name_98 = Text(txt_name_58)
group_26 = Group(Geometry=geo_261)
group_27 = Group(Geometry=geo_262)
num_score_101 = Number(Slider(18, range=0..100))
entwine = Entwine(Branch00=merge_7, FlattenInputs=True)
geo_294 = Geometry(geo_176)
txt_name_99 = Text(txt_name_55)
geo_295 = Geometry(geo_174)
geo_296 = Geometry(geo_175)
geo_297 = Geometry(geo_167)
geo_298 = Geometry(geo_165)
geo_299 = Geometry(geo_166)
group_28 = Group(Geometry=geo_272)
group_29 = Group(Geometry=geo_269)
entwine_2 = Entwine(Branch00=merge_9, FlattenInputs=True)
item_94 = ListItem(List=explode_94.Segments, Index=int_placement_92, Wrap=True)
item_95 = ListItem(List=explode_95.Segments, Index=int_placement_93, Wrap=True)
group_30 = Group(Geometry=geo_273)
join_26 = JoinCurves(Curves=item_88, Preserve=False)
entwine_3 = Entwine(Branch00=merge_5, FlattenInputs=True)
item_96 = ListItem(List=explode_96.Segments, Index=int_placement_94, Wrap=True)
merge_26 = Merge(
    Data1=txt_name_75,
    Data2=flatten(join_25),
    Data3=int_importance_68,
    Data4=num_score_76,
    Data5=geo_225,
    Data6=geo_226,
    Data7=group_24)
join_27 = JoinCurves(Curves=item_89, Preserve=False)
join_28 = JoinCurves(Curves=item_90, Preserve=False)
join_29 = JoinCurves(Curves=item_91, Preserve=False)
join_30 = JoinCurves(Curves=item_92, Preserve=False)
entwine_4 = Entwine(Branch00=merge_16, FlattenInputs=True)
join_31 = JoinCurves(Curves=item_93, Preserve=False)
merge_27 = Merge(
    Data1=txt_name_83,
    Data2=flatten(join_20),
    Data3=int_importance_77,
    Data4=num_score_85,
    Data5=geo_250,
    Data6=geo_251,
    Data7=group_20)
item_97 = ListItem(List=explode_97.Segments, Index=int_placement_95, Wrap=True)
item_98 = ListItem(List=explode_98.Segments, Index=int_placement_96, Wrap=True)
group_31 = Group(Geometry=geo_276)
group_32 = Group(Geometry=geo_277)
panel_3 = Panel(merge_22)
item_99 = ListItem(List=explode_99.Segments, Index=int_placement_97, Wrap=True)
group_33 = Group(Geometry=geo_282)
explode_100 = Explode(Curve=geo_295, Recursive=True)  # -> Segments, Vertices
explode_101 = Explode(Curve=geo_298, Recursive=True)  # -> Segments, Vertices
join_32 = JoinCurves(Curves=item_94, Preserve=False)
join_33 = JoinCurves(Curves=item_95, Preserve=False)
merge_28 = Merge(
    Data1=txt_name_86,
    Data2=flatten(join_26),
    Data3=int_importance_80,
    Data4=num_score_88,
    Data5=geo_258,
    Data6=geo_259,
    Data7=group_25)
join_34 = JoinCurves(Curves=item_96, Preserve=False)
group_34 = Group(Geometry=geo_287)
group_35 = Group(Geometry=geo_290)
entwine_5 = Entwine(Branch00=merge_10, FlattenInputs=True)
group_36 = Group(Geometry=geo_293)
entwine_6 = Entwine(Branch00=merge_8, FlattenInputs=True)
merge_29 = Merge(
    Data1=txt_name_87,
    Data2=flatten(join_27),
    Data3=int_importance_81,
    Data4=num_score_89,
    Data5=geo_263,
    Data6=geo_264,
    Data7=group_26)
merge_30 = Merge(
    Data1=txt_name_88,
    Data2=flatten(join_28),
    Data3=int_importance_82,
    Data4=num_score_90,
    Data5=geo_265,
    Data6=geo_266,
    Data7=group_27)
merge_31 = Merge(
    Data1=txt_name_90,
    Data2=flatten(join_29),
    Data3=int_importance_84,
    Data4=num_score_92,
    Data5=geo_270,
    Data6=geo_271,
    Data7=group_28)
merge_32 = Merge(
    Data1=txt_name_89,
    Data2=flatten(join_30),
    Data3=int_importance_83,
    Data4=num_score_91,
    Data5=geo_267,
    Data6=geo_268,
    Data7=group_29)
merge_33 = Merge(
    Data1=txt_name_91,
    Data2=flatten(join_31),
    Data3=int_importance_85,
    Data4=num_score_93,
    Data5=geo_274,
    Data6=geo_275,
    Data7=group_30)
cull_i = CullIndex(List=geo_297, Indices=Slider(2, range=0..3), Wrap=True)
join_35 = JoinCurves(Curves=item_97, Preserve=False)
join_36 = JoinCurves(Curves=item_98, Preserve=False)
entwine_7 = Entwine(Branch00=merge_12, Branch01=merge_13, FlattenInputs=True)
join_37 = JoinCurves(Curves=item_99, Preserve=False)
entwine_8 = Entwine(Branch00=merge_11, Branch01=merge_17, FlattenInputs=True)
entwine_9 = Entwine(Branch00=merge_15, FlattenInputs=True)
entwine_10 = Entwine(Branch00=merge_22, FlattenInputs=True)  # -> simplify(Result)
entwine_11 = Entwine(Branch00=merge_19, FlattenInputs=True)  # -> simplify(Result)
item_100 = ListItem(List=explode_100.Segments, Index=Slider(2, range=0..10), Wrap=True)
entwine_12 = Entwine(Branch00=merge_18, FlattenInputs=True)  # -> simplify(Result)
_1_kitchen = Data(entwine_3)
merge_34 = Merge(
    Data1=txt_name_92,
    Data2=flatten(join_32),
    Data3=int_importance_86,
    Data4=num_score_94,
    Data5=geo_278,
    Data6=geo_279,
    Data7=group_31)
merge_35 = Merge(
    Data1=txt_name_93,
    Data2=flatten(join_33),
    Data3=int_importance_87,
    Data4=num_score_95,
    Data5=geo_280,
    Data6=geo_281,
    Data7=group_32)
entwine_13 = Entwine(Branch00=merge_7, FlattenInputs=True)
entwine_14 = Entwine(Branch00=merge_27, FlattenInputs=True)  # -> simplify(Result)
item_101 = ListItem(List=explode_101.Segments, Index=Slider(3, range=0..3), Wrap=True)
entwine_15 = Entwine(Branch00=merge_24, FlattenInputs=True)  # -> simplify(Result)
merge_36 = Merge(
    Data1=txt_name_94,
    Data2=flatten(join_34),
    Data3=int_importance_88,
    Data4=num_score_96,
    Data5=geo_283,
    Data6=geo_284,
    Data7=group_33)
group_37 = Group(Geometry=geo_294)
group_38 = Group(Geometry=cull_i)  # -> flatten(Group)
entwine_16 = Entwine(Branch00=merge_14, Branch01=merge_25, FlattenInputs=True)
merge_37 = Merge(
    Data1=txt_name_95,
    Data2=flatten(join_35),
    Data3=int_importance_89,
    Data4=num_score_97,
    Data5=geo_285,
    Data6=geo_286,
    Data7=group_34)
merge_38 = Merge(
    Data1=txt_name_96,
    Data2=flatten(join_36),
    Data3=int_importance_90,
    Data4=num_score_98,
    Data5=geo_288,
    Data6=geo_289,
    Data7=group_35)
entwine_17 = Entwine(Branch00=merge_20, Branch01=merge_23, FlattenInputs=True)
merge_39 = Merge(
    Data1=txt_name_97,
    Data2=flatten(join_37),
    Data3=int_importance_91,
    Data4=num_score_99,
    Data5=geo_291,
    Data6=geo_292,
    Data7=group_36)
join_38 = JoinCurves(Curves=item_100, Preserve=False)
join_39 = JoinCurves(Curves=item_101, Preserve=False)
panel_4 = Panel("C:\Users\julii\Documents\Work\RoomFit\gh_to_code\furn_library\jsons")
dispatch = Dispatch(List=_1_kitchen, DispatchPattern=equals.Equality)  # -> ListA, ListB
merge_40 = Merge(
    Data1=txt_name_98,
    Data2=flatten(join_38),
    Data3=int_importance_92,
    Data4=num_score_100,
    Data5=geo_295,
    Data6=geo_296,
    Data7=group_37)
merge_41 = Merge(
    Data1=flatten(txt_name_99),
    Data2=flatten(join_39),
    Data3=int_importance_93,
    Data4=num_score_101,
    Data5=geo_298,
    Data6=geo_299,
    Data7=group_38)
entwine_18 = Entwine(Branch00=merge_28, Branch01=merge_29, Branch02=merge_30, FlattenInputs=True)
entwine_19 = Entwine(Branch0X=entwine_6, Branch1X=entwine_5, FlattenInputs=False)  # -> simplify(Result)
entwine_20 = Entwine(Branch0X=entwine_10, Branch1X=entwine_14, Branch2X=entwine_15, FlattenInputs=False)
entwine_21 = Entwine(Branch0X=entwine_7, Branch1X=entwine_13, FlattenInputs=False)  # -> simplify(Result)
entwine_22 = Entwine(Branch0X=entwine_9, Branch1X=entwine_4, FlattenInputs=False)  # -> simplify(Result)
entwine_23 = Entwine(Branch00=merge_31, Branch01=merge_32, Branch02=merge_33, FlattenInputs=True)
entwine_24 = Entwine(Branch00=merge_34, Branch01=merge_35, Branch02=merge_36, FlattenInputs=True)
entwine_25 = Entwine(Branch00=merge_40, FlattenInputs=True)
entwine_26 = Entwine(Branch00=entwine_12, FlattenInputs=True)
entwine_27 = Entwine(Branch00=merge_37, Branch01=merge_38, Branch02=merge_39, FlattenInputs=True)
panel_5 = Panel(entwine_20)
entwine_28 = Entwine(Branch0X=entwine_16, Branch1X=entwine_18, FlattenInputs=False)  # -> simplify(Result)
entwine_29 = Entwine(Branch00=merge_6, Branch01=merge_41, FlattenInputs=True)
_1_living = Data(entwine_19)
_2_living = Data(entwine_22)
dispatch_2 = Dispatch(List=_1_living, DispatchPattern=equals.Equality)  # -> ListA, ListB
_2_kitchen = Data(entwine_24)
entwine_30 = Entwine(Branch0X=entwine_23, Branch1X=entwine_25, FlattenInputs=False)  # -> simplify(Result)
dispatch_3 = Dispatch(List=_2_living, DispatchPattern=equals_3.Equality)  # -> ListA, ListB
_3_kitchen = Data(entwine_27)
_1_bath = Data(entwine_20)
dispatch_4 = Dispatch(List=_2_kitchen, DispatchPattern=equals_3.Equality)  # -> ListA, ListB
toggle = BooleanToggle(True)
entwine_31 = Entwine(Branch0X=entwine_29, Branch1X=entwine_8, FlattenInputs=False)  # -> simplify(Result)
dispatch_5 = Dispatch(List=_1_bath, DispatchPattern=equals.Equality)  # -> ListA, ListB
_3_living = Data(entwine_30)
dispatch_6 = Dispatch(List=_3_kitchen, DispatchPattern=equals_2.Equality)  # -> ListA, ListB
_3_bed_storage_secondary = Data()  # disabled
_3_bed_bed_secondary = Data()  # disabled
dispatch_7 = Dispatch(List=_3_living, DispatchPattern=equals_2.Equality)  # -> ListA, ListB
_4_children = Data(entwine_31)
_4_bedroom = Data(entwine_28)
_4_kitchen = Data(entwine_17)
_1_bed_storage = Data(merge_2)  # disabled
_3_bed_storage = Data()  # disabled
_1_bed_kitchen = Data(merge_3)  # disabled
_4_living = Data(entwine_21)
_4_wc = Data(entwine_26)
_3_bed_kitchen = Data()  # disabled
_1_bed_dining = Data()  # disabled
_3_bed_dining = Data()  # disabled
_1_bed_living = Data()  # disabled
_1_bed_bath_1 = Data()  # disabled
_1_bed_bath_2 = Data()  # disabled
_1_bed_bath_3 = Data()  # disabled
_3_bed_bath_1 = Data()  # disabled
_3_bed_bath_2 = Data()  # disabled
_3_bed_bath_3 = Data()  # disabled
_3_bed_living = Data()  # disabled
_1_bed_bed = Data(relay)  # disabled
_3_bed_bed = Data()  # disabled
dispatch_8 = Dispatch(List=_4_living, DispatchPattern=larger.OrEqualTo)  # -> ListA, ListB
dispatch_9 = Dispatch(List=_4_kitchen, DispatchPattern=larger.OrEqualTo)  # -> ListA, ListB
# 1 room export
panel_6 = Panel("1")
merge_42 = Merge(Data1=dispatch_9.ListA, Data2=dispatch_6.ListA, Data3=dispatch_4.ListA, Data4=dispatch.ListA)
merge_43 = Merge(Data1=dispatch_8.ListA, Data2=dispatch_7.ListA, Data3=dispatch_3.ListA, Data4=dispatch_2.ListA)
clean = CleanTree(RemoveNulls=True, RemoveInvalid=True, RemoveEmpty=True, Tree=merge_43)
clean_2 = CleanTree(RemoveNulls=True, RemoveInvalid=True, RemoveEmpty=True, Tree=merge_42)
py3 = Python3Script(
    i_apartment_type=panel_6,
    i_furn_name="Dining",
    i_data=merge_10,
    i_room_tag="Livingroom",
    i_out_folder=panel_4,
    i_run=toggle)  # -> out, o_log; inputs i_data: tree
# ---------- py3: Python ----------
"""
FURNITURE LIBRARY EXPORTER  ·  Grasshopper Python 3 Component (Rhino 8+)
═══════════════════════════════════════════════════════════════════════════

HOW TO WIRE  — 6 inputs total:

  GH input name    │ Access mode │ Type    │ What to connect
  ─────────────────┼─────────────┼─────────┼──────────────────────────────────
  i_data           │ Tree        │ Generic │ the Merge (or Entwine) output R
  i_apartment_type │ Item        │ Integer │ number of rooms: 1 / 2 / 3 / 4
  i_room_tag       │ Item        │ Text    │ e.g. "Bathroom" / "Livingroom"
  i_furn_name      │ Item        │ Text    │ e.g. "Sofa" / "Dining" / "Bath"
  i_out_folder     │ Item        │ Text    │ path to your furn_library/jsons folder
  i_run            │ Item        │ Boolean │ toggle True to export

  Output filename:  {apt_type}_{Room}_{FurnName}.json
  Examples:         3_Livingroom_Sofa.json
                    3_Livingroom_Dining.json
                    1_Bathroom_Bath.json

  Output:
  o_log            │ Item        │ Text    │ status / debug messages

──────────────────────────────────────────────────────────────────────────
EXPECTED DATA PER BRANCH  (what your Merge packs into each R output)

  index 0   name             str
  index 1   line placement   curve (line-like)
  index 2   importance       int
  index 3   score            int
  index 4   bbox big         curve (rectangle)
  index 5   bbox small       curve (rectangle)
  index 6+  geometry         one or more curves, or a GH Group of curves

BRANCH / PATH STRUCTURE

  Depth 1  {i}      → each branch is one furniture piece (no variants)
  Depth 2  {i ; j}  → i = piece index,  j = variant index
                       branches with the same i are grouped as variants

  The script detects depth automatically.
"""

import Rhino.Geometry as rg
import Rhino
import System
import rhinoscriptsyntax as rs
import Grasshopper.Kernel.Types as gkt
import json
import os
import math


# ─────────────────────────────────────────────────────────────────────────────
#  GEOMETRY HELPERS
# ─────────────────────────────────────────────────────────────────────────────

def pt2(pt):
    """Rhino Point3d → [x, y]  (Z dropped — 2-D library)."""
    return [round(pt.X, 4), round(pt.Y, 4)]


def to_curve(item):
    """
    Extract a Rhino Curve from whatever GH hands us.

    Resolution order:
      1. Already a Curve                      → return directly
      2. GH wrapper (.Value)                  → unwrap
      3. rg.Line struct                       → wrap in LineCurve
      4. rhinoscriptsyntax.coercecurve()      → resolves GH volatile GUIDs
      5. GH_Curve.CastFrom()                  → GH type-system cast
      6. ghenv GH-doc lookup                  → last resort for GH internals
    """
    if item is None:
        return None

    # 1. Already a Rhino curve
    if isinstance(item, rg.Curve):
        return item

    # 2. GH wrapper (GH_Curve, GH_Line…) — unwrap via .Value
    if hasattr(item, "Value"):
        val = item.Value
        if isinstance(val, rg.Curve):
            return val
        if isinstance(val, rg.Line):
            return rg.LineCurve(val)

    # 3. rg.Line struct passed directly
    if isinstance(item, rg.Line):
        return rg.LineCurve(item)

    # 4. rhinoscriptsyntax — designed to resolve GH volatile GUIDs
    try:
        crv = rs.coercecurve(item)
        if crv is not None:
            return crv
    except Exception:
        pass

    # 5. GH type-system cast (GH_Curve.CastFrom handles GH-internal refs)
    try:
        gh_crv = gkt.GH_Curve()
        if gh_crv.CastFrom(item):
            return gh_crv.Value
    except Exception:
        pass

    # 6. ghenv GH-document lookup
    try:
        doc  = ghenv.Component.OnPingDocument()
        obj  = doc.FindObject(item, True)
        if obj is not None and hasattr(obj, "VolatileData"):
            for path in obj.VolatileData.Paths:
                for goo in obj.VolatileData.Branch(path):
                    c = to_curve(goo)   # recurse once with the unwrapped goo
                    if c is not None:
                        return c
    except Exception:
        pass

    return None


def extract_curves(items):
    """
    Pull all Rhino Curves from a list of items.
    Handles: plain curves, GH-wrapped curves, GH Groups containing curves.
    """
    curves = []
    for item in items:
        if item is None:
            continue

        c = to_curve(item)
        if c is not None:
            curves.append(c)
            continue

        # Try iterating (List[Object], GH Group, or any other container)
        try:
            for sub in item:
                c = to_curve(sub)   # to_curve handles GUIDs internally
                if c is not None:
                    curves.append(c)
        except TypeError:
            pass  # not iterable — skip

    return curves


def serialize_line(curve):
    """
    Placement curve → { "points": [[x,y], ...] }

    Works for both simple lines (2 pts) and polyline corners (3+ pts).
    Always stores all vertices — downstream code can treat 2-pt result as a
    simple line and 3+-pt result as a placement corner / L-shape.
    """
    if curve is None:
        return None

    ok, pl = curve.TryGetPolyline()
    if ok and pl.Count >= 2:
        pts = [pt2(p) for p in pl]
        # drop duplicate closing point if curve is accidentally closed
        if curve.IsClosed and len(pts) > 1 and pts[0] == pts[-1]:
            pts = pts[:-1]
        return {"points": pts}

    # Fallback for non-polyline curves: just keep start + end
    return {"points": [pt2(curve.PointAtStart), pt2(curve.PointAtEnd)]}


def serialize_rect(curve):
    """
    Rectangle curve → { "origin":[x,y], "width":f, "height":f, "rotation":f }
    Falls back to axis-aligned bbox if the curve is not a clean 4-point polyline;
    adds "_note":"fallback-bbox" so you can spot it in the output.
    """
    if curve is None:
        return None

    ok, pl = curve.TryGetPolyline()
    if ok and pl.Count in (4, 5):
        pts = list(pl)[:4]
        dx  = pts[1].X - pts[0].X
        dy  = pts[1].Y - pts[0].Y
        dx2 = pts[2].X - pts[1].X
        dy2 = pts[2].Y - pts[1].Y
        return {
            "origin":   pt2(pts[0]),
            "width":    round(math.hypot(dx, dy),   4),
            "height":   round(math.hypot(dx2, dy2), 4),
            "rotation": round(math.degrees(math.atan2(dy, dx)), 4),
            "points":   [pt2(p) for p in pts]   # exact corners — used by viewer
        }

    bb = curve.GetBoundingBox(True)
    mn, mx = bb.Min, bb.Max
    return {
        "origin":   pt2(mn),
        "width":    round(mx.X - mn.X, 4),
        "height":   round(mx.Y - mn.Y, 4),
        "rotation": 0.0,
        "points":   [pt2(mn), [round(mx.X,4), round(mn.Y,4)],
                     pt2(mx), [round(mn.X,4), round(mx.Y,4)]],
        "_note":    "fallback-bbox"
    }


def serialize_curves(curves):
    """
    List of Rhino Curves → [ { "closed":bool, "points":[[x,y],...] }, ... ]
    Non-polyline curves are discretised to 32 points and flagged.
    """
    result = []
    for crv in curves:
        ok, pl = crv.TryGetPolyline()
        if ok:
            pts = [pt2(p) for p in pl]
            if crv.IsClosed and len(pts) > 1 and pts[0] == pts[-1]:
                pts = pts[:-1]   # drop duplicate closing point
            result.append({"closed": crv.IsClosed, "points": pts})
        else:
            n   = 32
            dom = crv.Domain
            cnt = n + (0 if crv.IsClosed else 1)
            pts = [pt2(crv.PointAt(dom.ParameterAt(i / n))) for i in range(cnt)]
            result.append({"closed": crv.IsClosed, "points": pts, "_discretised": True})
    return result


# ─────────────────────────────────────────────────────────────────────────────
#  BRANCH PARSER
# ─────────────────────────────────────────────────────────────────────────────

def parse_branch(items):
    """
    Read one Merge-R branch and return a variant dict.

    Expected layout:
      items[0]  name          (read upstream, not used here)
      items[1]  line placement
      items[2]  importance    (read upstream)
      items[3]  score         (read upstream)
      items[4]  bbox big
      items[5]  bbox small
      items[6+] geometry curves / group
    """
    lp_curve  = to_curve(items[1]) if len(items) > 1 else None
    bb_curve  = to_curve(items[4]) if len(items) > 4 else None
    bs_curve  = to_curve(items[5]) if len(items) > 5 else None
    geo_items = items[6:]          if len(items) > 6 else []

    return {
        "linePlacement": serialize_line(lp_curve),
        "bboxBig":       serialize_rect(bb_curve),
        "bboxSmall":     serialize_rect(bs_curve),
        "geometry":      serialize_curves(extract_curves(geo_items))
    }


# ─────────────────────────────────────────────────────────────────────────────
#  MAIN
# ─────────────────────────────────────────────────────────────────────────────

log_lines = []

# ── guard: catch wrong access mode early ─────────────────────────────────────
if isinstance(i_data, list):
    o_log = (
        "✗  i_data is a plain list — access mode is wrong.\n\n"
        "Fix:  right-click the  i_data  input on this component\n"
        "      → select  'Tree Access'\n"
        "      → reconnect the wire and run again."
    )
    raise SystemExit  # stop execution cleanly

if not i_run:
    # ── debug mode: print types + values for every item in every branch ───────
    log_lines.append("DEBUG — set  i_run = True  to export.")
    log_lines.append("")
    for path in i_data.Paths:
        branch = list(i_data.Branch(path))
        log_lines.append("Path {}  ({} items):".format(path, len(branch)))
        for i, item in enumerate(branch):
            t    = type(item)
            tmod = t.__module__ or ""
            tnm  = t.__name__
            full = "{}.{}".format(tmod, tnm) if tmod else tnm
            val  = str(item)[:60]
            # also try .Value if it exists
            inner = ""
            if hasattr(item, "Value"):
                iv = item.Value
                inner = "  .Value → {}.{}  {}".format(
                    type(iv).__module__ or "", type(iv).__name__, str(iv)[:40])
            # if it's a GUID, try resolving it and report the result
            resolve_note = ""
            if isinstance(item, System.Guid):
                crv = to_curve(item)
                resolve_note = "  → resolved: {}".format(
                    type(crv).__name__ if crv else "FAILED")
            log_lines.append("  [{}]  {}  |  {}{}{}".format(
                i, full, val, inner, resolve_note))
        log_lines.append("")
else:
    try:
        paths = list(i_data.Paths)

        # ── detect tree depth ─────────────────────────────────────────────────
        #   depth 1  {n}     → one branch = one piece
        #   depth 2  {n;m}   → outer index = piece,  inner = variant
        depth = max(len(list(p.Indices)) for p in paths) if paths else 1

        # ── group branches by piece index ─────────────────────────────────────
        from collections import defaultdict
        piece_branches = defaultdict(list)  # piece_i → [ (variant_i, [items]) ]

        for path in paths:
            indices  = list(path.Indices)
            piece_i  = indices[0]
            variant_i = indices[1] if depth >= 2 else 0
            piece_branches[piece_i].append((variant_i, list(i_data.Branch(path))))

        # sort pieces and variants
        pieces = []

        for piece_i in sorted(piece_branches.keys()):
            variants_raw = sorted(piece_branches[piece_i], key=lambda x: x[0])

            # scalar fields come from the first variant's branch
            first_items = variants_raw[0][1]
            name_val       = str(first_items[0]).strip() if len(first_items) > 0 else "unnamed-{}".format(piece_i)
            importance_val = int(first_items[2])         if len(first_items) > 2 else 0
            score_val      = int(first_items[3])         if len(first_items) > 3 else 0

            variants = [parse_branch(items) for _, items in variants_raw]

            pieces.append({
                "id":            name_val.lower().replace(" ", "-"),
                "name":          name_val,
                "apartmentType": int(i_apartment_type),
                "category":      i_room_tag,
                "furnitureName": i_furn_name.strip(),
                "importance":    importance_val,
                "score":         score_val,
                "variants":      variants
            })

            log_lines.append("  piece [{}]  '{}'  →  {} variant(s)".format(
                piece_i, name_val, len(variants)))

        # ── write JSON ────────────────────────────────────────────────────────
        os.makedirs(i_out_folder, exist_ok=True)
        filename = "{}_{}_{}".format(int(i_apartment_type), i_room_tag, i_furn_name.strip()) + ".json"
        out_file = os.path.join(i_out_folder, filename)

        payload = {
            "apartmentType": int(i_apartment_type),
            "category":      i_room_tag,
            "furnitureName": i_furn_name.strip(),
            "pieces":        pieces
        }
        with open(out_file, "w", encoding="utf-8") as f:
            json.dump(payload, f, indent=2, ensure_ascii=False)

        log_lines.insert(0, "✓  {} piece(s) → {}".format(len(pieces), out_file))
        log_lines.insert(1, "")

    except Exception as exc:
        import traceback
        log_lines.append("✗  ERROR: " + str(exc))
        log_lines.append("")
        log_lines.append(traceback.format_exc())

o_log = "\n".join(log_lines)
# ---------- end py3 ----------
py3_2 = Python3Script(
    i_apartment_type=panel_6,
    i_furn_name="Sofa",
    i_data=merge_8,
    i_room_tag="Livingroom",
    i_out_folder=panel_4,
    i_run=toggle)  # -> out, o_log; inputs i_data: tree; same code as py3
py3_3 = Python3Script(
    i_apartment_type=panel_6,
    i_furn_name="Kitchen",
    i_data=merge_5,
    i_room_tag="Kitchen",
    i_out_folder=panel_4,
    i_run=toggle)  # -> out, o_log; inputs i_data: tree; same code as py3
py3_4 = Python3Script(
    i_apartment_type=panel_6,
    i_furn_name="Sinc",
    i_data=entwine_11,
    i_room_tag="Bathroom",
    i_out_folder=panel_4,
    i_run=toggle)  # -> out, o_log; inputs i_data: tree; same code as py3
py3_5 = Python3Script(
    i_apartment_type=panel_6,
    i_furn_name="Shower",
    i_data=merge_24,
    i_room_tag="Bathroom",
    i_out_folder=panel_4,
    i_run=toggle)  # -> out, o_log; inputs i_data: tree; same code as py3
py3_6 = Python3Script(
    i_apartment_type=panel_6,
    i_furn_name="Toilet",
    i_data=entwine_12,
    i_room_tag="Bathroom",
    i_out_folder=panel_4,
    i_run=toggle)  # -> out, o_log; inputs i_data: tree; same code as py3
studio_kitchen = Data()  # disabled
studio_dining = Data()  # disabled
studio_bath_1 = Data()  # disabled
studio_bath_2 = Data()  # disabled
studio_bath_3 = Data()  # disabled
studio_living = Data()  # disabled
studio_bed = Data()  # disabled
toggle_2 = BooleanToggle(True)
panel_7 = Panel("Dining")
# 2 room export
panel_8 = Panel("2")
children = Data(_4_children)
bedroom = Data(_4_bedroom)
living = Data(clean)
kitchen = Data(clean_2)
wc = Data(_4_wc)
py3_7 = Python3Script(
    i_apartment_type=panel_8,
    i_furn_name=merge_16,
    i_data=merge_10,
    i_room_tag="Livingroom",
    i_out_folder=panel_4,
    i_run=toggle_2)  # -> out, o_log; inputs i_data: tree; same code as py3
py3_8 = Python3Script(
    i_apartment_type=panel_8,
    i_furn_name="Sofa",
    i_data=merge_15,
    i_room_tag="Livingroom",
    i_out_folder=panel_4,
    i_run=toggle_2)  # -> out, o_log; inputs i_data: tree; same code as py3
py3_9 = Python3Script(
    i_apartment_type=panel_8,
    i_furn_name="Sinc",
    i_data=entwine_11,
    i_room_tag="Bathroom",
    i_out_folder=panel_4,
    i_run=toggle_2)  # -> out, o_log; inputs i_data: tree; same code as py3
py3_10 = Python3Script(
    i_apartment_type=panel_8,
    i_furn_name="Kitchen",
    i_data=_2_kitchen,
    i_room_tag="Kitchen",
    i_out_folder=panel_4,
    i_run=toggle_2)  # -> out, o_log; inputs i_data: tree; same code as py3
py3_11 = Python3Script(
    i_apartment_type=panel_8,
    i_furn_name="Shower",
    i_data=merge_24,
    i_room_tag="Bathroom",
    i_out_folder=panel_4,
    i_run=toggle_2)  # -> out, o_log; inputs i_data: tree; same code as py3
py3_12 = Python3Script(
    i_apartment_type=panel_8,
    i_furn_name="Toilet",
    i_data=entwine_12,
    i_room_tag="Bathroom",
    i_out_folder=panel_4,
    i_run=toggle_2)  # -> out, o_log; inputs i_data: tree; same code as py3
py3_13 = Python3Script(
    i_apartment_type=panel_8,
    i_furn_name="Wardrobe",
    i_data=entwine_18,
    i_room_tag="Bedroom",
    i_out_folder=panel_4,
    i_run=toggle_2)  # -> out, o_log; inputs i_data: tree; same code as py3
py3_14 = Python3Script(
    i_apartment_type=panel_8,
    i_furn_name="Bed",
    i_data=entwine_16,
    i_room_tag="Bedroom",
    i_out_folder=panel_4,
    i_run=toggle_2)  # -> out, o_log; inputs i_data: tree; same code as py3
bedroom_2 = Data(bedroom)
kitchen_2 = Data(kitchen)
wc_2 = Data(wc)
living_2 = Data(living)
children_2 = Data(children)
panel_9 = Panel(py3_14.o_log)
toggle_3 = BooleanToggle(True)
# 3 room export
panel_11 = Panel("3")
py3_15 = Python3Script(
    i_apartment_type=panel_11,
    i_furn_name=merge_16,
    i_data=entwine_25,
    i_room_tag="Livingroom",
    i_out_folder=panel_4,
    i_run=toggle_3)  # -> out, o_log; inputs i_data: tree; same code as py3
py3_16 = Python3Script(
    i_apartment_type=panel_11,
    i_furn_name="Sofa",
    i_data=entwine_23,
    i_room_tag="Livingroom",
    i_out_folder=panel_4,
    i_run=toggle_3)  # -> out, o_log; inputs i_data: tree; same code as py3
py3_17 = Python3Script(
    i_apartment_type=panel_11,
    i_furn_name="Sinc",
    i_data=entwine_11,
    i_room_tag="Bathroom",
    i_out_folder=panel_4,
    i_run=toggle_3)  # -> out, o_log; inputs i_data: tree; same code as py3
py3_18 = Python3Script(
    i_apartment_type=panel_11,
    i_furn_name="Kitchen",
    i_data=entwine_27,
    i_room_tag="Kitchen",
    i_out_folder=panel_4,
    i_run=toggle_3)  # -> out, o_log; inputs i_data: tree; same code as py3
py3_19 = Python3Script(
    i_apartment_type=panel_11,
    i_furn_name="Toilet",
    i_data=entwine_12,
    i_room_tag="Bathroom",
    i_out_folder=panel_4,
    i_run=toggle_3)  # -> out, o_log; inputs i_data: tree; same code as py3
py3_20 = Python3Script(
    i_apartment_type=panel_11,
    i_furn_name="Wardrobe",
    i_data=entwine_18,
    i_room_tag="Bedroom",
    i_out_folder=panel_4,
    i_run=toggle_3)  # -> out, o_log; inputs i_data: tree; same code as py3
py3_21 = Python3Script(
    i_apartment_type=panel_11,
    i_furn_name="Wardrobe",
    i_data=entwine_8,
    i_room_tag="Children",
    i_out_folder=panel_4,
    i_run=toggle_3)  # -> out, o_log; inputs i_data: tree; same code as py3
py3_22 = Python3Script(
    i_apartment_type=panel_11,
    i_furn_name="Bed",
    i_data=entwine_16,
    i_room_tag="Bedroom",
    i_out_folder=panel_4,
    i_run=toggle_3)  # -> out, o_log; inputs i_data: tree; same code as py3
py3_23 = Python3Script(
    i_apartment_type=panel_11,
    i_furn_name="Bed",
    i_data=entwine_29,
    i_room_tag="Children",
    i_out_folder=panel_4,
    i_run=toggle_3)  # -> out, o_log; inputs i_data: tree; same code as py3
toggle_4 = BooleanToggle(True)
# 4 room export
panel_13 = Panel("4")
py3_24 = Python3Script(
    i_apartment_type=panel_13,
    i_furn_name=merge_16,
    i_data=entwine_13,
    i_room_tag="Livingroom",
    i_out_folder=panel_4,
    i_run=toggle_4)  # -> out, o_log; inputs i_data: tree; same code as py3
py3_25 = Python3Script(
    i_apartment_type=panel_13,
    i_furn_name="Sofa",
    i_data=entwine_7,
    i_room_tag="Livingroom",
    i_out_folder=panel_4,
    i_run=toggle_4)  # -> out, o_log; inputs i_data: tree; same code as py3
py3_26 = Python3Script(
    i_apartment_type=panel_13,
    i_furn_name="Sinc",
    i_data=entwine_11,
    i_room_tag="Bathroom",
    i_out_folder=panel_4,
    i_run=toggle_4)  # -> out, o_log; inputs i_data: tree; same code as py3
py3_27 = Python3Script(
    i_apartment_type=panel_13,
    i_furn_name="Kitchen",
    i_data=entwine_17,
    i_room_tag="Kitchen",
    i_out_folder=panel_4,
    i_run=toggle_4)  # -> out, o_log; inputs i_data: tree; same code as py3
py3_28 = Python3Script(
    i_apartment_type=panel_13,
    i_furn_name="Toilet",
    i_data=entwine_12,
    i_room_tag="Bathroom",
    i_out_folder=panel_4,
    i_run=toggle_4)  # -> out, o_log; inputs i_data: tree; same code as py3
py3_29 = Python3Script(
    i_apartment_type=panel_13,
    i_furn_name="Wardrobe",
    i_data=entwine_18,
    i_room_tag="Bedroom",
    i_out_folder=panel_4,
    i_run=toggle_4)  # -> out, o_log; inputs i_data: tree; same code as py3
py3_30 = Python3Script(
    i_apartment_type=panel_13,
    i_furn_name="Wardrobe",
    i_data=entwine_8,
    i_room_tag="Children",
    i_out_folder=panel_4,
    i_run=toggle_4)  # -> out, o_log; inputs i_data: tree; same code as py3
py3_31 = Python3Script(
    i_apartment_type=panel_13,
    i_furn_name="Bed",
    i_data=entwine_16,
    i_room_tag="Bedroom",
    i_out_folder=panel_4,
    i_run=toggle_4)  # -> out, o_log; inputs i_data: tree; same code as py3
py3_32 = Python3Script(
    i_apartment_type=panel_13,
    i_furn_name="Bed",
    i_data=entwine_29,
    i_room_tag="Children",
    i_out_folder=panel_4,
    i_run=toggle_4)  # -> out, o_log; inputs i_data: tree; same code as py3
py3_33 = Python3Script(i_apartment_type=panel_13, i_furn_name="Sinc", i_data=entwine_11, i_room_tag="WC", i_out_folder=panel_4, i_run=toggle_4)  # -> out, o_log; inputs i_data: tree; same code as py3
py3_34 = Python3Script(
    i_apartment_type=panel_13,
    i_furn_name="Toilet",
    i_data=entwine_12,
    i_room_tag="WC",
    i_out_folder=panel_4,
    i_run=toggle_4)  # -> out, o_log; inputs i_data: tree; same code as py3

# ---- group: Prepare and Sort
txt_name_100 = Text(program_51)
int_placement_100 = Integer(placementint_52)
geo_300 = Geometry(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)
geo_301 = Geometry([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])

# ----
explode_102 = Explode(Curve=geo_300, Recursive=True)  # -> Segments, Vertices
item_102 = ListItem(List=explode_102.Segments, Index=Slider(2, range=0..10), Wrap=True)
curvepoint_2 = PointOnCurve(item_102, parameter=0.5)
scale_nu_2 = ScaleNU(Geometry=geo_300, Plane=curvepoint_2, ScaleX=1, ScaleY=Slider(1.2, range=0..10), ScaleZ=1)  # -> Geometry, Transform

# ---- group: Prepare and Sort (continued)
geo_302 = Geometry(scale_nu_2.Geometry)

# ----
explode_103 = Explode(Curve=geo_302, Recursive=True)  # -> Segments, Vertices
item_103 = ListItem(List=explode_103.Segments, Index=int_placement_100, Wrap=True)
previewlw_60 = CustomPreviewLineweights(Geometry=item_103, Shader=ColourSwatch(SwatchColor=RGB(33, 33, 33)), Thickness=Slider(6, range=0..10), Absolute=False)
int_placement_101 = Integer(int_placement_100)
txt_name_101 = Text(txt_name_100)
geo_303 = Geometry(geo_301)
geo_304 = Geometry(geo_302)
geo_305 = Geometry(geo_300)
explode_104 = Explode(Curve=geo_304, Recursive=True)  # -> Segments, Vertices
item_104 = ListItem(List=explode_104.Segments, Index=int_placement_101, Wrap=True)
group_39 = Group(Geometry=geo_303)
join_40 = JoinCurves(Curves=item_104, Preserve=False)
merge_44 = Merge(
    Data1=flatten(txt_name_101),
    Data2=flatten(join_40),
    Data3=flatten(int_importance_73),
    Data4=flatten(num_score_81),
    Data5=flatten(geo_304),
    Data6=flatten(geo_305),
    Data7=flatten(group_39))
entwine_32 = Entwine(Branch00=merge_44, FlattenInputs=True)  # -> simplify(Result)
entwine_33 = Entwine(Branch0X=entwine_12, Branch1X=entwine_11, Branch2X=entwine_32, FlattenInputs=False)
_2_bath = Data(entwine_33)
dispatch_10 = Dispatch(List=_2_bath, DispatchPattern=equals_3.Equality)  # -> ListA, ListB
_3_bath = Data(entwine_33)
dispatch_11 = Dispatch(List=_3_bath, DispatchPattern=equals_2.Equality)  # -> ListA, ListB
_4_bath = Data(entwine_33)
dispatch_12 = Dispatch(List=_4_bath, DispatchPattern=larger.OrEqualTo)  # -> ListA, ListB
merge_45 = Merge(Data1=dispatch_12.ListA, Data2=dispatch_11.ListA, Data3=dispatch_10.ListA, Data4=dispatch_5.ListA)
clean_3 = CleanTree(RemoveNulls=True, RemoveInvalid=True, RemoveEmpty=True, Tree=merge_45)
panel_14 = Panel(clean_3)
bath = Data(clean_3)
bath_2 = Data(bath)
py3_35 = Python3Script(
    i_apartment_type=panel_11,
    i_furn_name="Bathtube",
    i_data=merge_44,
    i_room_tag="Bathroom",
    i_out_folder=panel_4,
    i_run=toggle_3)  # -> out, o_log; inputs i_data: tree; same code as py3
py3_36 = Python3Script(
    i_apartment_type=panel_13,
    i_furn_name="Bathtube",
    i_data=merge_44,
    i_room_tag="Bathroom",
    i_out_folder=panel_4,
    i_run=toggle_4)  # -> out, o_log; inputs i_data: tree; same code as py3
