# Grasshopper definition example.gh (Grasshopper 1.0.8)
# plug-ins: Human, Furnisher for Rhino

# ----
# Variants
f1 = Slider(1, range=0..2)
p1 = Slider(2, range=0..5)
f2 = Slider(0, range=0..2)
p2 = Slider(4, range=0..5)
merge = Merge(Data1=f1, Data2=p1, Data3=f2, Data4=p2)
# In this script, we can change variants
# of a furniture piece (f1 or f2 inputs)
# as well as scroll through placement
# variants (p1 and p2 inputs)
entwine = Entwine(Branch00=merge, Branch01=merge, Branch02=merge, Branch03=merge, Branch04=merge, Branch05=merge, FlattenInputs=True)  # -> simplify(Result)

spatial_timber____furnisher = STFurnish(Furnish=Toggle(True), ApartmentType=0, Var=entwine, NodeExe="node")  # -> Rooms, RoomNames, AptType, Furniture, Transitions, Footprints, StepNames, Options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
swatch = ColourSwatch(SwatchColor=RGB(217, 119, 87))
swatch_2 = ColourSwatch(SwatchColor=RGBA(217, 119, 87, 157))
crv = Curve(spatial_timber____furnisher.Rooms)
data = Data(spatial_timber____furnisher.RoomNames)
explode = Explode(Curve=crv, Recursive=True)  # -> Segments, Vertices
curvepoint = PointOnCurve(explode.Segments, parameter=0.5)
area = Area(Geometry=crv)  # -> Area, Centroid
panel = Panel(spatial_timber____furnisher.Info)
pdecon = Deconstruct(Point=explode.Vertices)  # -> XComponent, YComponent, ZComponent
dash = DashPattern(Curve=spatial_timber____furnisher.Transitions, Pattern=[Slider(0.16, range=0..1), Slider(0.33, range=0..1)])  # -> Dashes, Gaps
pdecon_2 = Deconstruct(Point=curvepoint)  # -> XComponent, YComponent, ZComponent
sort = SortList(Keys=pdecon.XComponent, ValuesA=explode.Vertices)  # -> Keys, ValuesA
sort_2 = SortList(Keys=pdecon_2.YComponent, ValuesA=explode.Segments)  # -> Keys, ValuesA
previewlw = CustomPreviewLineweights(Geometry=dash.Dashes, Shader=swatch, Absolute=False)
previewlw_2 = CustomPreviewLineweights(Geometry=spatial_timber____furnisher.Doors, Shader=swatch, Absolute=False)
score = Data(spatial_timber____furnisher.RoomScore)
item = ListItem(List=sort_2.ValuesA, Index=0, Wrap=True)  # -> flatten(Item)
item_2 = ListItem(List=sort.ValuesA, Index=[0, 1], Wrap=True)
curvepoint_2 = PointOnCurve(item, parameter=0.5)
graft = GraftTree(Tree=score, IncludeEmptyLists=True, IncludeNullItems=True)
# quick and dirty preview settings
previewlw_3 = CustomPreviewLineweights(Geometry=spatial_timber____furnisher.Furniture, Shader=swatch, Thickness=Slider(1.56, range=0..10), Absolute=False)
pdecon_3 = Deconstruct(Point=item_2)  # -> XComponent, YComponent, ZComponent
number_slider = Slider(0.8, range=0..1)
number_slider_2 = Slider(0.1, range=0..1)
number_slider_3 = Slider(0.6, range=0..1)
number_slider_4 = Slider(0.1, range=0..1)
concat = Concatenate(FragmentA=graft, FragmentB="/100")  # -> flatten(Result)
sort_3 = SortList(Keys=pdecon_3.YComponent, ValuesA=item_2)  # -> Keys, ValuesA
Y = UnitY(Factor=Slider(0.8, range=0..1))
Y_2 = UnitY(Factor=Slider(0.3, range=0..1))
rev = Reverse(Vector=Y_2)
tag = TextTag(Location=flatten(area.Centroid), Text=data, Colour=ColourSwatch(SwatchColor=RGB(120, 140, 93)))
item_3 = ListItem(List=sort_3.ValuesA, Index=0, Wrap=True)
panel_2 = Panel(concat)
X = UnitX(Factor=Slider(0.5, range=0..1))  # -> graft(UnitVector)
Y_3 = UnitY(Factor=Slider(0.2, range=0..1))
move = Move(Geometry=curvepoint_2, Motion=Y)  # -> Geometry, Transform
move_2 = Move(Geometry=area.Centroid, Motion=rev)  # -> Geometry, Transform
move_3 = Move(Geometry=item_3, Motion=X)  # -> Geometry, Transform
tag_2 = TextTag3D(
    Location=move.Geometry,
    Text=data,
    Size=Slider(0.22, range=0..1),
    Colour=ColourSwatch(SwatchColor=RGBA(120, 140, 93, 88)),
    Justification=8)
move_4 = Move(Geometry=move_3.Geometry, Motion=graft(Y_3))  # -> Geometry, Transform
swatch_3 = ColourSwatch(SwatchColor=RGB(0, 0, 0))
swatch_4 = ColourSwatch(SwatchColor=RGBA(217, 119, 87, 157))
swatch_5 = ColourSwatch(SwatchColor=RGB(125, 125, 125))
tag_3 = TextTag3D(Location=flatten(move_4.Geometry), Text=concat, Size=Slider(0.16, range=0..1), Colour=swatch_3, Justification=8)
screentext = ScreenOrientedText(Text=concat, Justification=7, Location=flatten(move_4.Geometry), SizeFactor=1, Color=swatch_3, Depth=0, Absolute=False)
