# Grasshopper definition temp.gh (Grasshopper 1.0.8)
# plug-ins: ClipperComponents, Human, Tree8, MetaHopper, Furnisher for Rhino, Wombat

panel = Panel("""40_279_13884
44_285_1121
81_116_520
109_178_730
112_148_649
134_159_700
138_136_620
145_312_1261
147_314_1272
204_393_1568
225_414_1646
233_431_1691
236_434_1705
242_444_49946
244_447_1755
262_474_1876
277_505_2000
280_519_2065
281_521_2075
283_525_2090
307_610_2508
320_650_2760
320_650_4490
332_690_2923
334_697_2952
358_773_3372""")

# ----
# floor ID index
number_slider = Slider(0, range=0..25)

folder_path = Python3Script()  # -> out, a, b
# ---------- folder_path: Python ----------
"""Get the current Grasshopper file directory.

Outputs:
    folder_path: The full path to the folder containing the current .gh/.ghx file.
    file_path: The full path to the current .gh/.ghx file itself.
"""

import Grasshopper
import os

# Get the active Grasshopper document
doc = Grasshopper.Instances.ActiveCanvas.Document

folder_path = None
file_path = None

if doc:
    # Get the Grasshopper file path
    file_path = doc.FilePath
    
    if file_path:
        # Normalize and get its directory
        file_path = os.path.abspath(file_path)
        folder_path = os.path.dirname(file_path)
    else:
        folder_path = None
else:
    folder_path = None

# Output
a = folder_path
b = file_path
# ---------- end folder_path ----------

# ----
# .3dm file folder
file_path = FilePath("C:\Bauhaus\Luyang Folder\FloorApartment_Examples_3dm-20250813T115639Z-1-001\FloorApartment_Examples_3dm\")

list_item = ListItem(List=panel, Index=number_slider, Wrap=True)
panel_2 = Panel(folder_path.a)
panel_3 = Panel("\Apartments_Examples\FloorApartment_Examples_3dm-20250813T115639Z-1-001\FloorApartment_Examples_3dm\")
concatenate = Concatenate(Folder=file_path, ID=list_item, _3dm=".3dm")
panel_4 = Panel(concatenate)

# ----
# outline
panel_5 = Panel("34_FLOOR_GRID_OUTLINE")
import_3dm = Import3DM(File=concatenate, Layer="35_APARTMENT_GRID_OUTLINE", Name="*")
import_3dm_2 = Import3DM(File=concatenate, Layer=panel_5, Name="*")
curve = Curve(import_3dm_2)
curve_2 = Curve(import_3dm)

# ----
# floor staircase grids
panel_6 = Panel("1_FLOOR_CORRIDOR")
import_3dm_3 = Import3DM(File=concatenate, Layer=panel_6, Name="*")
curve_3 = Curve(import_3dm_3)

concat = Concatenate(FragmentA=panel_2, FragmentB=panel_3)

# ----
# balcony grids
panel_7 = Panel("2_BALCONY")
import_3dm_4 = Import3DM(File=concatenate, Layer=panel_7, Name="*")
curve_4 = Curve(import_3dm_4)

# ----
# corridor grids
panel_8 = Panel("4_CORRIDOR")
import_3dm_5 = Import3DM(File=concatenate, Layer=panel_8, Name="*")
curve_5 = Curve(import_3dm_5)

# ----
# kitchen grids
panel_9 = Panel("5_KITCHEN")
import_3dm_6 = Import3DM(File=concatenate, Layer=panel_9, Name="*")
curve_6 = Curve(import_3dm_6)

# ----
# bathroom grids
panel_10 = Panel("8_BATHROOM_3")
import_3dm_7 = Import3DM(File=concatenate, Layer="6_BATHROOM_1", Name="*")
import_3dm_8 = Import3DM(File=concatenate, Layer="7_BATHROOM_2", Name="*")
import_3dm_9 = Import3DM(File=concatenate, Layer=panel_10, Name="*")
import_3dm_10 = Import3DM(File=concatenate, Layer="9_BATHROOM_4", Name="*")
curve_7 = Curve(import_3dm_7)
curve_8 = Curve(import_3dm_8)
curve_9 = Curve(import_3dm_9)
curve_10 = Curve(import_3dm_10)

# ----
# bedroom grids
panel_11 = Panel("11_ROOM_1")
import_3dm_11 = Import3DM(File=concatenate, Layer=panel_11, Name="*")
import_3dm_12 = Import3DM(File=concatenate, Layer="12_ROOM_2", Name="*")
import_3dm_13 = Import3DM(File=concatenate, Layer="13_ROOM_3", Name="*")
import_3dm_14 = Import3DM(File=concatenate, Layer="14_ROOM_4", Name="*")
import_3dm_15 = Import3DM(File=concatenate, Layer="15_ROOM_5", Name="*")
import_3dm_16 = Import3DM(File=concatenate, Layer="16_ROOM_6", Name="*")
curve_11 = Curve(import_3dm_11)
curve_12 = Curve(import_3dm_12)
curve_13 = Curve(import_3dm_15)
curve_14 = Curve(import_3dm_16)
curve_15 = Curve(import_3dm_13)
curve_16 = Curve(import_3dm_14)

# ----
# storeroom grids
panel_12 = Panel("3_STOREROOM")
import_3dm_17 = Import3DM(File=concatenate, Layer=panel_12, Name="*")
curve_17 = Curve(import_3dm_17)

# ----
# livingroom grids
panel_13 = Panel("10_LIVING")
import_3dm_18 = Import3DM(File=concatenate, Layer=panel_13, Name="*")
curve_18 = Curve(import_3dm_18)

file_path_2 = FilePath(concat)

# ----
# .png file folder
file_path_3 = FilePath("C:\Windows_Files\SpatialTimber\Project\GenerateFloorApartmentLoop\Dataset\FloorApartment_Examples_Png\")  # disabled

# ----
# image display
number_slider_2 = Slider(20, range=0..100)  # disabled
curve_19 = Curve(curve)  # disabled
negative = Negative(Value=number_slider_2)  # disabled
cluster = Cluster_2(floor_outline=curve_19)  # disabled
unit_x = UnitX(Factor=negative)  # disabled
number_slider_3 = Slider(55, range=0..100)  # disabled
point = Point(cluster)  # disabled
number_slider_4 = Slider(5, range=0..100)  # disabled
move = Move(Geometry=point, Motion=unit_x)  # -> Geometry, Transform; disabled
negative_2 = Negative(Value=number_slider_3)  # disabled
unit_y = UnitY(Factor=negative_2)  # disabled
negative_3 = Negative(Value=number_slider_4)  # disabled
move_2 = Move(Geometry=move.Geometry, Motion=unit_y)  # -> Geometry, Transform; disabled
unit_z = UnitZ(Factor=negative_3)  # disabled
number_slider_5 = Slider(100, range=0..100)  # disabled
move_3 = Move(Geometry=move_2.Geometry, Motion=unit_z)  # -> Geometry, Transform; disabled
rectangle = Rectangle(Plane=move_3.Geometry, XSize=number_slider_5, YSize=number_slider_5, Radius=0)  # -> Rectangle, Length; disabled
list_item_2 = ListItem(List=panel, Index=number_slider, Wrap=True)  # disabled
panel_14 = Panel(".png")  # disabled
concatenate_2 = Concatenate(Folder=file_path_3, ID=list_item_2, _3dm=panel_14)  # disabled
import_image = ImportImage(File=concatenate_2, Rectangle=rectangle.Rectangle)  # disabled

# ----
# floor staircase outlines
curve_20 = Curve(curve_3)
region_union = RegionUnion(Curves=curve_20)
curve_21 = Curve(region_union)

# ----
# bedroom outlines
curve_22 = Curve(curve_2)
curve_23 = Curve(curve_11)
curve_24 = Curve(curve_2)
curve_25 = Curve(curve_12)
curve_26 = Curve(curve_2)
curve_27 = Curve(curve_15)
curve_28 = Curve(curve_2)
curve_29 = Curve(curve_16)
curve_30 = Curve(curve_2)
curve_31 = Curve(curve_13)
curve_32 = Curve(curve_2)
curve_33 = Curve(curve_14)
cluster_2 = Cluster(apartment_outlines=curve_22, room_grids=curve_23)  # -> room_outlines_2, room_grids_4
cluster_3 = Cluster(apartment_outlines=curve_24, room_grids=curve_25)  # -> room_outlines_2, room_grids_4
cluster_4 = Cluster(apartment_outlines=curve_26, room_grids=curve_27)  # -> room_outlines_2, room_grids_4
cluster_5 = Cluster(apartment_outlines=curve_28, room_grids=curve_29)  # -> room_outlines_2, room_grids_4
cluster_6 = Cluster(apartment_outlines=curve_30, room_grids=curve_31)  # -> room_outlines_2, room_grids_4
cluster_7 = Cluster(apartment_outlines=curve_32, room_grids=curve_33)  # -> room_outlines_2, room_grids_4
curve_34 = Curve(cluster_2.room_outlines_2)
curve_35 = Curve(cluster_3.room_outlines_2)
curve_36 = Curve(cluster_3.room_grids_4)
curve_37 = Curve(cluster_4.room_outlines_2)
curve_38 = Curve(cluster_4.room_grids_4)
curve_39 = Curve(cluster_6.room_outlines_2)
curve_40 = Curve(cluster_2.room_grids_4)
curve_41 = Curve(cluster_5.room_outlines_2)
curve_42 = Curve(cluster_5.room_grids_4)
curve_43 = Curve(cluster_7.room_outlines_2)
curve_44 = Curve(cluster_7.room_grids_4)
curve_45 = Curve(cluster_6.room_grids_4)

# ----
# bathroom outlines
curve_46 = Curve(curve_2)
curve_47 = Curve(curve_7)
curve_48 = Curve(curve_2)
curve_49 = Curve(curve_8)
curve_50 = Curve(curve_2)
curve_51 = Curve(curve_9)
curve_52 = Curve(curve_2)
curve_53 = Curve(curve_10)
cluster_8 = Cluster(apartment_outlines=curve_46, room_grids=curve_47)  # -> room_outlines_2, room_grids_4
cluster_9 = Cluster(apartment_outlines=curve_48, room_grids=curve_49)  # -> room_outlines_2, room_grids_4
cluster_10 = Cluster(apartment_outlines=curve_50, room_grids=curve_51)  # -> room_outlines_2, room_grids_4
cluster_11 = Cluster(apartment_outlines=curve_52, room_grids=curve_53)  # -> room_outlines_2, room_grids_4
curve_54 = Curve(cluster_8.room_outlines_2)
curve_55 = Curve(cluster_8.room_grids_4)
curve_56 = Curve(cluster_9.room_outlines_2)
curve_57 = Curve(cluster_10.room_outlines_2)
curve_58 = Curve(cluster_10.room_grids_4)
curve_59 = Curve(cluster_11.room_outlines_2)
curve_60 = Curve(cluster_9.room_grids_4)
curve_61 = Curve(cluster_11.room_grids_4)

# ----
# balcony outlines
curve_62 = Curve(curve_2)
curve_63 = Curve(curve_4)
cluster_12 = Cluster(apartment_outlines=curve_62, room_grids=curve_63)  # -> room_outlines_2, room_grids_4
curve_64 = Curve(cluster_12.room_outlines_2)
curve_65 = Curve(cluster_12.room_grids_4)

# ----
# storeroom outlines
curve_66 = Curve(curve_2)
curve_67 = Curve(curve_17)
cluster_13 = Cluster(apartment_outlines=curve_66, room_grids=curve_67)  # -> room_outlines_2, room_grids_4
curve_68 = Curve(cluster_13.room_outlines_2)
curve_69 = Curve(cluster_13.room_grids_4)

# ----
# livingroom outlines
curve_70 = Curve(curve_2)
curve_71 = Curve(curve_18)
cluster_14 = Cluster(apartment_outlines=curve_70, room_grids=curve_71)  # -> room_outlines_2, room_grids_4
curve_72 = Curve(cluster_14.room_outlines_2)
curve_73 = Curve(cluster_14.room_grids_4)

# ----
# corridor outlines
curve_74 = Curve(curve_2)
curve_75 = Curve(curve_5)
cluster_15 = Cluster(apartment_outlines=curve_74, room_grids=curve_75)  # -> room_outlines_2, room_grids_4
curve_76 = Curve(cluster_15.room_outlines_2)
curve_77 = Curve(cluster_15.room_grids_4)

# ----
# kitchen outlines
curve_78 = Curve(curve_2)
curve_79 = Curve(curve_6)
cluster_16 = Cluster(apartment_outlines=curve_78, room_grids=curve_79)  # -> room_outlines_2, room_grids_4
curve_80 = Curve(cluster_16.room_outlines_2)
curve_81 = Curve(cluster_16.room_grids_4)

# ----
# apartment index
number_slider_6 = Slider(1, range=0..13)

# ----
# total number of apartments
list_length = ListLength(List=curve_2)
panel_15 = Panel(list_length)

num = Number()
construct_path = ConstructPath(Indices=number_slider_6)
panel_16 = Panel(num)
unit_z_2 = UnitZ(Factor="0.1")
curve_82 = Curve(curve_2)
curve_83 = Curve(curve_3)
move_4 = Move(Geometry=curve_82, Motion=unit_z_2)  # -> Geometry, Transform
region_union_2 = RegionUnion(Curves=curve_83)
curve_84 = Curve(curve)

# ----
# apartment outline
curve_85 = Curve(curve_2)
list_item_3 = ListItem(List=curve_85, Index=number_slider_6, Wrap=True)
curve_86 = Curve(list_item_3)

# ----
# balcony
tree_branch = TreeBranch(Tree=simplify(curve_64), Path=construct_path, MaintainPaths=True)
curve_87 = Curve(tree_branch)

# ----
# storeroom
tree_branch_2 = TreeBranch(Tree=simplify(curve_68), Path=construct_path, MaintainPaths=True)
curve_88 = Curve(tree_branch_2)

# ----
# corridor
tree_branch_3 = TreeBranch(Tree=simplify(curve_76), Path=construct_path, MaintainPaths=True)
curve_89 = Curve(tree_branch_3)

# ----
# livingroom
tree_branch_4 = TreeBranch(Tree=simplify(curve_72), Path=construct_path, MaintainPaths=True)
curve_90 = Curve(tree_branch_4)

# ----
# kitchen
tree_branch_5 = TreeBranch(Tree=simplify(curve_80), Path=construct_path, MaintainPaths=True)
curve_91 = Curve(tree_branch_5)

# ----
# bathroom 1
tree_branch_6 = TreeBranch(Tree=simplify(curve_54), Path=construct_path, MaintainPaths=True)
curve_92 = Curve(tree_branch_6)

# ----
# bathroom 2
tree_branch_7 = TreeBranch(Tree=simplify(curve_56), Path=construct_path, MaintainPaths=True)
curve_93 = Curve(tree_branch_7)

# ----
# bathroom 3
tree_branch_8 = TreeBranch(Tree=simplify(curve_57), Path=construct_path, MaintainPaths=True)
curve_94 = Curve(tree_branch_8)

# ----
# bathroom 4
tree_branch_9 = TreeBranch(Tree=simplify(curve_59), Path=construct_path, MaintainPaths=True)
curve_95 = Curve(tree_branch_9)

# ----
# bedroom 1
tree_branch_10 = TreeBranch(Tree=simplify(curve_34), Path=construct_path, MaintainPaths=True)
curve_96 = Curve(tree_branch_10)

# ----
# bedroom 2
tree_branch_11 = TreeBranch(Tree=simplify(curve_35), Path=construct_path, MaintainPaths=True)
curve_97 = Curve(tree_branch_11)

# ----
# bedroom 3
tree_branch_12 = TreeBranch(Tree=simplify(curve_37), Path=construct_path, MaintainPaths=True)
curve_98 = Curve(tree_branch_12)

# ----
# bedroom 4
tree_branch_13 = TreeBranch(Tree=simplify(curve_41), Path=construct_path, MaintainPaths=True)
curve_99 = Curve(tree_branch_13)

# ----
# bedroom 5
tree_branch_14 = TreeBranch(Tree=simplify(curve_39), Path=construct_path, MaintainPaths=True)
curve_100 = Curve(tree_branch_14)

# ----
# bedroom 6
tree_branch_15 = TreeBranch(Tree=simplify(curve_43), Path=construct_path, MaintainPaths=True)
curve_101 = Curve(tree_branch_15)

surface = Surface(region_union_2)
custom_preview_lineweights = CustomPreviewLineweights(Geometry=curve_84, Shader=ColourSwatch(SwatchColor=RGB(0, 0, 255)), Thickness="2", Absolute=False)
custom_preview_lineweights_2 = CustomPreviewLineweights(Geometry=move_4.Geometry, Shader=ColourSwatch(SwatchColor=RGB(162, 101, 161)), Thickness="2", Absolute=False)
custom_preview = CustomPreview(Geometry=surface, Material=ColourSwatch(SwatchColor=RGB(0, 0, 0)))
staircase = Surface(surface)
merge = Merge(Data1=curve_97, Data2=curve_98, Data3=curve_99, Data4=curve_100, Data5=curve_101)

bathroom = Bathroom()  # -> curve_22, point_22
toilet = Toilet()  # -> curve_22, point_22
kitchen = Kitchen()  # -> curve_22, point_22
children = Children()  # -> curve_22, point_22
livingroom = Livingroom()  # -> curve_22, point_22
bedroom = Bedroom()  # -> curve_22, point_22

# ----
# whole floor apartments display
colour_swatch = ColourSwatch(SwatchColor=RGBA(0, 131, 255, 150))
surface_2 = Surface(curve_64)
surface_3 = Surface(curve_68)
surface_4 = Surface(curve_76)
surface_5 = Surface(curve_72)
surface_6 = Surface(curve_80)
surface_7 = Surface(curve_54)
surface_8 = Surface(curve_56)
surface_9 = Surface(curve_57)
surface_10 = Surface(curve_59)
surface_11 = Surface(curve_34)
surface_12 = Surface(curve_35)
surface_13 = Surface(curve_43)
surface_14 = Surface(curve_37)
surface_15 = Surface(curve_41)
surface_16 = Surface(curve_39)
entwine = Entwine(
    Branch00=flatten(surface_2),
    Branch01=flatten(surface_3),
    Branch02=flatten(surface_4),
    Branch03=flatten(surface_5),
    Branch04=flatten(surface_6),
    Branch05=flatten(surface_7),
    Branch06=flatten(surface_8),
    Branch07=flatten(surface_9),
    Branch08=flatten(surface_10),
    Branch09=flatten(surface_11),
    Branch010=flatten(surface_12),
    Branch011=flatten(surface_14),
    Branch012=flatten(surface_15),
    Branch013=flatten(surface_16),
    Branch014=flatten(surface_13),
    FlattenInputs=True)
curve_102 = Curve(entwine)
custom_preview_lineweights_3 = CustomPreviewLineweights(Geometry=curve_102, Shader=ColourSwatch(SwatchColor=RGB(122, 122, 122)), Thickness="1", Absolute=False)
custom_preview_2 = CustomPreview(Geometry=surface_2, Material=ColourSwatch(SwatchColor=RGBA(84, 0, 51, 150)))
custom_preview_3 = CustomPreview(Geometry=surface_3, Material=ColourSwatch(SwatchColor=RGBA(0, 36, 255, 150)))
custom_preview_4 = CustomPreview(Geometry=surface_4, Material=ColourSwatch(SwatchColor=RGBA(141, 198, 17, 150)))
custom_preview_5 = CustomPreview(Geometry=surface_5, Material=ColourSwatch(SwatchColor=RGBA(229, 91, 175, 150)))
custom_preview_6 = CustomPreview(Geometry=surface_6, Material=ColourSwatch(SwatchColor=RGBA(123, 34, 175, 150)))
custom_preview_7 = CustomPreview(Geometry=surface_7, Material=colour_swatch)
custom_preview_8 = CustomPreview(Geometry=surface_8, Material=ColourSwatch(SwatchColor=RGBA(0, 175, 255, 150)))
custom_preview_9 = CustomPreview(Geometry=surface_9, Material=ColourSwatch(SwatchColor=RGBA(0, 222, 255, 150)))
custom_preview_10 = CustomPreview(Geometry=surface_10, Material=ColourSwatch(SwatchColor=RGBA(0, 255, 255, 150)))
custom_preview_11 = CustomPreview(Geometry=surface_11, Material=ColourSwatch(SwatchColor=RGBA(255, 0, 0, 150)))
custom_preview_12 = CustomPreview(Geometry=surface_12, Material=ColourSwatch(SwatchColor=RGBA(255, 78, 0, 150)))
custom_preview_13 = CustomPreview(Geometry=surface_14, Material=ColourSwatch(SwatchColor=RGBA(255, 131, 0, 150)))
custom_preview_14 = CustomPreview(Geometry=surface_15, Material=ColourSwatch(SwatchColor=RGBA(255, 175, 0, 150)))
custom_preview_15 = CustomPreview(Geometry=surface_16, Material=ColourSwatch(SwatchColor=RGBA(255, 202, 0, 150)))
custom_preview_16 = CustomPreview(Geometry=surface_13, Material=ColourSwatch(SwatchColor=RGBA(255, 255, 0, 150)))

apartment = Curve(curve_86)
bathrooms_rest = Curve([curve_93, curve_94, curve_95])
corridor = Curve(curve_89)
staircase_2 = Curve(staircase)
balcony = Curve(curve_87)
master_bedroom = Curve(curve_96)
area = Area(Geometry=master_bedroom)  # -> Area, Centroid
panel_17 = Panel(area.Area)
bedrooms = Curve(merge)
livingroom_2 = Curve(curve_90)
kitchen_2 = Curve(curve_91)
bathroom_1 = Curve(curve_92)

# ----
# generator of rooms
number_slider_7 = Slider(5, range=0..100)
# Furnisher Results
from_random_generator = BooleanToggle(False)
py3 = Python3Script(seed=number_slider_7)  # -> out, polygons, doors, names, active, apt_type; inputs seed: Int32
# ---------- py3: Python ----------
"""
Apartment Room Generator for Grasshopper
==========================================
Input:  seed (int) - number slider, e.g. 0 to 9999
Output: polygons - list of 9 closed polyline curves (None for inactive rooms)
        doors    - list of 9 door points (None for inactive rooms)
        names    - list of 9 room name strings
        active   - list of 9 booleans
        apt_type - string describing apartment type

Place a GhPython component, set one input "seed" (int, Item Access).
Add outputs: polygons, doors, names, active, apt_type
"""

import Rhino.Geometry as rg
import random

random.seed(seed)

# ============ CONFIGURATION ============

# Fixed room order (matches scorer output)
ROOM_ORDER = [
    "Bedroom", "Living room", "Bathroom", "WC", "Kitchen",
    "Children 1", "Children 2", "Children 3", "Children 4"
]

# Size ranges in meters: (min_w, max_w, min_h, max_h)
SIZE_RANGES = {
    "Bedroom":     (3.2, 5.5, 3.5, 5.0),
    "Living room": (4.0, 7.0, 4.0, 6.5),
    "Bathroom":    (1.8, 3.2, 2.2, 3.5),
    "WC":          (1.0, 2.0, 1.2, 2.2),
    "Kitchen":     (2.5, 4.5, 2.5, 4.5),
    "Children 1":  (2.8, 4.5, 3.0, 4.5),
    "Children 2":  (2.8, 4.5, 3.0, 4.5),
    "Children 3":  (2.8, 4.0, 3.0, 4.0),
    "Children 4":  (2.8, 4.0, 3.0, 4.0),
}

# Challenging size ranges — small or narrow rooms that will likely
# cause furniture placement failures. Used ~20% of the time.
CHALLENGING_RANGES = {
    "Bedroom":     (2.2, 3.2, 2.4, 3.5),
    "Living room": (2.5, 4.0, 2.5, 4.0),
    "Bathroom":    (1.2, 1.8, 1.5, 2.2),
    "WC":          (0.7, 1.0, 0.8, 1.2),
    "Kitchen":     (1.6, 2.5, 1.8, 2.5),
    "Children 1":  (2.0, 2.8, 2.2, 3.0),
    "Children 2":  (2.0, 2.8, 2.2, 3.0),
    "Children 3":  (2.0, 2.8, 2.2, 3.0),
    "Children 4":  (2.0, 2.8, 2.2, 3.0),
}

# Probability of generating a challenging (small/narrow) room
CHALLENGING_CHANCE = 0.20

# Probability of non-rectangular shape per room type
L_SHAPE_CHANCE = {
    "Bedroom":     0.55,
    "Living room": 0.65,
    "Bathroom":    0.25,
    "WC":          0.08,
    "Kitchen":     0.35,
    "Children 1":  0.50,
    "Children 2":  0.50,
    "Children 3":  0.45,
    "Children 4":  0.45,
}

# Visual spacing between rooms (meters)
ROOM_SPACING = 2.0


# ============ APARTMENT TYPE SELECTION ============

def get_active_rooms():
    """Randomly select which rooms are present based on apartment type."""
    r = random.random()
    
    if r < 0.10:
        # Studio with living only
        has_bed, has_liv, n_kids = False, True, 0
        label = "Studio (living)"
    elif r < 0.20:
        # Studio with bedroom only
        has_bed, has_liv, n_kids = True, False, 0
        label = "Studio (bedroom)"
    elif r < 0.40:
        # 1-bedroom
        has_bed, has_liv, n_kids = True, True, 0
        label = "1-Bedroom"
    elif r < 0.65:
        # 2-bedroom (1 children)
        has_bed, has_liv, n_kids = True, True, 1
        label = "2-Bedroom"
    elif r < 0.80:
        # 3-bedroom (2 children)
        has_bed, has_liv, n_kids = True, True, 2
        label = "3-Bedroom"
    elif r < 0.92:
        # 4-bedroom (3 children)
        has_bed, has_liv, n_kids = True, True, 3
        label = "4-Bedroom"
    else:
        # 5-bedroom (4 children)
        has_bed, has_liv, n_kids = True, True, 4
        label = "5-Bedroom"

    # WC more likely in larger apartments
    if has_bed and has_liv:
        has_wc = random.random() < 0.6
    else:
        has_wc = random.random() < 0.15

    flags = {
        "Bedroom": has_bed,
        "Living room": has_liv,
        "Bathroom": True,
        "WC": has_wc,
        "Kitchen": True,
        "Children 1": n_kids >= 1,
        "Children 2": n_kids >= 2,
        "Children 3": n_kids >= 3,
        "Children 4": n_kids >= 4,
    }
    return flags, label


# ============ SHAPE GENERATORS ============

def make_rectangle(w, h, ox, oy):
    """Simple rectangular room."""
    pts = [
        rg.Point3d(ox, oy, 0),
        rg.Point3d(ox + w, oy, 0),
        rg.Point3d(ox + w, oy + h, 0),
        rg.Point3d(ox, oy + h, 0),
        rg.Point3d(ox, oy, 0),  # close
    ]
    pl = rg.Polyline(pts)
    return pl.ToPolylineCurve()


def make_L_shape(w, h, ox, oy):
    """
    L-shaped room: rectangle with one corner cut.
    Cut size varies randomly — small cut looks like a door niche,
    large cut makes a clear L-shape.
    """
    cut_w, cut_h = _random_cut(w, h)
    corner = random.randint(0, 3)
    pts = _cut_corner(w, h, ox, oy, corner, cut_w, cut_h)
    pts.append(pts[0])
    pl = rg.Polyline(pts)
    return pl.ToPolylineCurve()


def make_double_cut(w, h, ox, oy):
    """
    Room with two corners cut out.
    Walks CCW around the rectangle (BL -> BR -> TR -> TL) and inserts
    notch vertices at each cut corner in the correct winding order.
    """
    corners = random.sample([0, 1, 2, 3], 2)
    cut1_w, cut1_h = _random_cut(w, h)
    cut2_w, cut2_h = _random_cut(w, h)

    cuts = {}
    cuts[corners[0]] = (cut1_w, cut1_h)
    cuts[corners[1]] = (cut2_w, cut2_h)

    # Ensure adjacent cuts don't overlap
    # Horizontal neighbors (BL+BR or TL+TR) share the width axis
    for pair in [(0, 1), (2, 3)]:
        if pair[0] in cuts and pair[1] in cuts:
            cw0 = cuts[pair[0]][0]
            cw1 = cuts[pair[1]][0]
            if cw0 + cw1 > w * 0.85:
                scale = (w * 0.85) / (cw0 + cw1)
                cuts[pair[0]] = (cw0 * scale, cuts[pair[0]][1])
                cuts[pair[1]] = (cw1 * scale, cuts[pair[1]][1])
    # Vertical neighbors (BL+TL or BR+TR) share the height axis
    for pair in [(0, 3), (1, 2)]:
        if pair[0] in cuts and pair[1] in cuts:
            ch0 = cuts[pair[0]][1]
            ch1 = cuts[pair[1]][1]
            if ch0 + ch1 > h * 0.85:
                scale = (h * 0.85) / (ch0 + ch1)
                cuts[pair[0]] = (cuts[pair[0]][0], ch0 * scale)
                cuts[pair[1]] = (cuts[pair[1]][0], ch1 * scale)

    # Walk CCW: BL(corner 0) -> BR(corner 1) -> TR(corner 2) -> TL(corner 3)
    # At each corner, either add the corner point or add notch points.
    pts = []

    # Corner 0: BL
    if 0 in cuts:
        cw, ch = cuts[0]
        pts.append(rg.Point3d(ox + cw, oy, 0))
    else:
        pts.append(rg.Point3d(ox, oy, 0))

    # Corner 1: BR
    if 1 in cuts:
        cw, ch = cuts[1]
        pts.append(rg.Point3d(ox + w - cw, oy, 0))
        pts.append(rg.Point3d(ox + w - cw, oy + ch, 0))
        pts.append(rg.Point3d(ox + w, oy + ch, 0))
    else:
        pts.append(rg.Point3d(ox + w, oy, 0))

    # Corner 2: TR
    if 2 in cuts:
        cw, ch = cuts[2]
        pts.append(rg.Point3d(ox + w, oy + h - ch, 0))
        pts.append(rg.Point3d(ox + w - cw, oy + h - ch, 0))
        pts.append(rg.Point3d(ox + w - cw, oy + h, 0))
    else:
        pts.append(rg.Point3d(ox + w, oy + h, 0))

    # Corner 3: TL
    if 3 in cuts:
        cw, ch = cuts[3]
        pts.append(rg.Point3d(ox + cw, oy + h, 0))
        pts.append(rg.Point3d(ox + cw, oy + h - ch, 0))
        pts.append(rg.Point3d(ox, oy + h - ch, 0))
    else:
        pts.append(rg.Point3d(ox, oy + h, 0))

    # Close: if BL was cut, add the remaining notch points
    if 0 in cuts:
        cw, ch = cuts[0]
        pts.append(rg.Point3d(ox, oy + ch, 0))
        pts.append(rg.Point3d(ox + cw, oy + ch, 0))

    pts.append(pts[0])  # close
    pl = rg.Polyline(pts)
    return pl.ToPolylineCurve()


def _random_cut(w, h):
    """Generate random cut dimensions for a corner notch."""
    cut_ratio = random.uniform(0.12, 0.45)
    cut_w = cut_ratio * w
    cut_h = random.uniform(0.15, 0.45) * h
    cut_w = max(cut_w, 0.4)
    cut_h = max(cut_h, 0.4)
    cut_w = min(cut_w, w * 0.42)
    cut_h = min(cut_h, h * 0.42)
    return cut_w, cut_h


def _cut_corner(w, h, ox, oy, corner, cut_w, cut_h):
    """Return point list for a rectangle with one corner cut."""
    if corner == 0:  # cut top-right
        return [
            rg.Point3d(ox, oy, 0),
            rg.Point3d(ox + w, oy, 0),
            rg.Point3d(ox + w, oy + h - cut_h, 0),
            rg.Point3d(ox + w - cut_w, oy + h - cut_h, 0),
            rg.Point3d(ox + w - cut_w, oy + h, 0),
            rg.Point3d(ox, oy + h, 0),
        ]
    elif corner == 1:  # cut top-left
        return [
            rg.Point3d(ox, oy, 0),
            rg.Point3d(ox + w, oy, 0),
            rg.Point3d(ox + w, oy + h, 0),
            rg.Point3d(ox + cut_w, oy + h, 0),
            rg.Point3d(ox + cut_w, oy + h - cut_h, 0),
            rg.Point3d(ox, oy + h - cut_h, 0),
        ]
    elif corner == 2:  # cut bottom-right
        return [
            rg.Point3d(ox, oy, 0),
            rg.Point3d(ox + w - cut_w, oy, 0),
            rg.Point3d(ox + w - cut_w, oy + cut_h, 0),
            rg.Point3d(ox + w, oy + cut_h, 0),
            rg.Point3d(ox + w, oy + h, 0),
            rg.Point3d(ox, oy + h, 0),
        ]
    else:  # cut bottom-left
        return [
            rg.Point3d(ox + cut_w, oy, 0),
            rg.Point3d(ox + w, oy, 0),
            rg.Point3d(ox + w, oy + h, 0),
            rg.Point3d(ox, oy + h, 0),
            rg.Point3d(ox, oy + cut_h, 0),
            rg.Point3d(ox + cut_w, oy + cut_h, 0),
        ]


def generate_room_shape(room_name, ox, oy):
    """Generate a random room shape at the given offset."""

    # 20% chance of challenging (small/narrow) dimensions
    if random.random() < CHALLENGING_CHANCE:
        mn_w, mx_w, mn_h, mx_h = CHALLENGING_RANGES[room_name]
        # Extra chance of making it narrow (one dim much smaller)
        if random.random() < 0.4:
            # Narrow variant: shrink one dimension further
            if random.random() < 0.5:
                mn_w *= 0.7
                mx_w *= 0.75
            else:
                mn_h *= 0.7
                mx_h *= 0.75
    else:
        mn_w, mx_w, mn_h, mx_h = SIZE_RANGES[room_name]

    w = random.uniform(mn_w, mx_w)
    h = random.uniform(mn_h, mx_h)

    # Randomly swap width/height for proportion variety
    if random.random() < 0.5:
        w, h = h, w

    # Choose shape type
    r = random.random()
    l_chance = L_SHAPE_CHANCE[room_name]

    # Split the L-shape chance: ~70% single cut, ~30% double cut
    # (but only if room is large enough for double cut)
    double_cut_ok = w >= 2.5 and h >= 2.5

    if r < l_chance * 0.65:
        return make_L_shape(w, h, ox, oy), w
    elif r < l_chance and double_cut_ok:
        return make_double_cut(w, h, ox, oy), w
    else:
        return make_rectangle(w, h, ox, oy), w


# ============ DOOR PLACEMENT ============

def place_door_on_curve(curve):
    """
    Place a door point on a random wall segment of the room.
    Picks a wall at least 1.2m long (if available), then places
    the door at a realistic position along that wall.
    """
    polyline = None
    rc, pl = curve.TryGetPolyline()
    if rc:
        polyline = pl

    if polyline is None:
        # Fallback: midpoint of curve
        return curve.PointAtNormalizedLength(0.5)

    # Collect wall segments (skip closing segment if degenerate)
    walls = []
    for i in range(polyline.Count - 1):
        p1 = polyline[i]
        p2 = polyline[i + 1]
        length = p1.DistanceTo(p2)
        if length > 0.3:
            walls.append((p1, p2, length))

    if not walls:
        return polyline[0]

    # Prefer walls at least 1.2m long (enough for a door)
    long_walls = [w for w in walls if w[2] >= 1.2]
    chosen_walls = long_walls if long_walls else walls

    p1, p2, length = random.choice(chosen_walls)

    # Place door: at least 0.4m from corners, biased toward one side
    margin = min(0.4, length * 0.2)
    t = random.uniform(margin / length, 1.0 - margin / length)

    door = rg.Point3d(
        p1.X + t * (p2.X - p1.X),
        p1.Y + t * (p2.Y - p1.Y),
        0
    )
    return door


# ============ MAIN ============

room_flags, apt_type = get_active_rooms()

polygons = []
doors = []
names = []
active = []

offset_x = 0.0

for room_name in ROOM_ORDER:
    names.append(room_name)
    is_active = room_flags[room_name]
    active.append(is_active)

    if not is_active:
        polygons.append(None)
        doors.append(None)
    else:
        curve, room_width = generate_room_shape(room_name, offset_x, 0)
        door_pt = place_door_on_curve(curve)

        polygons.append(curve)
        doors.append(door_pt)

        offset_x += room_width + ROOM_SPACING
# ---------- end py3 ----------

panel_18 = Panel("""2
0
5
6
7
8
4
1
3""")
panel_19 = Panel(py3.names)
crv = Curve(py3.polygons)
item = ListItem(List=crv, Index=0, Wrap=True)  # -> Item, Item1, Item2, Item3, Item4, Item5, Item6, Item7, Item8
item_2 = ListItem(List=py3.doors, Index=panel_18, Wrap=True)
pt = Point(item_2)
merge_2 = Merge(Data1=item.Item5, Data2=item.Item6, Data3=item.Item7, Data4=item.Item8)
clean = CleanTree(RemoveNulls=True, RemoveInvalid=True, RemoveEmpty=False, Tree=merge_2)
clean_2 = CleanTree(RemoveNulls=True, RemoveInvalid=True, RemoveEmpty=False, Tree=pt)
filter = StreamFilter(Gate=from_random_generator, Stream0=bedrooms, Stream1=clean)
filter_2 = StreamFilter(Gate=from_random_generator, Stream1=clean_2)
filter_3 = StreamFilter(Gate=from_random_generator, Stream0=bathroom_1, Stream1=item.Item2)
filter_4 = StreamFilter(Gate=from_random_generator, Stream0=kitchen_2, Stream1=item.Item4)
filter_5 = StreamFilter(Gate=from_random_generator, Stream0=livingroom_2, Stream1=item.Item1)

# ----
# reconstruct results
number_slider_8 = Slider(790, range=0..1000)
apt_reader = Python3Script(file_path="C:\Bauhaus\data\apartments.jsonl", index=number_slider_8)  # -> out, polygons, doors, names, active, scores, apt_type, seed_val, total; inputs index: Int32
# ---------- apt_reader: Python ----------
"""
Apartment Data Reader for Grasshopper
=======================================
Reads the JSONL file and reconstructs geometry + metadata.

Inputs (Item Access):
    file_path (str) - path to the .jsonl file
    index     (int) - apartment index to load (-1 for summary only)

Outputs:
    polygons   (list) - reconstructed polyline curves (None for inactive)
    doors      (list) - reconstructed door points (None for inactive)
    names      (list) - room names
    active     (list) - booleans
    scores     (list) - score values (None for inactive)
    apt_type   (str)  - apartment type label
    seed_val   (int)  - seed used to generate this apartment
    total      (int)  - total apartments in file
"""

import Rhino.Geometry as rg
import json

# Read all records
records = []
with open(file_path, "r") as f:
    for line in f:
        line = line.strip()
        if line:
            records.append(json.loads(line))

total = len(records)

# Default empty outputs
polygons = []
doors = []
names = []
active = []
scores = []
apt_type = ""
seed_val = -1

if index < 0 or index >= total:
    apt_type = "Total records: {}".format(total)
else:
    rec = records[index]
    seed_val = rec["seed"]
    apt_type = rec["apt_type"]

    for room in rec["rooms"]:
        names.append(room["name"])
        active.append(room["active"])
        scores.append(room["score"])

        # Reconstruct polyline
        if room["points"] is not None:
            pts = [rg.Point3d(p[0], p[1], p[2]) for p in room["points"]]
            pl = rg.Polyline(pts)
            polygons.append(pl.ToPolylineCurve())
        else:
            polygons.append(None)

        # Reconstruct door point
        if room["door"] is not None:
            d = room["door"]
            doors.append(rg.Point3d(d[0], d[1], d[2]))
        else:
            doors.append(None)
# ---------- end apt_reader ----------

unit_z_3 = UnitZ(Factor="0.2")
panel_20 = Panel(apt_reader.seed_val)
furnish = STFurnish(Furnish=Toggle(False), ApartmentType=0, NodeExe="node")  # -> Rooms, RoomNames, AptType, Furniture, Transitions, Footprints, StepNames, Options, Selected, Warnings
doors = Point(filter_2)
bbox = BoundingBox(Content=py3.polygons, Plane=PlaneXY(0, 0, 0), UnionBox=True)  # -> Box, Box_2
debrep = DeconstructBrep(Brep=bbox.Box)  # -> Faces, Edges, Vertices
boundary = BoundarySurfaces(Edges=debrep.Edges)
door_from_3 = Curve()
door_from_1 = Curve()
door_from_2 = Curve()
door_to = Curve()
addition = Addition(A="3", B="12")
addition_2 = Addition(A=addition, B="12")
furniture_piece_1 = Number()
num_var_bed_1 = Integer()
apartment_outline = Curve()
furniture_piece_2 = Number()
num_var_bed_2 = Integer()
y_dis = Number()
x_dis = Number()
furniture_piece_1_2 = Number("3")
furniture_piece_1_3 = Number()
furniture_piece_1_4 = Number()
furniture_piece_2_2 = Number("3")
apartment_outline_2 = Curve()
x_dis_2 = Number("3")
y_dis_2 = Number("-2")
apartment_outline_3 = Curve()
furniture_piece_2_3 = Number()
y_dis_3 = Number()
x_dis_3 = Number()
furniture_piece_2_4 = Number()
number_slider_9 = Slider(4, range=0..10)
furniture_piece_2_5 = Number()
y_dis_4 = Number()
x_dis_4 = Number()
furniture_piece_1_5 = Number("1")
furniture_piece_1_6 = Number("3")
negative_4 = Negative(Value="1.5")
furniture_piece_2_6 = Number("1")
furniture_piece_2_7 = Number("1")
construct_point = ConstructPoint(XCoordinate=0, YCoordinate=0, ZCoordinate=0)
furniture_piece_2_8 = Number("1")
unit_y_2 = UnitY(Factor="1.5")
unit_x_2 = UnitX(Factor="1.5")
x_dis_5 = Number(addition_2)
y_dis_5 = Number("-2")
x_dis_6 = Number(addition)
y_dis_6 = Number("-2")
number_slider_10 = Slider(4, range=0..10)
negative_5 = Negative(Value=number_slider_9)
number_slider_11 = Slider(4, range=0..10)
negative_6 = Negative(Value="1.5")
negative_7 = Negative(Value="1.5")
construct_point_2 = ConstructPoint(XCoordinate=0, YCoordinate=0, ZCoordinate=0)
unit_y_3 = UnitY(Factor=negative_5)
unit_x_3 = UnitX(Factor=number_slider_9)
unit_y_4 = UnitY(Factor="1.5")
unit_x_4 = UnitX(Factor="1.5")
construct_point_3 = ConstructPoint(XCoordinate=0, YCoordinate=0, ZCoordinate=0)
unit_y_5 = UnitY(Factor="1.5")
unit_x_5 = UnitX(Factor="1.5")
unit_y_6 = UnitY(Factor="1.5")
unit_x_6 = UnitX(Factor="1.5")
number = Number(number_slider_9)
negative_8 = Negative(Value=number_slider_10)
negative_9 = Negative(Value=number_slider_11)
division = Division(A=number, B=Slider(4, range=0..10))
unit_x_7 = UnitX(Factor=number_slider_10)
unit_y_7 = UnitY(Factor=negative_8)
unit_x_8 = UnitX(Factor=number_slider_11)
unit_y_8 = UnitY(Factor=negative_9)
negative_10 = Negative(Value=division)
unit_y_9 = UnitY(Factor=division)
number_slider_12 = Slider(0.5, range=0..1)
unit_x_9 = UnitX(Factor=negative_10)
negative_11 = Negative(Value=Slider(0.5, range=0..1))
number_slider_13 = Slider(0.5, range=0..1)
number_2 = Number(number_slider_10)
number_3 = Number(number_slider_10)
number_4 = Number(number_slider_11)
division_2 = Division(A=number_2, B=Slider(5, range=0..10))
division_3 = Division(A=number_3, B=Slider(5, range=0..10))
unit_x_10 = UnitX(Factor=negative_11)
unit_y_10 = UnitY(Factor=negative_11)
division_4 = Division(A=number_4, B=Slider(5, range=0..10))
negative_12 = Negative(Value=number_slider_12)
negative_13 = Negative(Value=division_2)
negative_14 = Negative(Value=division_4)
unit_x_11 = UnitX(Factor=number_slider_12)
negative_15 = Negative(Value=number_slider_13)
negative_16 = Negative(Value=division_3)
unit_y_11 = UnitY(Factor="0")
unit_x_12 = UnitX(Factor="0")
unit_y_12 = UnitY(Factor="0")
unit_x_13 = UnitX(Factor="0")
multiplication = Multiplication(A=division_3, B=Slider(2, range=0..10))
unit_x_14 = UnitX(Factor="0")
pi = Pi(Factor=Slider(0, range=0..1))
unit_z_4 = UnitZ(Factor="-0.1")
multiplication_2 = Multiplication(A=division_4, B=Slider(2, range=0..10))
number_slider_14 = Slider(3, range=0..10)
unit_y_13 = UnitY(Factor=negative_12)
unit_y_14 = UnitY(Factor="0")
unit_z_5 = UnitZ(Factor="-0.1")
unit_x_15 = UnitX(Factor=number_slider_13)
unit_y_15 = UnitY(Factor=negative_15)
multiplication_3 = Multiplication(A=division_2, B=Slider(2, range=0..10))
negative_17 = Negative(Value=division)
unit_z_6 = UnitZ(Factor="-0.1")
unit_z_7 = UnitZ(Factor="-0.1")
unit_z_8 = UnitZ(Factor="-0.1")
pi_2 = Pi(Factor=Slider(0, range=0..1))
pi_3 = Pi(Factor=Slider(0, range=0..1))
unit_z_9 = UnitZ(Factor="-0.1")
unit_x_16 = UnitX(Factor=division)
unit_y_16 = UnitY(Factor=negative_17)
unit_z_10 = UnitZ(Factor="-0.1")
symbol_simple = SymbolSimple(Style=3, Size="6", Rotation=0, Colour=ColourSwatch(SwatchColor=RGB(255, 0, 0)))
negative_18 = Negative(Value=multiplication_3)
negative_19 = Negative(Value=multiplication)
negative_20 = Negative(Value=multiplication_2)
unit_x_17 = UnitX(Factor=multiplication_3)
unit_y_17 = UnitY(Factor=negative_18)
unit_x_18 = UnitX(Factor=multiplication)
unit_y_18 = UnitY(Factor=negative_19)
unit_x_19 = UnitX(Factor=multiplication_2)
unit_y_19 = UnitY(Factor=negative_20)
symbol_simple_2 = SymbolSimple(Style=3, Size="6", Rotation=0, Colour=ColourSwatch(SwatchColor=RGB(255, 0, 0)))
symbol_simple_3 = SymbolSimple(Style=3, Size="6", Rotation=0, Colour=ColourSwatch(SwatchColor=RGB(255, 0, 0)))
symbol_simple_4 = SymbolSimple(Style=3, Size="6", Rotation=0, Colour=ColourSwatch(SwatchColor=RGB(255, 0, 0)))
font_table = FontTable()
symbol_simple_5 = SymbolSimple(Style=3, Size="6", Rotation=0, Colour=ColourSwatch(SwatchColor=RGB(255, 0, 0)))
symbol_simple_6 = SymbolSimple(Style=3, Size="6", Rotation=0, Colour=ColourSwatch(SwatchColor=RGB(255, 0, 0)))
symbol_simple_7 = SymbolSimple(Style=3, Size="6", Rotation=0, Colour=ColourSwatch(SwatchColor=RGB(255, 0, 0)))
panel_21 = Panel(font_table)
unit_z_11 = UnitZ(Factor="0.1")
number_slider_15 = Slider(2, range=0..10)
unit_z_12 = UnitZ(Factor="0.1")
unit_z_13 = UnitZ(Factor="0.1")
unit_z_14 = UnitZ(Factor="0.1")
unit_z_15 = UnitZ(Factor="0.1")
unit_z_16 = UnitZ(Factor="0.1")
unit_z_17 = UnitZ(Factor="0.1")
addition_3 = Addition(A="-2", B="10")
negative_21 = Negative(Value=addition_3)
furniture_piece_1_7 = Number()
apartment_outline_4 = Curve()
furniture_piece_2_9 = Number()
y_dis_7 = Number()
x_dis_7 = Number()
furniture_piece_1_8 = Number("2")
panel_22 = Panel("1")
relay = Relay()
furniture_piece_2_10 = Number("2")
x_dis_8 = Number("3")
y_dis_8 = Number(negative_21)
number_slider_16 = Slider(4, range=0..10)
negative_22 = Negative(Value="1.5")
construct_point_4 = ConstructPoint(XCoordinate=0, YCoordinate=0, ZCoordinate=0)
unit_y_20 = UnitY(Factor="1.5")
unit_x_20 = UnitX(Factor="1.5")
negative_23 = Negative(Value=number_slider_16)
unit_x_21 = UnitX(Factor=number_slider_16)
furniture_piece_1_9 = Number()
unit_y_21 = UnitY(Factor=negative_23)
number_slider_17 = Slider(0.5, range=0..1)
number_5 = Number(number_slider_16)
apartment_outline_5 = Curve()
furniture_piece_2_11 = Number()
y_dis_9 = Number()
x_dis_9 = Number()
furniture_piece_1_10 = Number("3")
division_5 = Division(A=number_5, B=Slider(5, range=0..10))
unit_y_22 = UnitY(Factor=division_5)
furniture_piece_2_12 = Number(relay)
negative_24 = Negative(Value=division_5)
unit_x_22 = UnitX(Factor=negative_24)
negative_25 = Negative(Value=number_slider_17)
x_dis_10 = Number(addition)
y_dis_10 = Number(negative_21)
number_slider_18 = Slider(4, range=0..10)
multiplication_4 = Multiplication(A=division_5, B=Slider(2, range=0..10))
unit_x_23 = UnitX(Factor=number_slider_17)
unit_y_23 = UnitY(Factor=negative_25)
negative_26 = Negative(Value="1.5")
number_slider_19 = Slider(0, range=0..10)
construct_point_5 = ConstructPoint(XCoordinate=0, YCoordinate=0, ZCoordinate=0)
unit_y_24 = UnitY(Factor="1.5")
unit_x_24 = UnitX(Factor="1.5")
negative_27 = Negative(Value=number_slider_18)
unit_z_18 = UnitZ(Factor="-0.1")
pi_4 = Pi(Factor=Slider(0, range=0..1))
unit_z_19 = UnitZ(Factor="-0.1")
unit_x_25 = UnitX(Factor=number_slider_18)
unit_y_25 = UnitY(Factor=negative_27)
negative_28 = Negative(Value=multiplication_4)
number_slider_20 = Slider(4, range=0..6)
number_slider_21 = Slider(0.5, range=0..1)
number_6 = Number(number_slider_18)
division_6 = Division(A=number_6, B=Slider(5, range=0..10))
unit_y_26 = UnitY(Factor=negative_28)
unit_x_26 = UnitX(Factor=multiplication_4)
symbol_simple_8 = SymbolSimple(Style=3, Size="6", Rotation=0, Colour=ColourSwatch(SwatchColor=RGB(255, 0, 0)))
negative_29 = Negative(Value=number_slider_21)
unit_x_27 = UnitX(Factor=number_slider_21)
unit_y_27 = UnitY(Factor="0")
multiplication_5 = Multiplication(A=division_6, B=Slider(2, range=0..10))
unit_y_28 = UnitY(Factor=negative_29)
number_slider_22 = Slider(6, range=0..6)
symbol_simple_9 = SymbolSimple(Style=3, Size="6", Rotation=0, Colour=ColourSwatch(SwatchColor=RGB(255, 0, 0)))
unit_z_20 = UnitZ(Factor="-0.1")
pi_5 = Pi(Factor=Slider(0, range=0..1))
unit_z_21 = UnitZ(Factor="-0.1")
negative_30 = Negative(Value=multiplication_5)
unit_x_28 = UnitX(Factor=multiplication_5)
unit_y_29 = UnitY(Factor=negative_30)
symbol_simple_10 = SymbolSimple(Style=3, Size="6", Rotation=0, Colour=ColourSwatch(SwatchColor=RGB(255, 0, 0)))
unit_z_22 = UnitZ(Factor="0.1")
unit_z_23 = UnitZ(Factor="0.1")
number_slider_23 = Slider(0, range=0..5)
number_slider_24 = Slider(0, range=0..5)
symbol_simple_11 = SymbolSimple(Style=3, Size="6", Rotation=0, Colour=ColourSwatch(SwatchColor=RGB(255, 0, 0)))
unit_z_24 = UnitZ(Factor="0.1")
unit_z_25 = UnitZ(Factor="0.1")
item_3 = ListItem(Index=0, Wrap=True)
reb = RebuildCurve(Count=10, Tangents=False)
xy = XYPlane(Origin=Point(0, 0, 0))
end = EndPoints()  # -> Start, End
end_2 = EndPoints()  # -> Start, End
tolerance = Data()
tolerance_2 = Data(tolerance)
number_slider_25 = Slider(0.1, range=0..0.1)
null = NullItem(Item=tolerance_2)  # -> NullFlags, InvalidFlags, Description
filter_6 = StreamFilter(Gate=null.NullFlags, Stream0=tolerance_2, Stream1=Slider(0, range=0..1))
tolerance_3 = Data(filter_6)
graft = GraftTree(IncludeEmptyLists=True, IncludeNullItems=True)
crv_2 = Curve()
crv_3 = Curve()
nulls_in_empty = NullsInEmptyBranches(DataWithEmptyBranches=crv_2)
nulls_in_empty_2 = NullsInEmptyBranches(DataWithEmptyBranches=crv_3)
children_4_2 = Data()
children_4_1 = Data()
children_5_2 = Data()
children_5_1 = Data()
wrap = WrapList(Data=children_5_1)
wrap_2 = WrapList(Data=children_5_2)
wrap_3 = WrapList(Data=children_4_1)
wrap_4 = WrapList(Data=children_4_2)
chi5 = Data([wrap, wrap_2])
chi4 = Data([wrap_3, wrap_4])

# ----
# VALIDATION
# geometry of test set
number_slider_26 = Slider(2, range=0..13)
test_set = TestSet(option_num=number_slider_26)  # -> bed_1_3, bed_2_3, chi_1_3, chi_2_4, chi_2_1_3, chi_2_2_3, liv_1_2, liv_2_3, kit_1_3, bath_2_3
panel_23 = Panel(test_set.chi_1_3)
panel_24 = Panel(test_set.chi_2_1_3)
panel_25 = Panel(test_set.chi_2_4)
entwine_2 = Entwine(
    Branch0X=test_set.bed_1_3,
    Branch1X=test_set.bed_2_3,
    Branch2X=test_set.chi_1_3,
    Branch3X=test_set.chi_2_4,
    Branch4X=test_set.chi_2_1_3,
    Branch5X=test_set.chi_2_2_3,
    Branch6X=test_set.liv_1_2,
    Branch7X=test_set.liv_2_3,
    Branch8X=test_set.kit_1_3,
    Branch9X=test_set.bath_2_3,
    FlattenInputs=False)  # -> simplify(Result)
panel_26 = Panel(test_set.chi_2_2_3)
switch_on_test_set = BooleanToggle(False)
panel_27 = Panel(entwine_2)
match = MatchTree(Tree=entwine_2)
panel_28 = Panel("apt 5")
internalized_apartments = InternalizedApartments(num=number_slider_26)  # -> apartment_17, master_bedroom_23, bedrooms_23, bathroom_1_17, bathrooms_rest_17, kitchen_17, livingroom_17, corridor_17, stairs_2
toggle = BooleanToggle(False)
apartment_2 = Curve(internalized_apartments.apartment_17)
master_bedroom_2 = Curve(internalized_apartments.master_bedroom_23)
livingroom_3 = Curve(internalized_apartments.livingroom_17)
kitchen_3 = Curve(internalized_apartments.kitchen_17)
bathroom_1_2 = Curve(internalized_apartments.bathroom_1_17)
bathrooms_rest_2 = Curve(internalized_apartments.bathrooms_rest_17)
corridor_2 = Curve(internalized_apartments.corridor_17)
staircase_3 = Curve(internalized_apartments.stairs_2)
bedrooms_2 = Curve(internalized_apartments.bedrooms_23)
area_2 = Area(Geometry=master_bedroom_2)  # -> Area, Centroid
panel_29 = Panel(area_2.Area)

bool = Boolean(switch_on_test_set)
filter_7 = StreamFilter(Gate=bool, Stream0=livingroom_2, Stream1=livingroom_3)
filter_8 = StreamFilter(Gate=bool, Stream0=bedrooms, Stream1=bedrooms_2)
filter_9 = StreamFilter(Gate=bool, Stream0=bathroom_1, Stream1=bathroom_1_2)
filter_10 = StreamFilter(Gate=bool, Stream0=apartment, Stream1=apartment_2)
filter_11 = StreamFilter(Gate=bool, Stream0=kitchen_2, Stream1=kitchen_3)
filter_12 = StreamFilter(Gate=bool, Stream0=bathrooms_rest, Stream1=bathrooms_rest_2)
filter_13 = StreamFilter(Gate=bool, Stream0=corridor, Stream1=corridor_2)
filter_14 = StreamFilter(Gate=bool, Stream0=staircase_2, Stream1=staircase_3)
filter_15 = StreamFilter(Gate=bool, Stream0=master_bedroom, Stream1=master_bedroom_2)
item_4 = ListItem(List=filter_8, Index=0, Wrap=True)
shift = ShiftList(List=filter_12, Shift=1, Wrap=False)
item_5 = ListItem(List=filter_12, Index=0, Wrap=True)
shift_2 = ShiftList(List=shift, Shift=1, Wrap=False)
shift_3 = ShiftList(List=filter_8, Shift=1, Wrap=False)
item_6 = ListItem(List=shift, Index=0, Wrap=True)
item_7 = ListItem(List=shift_2, Index=0, Wrap=True)
item_8 = ListItem(List=shift_3, Index=0, Wrap=True)
shift_4 = ShiftList(List=shift_3, Shift=1, Wrap=False)
item_9 = ListItem(List=shift_4, Index=0, Wrap=True)
shift_5 = ShiftList(List=shift_4, Shift=1, Wrap=False)
item_10 = ListItem(List=shift_5, Index=0, Wrap=True)
shift_6 = ShiftList(List=shift_5, Shift=1, Wrap=False)
children_1 = Curve(item_8)
children_2 = Curve(item_9)
children_3 = Curve(item_10)
bedroom_2 = Curve(item_4)
living = Curve(filter_15)
kitchen_4 = Curve(filter_11)
bathroom_2 = Curve(filter_9)
wc = Curve(filter_12)
item_11 = ListItem(List=shift_6, Index=0, Wrap=True)
polyoffset = PolylineOffset(
    Polylines=children_1,
    Distance="0.05",
    Plane=Plane(origin=(0, 0, 0), x=(0, 0, 0), y=(0, 0, 0)),
    Tolerance=0.001,
    ClosedFillet=1,
    OpenFillet=1,
    Miter=2)  # -> Contour, Holes
polyoffset_2 = PolylineOffset(
    Polylines=children_2,
    Distance="0.05",
    Plane=Plane(origin=(0, 0, 0), x=(0, 0, 0), y=(0, 0, 0)),
    Tolerance=0.001,
    ClosedFillet=1,
    OpenFillet=1,
    Miter=2)  # -> Contour, Holes
polyoffset_3 = PolylineOffset(
    Polylines=children_3,
    Distance="0.05",
    Plane=Plane(origin=(0, 0, 0), x=(0, 0, 0), y=(0, 0, 0)),
    Tolerance=0.001,
    ClosedFillet=1,
    OpenFillet=1,
    Miter=2)  # -> Contour, Holes
polyoffset_4 = PolylineOffset(
    Polylines=bathroom_2,
    Distance="0.05",
    Plane=Plane(origin=(0, 0, 0), x=(0, 0, 0), y=(0, 0, 0)),
    Tolerance=0.001,
    ClosedFillet=1,
    OpenFillet=1,
    Miter=2)  # -> Contour, Holes
polyoffset_5 = PolylineOffset(
    Polylines=wc,
    Distance="0.05",
    Plane=Plane(origin=(0, 0, 0), x=(0, 0, 0), y=(0, 0, 0)),
    Tolerance=0.001,
    ClosedFillet=1,
    OpenFillet=1,
    Miter=2)  # -> Contour, Holes
polyoffset_6 = PolylineOffset(
    Polylines=bedroom_2,
    Distance="0.05",
    Plane=Plane(origin=(0, 0, 0), x=(0, 0, 0), y=(0, 0, 0)),
    Tolerance=0.001,
    ClosedFillet=1,
    OpenFillet=1,
    Miter=2)  # -> Contour, Holes
polyoffset_7 = PolylineOffset(
    Polylines=living,
    Distance="0.05",
    Plane=Plane(origin=(0, 0, 0), x=(0, 0, 0), y=(0, 0, 0)),
    Tolerance=0.001,
    ClosedFillet=1,
    OpenFillet=1,
    Miter=2)  # -> Contour, Holes
polyoffset_8 = PolylineOffset(
    Polylines=kitchen_4,
    Distance="0.05",
    Plane=Plane(origin=(0, 0, 0), x=(0, 0, 0), y=(0, 0, 0)),
    Tolerance=0.001,
    ClosedFillet=1,
    OpenFillet=1,
    Miter=2)  # -> Contour, Holes
children_1_2 = Curve(polyoffset.Holes)
children_2_2 = Curve(polyoffset_2.Holes)
children_3_2 = Curve(polyoffset_3.Holes)
bathroom_3 = Curve(polyoffset_4.Holes)
wc_2 = Curve(polyoffset_5.Holes)
bedroom_3 = Curve(polyoffset_6.Holes)
living_2 = Curve(polyoffset_7.Holes)
kitchen_5 = Curve(polyoffset_8.Holes)

# ----
# selected apartment display
colour_swatch_2 = ColourSwatch(SwatchColor=RGBA(0, 131, 255, 150))
balcony_2 = Surface(curve_87)  # disabled
surface_17 = Surface(curve_88)
surface_18 = Surface(filter_13)
surface_19 = Surface(filter_7)
surface_20 = Surface(filter_11)
surface_21 = Surface(filter_9)
surface_22 = Surface(item_5)
surface_23 = Surface(item_6)
surface_24 = Surface(filter_15)
surface_25 = Surface(item_4)
surface_26 = Surface(item_7)
surface_27 = Surface(item_10)
surface_28 = Surface(item_11)
surface_29 = Surface(item_8)
surface_30 = Surface(item_9)
entwine_3 = Entwine(
    Branch00=flatten(balcony_2),
    Branch01=flatten(surface_17),
    Branch02=flatten(surface_18),
    Branch03=flatten(surface_19),
    Branch04=flatten(surface_20),
    Branch05=flatten(surface_21),
    Branch06=flatten(surface_22),
    Branch07=flatten(surface_23),
    Branch08=flatten(surface_26),
    Branch09=flatten(surface_24),
    Branch010=flatten(surface_25),
    Branch011=flatten(surface_29),
    Branch012=flatten(surface_30),
    Branch013=flatten(surface_27),
    Branch014=flatten(surface_28),
    FlattenInputs=True)
curve_103 = Curve(entwine_3)
custom_preview_lineweights_4 = CustomPreviewLineweights(Geometry=curve_103, Shader=ColourSwatch(SwatchColor=RGB(122, 122, 122)), Thickness="2", Absolute=False)
custom_preview_17 = CustomPreview(Geometry=balcony_2, Material=ColourSwatch(SwatchColor=RGBA(84, 0, 51, 150)))
custom_preview_18 = CustomPreview(Geometry=surface_17, Material=ColourSwatch(SwatchColor=RGBA(0, 36, 255, 150)))
custom_preview_19 = CustomPreview(Geometry=surface_18, Material=ColourSwatch(SwatchColor=RGBA(141, 198, 17, 150)))
custom_preview_20 = CustomPreview(Geometry=surface_19, Material=ColourSwatch(SwatchColor=RGBA(229, 91, 175, 150)))
custom_preview_21 = CustomPreview(Geometry=surface_20, Material=ColourSwatch(SwatchColor=RGBA(123, 34, 175, 150)))
custom_preview_22 = CustomPreview(Geometry=surface_21, Material=colour_swatch_2)
custom_preview_23 = CustomPreview(Geometry=surface_22, Material=ColourSwatch(SwatchColor=RGBA(0, 175, 255, 150)))
custom_preview_24 = CustomPreview(Geometry=surface_23, Material=ColourSwatch(SwatchColor=RGBA(0, 222, 255, 150)))
custom_preview_25 = CustomPreview(Geometry=surface_26, Material=ColourSwatch(SwatchColor=RGBA(0, 255, 255, 150)))
custom_preview_26 = CustomPreview(Geometry=surface_24, Material=ColourSwatch(SwatchColor=RGBA(255, 0, 0, 150)))
custom_preview_27 = CustomPreview(Geometry=surface_25, Material=ColourSwatch(SwatchColor=RGBA(255, 78, 0, 150)))
custom_preview_28 = CustomPreview(Geometry=surface_29, Material=ColourSwatch(SwatchColor=RGBA(255, 131, 0, 150)))
custom_preview_29 = CustomPreview(Geometry=surface_30, Material=ColourSwatch(SwatchColor=RGBA(255, 175, 0, 150)))
custom_preview_30 = CustomPreview(Geometry=surface_27, Material=ColourSwatch(SwatchColor=RGBA(255, 202, 0, 150)))
custom_preview_31 = CustomPreview(Geometry=surface_28, Material=ColourSwatch(SwatchColor=RGBA(255, 255, 0, 150)))

filter_16 = StreamFilter(Gate=from_random_generator, Stream0=filter_15, Stream1=item.Item)
filter_17 = StreamFilter(Gate=from_random_generator, Stream0=item_5, Stream1=item.Item3)
curve_104 = Curve(filter_10)
move_5 = Move(Geometry=curve_104, Motion=unit_z_3)  # -> Geometry, Transform
custom_preview_lineweights_5 = CustomPreviewLineweights(Geometry=move_5.Geometry, Shader=ColourSwatch(SwatchColor=RGB(161, 0, 161)), Thickness="5", Absolute=False)

apartment_contour = Curve(filter_10)
living_room = Curve(flatten(filter_5))
bedroom_4 = Curve(flatten(filter_16))
bathroom_4 = Curve(flatten(filter_3))
children_4 = Curve(flatten(filter))
corridor_3 = Curve(flatten(filter_13))
kitchen_6 = Curve(flatten(filter_4))
staircase_4 = Curve(filter_14)
working = Curve()  # disabled
bath2 = Curve(filter_17)

clean_3 = CleanTree(RemoveNulls=True, RemoveInvalid=True, RemoveEmpty=False, Tree=bath2)
curve_105 = Curve(curve_104)
filter_18 = StreamFilter(Gate=from_random_generator, Stream0=curve_105, Stream1=boundary)
simplify = Simplify(crv=bedroom_4)  # -> flatten(crv_4)
simplify_2 = Simplify(crv=kitchen_6)  # -> flatten(crv_4)
simplify_3 = Simplify(crv=living_room)  # -> flatten(crv_4)
simplify_4 = Simplify(crv=clean_3)  # -> flatten(crv_4)
simplify_5 = Simplify(crv=children_4)  # -> flatten(crv_4)
simplify_6 = Simplify(crv=bathroom_4)  # -> flatten(crv_4)
simplify_7 = Simplify(crv=corridor_3)  # -> flatten(crv_4)
crv_4 = Curve(filter_18)
explode = Explode(Curve=simplify, Recursive=True)  # -> Segments, Vertices
curve_106 = Curve(crv_4)
curve_107 = Curve(crv_4)
bath2_2 = Curve(simplify_4)

# ---- group: to rooms
children_5 = Curve(simplify_5)  # disabled
working_2 = Curve(working)  # disabled
bedroom_5 = Curve(simplify)  # disabled
kitchen_7 = Curve(simplify_2)  # disabled
bathroom_5 = Curve(simplify_6)
merge_3 = Merge(Data1=children_5, Data2=working_2, Data3=bedroom_5, Data4=kitchen_7, Data5=bathroom_5, Data6=bath2_2)  # -> flatten(Result)
living_room_2 = Curve(simplify_3)
corridor_4 = Curve(simplify_7)
bedroom_6 = Curve(simplify)
graft_2 = GraftTree(Tree=merge_3, IncludeEmptyLists=True, IncludeNullItems=True)
crvprox = CurveProximity(CurveA=graft_2, CurveB=corridor_4)  # -> PointA, PointB, Distance
crvprox_2 = CurveProximity(CurveA=graft_2, CurveB=living_room_2)  # -> PointA, PointB, Distance
crvprox_3 = CurveProximity(CurveA=graft_2, CurveB=bedroom_6)  # -> PointA, PointB, Distance
smaller = SmallerThan(FirstNumber=crvprox.Distance, SecondNumber=0.25)  # -> SmallerThan, OrEqualTo
smaller_2 = SmallerThan(FirstNumber=crvprox_2.Distance, SecondNumber=0.25)  # -> SmallerThan, OrEqualTo
smaller_3 = SmallerThan(FirstNumber=crvprox_3.Distance, SecondNumber=0.25)  # -> SmallerThan, OrEqualTo
cull = CullPattern(List=corridor_4, CullPattern=smaller.SmallerThan)
cull_2 = CullPattern(List=bedroom_6, CullPattern=smaller_3.SmallerThan)
cull_3 = CullPattern(List=living_room_2, CullPattern=smaller_2.SmallerThan)
null_2 = NullItem(Item=cull)  # -> NullFlags, InvalidFlags, Description
dispatch = Dispatch(List=cull_3, DispatchPattern=null_2.NullFlags)  # -> ListA, ListB
dispatch_2 = Dispatch(List=cull, DispatchPattern=null_2.NullFlags)  # -> ListA, ListB
panel_30 = Panel(null_2.NullFlags)
merge_4 = Merge(Data1=dispatch_2.ListB, Data2=dispatch.ListA)
null_3 = NullItem(Item=merge_4)  # -> NullFlags, InvalidFlags, Description
dispatch_3 = Dispatch(List=merge_4, DispatchPattern=null_3.NullFlags)  # -> ListA, ListB
dispatch_4 = Dispatch(List=cull_2, DispatchPattern=null_3.NullFlags)  # -> ListA, ListB
merge_5 = Merge(Data1=dispatch_3.ListB, Data2=dispatch_4.ListA)

children_6 = Curve(simplify_5)
working_3 = Curve(working)
bedroom_7 = Curve(simplify)
kitchen_8 = Curve(simplify_2)
merge_6 = Merge(Data1=children_6, Data2=working_3, Data3=bedroom_7, Data4=kitchen_8)  # -> flatten(Result)
living_room_3 = Curve(simplify_3)
corridor_5 = Curve(simplify_7)
graft_3 = GraftTree(Tree=merge_6, IncludeEmptyLists=True, IncludeNullItems=True)
crvprox_4 = CurveProximity(CurveA=graft_3, CurveB=corridor_5)  # -> PointA, PointB, Distance
crvprox_5 = CurveProximity(CurveA=graft_3, CurveB=living_room_3)  # -> PointA, PointB, Distance
smaller_4 = SmallerThan(FirstNumber=crvprox_4.Distance, SecondNumber=0.25)  # -> SmallerThan, OrEqualTo
smaller_5 = SmallerThan(FirstNumber=crvprox_5.Distance, SecondNumber=0.25)  # -> SmallerThan, OrEqualTo
cull_4 = CullPattern(List=corridor_5, CullPattern=smaller_4.SmallerThan)
cull_5 = CullPattern(List=living_room_3, CullPattern=smaller_5.SmallerThan)
null_4 = NullItem(Item=cull_4)  # -> NullFlags, InvalidFlags, Description
dispatch_5 = Dispatch(List=cull_5, DispatchPattern=null_4.NullFlags)  # -> ListA, ListB
dispatch_6 = Dispatch(List=cull_4, DispatchPattern=null_4.NullFlags)  # -> ListA, ListB
panel_31 = Panel(null_4.NullFlags)
merge_7 = Merge(Data1=dispatch_6.ListB, Data2=dispatch_5.ListA)

living_3 = Curve(simplify_3)
merge_8 = Merge(Data1=living_3)  # -> flatten(Result)
staircase_5 = Curve(simplify_3)
corridor_6 = Curve(simplify_7)
graft_4 = GraftTree(Tree=merge_8, IncludeEmptyLists=True, IncludeNullItems=True)
crvprox_6 = CurveProximity(CurveA=graft_4, CurveB=corridor_6)  # -> PointA, PointB, Distance
crvprox_7 = CurveProximity(CurveA=graft_4, CurveB=staircase_5)  # -> PointA, PointB, Distance
smaller_6 = SmallerThan(FirstNumber=crvprox_6.Distance, SecondNumber=0.25)  # -> SmallerThan, OrEqualTo
smaller_7 = SmallerThan(FirstNumber=crvprox_7.Distance, SecondNumber=0.25)  # -> SmallerThan, OrEqualTo
cull_6 = CullPattern(List=corridor_6, CullPattern=smaller_6.SmallerThan)
cull_7 = CullPattern(List=staircase_5, CullPattern=smaller_7.SmallerThan)
null_5 = NullItem(Item=cull_6)  # -> NullFlags, InvalidFlags, Description
dispatch_7 = Dispatch(List=cull_7, DispatchPattern=null_5.NullFlags)  # -> ListA, ListB
dispatch_8 = Dispatch(List=cull_6, DispatchPattern=null_5.NullFlags)  # -> ListA, ListB
panel_32 = Panel(null_5.NullFlags)
merge_9 = Merge(Data1=dispatch_8.ListB, Data2=dispatch_7.ListA)

# ----
apartment_outline_6 = Curve(crv_4)
explode_2 = Explode(Curve=apartment_outline_6, Recursive=True)  # -> Segments, Vertices
apartment_outline_7 = Curve(curve_106)
apartment_outline_8 = Curve(curve_107)
point_2 = Point(explode_2.Vertices)
explode_3 = Explode(Curve=apartment_outline_7, Recursive=True)  # -> Segments, Vertices
deconstruct = Deconstruct(Point=point_2)  # -> XComponent, YComponent, ZComponent
explode_4 = Explode(Curve=apartment_outline_8, Recursive=True)  # -> Segments, Vertices
point_3 = Point(explode_3.Vertices)
point_4 = Point(explode_4.Vertices)
sort_list = SortList(Keys=deconstruct.YComponent)  # -> reverse(Keys), ValuesValuesA
sort_list_2 = SortList(Keys=deconstruct.XComponent)  # -> reverse(Keys), ValuesValuesA
deconstruct_2 = Deconstruct(Point=point_3)  # -> XComponent, YComponent, ZComponent
deconstruct_3 = Deconstruct(Point=point_4)  # -> XComponent, YComponent, ZComponent
list_item_4 = ListItem(List=sort_list_2.Keys, Index=0, Wrap=True)
sort_list_3 = SortList(Keys=deconstruct_2.YComponent)  # -> reverse(Keys), ValuesValuesA
sort_list_4 = SortList(Keys=deconstruct_2.XComponent)  # -> reverse(Keys), ValuesValuesA
list_item_5 = ListItem(List=sort_list.Keys, Index=0, Wrap=True)
sort_list_5 = SortList(Keys=deconstruct_3.YComponent)  # -> reverse(Keys), ValuesValuesA
sort_list_6 = SortList(Keys=deconstruct_3.XComponent)  # -> reverse(Keys), ValuesValuesA
addition_4 = Addition(A=list_item_4, B=x_dis_2)
unit_x_29 = UnitX(Factor=addition_4)
move_6 = Move(Geometry=construct_point, Motion=unit_x_29)  # -> Geometry, Transform
addition_5 = Addition(A=list_item_5, B=y_dis_2)
unit_y_30 = UnitY(Factor=addition_5)
move_7 = Move(Geometry=move_6.Geometry, Motion=unit_y_30)  # -> Geometry, Transform
linear_array = LinearArray(Geometry=move_7.Geometry, Direction=unit_x_3, Count=furniture_piece_1_2)  # -> Geometry, Transform
point_5 = Point(linear_array.Geometry)
deconstruct_4 = Deconstruct(Point=point_5)  # -> XComponent, YComponent, ZComponent
average = Average(Input=deconstruct_4.XComponent)
point_6 = Point(linear_array.Geometry)
addition_6 = Addition(A=deconstruct_4.YComponent, B=negative_4)
move_8 = Move(Geometry=point_6, Motion=unit_y_2)  # -> Geometry, Transform
construct_point_6 = ConstructPoint(XCoordinate=average, YCoordinate=addition_6, ZCoordinate=0)
move_9 = Move(Geometry=move_8.Geometry, Motion=unit_x_9)  # -> Geometry, Transform
point_7 = Point(simplify(construct_point_6))
graft_tree = GraftTree(Tree=linear_array.Geometry, IncludeEmptyLists=True, IncludeNullItems=True)  # -> simplify(Tree)
point_8 = Point(graft_tree)
point_9 = Point(simplify(construct_point_6))
point_10 = Point(point_5)
line = Line(StartPoint=point_10, EndPoint=point_9)
point_11 = Point(move_9.Geometry)
list_item_6 = ListItem(List=sort_list_4.Keys, Index=0, Wrap=True)
move_10 = Move(Geometry=point_7, Motion=unit_y_10)  # -> Geometry, Transform
list_item_7 = ListItem(List=sort_list_3.Keys, Index=0, Wrap=True)
list_item_8 = ListItem(List=sort_list_6.Keys, Index=0, Wrap=True)
list_item_9 = ListItem(List=sort_list_5.Keys, Index=0, Wrap=True)
addition_7 = Addition(A=list_item_6, B=x_dis_5)
unit_x_30 = UnitX(Factor=addition_7)
move_11 = Move(Geometry=construct_point_2, Motion=unit_x_30)  # -> Geometry, Transform
addition_8 = Addition(A=list_item_7, B=y_dis_5)
unit_y_31 = UnitY(Factor=addition_8)
move_12 = Move(Geometry=move_11.Geometry, Motion=unit_y_31)  # -> Geometry, Transform
linear_array_2 = LinearArray(Geometry=move_12.Geometry, Direction=unit_x_7, Count=furniture_piece_1_5)  # -> Geometry, Transform
point_12 = Point(linear_array_2.Geometry)
deconstruct_5 = Deconstruct(Point=point_12)  # -> XComponent, YComponent, ZComponent
average_2 = Average(Input=deconstruct_5.XComponent)
point_13 = Point(linear_array_2.Geometry)
addition_9 = Addition(A=deconstruct_5.YComponent, B=negative_6)
move_13 = Move(Geometry=point_13, Motion=unit_y_4)  # -> Geometry, Transform
point_14 = Point(move_13.Geometry)
move_14 = Move(Geometry=point_14, Motion=unit_y_5)  # -> Geometry, Transform
construct_point_7 = ConstructPoint(XCoordinate=average_2, YCoordinate=addition_9, ZCoordinate=0)
move_15 = Move(Geometry=move_13.Geometry, Motion=unit_x_14)  # -> Geometry, Transform
move_16 = Move(Geometry=move_14.Geometry, Motion=unit_x_13)  # -> Geometry, Transform
point_15 = Point(simplify(construct_point_7))
graft_tree_2 = GraftTree(Tree=linear_array_2.Geometry, IncludeEmptyLists=True, IncludeNullItems=True)  # -> simplify(Tree)
point_16 = Point(graft_tree_2)
point_17 = Point(graft_tree_2)
point_18 = Point(simplify(construct_point_7))
point_19 = Point(point_12)
addition_10 = Addition(A=list_item_8, B=x_dis_6)
unit_x_31 = UnitX(Factor=addition_10)
move_17 = Move(Geometry=construct_point_3, Motion=unit_x_31)  # -> Geometry, Transform
addition_11 = Addition(A=list_item_9, B=y_dis_6)
unit_y_32 = UnitY(Factor=addition_11)
move_18 = Move(Geometry=move_17.Geometry, Motion=unit_y_32)  # -> Geometry, Transform
linear_array_3 = LinearArray(Geometry=move_18.Geometry, Direction=unit_x_8, Count=furniture_piece_1_6)  # -> Geometry, Transform
point_20 = Point(linear_array_3.Geometry)
deconstruct_6 = Deconstruct(Point=point_20)  # -> XComponent, YComponent, ZComponent
average_3 = Average(Input=deconstruct_6.XComponent)
point_21 = Point(linear_array_3.Geometry)
addition_12 = Addition(A=deconstruct_6.YComponent, B=negative_7)
move_19 = Move(Geometry=point_21, Motion=unit_y_6)  # -> Geometry, Transform
construct_point_8 = ConstructPoint(XCoordinate=average_3, YCoordinate=addition_12, ZCoordinate=0)
move_20 = Move(Geometry=move_19.Geometry, Motion=unit_x_12)  # -> Geometry, Transform
point_22 = Point(simplify(construct_point_8))
graft_tree_3 = GraftTree(Tree=linear_array_3.Geometry, IncludeEmptyLists=True, IncludeNullItems=True)  # -> simplify(Tree)
point_23 = Point(graft_tree_3)
point_24 = Point(simplify(construct_point_8))
point_25 = Point(point_20)
move_21 = Move(Geometry=line, Motion=unit_z_5)  # -> Geometry, Transform
rotate_plane = RotatePlane(Plane=move_10.Geometry, Angle=pi)
line_2 = Line(StartPoint=point_19, EndPoint=point_18)
line_3 = Line(StartPoint=point_25, EndPoint=point_24)
move_22 = Move(Geometry=point_15, Motion=unit_y_13)  # -> Geometry, Transform
move_23 = Move(Geometry=point_22, Motion=unit_y_15)  # -> Geometry, Transform
point_26 = Point(move_15.Geometry)
point_27 = Point(move_16.Geometry)
point_28 = Point(move_20.Geometry)
move_24 = Move(Geometry=line_2, Motion=unit_z_9)  # -> Geometry, Transform
move_25 = Move(Geometry=line_3, Motion=unit_z_10)  # -> Geometry, Transform
rotate_plane_2 = RotatePlane(Plane=move_22.Geometry, Angle=pi_2)
rotate_plane_3 = RotatePlane(Plane=move_23.Geometry, Angle=pi_3)
linear_array_4 = LinearArray(Geometry=point_11, Direction=unit_x_16, Count=furniture_piece_2_2)  # -> Geometry, Transform
point_29 = Point(simplify(linear_array_4.Geometry))
point_30 = Point(simplify(point_29))
line_4 = Line(StartPoint=point_8, EndPoint=point_30)
move_26 = Move(Geometry=line_4, Motion=unit_z_4)  # -> Geometry, Transform
linear_array_5 = LinearArray(Geometry=point_26, Direction=unit_x_17, Count=furniture_piece_2_6)  # -> Geometry, Transform
linear_array_6 = LinearArray(Geometry=point_27, Direction=unit_x_18, Count=furniture_piece_2_7)  # -> Geometry, Transform
linear_array_7 = LinearArray(Geometry=point_28, Direction=unit_x_19, Count=furniture_piece_2_8)  # -> Geometry, Transform
point_31 = Point(simplify(linear_array_5.Geometry))
point_32 = Point(simplify(point_31))
line_5 = Line(StartPoint=point_16, EndPoint=point_32)
move_27 = Move(Geometry=line_5, Motion=unit_z_6)  # -> Geometry, Transform
point_33 = Point(simplify(linear_array_6.Geometry))
point_34 = Point(simplify(point_33))
line_6 = Line(StartPoint=point_17, EndPoint=point_34)
move_28 = Move(Geometry=line_6, Motion=unit_z_7)  # -> Geometry, Transform
point_35 = Point(simplify(linear_array_7.Geometry))
point_36 = Point(simplify(point_35))
line_7 = Line(StartPoint=point_23, EndPoint=point_36)
move_29 = Move(Geometry=line_7, Motion=unit_z_8)  # -> Geometry, Transform
bedroom_8 = Curve(simplify)
justifiedtext3d = JustifiedText3d(
    Location=rotate_plane,
    Text="Bedroom",
    Size="0.5",
    Color=ColourSwatch(SwatchColor=RGB(0, 0, 0)),
    HorizontalAlignment=1,
    VerticalAlginment=1,
    Font="Arial Black",
    UseMeshes=False,
    Bake=False)
custom_preview_lineweights_6 = CustomPreviewLineweights(Geometry=move_26.Geometry, Shader=ColourSwatch(SwatchColor=RGB(0, 0, 0)), Absolute=False)
custom_preview_lineweights_7 = CustomPreviewLineweights(Geometry=move_21.Geometry, Shader=ColourSwatch(SwatchColor=RGB(0, 0, 0)), Absolute=False)
justifiedtext3d_2 = JustifiedText3d(
    Location=rotate_plane_3,
    Text="Living",
    Size="0.5",
    Color=ColourSwatch(SwatchColor=RGB(0, 0, 0)),
    HorizontalAlignment=1,
    VerticalAlginment=1,
    Font="Arial Black",
    UseMeshes=False,
    Bake=False)
custom_preview_lineweights_8 = CustomPreviewLineweights(Geometry=move_29.Geometry, Shader=ColourSwatch(SwatchColor=RGB(0, 0, 0)), Absolute=False)
custom_preview_lineweights_9 = CustomPreviewLineweights(Geometry=move_25.Geometry, Shader=ColourSwatch(SwatchColor=RGB(0, 0, 0)), Absolute=False)
justifiedtext3d_3 = JustifiedText3d(
    Location=rotate_plane_2,
    Text="Bathroom",
    Size="0.5",
    Color=ColourSwatch(SwatchColor=RGB(0, 0, 0)),
    HorizontalAlignment=1,
    VerticalAlginment=1,
    Font="Arial Black",
    UseMeshes=False,
    Bake=False)
custom_preview_lineweights_10 = CustomPreviewLineweights(Geometry=move_27.Geometry, Shader=ColourSwatch(SwatchColor=RGB(0, 0, 0)), Absolute=False)
custom_preview_lineweights_11 = CustomPreviewLineweights(Geometry=move_28.Geometry, Shader=ColourSwatch(SwatchColor=RGB(0, 0, 0)), Absolute=False)
custom_preview_lineweights_12 = CustomPreviewLineweights(Geometry=move_24.Geometry, Shader=ColourSwatch(SwatchColor=RGB(0, 0, 0)), Absolute=False)
curve_108 = Curve(crv_4)
curve_109 = Curve(crv_4)
apartment_outline_9 = Curve(curve_108)
explode_5 = Explode(Curve=apartment_outline_9, Recursive=True)  # -> Segments, Vertices
point_37 = Point(explode_5.Vertices)
deconstruct_7 = Deconstruct(Point=point_37)  # -> XComponent, YComponent, ZComponent
sort_list_7 = SortList(Keys=deconstruct_7.YComponent)  # -> reverse(Keys), ValuesValuesA
sort_list_8 = SortList(Keys=deconstruct_7.XComponent)  # -> reverse(Keys), ValuesValuesA
apartment_outline_10 = Curve(curve_109)
list_item_10 = ListItem(List=sort_list_8.Keys, Index=0, Wrap=True)
list_item_11 = ListItem(List=sort_list_7.Keys, Index=0, Wrap=True)
explode_6 = Explode(Curve=apartment_outline_10, Recursive=True)  # -> Segments, Vertices
addition_13 = Addition(A=list_item_10, B=x_dis_8)
unit_x_32 = UnitX(Factor=addition_13)
move_30 = Move(Geometry=construct_point_4, Motion=unit_x_32)  # -> Geometry, Transform
addition_14 = Addition(A=list_item_11, B=y_dis_8)
unit_y_33 = UnitY(Factor=addition_14)
move_31 = Move(Geometry=move_30.Geometry, Motion=unit_y_33)  # -> Geometry, Transform
linear_array_8 = LinearArray(Geometry=move_31.Geometry, Direction=unit_x_21, Count=furniture_piece_1_8)  # -> Geometry, Transform
point_38 = Point(linear_array_8.Geometry)
deconstruct_8 = Deconstruct(Point=point_38)  # -> XComponent, YComponent, ZComponent
average_4 = Average(Input=deconstruct_8.XComponent)
point_39 = Point(linear_array_8.Geometry)
addition_15 = Addition(A=deconstruct_8.YComponent, B=negative_22)
move_32 = Move(Geometry=point_39, Motion=unit_y_20)  # -> Geometry, Transform
construct_point_9 = ConstructPoint(XCoordinate=average_4, YCoordinate=addition_15, ZCoordinate=0)
move_33 = Move(Geometry=move_32.Geometry, Motion=unit_x_22)  # -> Geometry, Transform
point_40 = Point(simplify(construct_point_9))
graft_tree_4 = GraftTree(Tree=linear_array_8.Geometry, IncludeEmptyLists=True, IncludeNullItems=True)  # -> simplify(Tree)
point_41 = Point(graft_tree_4)
point_42 = Point(simplify(construct_point_9))
point_43 = Point(point_38)
point_44 = Point(explode_6.Vertices)
line_8 = Line(StartPoint=point_43, EndPoint=point_42)
move_34 = Move(Geometry=point_40, Motion=unit_y_23)  # -> Geometry, Transform
point_45 = Point(move_33.Geometry)
deconstruct_9 = Deconstruct(Point=point_44)  # -> XComponent, YComponent, ZComponent
move_35 = Move(Geometry=line_8, Motion=unit_z_19)  # -> Geometry, Transform
rotate_plane_4 = RotatePlane(Plane=move_34.Geometry, Angle=pi_4)
sort_list_9 = SortList(Keys=deconstruct_9.YComponent)  # -> reverse(Keys), ValuesValuesA
sort_list_10 = SortList(Keys=deconstruct_9.XComponent)  # -> reverse(Keys), ValuesValuesA
list_item_12 = ListItem(List=sort_list_10.Keys, Index=0, Wrap=True)
linear_array_9 = LinearArray(Geometry=point_45, Direction=unit_x_26, Count=furniture_piece_2_10)  # -> Geometry, Transform
list_item_13 = ListItem(List=sort_list_9.Keys, Index=0, Wrap=True)
addition_16 = Addition(A=list_item_12, B=x_dis_10)
unit_x_33 = UnitX(Factor=addition_16)
move_36 = Move(Geometry=construct_point_5, Motion=unit_x_33)  # -> Geometry, Transform
addition_17 = Addition(A=list_item_13, B=y_dis_10)
unit_y_34 = UnitY(Factor=addition_17)
move_37 = Move(Geometry=move_36.Geometry, Motion=unit_y_34)  # -> Geometry, Transform
linear_array_10 = LinearArray(Geometry=move_37.Geometry, Direction=unit_x_25, Count=furniture_piece_1_10)  # -> Geometry, Transform
point_46 = Point(linear_array_10.Geometry)
deconstruct_10 = Deconstruct(Point=point_46)  # -> XComponent, YComponent, ZComponent
average_5 = Average(Input=deconstruct_10.XComponent)
point_47 = Point(linear_array_10.Geometry)
addition_18 = Addition(A=deconstruct_10.YComponent, B=negative_26)
move_38 = Move(Geometry=point_47, Motion=unit_y_24)  # -> Geometry, Transform
construct_point_10 = ConstructPoint(XCoordinate=average_5, YCoordinate=addition_18, ZCoordinate=0)
move_39 = Move(Geometry=move_38.Geometry, Motion=unit_y_27)  # -> Geometry, Transform
graft_tree_5 = GraftTree(Tree=linear_array_10.Geometry, IncludeEmptyLists=True, IncludeNullItems=True)  # -> simplify(Tree)
point_48 = Point(graft_tree_5)
point_49 = Point(simplify(construct_point_10))
point_50 = Point(simplify(construct_point_10))
point_51 = Point(point_46)
point_52 = Point(simplify(linear_array_9.Geometry))
point_53 = Point(simplify(point_52))
line_9 = Line(StartPoint=point_41, EndPoint=point_53)
move_40 = Move(Geometry=line_9, Motion=unit_z_18)  # -> Geometry, Transform
line_10 = Line(StartPoint=point_51, EndPoint=point_50)
move_41 = Move(Geometry=point_49, Motion=unit_y_28)  # -> Geometry, Transform
point_54 = Point(move_39.Geometry)
move_42 = Move(Geometry=line_10, Motion=unit_z_21)  # -> Geometry, Transform
rotate_plane_5 = RotatePlane(Plane=move_41.Geometry, Angle=pi_5)
linear_array_11 = LinearArray(Geometry=point_54, Direction=unit_x_28, Count=furniture_piece_2_12)  # -> Geometry, Transform
point_55 = Point(simplify(linear_array_11.Geometry))
point_56 = Point(simplify(point_55))
line_11 = Line(StartPoint=point_48, EndPoint=point_56)
move_43 = Move(Geometry=line_11, Motion=unit_z_20)  # -> Geometry, Transform
custom_preview_lineweights_13 = CustomPreviewLineweights(Geometry=move_40.Geometry, Shader=ColourSwatch(SwatchColor=RGB(0, 0, 0)), Absolute=False)
justifiedtext3d_4 = JustifiedText3d(
    Location=rotate_plane_4,
    Text="Children",
    Size="0.5",
    Color=ColourSwatch(SwatchColor=RGB(0, 0, 0)),
    HorizontalAlignment=1,
    VerticalAlginment=1,
    Font="Arial Black",
    UseMeshes=False,
    Bake=False)
custom_preview_lineweights_14 = CustomPreviewLineweights(Geometry=move_35.Geometry, Shader=ColourSwatch(SwatchColor=RGB(0, 0, 0)), Absolute=False)
custom_preview_lineweights_15 = CustomPreviewLineweights(Geometry=move_43.Geometry, Shader=ColourSwatch(SwatchColor=RGB(0, 0, 0)), Absolute=False)
justifiedtext3d_5 = JustifiedText3d(
    Location=rotate_plane_5,
    Text="Kitchen",
    Size="0.5",
    Color=ColourSwatch(SwatchColor=RGB(0, 0, 0)),
    HorizontalAlignment=1,
    VerticalAlginment=1,
    Font="Arial Black",
    UseMeshes=False,
    Bake=False)
custom_preview_lineweights_16 = CustomPreviewLineweights(Geometry=move_42.Geometry, Shader=ColourSwatch(SwatchColor=RGB(0, 0, 0)), Absolute=False)
bath2_3 = Curve(bath2_2)
clean_4 = CleanTree(RemoveNulls=True, RemoveInvalid=True, RemoveEmpty=False, Tree=bath2_3)
lng = ListLength(List=clean_4)
repeat = RepeatData(Data="0.38", Length=lng)

# ----
# record results
panel_33 = Panel("C:\Bauhaus\data\apartments1.jsonl")

# ----
# Preview of furniuture options
# Bath
chi5_2 = Data(chi5)
chi4_2 = Data(chi4)
number_slider_27 = Slider(0, range=0..10)
number_slider_28 = Slider(10, range=0..10)
addition_19 = Addition(A=Slider(0, range=0..100), B=number_slider_27)
addition_20 = Addition(A=Slider(0, range=0..4), B=number_slider_27)
addition_21 = Addition(A=Slider(0, range=0..300), B=number_slider_27)
addition_22 = Addition(A=Slider(0, range=0..100), B=number_slider_27)
addition_23 = Addition(A=Slider(0, range=0..4), B=number_slider_27)
unwrap_list = UnwrapList(WrappedData=chi4_2)
unwrap_list_2 = UnwrapList(WrappedData=chi5_2)
addition_24 = Addition(A=Slider(1, range=0..100), B=number_slider_27)
addition_25 = Addition(A=Slider(7, range=0..100), B=number_slider_27)
item_12 = ListItem(List=unwrap_list, Index=addition_19, Wrap=True)
item_13 = ListItem(List=unwrap_list_2, Index=addition_19, Wrap=True)
ungroup = Ungroup(Group=item_12)
ungroup_2 = Ungroup(Group=item_13)

doorpoints_as_inputs = Point(doors)
null_6 = NullItem(Item=flatten(doorpoints_as_inputs))  # -> NullFlags, InvalidFlags, Description

# ----
# Define Apartment Type
merge_10 = Merge(Data1=simplify, Data2=simplify_5, Data3=working, Data4=simplify_3)
flatten = FlattenTree(Tree=merge_10, Path="{0}")

merge_11 = Merge(Data1=merge_10, Data2=simplify_6, Data3=simplify_2)
clean_5 = CleanTree(RemoveNulls=True, RemoveInvalid=True, RemoveEmpty=False, Tree=flatten)

lng_2 = ListLength(List=clean_5)
wohnungstyp = Panel(lng_2)

furniture_cluster = FurnitureCluster(apartment_type=lng_2)  # -> simplify(bedroom_2), simplify(children_2), simplify(living_2), simplify(kitchen_2), simplify(bath_2), simplify(wc_2)

# ----
# Bedroom
wrap_5 = WrapList(Data=furniture_cluster.bedroom_2)
trim = TrimTree(Tree=wrap_5, Depth=1)
lng_3 = ListLength(List=trim)
lng_4 = ListLength(List=flatten(lng_3))
nr_of_blocks_to_place = Panel(lng_4)
bang = ExplodeTree(Data=trim)  # -> Branch0, Branch1, Branch2
block_0 = UnwrapList(WrappedData=bang.Branch0)
block_1 = UnwrapList(WrappedData=bang.Branch1)

wrap_6 = WrapList(Data=furniture_cluster.living_2)
trim_2 = TrimTree(Tree=wrap_6, Depth=1)
null_7 = NullItem(Item=flatten(trim_2))  # -> NullFlags, InvalidFlags, Description
lng_5 = ListLength(List=trim_2)
filter_19 = StreamFilter(Gate=null_7.NullFlags, Stream0=trim_2, Stream1=wrap_6)
lng_6 = ListLength(List=flatten(lng_5))
nr_of_blocks_to_place_2 = Panel(lng_6)
bang_2 = ExplodeTree(Data=filter_19)  # -> Branch0, Branch1, Branch2
block_1_2 = UnwrapList(WrappedData=bang_2.Branch1)
block_0_2 = UnwrapList(WrappedData=bang_2.Branch0)

wrap_7 = WrapList(Data=furniture_cluster.bath_2)
trim_3 = TrimTree(Tree=wrap_7, Depth=1)
null_8 = NullItem(Item=flatten(trim_3))  # -> NullFlags, InvalidFlags, Description
filter_20 = StreamFilter(Gate=null_8.NullFlags, Stream0=trim_3, Stream1=wrap_7)
lng_7 = ListLength(List=filter_20)
lng_8 = ListLength(List=flatten(lng_7))
nr_of_blocks_to_place_3 = Panel(lng_8)
bang_3 = ExplodeTree(Data=filter_20)  # -> Branch0, Branch1, Branch2
block_2 = UnwrapList(WrappedData=bang_3.Branch1)
block_0_3 = UnwrapList(WrappedData=bang_3.Branch2)
block_1_3 = UnwrapList(WrappedData=bang_3.Branch0)

furniture = Data(block_1)
furniture_2 = Data(block_0)
furniture_3 = Data(block_0_2)
furniture_4 = Data(block_1_2)
small_rectangle = ListItem(List=furniture, Index=Slider(6, range=0..10), Wrap=True)  # -> flatten(Item)
small_rectangle_2 = ListItem(List=furniture, Index=Slider(5, range=0..10), Wrap=True)
guideline = ListItem(List=furniture, Index=Slider(1, range=0..1), Wrap=True)
big_rectangle = ListItem(List=furniture, Index=Slider(4, range=0..10), Wrap=True)
lng_9 = ListLength(List=furniture)  # -> flatten(Length)
small_rectangle_3 = ListItem(List=furniture_2, Index=Slider(6, range=0..10), Wrap=True)  # -> flatten(Item)
small_rectangle_4 = ListItem(List=furniture_2, Index=Slider(5, range=0..10), Wrap=True)
guideline_2 = ListItem(List=furniture_2, Index=Slider(1, range=0..1), Wrap=True)
big_rectangle_2 = ListItem(List=furniture_2, Index=Slider(4, range=0..10), Wrap=True)
lng_10 = ListLength(List=furniture_2)  # -> flatten(Length)
wall_crv = Curve(flatten(guideline))
big_bb = Curve(flatten(big_rectangle))
small_bb = Curve(flatten(small_rectangle_2))
lng_11 = ListLength(List=lng_9)
wall_crv_2 = Curve(flatten(guideline_2))
big_bb_2 = Curve(flatten(big_rectangle_2))
small_bb_2 = Curve(flatten(small_rectangle_4))
lng_12 = ListLength(List=lng_10)
series = Series(Start=0, Step=1, Count=lng_11)
small_rectangle_5 = ListItem(List=furniture_3, Index=Slider(6, range=0..10), Wrap=True)  # -> flatten(Item)
small_rectangle_6 = ListItem(List=furniture_3, Index=Slider(5, range=0..10), Wrap=True)
guideline_3 = ListItem(List=furniture_3, Index=Slider(1, range=0..1), Wrap=True)
big_rectangle_3 = ListItem(List=furniture_3, Index=Slider(4, range=0..10), Wrap=True)
small_rectangle_7 = ListItem(List=furniture_4, Index=Slider(6, range=0..10), Wrap=True)  # -> flatten(Item)
lng_13 = ListLength(List=furniture_3)  # -> flatten(Length)
# One Placement
series_2 = Series(Start=0, Step=1, Count=lng_12)
small_rectangle_8 = ListItem(List=furniture_4, Index=Slider(5, range=0..10), Wrap=True)
guideline_4 = ListItem(List=furniture_4, Index=Slider(1, range=0..1), Wrap=True)
big_rectangle_4 = ListItem(List=furniture_4, Index=Slider(4, range=0..10), Wrap=True)
lng_14 = ListLength(List=furniture_4)  # -> flatten(Length)
wall_crv_3 = Curve(flatten(guideline_3))
big_bb_3 = Curve(flatten(big_rectangle_3))
small_bb_3 = Curve(flatten(small_rectangle_6))
furniture_5 = Data(block_2)
lng_15 = ListLength(List=lng_13)
wall_crv_4 = Curve(flatten(guideline_4))
big_bb_4 = Curve(flatten(big_rectangle_4))
small_bb_4 = Curve(flatten(small_rectangle_8))
furniture_6 = Data(block_1_3)
lng_16 = ListLength(List=lng_14)
furniture_7 = Data(block_0_3)
# One Placement
series_3 = Series(Start=0, Step=1, Count=lng_15)
series_4 = Series(Start=0, Step=1, Count=lng_16)
small_rectangle_9 = ListItem(List=furniture_5, Index=Slider(6, range=0..10), Wrap=True)  # -> flatten(Item)
small_rectangle_10 = ListItem(List=furniture_5, Index=Slider(5, range=0..10), Wrap=True)
guideline_5 = ListItem(List=furniture_5, Index=Slider(1, range=0..1), Wrap=True)
big_rectangle_5 = ListItem(List=furniture_5, Index=Slider(4, range=0..10), Wrap=True)
lng_17 = ListLength(List=furniture_5)  # -> flatten(Length)
small_rectangle_11 = ListItem(List=furniture_6, Index=Slider(6, range=0..10), Wrap=True)  # -> flatten(Item)
small_rectangle_12 = ListItem(List=furniture_6, Index=Slider(5, range=0..10), Wrap=True)
guideline_6 = ListItem(List=furniture_6, Index=Slider(1, range=0..1), Wrap=True)
big_rectangle_6 = ListItem(List=furniture_6, Index=Slider(4, range=0..10), Wrap=True)
lng_18 = ListLength(List=furniture_6)  # -> flatten(Length)
small_rectangle_13 = ListItem(List=furniture_7, Index=Slider(6, range=0..10), Wrap=True)  # -> flatten(Item)
small_rectangle_14 = ListItem(List=furniture_7, Index=Slider(5, range=0..10), Wrap=True)
guideline_7 = ListItem(List=furniture_7, Index=Slider(1, range=0..1), Wrap=True)
big_rectangle_7 = ListItem(List=furniture_7, Index=Slider(4, range=0..10), Wrap=True)
lng_19 = ListLength(List=furniture_7)  # -> flatten(Length)
wall_crv_5 = Curve(flatten(guideline_5))
big_bb_5 = Curve(flatten(big_rectangle_5))
small_bb_5 = Curve(flatten(small_rectangle_10))
lng_20 = ListLength(List=lng_17)
wall_crv_6 = Curve(flatten(guideline_6))
big_bb_6 = Curve(flatten(big_rectangle_6))
small_bb_6 = Curve(flatten(small_rectangle_12))
lng_21 = ListLength(List=lng_18)
wall_crv_7 = Curve(flatten(guideline_7))
big_bb_7 = Curve(flatten(big_rectangle_7))
small_bb_7 = Curve(flatten(small_rectangle_14))
lng_22 = ListLength(List=lng_19)
# One Placement
series_5 = Series(Start=0, Step=1, Count=lng_20)
# One Placement
series_6 = Series(Start=0, Step=1, Count=lng_21)
# BATHROOM
# One Placement
series_7 = Series(Start=0, Step=1, Count=lng_22)
result_details = Data(small_rectangle_3)
result_details_2 = Data(small_rectangle)
result_details_3 = Data(small_rectangle_5)
result_details_4 = Data(small_rectangle_7)
result_details_5 = Data(small_rectangle_13)
result_details_6 = Data(small_rectangle_11)
result_details_7 = Data(small_rectangle_9)

wrap_8 = WrapList(Data=furniture_cluster.children_2)
trim_4 = TrimTree(Tree=wrap_8, Depth=1)
lng_23 = ListLength(List=trim_4)
lng_24 = ListLength(List=flatten(lng_23))
nr_of_blocks_to_place_4 = Panel(lng_24)
bang_4 = ExplodeTree(Data=trim_4)  # -> Branch0, Branch1, Branch2
block_0_4 = UnwrapList(WrappedData=bang_4.Branch0)
block_1_4 = UnwrapList(WrappedData=bang_4.Branch1)

furniture_8 = Data(block_0_4)
furniture_9 = Data(block_1_4)
small_rectangle_15 = ListItem(List=furniture_8, Index=Slider(6, range=0..10), Wrap=True)  # -> flatten(Item)
small_rectangle_16 = ListItem(List=furniture_8, Index=Slider(5, range=0..10), Wrap=True)
guideline_8 = ListItem(List=furniture_8, Index=Slider(1, range=0..1), Wrap=True)
big_rectangle_8 = ListItem(List=furniture_8, Index=Slider(4, range=0..10), Wrap=True)
lng_25 = ListLength(List=furniture_8)  # -> flatten(Length)
small_rectangle_17 = ListItem(List=furniture_9, Index=Slider(6, range=0..10), Wrap=True)  # -> flatten(Item)
small_rectangle_18 = ListItem(List=furniture_9, Index=Slider(5, range=0..10), Wrap=True)
guideline_9 = ListItem(List=furniture_9, Index=Slider(1, range=0..1), Wrap=True)
big_rectangle_9 = ListItem(List=furniture_9, Index=Slider(4, range=0..10), Wrap=True)
lng_26 = ListLength(List=furniture_9)  # -> flatten(Length)
wall_crv_8 = Curve(flatten(guideline_8))
big_bb_8 = Curve(flatten(big_rectangle_8))
small_bb_8 = Curve(flatten(small_rectangle_16))
lng_27 = ListLength(List=lng_25)
wall_crv_9 = Curve(flatten(guideline_9))
big_bb_9 = Curve(flatten(big_rectangle_9))
small_bb_9 = Curve(flatten(small_rectangle_18))
lng_28 = ListLength(List=lng_26)
series_8 = Series(Start=0, Step=1, Count=lng_27)
series_9 = Series(Start=0, Step=1, Count=lng_28)
result_details_8 = Data(small_rectangle_15)
result_details_9 = Data(small_rectangle_17)

wrap_9 = WrapList(Data=furniture_cluster.children_2)
trim_5 = TrimTree(Tree=wrap_9, Depth=1)
lng_29 = ListLength(List=trim_5)
lng_30 = ListLength(List=flatten(lng_29))
nr_of_blocks_to_place_5 = Panel(lng_30)
bang_5 = ExplodeTree(Data=trim_5)  # -> Branch0, Branch1, Branch2
block_0_5 = UnwrapList(WrappedData=bang_5.Branch0)
block_1_5 = UnwrapList(WrappedData=bang_5.Branch1)

furniture_10 = Data(block_1_5)
furniture_11 = Data(block_0_5)
small_rectangle_19 = ListItem(List=furniture_10, Index=Slider(6, range=0..10), Wrap=True)  # -> flatten(Item)
small_rectangle_20 = ListItem(List=furniture_10, Index=Slider(5, range=0..10), Wrap=True)
guideline_10 = ListItem(List=furniture_10, Index=Slider(1, range=0..1), Wrap=True)
big_rectangle_10 = ListItem(List=furniture_10, Index=Slider(4, range=0..10), Wrap=True)
lng_31 = ListLength(List=furniture_10)  # -> flatten(Length)
small_rectangle_21 = ListItem(List=furniture_11, Index=Slider(6, range=0..10), Wrap=True)  # -> flatten(Item)
small_rectangle_22 = ListItem(List=furniture_11, Index=Slider(5, range=0..10), Wrap=True)
guideline_11 = ListItem(List=furniture_11, Index=Slider(1, range=0..1), Wrap=True)
big_rectangle_11 = ListItem(List=furniture_11, Index=Slider(4, range=0..10), Wrap=True)
lng_32 = ListLength(List=furniture_11)  # -> flatten(Length)
wall_crv_10 = Curve(flatten(guideline_10))
big_bb_10 = Curve(flatten(big_rectangle_10))
small_bb_10 = Curve(flatten(small_rectangle_20))
lng_33 = ListLength(List=lng_31)
wall_crv_11 = Curve(flatten(guideline_11))
big_bb_11 = Curve(flatten(big_rectangle_11))
small_bb_11 = Curve(flatten(small_rectangle_22))
lng_34 = ListLength(List=lng_32)
series_10 = Series(Start=0, Step=1, Count=lng_33)
series_11 = Series(Start=0, Step=1, Count=lng_34)
result_details_10 = Data(small_rectangle_21)
result_details_11 = Data(small_rectangle_19)

wrap_10 = WrapList(Data=furniture_cluster.children_2)
trim_6 = TrimTree(Tree=wrap_10, Depth=1)
lng_35 = ListLength(List=trim_6)
lng_36 = ListLength(List=flatten(lng_35))
nr_of_blocks_to_place_6 = Panel(lng_36)
bang_6 = ExplodeTree(Data=trim_6)  # -> Branch0, Branch1, Branch2
block_0_6 = UnwrapList(WrappedData=bang_6.Branch0)
block_1_6 = UnwrapList(WrappedData=bang_6.Branch1)

furniture_12 = Data(block_1_6)
furniture_13 = Data(block_0_6)
small_rectangle_23 = ListItem(List=furniture_12, Index=Slider(6, range=0..10), Wrap=True)  # -> flatten(Item)
small_rectangle_24 = ListItem(List=furniture_12, Index=Slider(5, range=0..10), Wrap=True)
guideline_12 = ListItem(List=furniture_12, Index=Slider(1, range=0..1), Wrap=True)
big_rectangle_12 = ListItem(List=furniture_12, Index=Slider(4, range=0..10), Wrap=True)
lng_37 = ListLength(List=furniture_12)  # -> flatten(Length)
small_rectangle_25 = ListItem(List=furniture_13, Index=Slider(6, range=0..10), Wrap=True)  # -> flatten(Item)
small_rectangle_26 = ListItem(List=furniture_13, Index=Slider(5, range=0..10), Wrap=True)
guideline_13 = ListItem(List=furniture_13, Index=Slider(1, range=0..1), Wrap=True)
big_rectangle_13 = ListItem(List=furniture_13, Index=Slider(4, range=0..10), Wrap=True)
lng_38 = ListLength(List=furniture_13)  # -> flatten(Length)
wall_crv_12 = Curve(flatten(guideline_12))
big_bb_12 = Curve(flatten(big_rectangle_12))
small_bb_12 = Curve(flatten(small_rectangle_24))
lng_39 = ListLength(List=lng_37)
wall_crv_13 = Curve(flatten(guideline_13))
big_bb_13 = Curve(flatten(big_rectangle_13))
small_bb_13 = Curve(flatten(small_rectangle_26))
lng_40 = ListLength(List=lng_38)
series_12 = Series(Start=0, Step=1, Count=lng_39)
series_13 = Series(Start=0, Step=1, Count=lng_40)
result_details_12 = Data(small_rectangle_25)
result_details_13 = Data(small_rectangle_23)

wrap_11 = WrapList(Data=furniture_cluster.children_2)
trim_7 = TrimTree(Tree=wrap_11, Depth=1)
lng_41 = ListLength(List=trim_7)
lng_42 = ListLength(List=flatten(lng_41))
nr_of_blocks_to_place_7 = Panel(lng_42)
bang_7 = ExplodeTree(Data=trim_7)  # -> Branch0, Branch1, Branch2
block_0_7 = UnwrapList(WrappedData=bang_7.Branch0)
block_1_7 = UnwrapList(WrappedData=bang_7.Branch1)

furniture_14 = Data(block_1_7)
furniture_15 = Data(block_0_7)
small_rectangle_27 = ListItem(List=furniture_14, Index=Slider(6, range=0..10), Wrap=True)  # -> flatten(Item)
small_rectangle_28 = ListItem(List=furniture_14, Index=Slider(5, range=0..10), Wrap=True)
guideline_14 = ListItem(List=furniture_14, Index=Slider(1, range=0..1), Wrap=True)
big_rectangle_14 = ListItem(List=furniture_14, Index=Slider(4, range=0..10), Wrap=True)
lng_43 = ListLength(List=furniture_14)  # -> flatten(Length)
small_rectangle_29 = ListItem(List=furniture_15, Index=Slider(6, range=0..10), Wrap=True)  # -> flatten(Item)
small_rectangle_30 = ListItem(List=furniture_15, Index=Slider(5, range=0..10), Wrap=True)
guideline_15 = ListItem(List=furniture_15, Index=Slider(1, range=0..1), Wrap=True)
big_rectangle_15 = ListItem(List=furniture_15, Index=Slider(4, range=0..10), Wrap=True)
lng_44 = ListLength(List=furniture_15)  # -> flatten(Length)
wall_crv_14 = Curve(flatten(guideline_14))
big_bb_14 = Curve(flatten(big_rectangle_14))
small_bb_14 = Curve(flatten(small_rectangle_28))
lng_45 = ListLength(List=lng_43)
wall_crv_15 = Curve(flatten(guideline_15))
big_bb_15 = Curve(flatten(big_rectangle_15))
small_bb_15 = Curve(flatten(small_rectangle_30))
lng_46 = ListLength(List=lng_44)
series_14 = Series(Start=0, Step=1, Count=lng_45)
series_15 = Series(Start=0, Step=1, Count=lng_46)
result_details_14 = Data(small_rectangle_29)
result_details_15 = Data(small_rectangle_27)

door_from = Curve(merge_7)
door_to_2 = Curve(graft_3)
door_from_4 = Curve(merge_9)
door_to_3 = Curve(graft_4)

# ----
# DOORpoints
# Door options:
# 
# * to rooms from corridor OR from living room
# * to kitchen from living room OR from corridor
# * to bath from Corridor OR from living room OR from a room
door_from_5 = Curve(merge_5)
door_to_4 = Curve(graft_2)

entwine_4 = Entwine(Branch00=door_from, Branch01=door_from_4, Branch02=door_from_5, FlattenInputs=True)  # -> flatten(Result)
entwine_5 = Entwine(Branch00=door_to_2, Branch01=door_to_3, Branch02=door_to_4, FlattenInputs=True)  # -> flatten(Result)
graft_5 = GraftTree(Tree=entwine_5, IncludeEmptyLists=True, IncludeNullItems=True)
graft_6 = GraftTree(Tree=entwine_4, IncludeEmptyLists=True, IncludeNullItems=True)
door_from_6 = Curve(graft_6)
door_to_5 = Curve(graft_5)

explode_7 = Explode(Curve=door_to_5, Recursive=True)  # -> Segments, Vertices
crv_cp = CurveClosestPoint(Point=explode_7.Vertices, Curve=door_to_5)  # -> Point, Parameter, Distance
eval = EvaluateCurve(Curve=door_to_5, Parameter=crv_cp.Parameter)  # -> Point, Tangent, Angle
deg = Degrees(Radians=eval.Angle)
smaller_8 = SmallerThan(FirstNumber=deg, SecondNumber="45")  # -> SmallerThan, OrEqualTo
panel_34 = Panel(deg)
dispatch_9 = Dispatch(List=explode_7.Vertices, DispatchPattern=smaller_8.SmallerThan)  # -> ListA, ListB
pline = PolyLine(Vertices=dispatch_9.ListB, Closed=False)

explode_8 = Explode(Curve=door_from_6, Recursive=True)  # -> Segments, Vertices
crv_cp_2 = CurveClosestPoint(Point=explode_8.Vertices, Curve=door_from_6)  # -> Point, Parameter, Distance
eval_2 = EvaluateCurve(Curve=door_from_6, Parameter=crv_cp_2.Parameter)  # -> Point, Tangent, Angle
deg_2 = Degrees(Radians=eval_2.Angle)
smaller_9 = SmallerThan(FirstNumber=deg_2, SecondNumber="45")  # -> SmallerThan, OrEqualTo
panel_35 = Panel(deg_2)
dispatch_10 = Dispatch(List=explode_8.Vertices, DispatchPattern=smaller_9.SmallerThan)  # -> ListA, ListB
pline_2 = PolyLine(Vertices=dispatch_10.ListB, Closed=True)

door_from_7 = Curve(pline_2)
door_to_6 = Curve(pline)
explode_9 = Explode(Curve=door_to_6, Recursive=True)  # -> Segments, Vertices
ext = ExtendCurve(Curve=explode_9.Segments, Type=0, Start="-0.3", End="-0.3")
crvprox_8 = CurveProximity(CurveA=ext, CurveB=door_from_7)  # -> PointA, PointB, Distance
abs = Absolute(Value=Slider(0.2, range=0..1))
smaller_10 = SmallerThan(FirstNumber=crvprox_8.Distance, SecondNumber=abs)  # -> SmallerThan, OrEqualTo
cull_8 = CullPattern(List=explode_9.Segments, CullPattern=smaller_10.SmallerThan)
segment_possible = Curve(simplify(cull_8))
join = JoinCurves(Curves=segment_possible, Preserve=False)
sort = SortList(Keys=join, ValuesA=join)  # -> Keys, reverse(ValuesA)
explode_10 = Explode(Curve=door_from_7, Recursive=True)  # -> Segments, Vertices
item_14 = ListItem(List=sort.ValuesA, Index=0, Wrap=True)
crv_cp_3 = CurveClosestPoint(Point=explode_10.Vertices, Curve=item_14)  # -> Point, Parameter, Distance
shatter = Shatter(Curve=item_14, Parameters=crv_cp_3.Parameter)
curvepoint = PointOnCurve(shatter, parameter=0.5)
crv_cp_4 = CurveClosestPoint(Point=curvepoint, Curve=door_from_7)  # -> Point, Parameter, Distance
smaller_11 = SmallerThan(FirstNumber=crv_cp_4.Distance, SecondNumber="0.1")  # -> SmallerThan, OrEqualTo
cull_9 = CullPattern(List=shatter, CullPattern=smaller_11.SmallerThan)
intersection_segment_to_place_the_door_a = Curve(cull_9)  # "intersection segment to place the door at"

# ----
# Prepare inputs for furniture placing
room = Curve(simplify)
polyoffset_9 = PolylineOffset(
    Polylines=room,
    Distance="0.05",
    Plane=Plane(origin=(0, 0, 0), x=(0, 0, 0), y=(0, 0, 0)),
    Tolerance=0.01,
    ClosedFillet=1,
    OpenFillet=1,
    Miter=2)  # -> Contour, Holes
inner_walls_contour = Curve(graft(polyoffset_9.Holes))
room_2 = Curve(inner_walls_contour)

inp1 = Data(room_2)
inp3 = Data(inp1)
inp3_2 = Data(inp1)
item_15 = ListItem(List=inp1, Index=Slider(0, range=0..12), Wrap=True)
crv_5 = Curve(room_2)
null_9 = NullItem(Item=crv_5)  # -> NullFlags, InvalidFlags, Description
not = GateNot(A=null_9.NullFlags)
merge_12 = Merge(Data1=flatten("Bedroom"), Data2=flatten(not))
nulls_in_empty_3 = NullsInEmptyBranches(DataWithEmptyBranches=room)

room_3 = Curve(simplify_3)
polyoffset_10 = PolylineOffset(
    Polylines=room_3,
    Distance="0.05",
    Plane=Plane(origin=(0, 0, 0), x=(0, 0, 0), y=(0, 0, 0)),
    Tolerance=0.01,
    ClosedFillet=1,
    OpenFillet=1,
    Miter=2)  # -> Contour, Holes
inner_walls_contour_2 = Curve(graft(polyoffset_10.Holes))
room_4 = Curve(inner_walls_contour_2)

srf = Surface(room_4)
inp1_2 = Data(room_4)
inp3_3 = Data(inp1_2)
inp3_4 = Data(inp1_2)
area_3 = Area(Geometry=inp1_2)  # -> Area, Centroid
crv_6 = Curve(room_4)
null_10 = NullItem(Item=crv_6)  # -> NullFlags, InvalidFlags, Description
not_2 = GateNot(A=null_10.NullFlags)
merge_13 = Merge(Data1=flatten("Living room"), Data2=flatten(not_2))
nulls_in_empty_4 = NullsInEmptyBranches(DataWithEmptyBranches=room_3)

# ----
# in case i want to have another type of doors for the bath
panel_36 = Panel("0.38")

bath = Curve(simplify_6)
polyoffset_11 = PolylineOffset(
    Polylines=bath,
    Distance="0.05",
    Plane=Plane(origin=(0, 0, 0), x=(0, 0, 0), y=(0, 0, 0)),
    Tolerance=0.01,
    ClosedFillet=number_slider_15,
    OpenFillet=number_slider_15,
    Miter=2)  # -> Contour, Holes
inner_walls_contour_3 = Curve(graft(polyoffset_11.Holes))
room_5 = Curve(inner_walls_contour_3)

inp1_3 = Data(room_5)
inp3_5 = Data(inp1_3)
inp3_6 = Data(inp1_3)
inp3_7 = Data(inp1_3)
crv_7 = Curve(room_5)
null_11 = NullItem(Item=crv_7)  # -> NullFlags, InvalidFlags, Description
not_3 = GateNot(A=null_11.NullFlags)
merge_14 = Merge(Data1=flatten("Bathroom"), Data2=flatten(not_3))
nulls_in_empty_5 = NullsInEmptyBranches(DataWithEmptyBranches=bath)

wrap_12 = WrapList(Data=furniture_cluster.wc_2)
number_slider_29 = Slider(2, range=0..10)
trim_8 = TrimTree(Tree=wrap_12, Depth=1)
null_12 = NullItem(Item=flatten(trim_8))  # -> NullFlags, InvalidFlags, Description
filter_21 = StreamFilter(Gate=null_12.NullFlags, Stream0=trim_8, Stream1=wrap_12)
wc_3 = Curve(simplify_4)
lng_47 = ListLength(List=filter_21)
polyoffset_12 = PolylineOffset(
    Polylines=wc_3,
    Distance="0.05",
    Plane=Plane(origin=(0, 0, 0), x=(0, 0, 0), y=(0, 0, 0)),
    Tolerance=0.01,
    ClosedFillet=number_slider_29,
    OpenFillet=number_slider_29,
    Miter=2)  # -> Contour, Holes
lng_48 = ListLength(List=flatten(lng_47))
inner_walls_contour_4 = Curve(graft(polyoffset_12.Holes))
nr_of_blocks_to_place_8 = Panel(lng_48)
bang_8 = ExplodeTree(Data=filter_21)  # -> Branch0, Branch1, Branch2
room_6 = Curve(inner_walls_contour_4)
block_0_8 = UnwrapList(WrappedData=bang_8.Branch0)

# ----
# WC
inp1_4 = Data(room_6)
inp3_8 = Data(inp1_4)
furniture_16 = Data(block_0_8)
small_rectangle_31 = ListItem(List=furniture_16, Index=Slider(6, range=0..10), Wrap=True)  # -> flatten(Item)
small_rectangle_32 = ListItem(List=furniture_16, Index=Slider(5, range=0..10), Wrap=True)
guideline_16 = ListItem(List=furniture_16, Index=Slider(1, range=0..1), Wrap=True)
big_rectangle_16 = ListItem(List=furniture_16, Index=Slider(4, range=0..10), Wrap=True)
lng_49 = ListLength(List=furniture_16)  # -> flatten(Length)
wall_crv_16 = Curve(flatten(guideline_16))
big_bb_16 = Curve(flatten(big_rectangle_16))
small_bb_16 = Curve(flatten(small_rectangle_32))
lng_50 = ListLength(List=lng_49)
series_16 = Series(Start=0, Step=1, Count=lng_50)
panel_37 = Panel(small_rectangle_31)
result_details_16 = Data(small_rectangle_31)
crv_8 = Curve(room_6)
null_13 = NullItem(Item=crv_8)  # -> NullFlags, InvalidFlags, Description
not_4 = GateNot(A=null_13.NullFlags)
merge_15 = Merge(Data1=flatten("WC"), Data2=flatten(not_4))
crv_9 = Curve(wc_3)
nulls_in_empty_6 = NullsInEmptyBranches(DataWithEmptyBranches=crv_9)

# ----
# idea is, that I
# 1) first identify common segment.
# 2) then try to group points. if possible, create doorpoints in "clusters".
intersection_segment_to_place_the_door_a_2 = Curve(intersection_segment_to_place_the_door_a)  # "intersection segment to place the door at"
door_to_7 = Curve(door_to_6)
sort_2 = SortList(Keys=intersection_segment_to_place_the_door_a_2, ValuesA=intersection_segment_to_place_the_door_a_2)  # -> Keys, reverse(ValuesA)
item_16 = ListItem(List=sort_2.ValuesA, Index=0, Wrap=True)
end_3 = EndPoints(Curve=item_16)  # -> simplify(Start), simplify(End)
explode_11 = Explode(Curve=door_to_7, Recursive=True)  # -> Segments, Vertices
panel_38 = Panel(explode_11.Vertices)
dist = Distance(PointA=end_3.End, PointB=explode_11.Vertices)  # -> simplify(Distance)
dist_2 = Distance(PointA=end_3.Start, PointB=explode_11.Vertices)  # -> simplify(Distance)
clean_6 = CleanTree(RemoveNulls=True, RemoveInvalid=True, RemoveEmpty=False)
sort_3 = SortList(Keys=dist)  # -> Keys, ValuesA
sort_4 = SortList(Keys=dist_2)  # -> Keys, ValuesA
merge_16 = Merge(Data1=end_3.Start, Data2=end_3.End)
item_17 = ListItem(List=sort_3.Keys, Index=0, Wrap=True)
item_18 = ListItem(List=sort_4.Keys, Index=0, Wrap=True)
number_slider_30 = Slider(0, range=0..2)
merge_17 = Merge(Data1=item_18, Data2=item_17)
tbranch = TreeBranch(Tree=simplify(item_16), Path=number_slider_30, MaintainPaths=True, SplitTree=False)
tbranch_2 = TreeBranch(Tree=simplify(end_3.End), Path=number_slider_30, MaintainPaths=True, SplitTree=False)
tbranch_3 = TreeBranch(Tree=simplify(end_3.Start), Path=number_slider_30, MaintainPaths=True, SplitTree=False)
sort_5 = SortList(Keys=merge_17, ValuesA=merge_16)  # -> Keys, ValuesA
item_19 = ListItem(List=sort_5.ValuesA, Index=0, Wrap=True)  # -> Item, Item1
pt_2 = Point(item_19.Item)
pt_3 = Point(item_19.Item1)

end_4 = EndPoints(Curve=item_16)  # -> Start, End
number_slider_31 = Slider(1.5, range=0..10)
merge_18 = Merge(Data1=end_4.Start, Data2=end_4.End)
flatten_2 = FlattenTree(Tree=merge_18, Path="{0}")
pgroups = PointGroups(Points=flatten_2, Distance=number_slider_31)  # -> Groups, Indices

lng_51 = ListLength(List=pgroups.Groups)
larger = LargerThan(FirstNumber=lng_51, SecondNumber=1)  # -> LargerThan, OrEqualTo
cull_10 = CullPattern(List=pgroups.Groups, CullPattern=larger.LargerThan)

avr = Average(Input=cull_10)
clean_7 = CleanTree(RemoveNulls=True, RemoveInvalid=True, RemoveEmpty=False, Tree=avr)
pt_4 = Point(flatten(clean_7))

dist_3 = Distance(PointA=end_3.Start, PointB=pt_4)  # -> simplify(Distance)
dist_4 = Distance(PointA=end_3.End, PointB=pt_4)  # -> simplify(Distance)
sort_6 = SortList(Keys=dist_4)  # -> Keys, ValuesA
sort_7 = SortList(Keys=dist_3)  # -> Keys, ValuesA
item_20 = ListItem(List=sort_6.Keys, Index=0, Wrap=True)
item_21 = ListItem(List=sort_7.Keys, Index=0, Wrap=True)
merge_19 = Merge(Data1=item_21, Data2=item_20)
sort_8 = SortList(Keys=merge_19, ValuesA=merge_16)  # -> Keys, ValuesA
item_22 = ListItem(List=sort_8.Keys, Index=0, Wrap=True)
item_23 = ListItem(List=sort_8.ValuesA, Index=0, Wrap=True)  # -> Item, Item1
smaller_12 = SmallerThan(FirstNumber=item_22, SecondNumber=number_slider_31)  # -> SmallerThan, OrEqualTo
pt_5 = Point(item_23.Item)
pt_6 = Point(item_23.Item1)
panel_39 = Panel(avr)
panel_40 = Panel(item_22)
dispatch_11 = Dispatch(List=pt_6, DispatchPattern=smaller_12.SmallerThan)  # -> ListA, ListB
dispatch_12 = Dispatch(List=pt_5, DispatchPattern=smaller_12.SmallerThan)  # -> ListA, ListB
dispatch_13 = Dispatch(List=pt_3, DispatchPattern=smaller_12.SmallerThan)  # -> ListA, ListB
dispatch_14 = Dispatch(List=pt_2, DispatchPattern=smaller_12.SmallerThan)  # -> ListA, ListB
panel_41 = Panel(item_20)
merge_20 = Merge(Data1=dispatch_11.ListA, Data2=dispatch_13.ListB)
merge_21 = Merge(Data1=dispatch_12.ListA, Data2=dispatch_14.ListB)
vec2pt = Vector2Pt(PointA=merge_21, PointB=merge_20, Unitize=False)  # -> Vector, Length
amp = Amplitude(Vector=vec2pt.Vector, Amplitude=Slider(0.5, range=0..1))
move_44 = Move(Geometry=merge_21, Motion=amp)  # -> Geometry, Transform
pt_7 = Point(move_44.Geometry)

doorpoints_from_algorithm = Point(pt_7)
filter_22 = StreamFilter(Gate=null_6.NullFlags, Stream0=graft(doorpoints_as_inputs), Stream1=doorpoints_from_algorithm)
doorpoints = Point(filter_22)

rev = Reverse(Vector=amp)
move_45 = Move(Geometry=move_44.Geometry, Motion=rev)  # -> Geometry, Transform

doorpoints_2 = Point(doorpoints)
doors_2 = Point(pt_7)

# ----
# DEFINE DOOR AREA
# create a list of rooms per door point in descending order (for door opening). select one in the end.
door_width = Slider(0.45, range=0..1)
bathroom_6 = Curve(simplify_6)
children_7 = Curve(simplify_5)
living_room_4 = Curve(simplify_3)
bedroom_9 = Curve(simplify)
kitchen_9 = Curve(simplify_2)
pt_8 = Point(doorpoints_2)
merge_22 = Merge(Data1=bathroom_6, Data2=bedroom_9, Data3=children_7, Data4=kitchen_9, Data5=living_room_4, Data6=clean_4)
crv_cp_5 = CurveClosestPoint(Point=pt_8, Curve=merge_22)  # -> Point, Parameter, Distance
smaller_13 = SmallerThan(FirstNumber=crv_cp_5.Distance, SecondNumber="0.1")  # -> SmallerThan, OrEqualTo
dispatch_15 = Dispatch(List=merge_22, DispatchPattern=smaller_13.SmallerThan)  # -> ListA, ListB
item_24 = ListItem(List=dispatch_15.ListA, Index=0, Wrap=True)
pt_door = Point(pt_8)
flatten_3 = FlattenTree(Tree=pt_door, Path="{0}")
number_slider_32 = Slider(0.45, range=0..1)
panel_42 = Panel("-0.4 To 0.4")

cluster_17 = Cluster_3(room=inner_walls_contour_3, pt_door=pt_8, door_width=panel_36)
door_area = Curve(cluster_17)

tbranch_4 = TreeBranch(Tree=pt_8, Path=Slider(3, range=0..5), MaintainPaths=True, SplitTree=False)
cluster_18 = Cluster_3(room=inner_walls_contour, pt_door=pt_8)
lng_52 = ListLength(List=bathroom_6)
lng_53 = ListLength(List=bedroom_9)
lng_54 = ListLength(List=living_room_4)
lng_55 = ListLength(List=children_7)
lng_56 = ListLength(List=kitchen_9)
repeat_2 = RepeatData(Data="0.38", Length=lng_52)
repeat_3 = RepeatData(Data="0.45", Length=lng_54)
repeat_4 = RepeatData(Data="0.45", Length=lng_53)
repeat_5 = RepeatData(Data="0.45", Length=lng_55)
repeat_6 = RepeatData(Data="0.45", Length=lng_56)
panel_43 = Panel(pt_8)
merge_23 = Merge(Data1=repeat_2, Data2=repeat_4, Data3=repeat_5, Data4=repeat_6, Data5=repeat_3, Data6=repeat)  # -> flatten(Result)
dispatch_16 = Dispatch(List=merge_23, DispatchPattern=smaller_13.SmallerThan)  # -> ListA, ListB
item_25 = ListItem(List=dispatch_16.ListA, Index=0, Wrap=True)
panel_44 = Panel(item_25)
match_2 = MatchTree(Tree=item_24, Guide=pt_8)

room_7 = Curve(simplify_2)
polyoffset_13 = PolylineOffset(
    Polylines=room_7,
    Distance="0.05",
    Plane=Plane(origin=(0, 0, 0), x=(0, 0, 0), y=(0, 0, 0)),
    Tolerance=0.01,
    ClosedFillet=1,
    OpenFillet=1,
    Miter=2)  # -> Contour, Holes
inner_walls_contour_5 = Curve(graft(polyoffset_13.Holes))
room_8 = Curve(inner_walls_contour_5)

crv_10 = Curve(room_8)
null_14 = NullItem(Item=crv_10)  # -> NullFlags, InvalidFlags, Description
not_5 = GateNot(A=null_14.NullFlags)
merge_24 = Merge(Data1=flatten("Kitchen"), Data2=flatten(not_5))
cluster_19 = Cluster_3(room=inner_walls_contour_5, pt_door=pt_8, door_width="0.45")

rdiff = RegionDifference(CurvesA=inner_walls_contour_5, CurvesB=cluster_19)
room_diff = Curve(rdiff)

lng_57 = ListLength(List=flatten(room_8))
nr_of_rooms_of_this_type = Number(lng_57)
nulls_in_empty_7 = NullsInEmptyBranches(DataWithEmptyBranches=room_7)

wrap_13 = WrapList(Data=furniture_cluster.kitchen_2)
trim_9 = TrimTree(Tree=wrap_13, Depth=1)

flatten_4 = FlattenTree(Tree=trim_9, Path="{0}")
clean_8 = CleanTree(RemoveNulls=True, RemoveInvalid=True, RemoveEmpty=False, Tree=flatten_4)
null_15 = NullItem(Item=clean_8)  # -> NullFlags, InvalidFlags, Description
filter_23 = StreamFilter(Gate=null_15.NullFlags, Stream0=trim_9, Stream1=wrap_13)

lng_58 = ListLength(List=filter_23)
lng_59 = ListLength(List=flatten(lng_58))
nr_of_blocks_to_place_9 = Panel(lng_59)
bang_9 = ExplodeTree(Data=filter_23)  # -> Branch0, Branch1, Branch2
block_0_9 = UnwrapList(WrappedData=bang_9.Branch0)
block_1_8 = UnwrapList(WrappedData=bang_9.Branch1)
block_2_2 = UnwrapList(WrappedData=bang_9.Branch2)

# ----
# Furniture Data
# KITCHEN
furniture_piece = Data(block_0_9)
guideline_17 = ListItem(List=furniture_piece, Index=Slider(1, range=0..1), Wrap=True)
big_rectangle_17 = ListItem(List=furniture_piece, Index=Slider(4, range=0..10), Wrap=True)
importance = ListItem(List=furniture_piece, Index=Slider(2, range=0..10), Wrap=True)
score = ListItem(List=furniture_piece, Index=Slider(3, range=0..10), Wrap=True)
small_rectangle_33 = ListItem(List=furniture_piece, Index=Slider(5, range=0..10), Wrap=True)
details = ListItem(List=furniture_piece, Index=Slider(6, range=0..10), Wrap=True)
small_bb_17 = Curve(small_rectangle_33)
big_bb_17 = Curve(big_rectangle_17)
detsils = Geometry(details)
wall_crv_17 = Curve(guideline_17)
panel_45 = Panel(importance)
explode_12 = Explode(Curve=wall_crv_17, Recursive=True)  # -> Segments, Vertices
equals = Equality(FirstNumber=importance, SecondNumber=1)  # -> Equality, Inequality
panel_46 = Panel(score)
multiplication_6 = Multiplication(A=equals.Equality, B=score)
item_26 = ListItem(List=explode_12.Segments, Index=0, Wrap=True)  # -> Item, Item1
flatten_5 = FlattenTree(Tree=multiplication_6, Path="{0}")
ccx = CurveCurve(CurveA=item_26.Item, CurveB=item_26.Item1)  # -> Points, ParamsA, ParamsB
rev_2 = Reverse(Vector=item_26.Item)
sort_9 = SortList(Keys=flatten_5)  # -> Keys, ValuesA
panel_47 = Panel(sort_9.Keys)
pl = ConstructPlane(Origin=ccx.Points, XAxis=rev_2, YAxis=item_26.Item1)
item_27 = ListItem(List=sort_9.Keys, Index=0, Wrap=True)  # -> Item1, Item
flatten_6 = FlattenTree(Tree=pl, Path="{0}")
panel_48 = Panel(item_27.Item)
plane = Data(flatten_6)

item_28 = ListItem(List=explode_12.Segments, Index=0, Wrap=True)  # -> Item, Item1
len = Length(Curve=item_28.Item1)
len_2 = Length(Curve=item_28.Item)
flatten_7 = FlattenTree(Tree=len, Path="{0}")
flatten_8 = FlattenTree(Tree=len_2, Path="{0}")
lng_60 = ListLength(List=flatten_8)
subtraction = Subtraction(A=flatten_8, B=tolerance_3)
panel_49 = Panel(subtraction)
subtraction_2 = Subtraction(A=flatten_7, B=tolerance_3)
panel_50 = Panel(subtraction_2)
series_17 = Series(Start=0, Step=1, Count=lng_60)
panel_51 = Panel(flatten_8)
score_2 = Data(flatten(score))
details_2 = Data(flatten(detsils))
detsils_2 = Geometry(detsils)
lng_61 = ListLength(List=detsils_2)  # -> flatten(Length)
lng_62 = ListLength(List=lng_61)

door_width_2 = Number(item_25)
neg = Negative(Value=door_width_2)
dom = ConstructDomain(DomainStart=neg, DomainEnd=door_width_2)
room_9 = Curve(match_2)
scale = Scale(Geometry=room_9, Center=Point(0, 0, 0), Factor=0.5)  # -> Geometry, Transform

project = Project(Geometry=room_9, Plane=xy)  # -> Geometry, Transform

explode_13 = Explode(Curve=project.Geometry, Recursive=True)  # -> Segments, Vertices
srf_2 = Surface(project.Geometry)
boundary_2 = BoundarySurfaces(Edges=srf_2)
edges = BrepEdges(Brep=boundary_2)  # -> Naked, Interior, NonManifold
join_2 = JoinCurves(Curves=edges.Naked, Preserve=False)
polyoffset_14 = PolylineOffset(
    Polylines=join_2,
    Distance="0.05",
    Plane=Plane(origin=(0, 0, 0), x=(0, 0, 0), y=(0, 0, 0)),
    Tolerance=0.01,
    ClosedFillet=1,
    OpenFillet=1,
    Miter=2)  # -> Contour, Holes
explode_14 = Explode(Curve=polyoffset_14.Holes, Recursive=True)  # -> Segments, Vertices
crv_cp_6 = CurveClosestPoint(Point=pt_door, Curve=explode_14.Segments)  # -> Point, Parameter, Distance
sort_10 = SortList(Keys=crv_cp_6.Distance, ValuesA=explode_14.Segments)  # -> Keys, ValuesA
area_4 = Area(Geometry=polyoffset_14.Holes)  # -> Area, Centroid
item_29 = ListItem(List=sort_10.ValuesA, Index=0, Wrap=True)
curvepoint_2 = PointOnCurve(item_29, parameter=0.5)
scale_2 = Scale(Geometry=item_29, Center=curvepoint_2, Factor=5)  # -> Geometry, Transform
crv_cp_7 = CurveClosestPoint(Point=area_4.Centroid, Curve=scale_2.Geometry)  # -> Point, Parameter, Distance
ln = Line(StartPoint=area_4.Centroid, EndPoint=crv_cp_7.Point)
amp_2 = Amplitude(Vector=ln, Amplitude=item_25)
rev_3 = Reverse(Vector=amp_2)
pl_2 = ConstructPlane(Origin=pt_door, XAxis=item_29, YAxis=rev_3)
rectangle_2 = Rectangle(Plane=pl_2, XSize=dom, YSize=dom, Radius=0)  # -> Rectangle, Length
move_46 = Move(Geometry=rectangle_2.Rectangle, Motion=rev_3)  # -> Geometry, Transform

move_47 = Move(Geometry=rectangle_2.Rectangle, Motion=amp_2)  # -> Geometry, Transform

# ---- group: door bounding box
door_area_2 = Curve(move_46.Geometry)

# ----
merge_25 = Merge(Data1=move_46.Geometry, Data2=move_47.Geometry)
total_door_area = Curve(flatten(merge_25))

rdiff_2 = RegionDifference(CurvesA=inner_walls_contour_2, CurvesB=flatten(total_door_area))
sort_11 = SortList(Keys=rdiff_2, ValuesA=rdiff_2)  # -> Keys, reverse(ValuesA)
item_30 = ListItem(List=sort_11.ValuesA, Index=0, Wrap=True)
room_diff_2 = Curve(item_30)

rdiff_3 = RegionDifference(CurvesA=inner_walls_contour_3, CurvesB=total_door_area)
room_diff_3 = Curve(rdiff_3)

rdiff_4 = RegionDifference(CurvesA=inner_walls_contour_4, CurvesB=total_door_area)
room_diff_4 = Curve(rdiff_4)

inp2 = Data(room_diff_2)
inp2_2 = Data(room_diff_3)
_2801_placement = Python3Script(
    room_full=inp1_2,
    room_rdc=inp2,
    walls=inp3_3,
    walls_must=Toggle(True),
    wall_crv=wall_crv_3,
    furn_index=series_3,
    big_bb_input=big_bb_3,
    small_bb_input=small_bb_3,
    subdivs=20,
    multiplier=1.4,
    offset_distance=0.3)  # -> out, result_room_full, result_room_rdc, result_initial, result_index_furn, result_transformation_data, final_fitting_curve_out, new_plane_startpoint; inputs room_full: list of Curve, room_rdc: list of Curve, walls: list of Curve, walls_must: Boolean, wall_crv: list of Curve, furn_index: list of Int32, big_bb_input: list of Curve, small_bb_input: list of Curve, subdivs: Int32, multiplier: Double, offset_distance: Double
# ---------- _2801_placement: Python ----------
"""
UNIFIED FURNITURE PLACEMENT SCRIPT
===================================
Combines scripts 0-4 into a single streamlined workflow.

Inputs:
    room_full: List of full room curves (Type: Curve, Access: List)
    room_rdc: List of reduced room curves (Type: Curve, Access: List)
    walls: List of wall curves for proximity check (Type: Curve, Access: List)
    walls_must: Boolean flag to enable proximity filtering (Type: Boolean, Access: Item)
    wall_crv: List of furniture width reference curves (Type: Curve, Access: List)
    big_bb_input: List of furniture large bounding boxes (Type: Curve, Access: List)
    small_bb_input: List of furniture small bounding boxes (Type: Curve, Access: List)
    furn_index: List of furniture indices (Type: int, Access: List)
    subdivs: Number of subdivisions per wall for ray casting (Type: int, Access: Item, Default: 1)
    multiplier: Length ratio threshold for adding end position (Type: float, Access: Item, Default: 1.4)
    offset_distance: Offset distance for cleaning (Type: float, Access: Item, Default: 0.3)

Outputs:
    result_room_full: Final cleaned room_full after all processing (Type: Curve, Access: List)
    result_room_rdc: Final cleaned room_rdc after all processing (Type: Curve, Access: List)
    result_initial: Final wall polylines (Type: Curve, Access: List)
    result_index_furn: Final furniture indices (Type: int, Access: List)
    result_transformation_data: Transformation matrices for furniture placement (Type: Transform, Access: List)
    final_fitting_curve_out: Placement curves ready for furniture (Type: Curve, Access: List)
    new_plane_startpoint: Constructed placement planes (Type: Plane, Access: List)
"""

import Rhino.Geometry as rg

# =============================================================================
# HELPER FUNCTIONS
# =============================================================================

def ensure_list(item):
    """Ensure input is a list (handling single item inputs)"""
    if item is None:
        return []
    if isinstance(item, list):
        return item
    return [item]

def get_oriented_segments(bb_crv, wall_crv):
    """
    Extract width and depth segments from furniture bounding box.
    Orients curve, explodes it, and finds width/depth segments based on proximity to wall.

    Returns: (crv_width, crv_depth) tuple
    """
    if not bb_crv or not wall_crv:
        return None, None

    # Duplicate to avoid modifying original
    crv = bb_crv.DuplicateCurve()

    # Force Counter-Clockwise orientation
    plane = rg.Plane.WorldXY
    orientation = crv.ClosedCurveOrientation(plane)

    if orientation == rg.CurveOrientation.Clockwise:
        crv.Reverse()

    # Explode into segments
    segments = crv.DuplicateSegments()

    # Find the segment closest to the wall_crv
    closest_dist = float("inf")
    closest_index = -1

    for i, seg in enumerate(segments):
        mid_pt = seg.PointAtNormalizedLength(0.5)

        success, t = wall_crv.ClosestPoint(mid_pt)
        if success:
            pt_on_wall = wall_crv.PointAt(t)
            dist = mid_pt.DistanceTo(pt_on_wall)

            if dist < closest_dist:
                closest_dist = dist
                closest_index = i

    # Extract Width and Depth (depth is the segment before width)
    if closest_index != -1:
        crv_width = segments[closest_index]
        crv_depth = segments[closest_index - 1]  # Negative indexing for loop-around

        return crv_width, crv_depth

    return None, None

def find_inward_normal(wall_curve, room_curve, test_length=0.1):
    """Find the normal vector pointing inward (into the room)"""
    start_pt = wall_curve.PointAtStart
    end_pt = wall_curve.PointAtEnd
    wall_direction = end_pt - start_pt
    wall_direction.Unitize()

    normal1 = rg.Vector3d(-wall_direction.Y, wall_direction.X, 0)
    normal1.Unitize()
    normal2 = -normal1

    mid_param = wall_curve.Domain.Mid
    mid_pt = wall_curve.PointAt(mid_param)

    test_pt1 = mid_pt + normal1 * test_length
    test_pt2 = mid_pt + normal2 * test_length

    relation1 = room_curve.Contains(test_pt1, rg.Plane.WorldXY, 0.001)
    relation2 = room_curve.Contains(test_pt2, rg.Plane.WorldXY, 0.001)

    if relation1 == rg.PointContainment.Inside:
        return normal1
    elif relation2 == rg.PointContainment.Inside:
        return normal2
    else:
        return normal1

def find_longest_merged_segment(valid_indices, wall_start, wall_vec, wall_length, subdivs):
    """Merge consecutive valid subwall indices and return the longest segment"""
    if not valid_indices or len(valid_indices) == 0:
        return None

    groups = []
    current_group = [valid_indices[0]]

    for i in range(1, len(valid_indices)):
        if valid_indices[i] == valid_indices[i-1] + 1:
            current_group.append(valid_indices[i])
        else:
            groups.append(current_group)
            current_group = [valid_indices[i]]

    groups.append(current_group)

    longest_segment = None
    longest_length = 0

    for group in groups:
        first_idx = group[0]
        t_start = float(first_idx) / subdivs

        last_idx = group[-1]
        t_end = float(last_idx + 1) / subdivs

        merged_start = wall_start + wall_vec * (t_start * wall_length)
        merged_end = wall_start + wall_vec * (t_end * wall_length)
        merged_segment = rg.LineCurve(merged_start, merged_end)

        segment_length = merged_segment.GetLength()
        if segment_length > longest_length:
            longest_length = segment_length
            longest_segment = merged_segment

    return longest_segment

def calculate_extended_length_line_line(segment, room_full_curve, tolerance=0.001, inset_dist=0.1):
    """Extends a segment to room boundaries using line-line intersections"""
    if segment is None or room_full_curve is None:
        seg_len = segment.GetLength() if segment else 0
        null_pt = rg.Point3d.Unset
        return segment, seg_len, 0.0, 0.0, null_pt, null_pt

    start_pt = segment.PointAtStart
    end_pt = segment.PointAtEnd
    direction = end_pt - start_pt
    segment_length = direction.Length
    direction.Unitize()

    normal1 = rg.Vector3d(-direction.Y, direction.X, 0)
    normal1.Unitize()
    normal2 = -normal1

    mid_pt = segment.PointAt(segment.Domain.Mid)
    test_pt1 = mid_pt + normal1 * 0.01
    test_pt2 = mid_pt + normal2 * 0.01

    relation1 = room_full_curve.Contains(test_pt1, rg.Plane.WorldXY, 0.001)
    relation2 = room_full_curve.Contains(test_pt2, rg.Plane.WorldXY, 0.001)

    inward_normal = normal1 if relation1 == rg.PointContainment.Inside else normal2

    shifted_start = start_pt + inward_normal * inset_dist
    shifted_end = end_pt + inward_normal * inset_dist

    room_full_dup = room_full_curve.DuplicateCurve()
    room_segments = room_full_dup.DuplicateSegments()

    if not room_segments or len(room_segments) == 0:
        return segment, segment_length, 0.0, 0.0, start_pt, end_pt

    left_extension = 0.0
    right_extension = 0.0
    left_intersect_pt = None
    right_intersect_pt = None

    for room_seg in room_segments:
        room_line = rg.Line(room_seg.PointAtStart, room_seg.PointAtEnd)
        big_line = rg.Line(shifted_start - direction * 100, shifted_end + direction * 100)

        success, param_on_big_line, param_on_room_line = rg.Intersect.Intersection.LineLine(
            big_line, room_line
        )

        if not success:
            continue

        room_direction = room_seg.PointAtEnd - room_seg.PointAtStart
        room_direction.Unitize()

        dot_parallel = abs(direction * room_direction)
        if dot_parallel > 0.99:
            continue

        intersect_pt = big_line.PointAt(param_on_big_line)

        if param_on_room_line < 0.0 or param_on_room_line > 1.0:
            continue

        vec_to_intersect = intersect_pt - shifted_start
        dot_product = vec_to_intersect * direction

        if dot_product < -tolerance:
            dist = shifted_start.DistanceTo(intersect_pt)
            if left_extension == 0 or dist < left_extension:
                left_extension = dist
                left_intersect_pt = intersect_pt

        elif dot_product > segment_length + tolerance:
            dist = shifted_end.DistanceTo(intersect_pt)
            if right_extension == 0 or dist < right_extension:
                right_extension = dist
                right_intersect_pt = intersect_pt

    extended_length = left_extension + segment_length + right_extension

    extended_start = start_pt - direction * left_extension
    extended_end = end_pt + direction * right_extension
    extended_segment = rg.LineCurve(extended_start, extended_end)

    if left_intersect_pt is None:
        left_intersect_pt = start_pt
    if right_intersect_pt is None:
        right_intersect_pt = end_pt

    return extended_segment, extended_length, left_extension, right_extension, left_intersect_pt, right_intersect_pt

def clean_shape_with_offset(curve, offset_dist=0.3, tolerance=0.01):
    """Clean a shape by offsetting outward then back inward (area-based selection)"""
    if curve is None:
        return None

    plane = rg.Plane.WorldXY

    offset_curves_out = curve.Offset(
        plane,
        offset_dist,
        tolerance,
        rg.CurveOffsetCornerStyle.Sharp
    )

    if offset_curves_out is None or len(offset_curves_out) == 0:
        print("WARNING: First offset failed, returning original curve")
        return curve

    if len(offset_curves_out) > 1:
        largest_curve = None
        max_area = 0
        for crv in offset_curves_out:
            if crv.IsClosed and crv.IsPlanar():
                amp = rg.AreaMassProperties.Compute(crv)
                if amp is not None:
                    area = amp.Area
                    if area > max_area:
                        max_area = area
                        largest_curve = crv

        if largest_curve is not None:
            selected_curve = largest_curve
            print(f"DEBUG: Multiple offset results ({len(offset_curves_out)}), selected largest with area {max_area:.3f}")
        else:
            selected_curve = max(offset_curves_out, key=lambda c: c.GetLength())
            print(f"DEBUG: Multiple offset results, fallback to largest perimeter")
    else:
        selected_curve = offset_curves_out[0]

    if selected_curve is None:
        print("WARNING: No valid curve after first offset, returning original")
        return curve

    offset_curves_in = selected_curve.Offset(
        plane,
        -offset_dist,
        tolerance,
        rg.CurveOffsetCornerStyle.Sharp
    )

    if offset_curves_in is None or len(offset_curves_in) == 0:
        print("WARNING: Second offset failed, returning result of first offset")
        return selected_curve

    return offset_curves_in[0]

# =============================================================================
# INPUT STANDARDIZATION
# =============================================================================

print("="*80)
print("STARTING UNIFIED PLACEMENT SCRIPT")
print("="*80)

# Standardize all inputs
room_full = ensure_list(room_full)
room_rdc = ensure_list(room_rdc)
walls = ensure_list(walls)
wall_crv = ensure_list(wall_crv)
big_bb_input = ensure_list(big_bb_input)
small_bb_input = ensure_list(small_bb_input)
furn_index = ensure_list(furn_index)

# Default parameters
if "walls_must" not in globals() or walls_must is None:
    walls_must = False
if "subdivs" not in globals() or subdivs is None:
    subdivs = 1
if "multiplier" not in globals() or multiplier is None:
    multiplier = 1.4
if "offset_distance" not in globals() or offset_distance is None:
    offset_distance = 0.3

print(f"\nINPUT COUNTS:")
print(f"  walls: {len(walls)}")
print(f"  room_full: {len(room_full)}")
print(f"  room_rdc: {len(room_rdc)}")
print(f"  wall_crv (furniture): {len(wall_crv)}")
print(f"  big_bb_input: {len(big_bb_input)}")
print(f"  small_bb_input: {len(small_bb_input)}")
print(f"  furn_index: {len(furn_index)}")
print(f"\nPARAMETERS:")
print(f"  walls_must: {walls_must}")
print(f"  subdivs: {subdivs}")
print(f"  multiplier: {multiplier}")
print(f"  offset_distance: {offset_distance}")

# =============================================================================
# STAGE 0: EXTRACT FURNITURE DIMENSIONS (Script 0)
# =============================================================================

print("\n" + "="*80)
print("STAGE 0: EXTRACT FURNITURE DIMENSIONS")
print("="*80)

width_full = []
width_rdc = []
depth_full = []
depth_rdc = []
pathway_left = []
pathway_right = []
plane_startpoint = []
plane_endpoint = []
big_bb = []
small_bb = []

for i in range(len(wall_crv)):
    wall_crv_item = wall_crv[i] if i < len(wall_crv) else None
    big_bb_item = big_bb_input[i] if i < len(big_bb_input) else None
    small_bb_item = small_bb_input[i] if i < len(small_bb_input) else None

    if wall_crv_item and big_bb_item and small_bb_item:
        # Extract width and depth segments from big_bb
        crv_width_full, crv_depth_full = get_oriented_segments(big_bb_item, wall_crv_item)

        # Extract width and depth segments from small_bb
        crv_width_rdc, crv_depth_rdc = get_oriented_segments(small_bb_item, wall_crv_item)

        if crv_width_full and crv_depth_full and crv_width_rdc and crv_depth_rdc:
            # Calculate lengths
            width_full.append(crv_width_full.GetLength())
            depth_full.append(crv_depth_full.GetLength())
            width_rdc.append(crv_width_rdc.GetLength())
            depth_rdc.append(crv_depth_rdc.GetLength())

            # Calculate pathways (distances between width curves)
            pt_start_full = crv_width_full.PointAtStart
            pt_start_rdc = crv_width_rdc.PointAtStart
            pathway_left.append(pt_start_full.DistanceTo(pt_start_rdc))

            pt_end_full = crv_width_full.PointAtEnd
            pt_end_rdc = crv_width_rdc.PointAtEnd
            pathway_right.append(pt_end_full.DistanceTo(pt_end_rdc))

            # Create planes
            vec_width = pt_end_full - pt_start_full
            vec_depth = crv_depth_full.PointAtEnd - crv_depth_full.PointAtStart

            # Plane at start: X=Width, Y=-Depth
            plane_startpoint.append(rg.Plane(pt_start_full, vec_width, -vec_depth))

            # Plane at end: X=-Width, Y=-Depth
            plane_endpoint.append(rg.Plane(pt_end_full, -vec_width, -vec_depth))

            # Store bounding boxes for later use
            big_bb.append(big_bb_item)
            small_bb.append(small_bb_item)

        else:
            # Failed to extract segments
            print(f"WARNING: Failed to extract segments for furniture {i}")
            width_full.append(None)
            depth_full.append(None)
            width_rdc.append(None)
            depth_rdc.append(None)
            pathway_left.append(None)
            pathway_right.append(None)
            plane_startpoint.append(None)
            plane_endpoint.append(None)
            big_bb.append(None)
            small_bb.append(None)
    else:
        # Missing input curves
        print(f"WARNING: Missing input curves for furniture {i}")
        width_full.append(None)
        depth_full.append(None)
        width_rdc.append(None)
        depth_rdc.append(None)
        pathway_left.append(None)
        pathway_right.append(None)
        plane_startpoint.append(None)
        plane_endpoint.append(None)
        big_bb.append(None)
        small_bb.append(None)

print(f"Extracted dimensions for {len(width_full)} furniture items")
print(f"  width_full range: {[f'{w:.3f}' if w else 'None' for w in width_full[:3]]}...")
print(f"  depth_full range: {[f'{d:.3f}' if d else 'None' for d in depth_full[:3]]}...")

# =============================================================================
# STAGE 1: FILTER WALLS (Script 1)
# =============================================================================

print("\n" + "="*80)
print("STAGE 1: FILTER WALLS")
print("="*80)

edges_rdc = []
edges_rdc_room_index = []
edges_rdc_to_wall_polyline = []

# Explode walls polylines and track original polyline
wall_segments = []
wall_segments_to_polyline = []

for wall_polyline in walls:
    if wall_polyline is None:
        continue

    crv = wall_polyline.DuplicateCurve()
    plane_check = rg.Plane.WorldXY
    if crv.ClosedCurveOrientation(plane_check) == rg.CurveOrientation.Clockwise:
        crv.Reverse()

    segments = crv.DuplicateSegments()

    for seg in segments:
        wall_segments.append(seg)
        wall_segments_to_polyline.append(wall_polyline)

print(f"Exploded {len(walls)} wall polylines into {len(wall_segments)} segments")

# Process room_rdc polylines
for room_idx, r_crv in enumerate(room_rdc):
    if r_crv is None:
        continue

    crv = r_crv.DuplicateCurve()
    plane_check = rg.Plane.WorldXY
    if crv.ClosedCurveOrientation(plane_check) == rg.CurveOrientation.Clockwise:
        crv.Reverse()

    segments = crv.DuplicateSegments()

    for seg in segments:
        matched_wall_polyline = None

        if walls_must:
            mid_pt = seg.PointAtNormalizedLength(0.5)
            is_close = False
            closest_wall_idx = -1
            closest_dist = float('inf')

            for wall_idx, wall_seg in enumerate(wall_segments):
                if wall_seg:
                    success, t = wall_seg.ClosestPoint(mid_pt)
                    if success:
                        pt_on_wall = wall_seg.PointAt(t)
                        dist = mid_pt.DistanceTo(pt_on_wall)
                        if dist < 0.02 and dist < closest_dist:
                            is_close = True
                            closest_dist = dist
                            closest_wall_idx = wall_idx

            if is_close and closest_wall_idx >= 0:
                matched_wall_polyline = wall_segments_to_polyline[closest_wall_idx]
                edges_rdc.append(seg)
                edges_rdc_room_index.append(room_idx)
                edges_rdc_to_wall_polyline.append(matched_wall_polyline)
        else:
            edges_rdc.append(seg)
            edges_rdc_room_index.append(room_idx)
            edges_rdc_to_wall_polyline.append(None)

print(f"Found {len(edges_rdc)} room segments")

# Pre-compute extended lengths
segment_data = []

for i, seg in enumerate(edges_rdc):
    room_idx = edges_rdc_room_index[i]
    wall_polyline = edges_rdc_to_wall_polyline[i]
    room_full_curve = room_full[room_idx] if room_idx < len(room_full) else None

    physical_len = seg.GetLength()
    extended_seg, extended_len, left_ext, right_ext, int_pt_left, int_pt_right = calculate_extended_length_line_line(seg, room_full_curve)

    segment_data.append((i, seg, room_idx, wall_polyline, physical_len, extended_len, left_ext, right_ext, int_pt_left, int_pt_right))

# Check both conditions for each (segment, furniture) pair
walls_long_enough = []
initial_s1 = []
room_full_s1 = []
room_rdc_s1 = []
width_full_s1 = []
width_rdc_s1 = []
pathway_left_s1 = []
pathway_right_s1 = []
furn_index_s1 = []
plane_startpoint_s1 = []
plane_endpoint_s1 = []
big_bb_s1 = []
small_bb_s1 = []
extended_walls_s1 = []

for seg_idx, seg, room_idx, wall_polyline, physical_len, extended_len, left_ext, right_ext, int_pt_left, int_pt_right in segment_data:

    for j in range(len(width_rdc)):
        width_rdc_val = width_rdc[j] if j < len(width_rdc) else 0
        width_full_val = width_full[j] if j < len(width_full) else 0

        # Check 1: Physical check
        if physical_len < width_rdc_val:
            continue

        # Check 2: Capacity check
        if extended_len < width_full_val:
            continue

        # BOTH CHECKS PASSED
        walls_long_enough.append(seg)
        initial_s1.append(wall_polyline)

        # Extension with pathway constraints
        pathway_left_val = pathway_left[j] if j < len(pathway_left) else 0
        pathway_right_val = pathway_right[j] if j < len(pathway_right) else 0

        min_left = min(left_ext, pathway_left_val) if pathway_left_val > 0 else 0
        min_right = min(right_ext, pathway_right_val) if pathway_right_val > 0 else 0

        seg_start = seg.PointAtStart
        seg_end = seg.PointAtEnd
        seg_direction = seg_end - seg_start
        seg_direction.Unitize()

        extended_pt_left = seg_start - seg_direction * min_left
        extended_pt_right = seg_end + seg_direction * min_right

        extended_wall = rg.LineCurve(extended_pt_left, extended_pt_right)
        extended_walls_s1.append(extended_wall)

        # Append corresponding data
        room_full_s1.append(room_full[room_idx] if room_idx < len(room_full) else None)
        room_rdc_s1.append(room_rdc[room_idx] if room_idx < len(room_rdc) else None)
        width_full_s1.append(width_full[j] if j < len(width_full) else None)
        width_rdc_s1.append(width_rdc[j] if j < len(width_rdc) else None)
        pathway_left_s1.append(pathway_left[j] if j < len(pathway_left) else None)
        pathway_right_s1.append(pathway_right[j] if j < len(pathway_right) else None)
        furn_index_s1.append(furn_index[j] if j < len(furn_index) else None)
        plane_startpoint_s1.append(plane_startpoint[j] if j < len(plane_startpoint) else None)
        plane_endpoint_s1.append(plane_endpoint[j] if j < len(plane_endpoint) else None)
        big_bb_s1.append(big_bb[j] if j < len(big_bb) else None)
        small_bb_s1.append(small_bb[j] if j < len(small_bb) else None)

print(f"After width checks: {len(walls_long_enough)} valid walls")

# =============================================================================
# STAGE 2: RAY CASTING & PERPENDICULAR FILTERING (Script 2)
# =============================================================================

print("\n" + "="*80)
print("STAGE 2: RAY CASTING & FILTERING")
print("="*80)

updated_full_s2 = []
vectors_s2 = []
width_full_s2 = []
furn_index_s2 = []
room_full_s2 = []
room_rdc_s2 = []
plane_startpoint_s2 = []
plane_endpoint_s2 = []
big_bb_s2 = []
small_bb_s2 = []
initial_s2 = []

for i, wall in enumerate(extended_walls_s1):
    if wall is None:
        continue

    wall_long_enough = walls_long_enough[i] if i < len(walls_long_enough) else None

    if wall_long_enough is None:
        continue

    furn_idx = furn_index_s1[i] if i < len(furn_index_s1) else 0

    depth_full_val = depth_full[furn_idx] if furn_idx < len(depth_full) else 0
    depth_rdc_val = depth_rdc[furn_idx] if furn_idx < len(depth_rdc) else 0
    width_full_val = width_full_s1[i] if i < len(width_full_s1) else 0

    room_curve = room_full_s1[i] if i < len(room_full_s1) else None
    room_rdc_curve = room_rdc_s1[i] if i < len(room_rdc_s1) else None

    if room_curve is None:
        continue

    normal = find_inward_normal(wall, room_curve)

    wall_start = wall.PointAtStart
    wall_end = wall.PointAtEnd
    wall_vec = wall_end - wall_start
    wall_length = wall_vec.Length
    wall_vec.Unitize()

    valid_indices = []

    for j in range(subdivs):
        t_start = float(j) / subdivs
        t_end = float(j + 1) / subdivs
        t_mid = (t_start + t_end) / 2.0

        center_pt = wall_start + wall_vec * (t_mid * wall_length)

        ray_full_end = center_pt + normal * depth_full_val
        ray_full = rg.Line(center_pt, ray_full_end)

        success, t_closest = wall_long_enough.ClosestPoint(center_pt)
        if success:
            projected_pt = wall_long_enough.PointAt(t_closest)
        else:
            projected_pt = center_pt

        ray_rdc_end = projected_pt + normal * depth_rdc_val
        ray_rdc = rg.Line(projected_pt, ray_rdc_end)

        has_blocking_intersection_full = False
        if room_curve is not None:
            ray_full_curve = ray_full.ToNurbsCurve()
            intersections_full = rg.Intersect.Intersection.CurveCurve(
                ray_full_curve, room_curve, 0.001, 0.001
            )

            if intersections_full.Count > 0:
                for k in range(intersections_full.Count):
                    int_pt = intersections_full[k].PointA
                    dist_from_start = center_pt.DistanceTo(int_pt)
                    if dist_from_start > 0.01:
                        has_blocking_intersection_full = True
                        break

        has_blocking_intersection_rdc = False
        if room_rdc_curve is not None:
            ray_rdc_curve = ray_rdc.ToNurbsCurve()
            intersections_rdc = rg.Intersect.Intersection.CurveCurve(
                ray_rdc_curve, room_rdc_curve, 0.001, 0.001
            )

            if intersections_rdc.Count > 0:
                for k in range(intersections_rdc.Count):
                    int_pt = intersections_rdc[k].PointA
                    dist_from_start = projected_pt.DistanceTo(int_pt)
                    if dist_from_start > 0.01:
                        has_blocking_intersection_rdc = True
                        break

        if not has_blocking_intersection_full and not has_blocking_intersection_rdc:
            valid_indices.append(j)

    longest_full = find_longest_merged_segment(valid_indices, wall_start, wall_vec, wall_length, subdivs)
    if longest_full is not None:
        curve_length = longest_full.GetLength()
        if curve_length >= width_full_val:
            updated_full_s2.append(longest_full)
            vectors_s2.append(normal)
            width_full_s2.append(width_full_val)
            furn_index_s2.append(furn_idx)
            room_full_s2.append(room_curve)
            room_rdc_s2.append(room_rdc_curve)
            plane_startpoint_s2.append(plane_startpoint_s1[i] if i < len(plane_startpoint_s1) else None)
            plane_endpoint_s2.append(plane_endpoint_s1[i] if i < len(plane_endpoint_s1) else None)
            big_bb_s2.append(big_bb_s1[i] if i < len(big_bb_s1) else None)
            small_bb_s2.append(small_bb_s1[i] if i < len(small_bb_s1) else None)
            initial_s2.append(initial_s1[i] if i < len(initial_s1) else None)

print(f"After ray casting: {len(updated_full_s2)} valid segments")

# =============================================================================
# STAGE 3: EXTEND PLACEMENT POSITIONS (Script 3)
# =============================================================================

print("\n" + "="*80)
print("STAGE 3: EXTEND PLACEMENT POSITIONS")
print("="*80)

final_fitting_curve_s3 = []
vector_s3 = []
furn_index_s3 = []
room_full_s3 = []
room_rdc_s3 = []
initial_s3 = []
big_bb_transformed_s3 = []
small_bb_transformed_s3 = []
transformation_s3 = []
new_plane_startpoint_s3 = []

for i, curve in enumerate(updated_full_s2):
    if curve is None:
        continue

    curve_vector = vectors_s2[i] if i < len(vectors_s2) else rg.Vector3d.ZAxis
    curve_width = width_full_s2[i] if i < len(width_full_s2) else 1.0
    curve_furn_idx = furn_index_s2[i] if i < len(furn_index_s2) else 0
    curve_room_full = room_full_s2[i] if i < len(room_full_s2) else None
    curve_room_rdc = room_rdc_s2[i] if i < len(room_rdc_s2) else None
    curve_initial = initial_s2[i] if i < len(initial_s2) else None
    curve_plane_start = plane_startpoint_s2[i] if i < len(plane_startpoint_s2) else None
    curve_plane_end = plane_endpoint_s2[i] if i < len(plane_endpoint_s2) else None
    curve_big_bb = big_bb_s2[i] if i < len(big_bb_s2) else None
    curve_small_bb = small_bb_s2[i] if i < len(small_bb_s2) else None

    curve_length = curve.GetLength()
    length_ratio = curve_length / curve_width if curve_width > 0 else 0

    add_end_position = length_ratio >= multiplier

    def process_curve(crv, is_reversed=False):
        start_pt = crv.PointAtStart
        start_tangent = crv.TangentAtStart
        start_tangent.Unitize()

        new_plane = rg.Plane(start_pt, start_tangent, curve_vector)

        initial_plane = curve_plane_end if is_reversed else curve_plane_start

        if initial_plane is not None:
            xform = rg.Transform.PlaneToPlane(initial_plane, new_plane)
        else:
            xform = rg.Transform.Identity

        if curve_big_bb is not None:
            big_bb_copy = curve_big_bb.Duplicate()
            big_bb_copy.Transform(xform)
            big_bb_transformed_s3.append(big_bb_copy)
        else:
            big_bb_transformed_s3.append(None)

        if curve_small_bb is not None:
            small_bb_copy = curve_small_bb.Duplicate()
            small_bb_copy.Transform(xform)
            small_bb_transformed_s3.append(small_bb_copy)
        else:
            small_bb_transformed_s3.append(None)

        final_fitting_curve_s3.append(crv)
        vector_s3.append(curve_vector)
        furn_index_s3.append(curve_furn_idx)
        room_full_s3.append(curve_room_full)
        room_rdc_s3.append(curve_room_rdc)
        initial_s3.append(curve_initial)
        transformation_s3.append(xform)
        new_plane_startpoint_s3.append(new_plane)

    process_curve(curve, is_reversed=False)

    if add_end_position:
        reversed_curve = curve.DuplicateCurve()
        reversed_curve.Reverse()
        process_curve(reversed_curve, is_reversed=True)

print(f"After position extension: {len(final_fitting_curve_s3)} placement positions")

# =============================================================================
# STAGE 4: REGION DIFFERENCE (Script 4)
# =============================================================================

print("\n" + "="*80)
print("STAGE 4: REGION DIFFERENCE")
print("="*80)

# Small offset to push bbox outside room boundary for clean boolean
bbox_outward_offset = 0.05  # Adjust as needed

result_room_full = []
result_room_rdc = []
result_initial = []
result_index_furn = []
result_transformation_data = []

num_items = len(room_full_s3)

for i in range(num_items):
    room_full_curve = room_full_s3[i] if i < len(room_full_s3) else None
    room_rdc_curve = room_rdc_s3[i] if i < len(room_rdc_s3) else None
    bb_small = small_bb_transformed_s3[i] if i < len(small_bb_transformed_s3) else None
    bb_big = big_bb_transformed_s3[i] if i < len(big_bb_transformed_s3) else None
    initial_curve = initial_s3[i] if i < len(initial_s3) else None
    furn_idx = furn_index_s3[i] if i < len(furn_index_s3) else None
    xform = transformation_s3[i] if i < len(transformation_s3) else None
    inward_vector = vector_s3[i] if i < len(vector_s3) else None

    # Calculate outward direction (opposite of inward normal)
    outward_vector = None
    if inward_vector is not None:
        outward_vector = -inward_vector
        outward_vector.Unitize()

    # Offset bounding boxes outward for clean boolean difference
    bb_small_offset = None
    bb_big_offset = None

    if bb_small is not None and outward_vector is not None:
        bb_small_offset = bb_small.DuplicateCurve()
        move_xform = rg.Transform.Translation(outward_vector * bbox_outward_offset)
        bb_small_offset.Transform(move_xform)
    else:
        bb_small_offset = bb_small

    if bb_big is not None and outward_vector is not None:
        bb_big_offset = bb_big.DuplicateCurve()
        move_xform = rg.Transform.Translation(outward_vector * bbox_outward_offset)
        bb_big_offset.Transform(move_xform)
    else:
        bb_big_offset = bb_big

    # Part 1: room_full - bb_small (offset)
    cleaned_room_full = None
    if room_full_curve is not None and bb_small_offset is not None:
        diff_curves = rg.Curve.CreateBooleanDifference(
            room_full_curve,
            bb_small_offset,
            0.01
        )

        if diff_curves is not None and len(diff_curves) > 0:
            # Select the curve with largest area
            if len(diff_curves) == 1:
                diff_result = diff_curves[0]
            else:
                largest_curve = None
                max_area = 0
                for crv in diff_curves:
                    if crv.IsClosed and crv.IsPlanar():
                        amp = rg.AreaMassProperties.Compute(crv)
                        if amp is not None and amp.Area > max_area:
                            max_area = amp.Area
                            largest_curve = crv
                diff_result = largest_curve if largest_curve is not None else diff_curves[0]
            # Apply offset cleaning
            cleaned_room_full = clean_shape_with_offset(diff_result, offset_distance)
        else:
            cleaned_room_full = room_full_curve
    else:
        cleaned_room_full = room_full_curve

    # Part 2: room_rdc - bb_big (offset)
    cleaned_room_rdc = None
    if room_rdc_curve is not None and bb_big_offset is not None:
        diff_curves = rg.Curve.CreateBooleanDifference(
            room_rdc_curve,
            bb_big_offset,
            0.01
        )

        if diff_curves is not None and len(diff_curves) > 0:
            # Select the curve with largest area
            if len(diff_curves) == 1:
                diff_result = diff_curves[0]
            else:
                largest_curve = None
                max_area = 0
                for crv in diff_curves:
                    if crv.IsClosed and crv.IsPlanar():
                        amp = rg.AreaMassProperties.Compute(crv)
                        if amp is not None and amp.Area > max_area:
                            max_area = amp.Area
                            largest_curve = crv
                diff_result = largest_curve if largest_curve is not None else diff_curves[0]
            # Apply offset cleaning
            cleaned_room_rdc = clean_shape_with_offset(diff_result, offset_distance)
        else:
            cleaned_room_rdc = room_rdc_curve
    else:
        cleaned_room_rdc = room_rdc_curve

    result_room_full.append(cleaned_room_full)
    result_room_rdc.append(cleaned_room_rdc)
    result_initial.append(initial_curve)
    result_index_furn.append(furn_idx)
    result_transformation_data.append(xform)

print(f"After region difference: {len(result_room_full)} results")

# =============================================================================
# FINAL OUTPUTS
# =============================================================================

print("\n" + "="*80)
print("FINAL OUTPUTS")
print("="*80)
print(f"  result_room_full: {len(result_room_full)}")
print(f"  result_room_rdc: {len(result_room_rdc)}")
print(f"  result_initial: {len(result_initial)}")
print(f"  result_index_furn: {len(result_index_furn)}")
print(f"  result_transformation_data: {len(result_transformation_data)}")
print(f"  final_fitting_curve_out: {len(final_fitting_curve_s3)}")
print(f"  new_plane_startpoint: {len(new_plane_startpoint_s3)}")
print("="*80)

# Assign final outputs
final_fitting_curve_out = final_fitting_curve_s3
new_plane_startpoint = new_plane_startpoint_s3
# ---------- end _2801_placement ----------
inp2_3 = Data(room_diff_4)
null_16 = NullItem(Item=_2801_placement.result_room_rdc)  # -> NullFlags, InvalidFlags, Description
_2801_placement_2 = Python3Script(
    room_full=inp1_3,
    room_rdc=inp2_2,
    walls=inp3_7,
    walls_must=Toggle(True),
    wall_crv=wall_crv_7,
    furn_index=series_7,
    big_bb_input=big_bb_7,
    small_bb_input=small_bb_7,
    subdivs=20,
    multiplier=1.4,
    offset_distance=0.3)  # -> out, result_room_full, result_room_rdc, result_initial, result_index_furn, result_transformation_data, final_fitting_curve_out, new_plane_startpoint; inputs room_full: list of Curve, room_rdc: list of Curve, walls: list of Curve, walls_must: Boolean, wall_crv: list of Curve, furn_index: list of Int32, big_bb_input: list of Curve, small_bb_input: list of Curve, subdivs: Int32, multiplier: Double, offset_distance: Double; same code as _2801_placement
py3_2 = Python3Script(input_data=_2801_placement.result_room_full, mode=0)  # -> out, branch_indices, item_indices, paths, data_out; inputs input_data: tree, mode: Int32
# ---------- py3_2: Python ----------
"""
TREE REORGANIZATION SCRIPT
===========================
Reorganizes data tree structure by extracting path indices or regrafting data.

Inputs:
    input_data: Input data tree to reorganize (Type: Generic, Access: Tree)
    mode: Reorganization mode (Type: int, Access: Item, Default: 0)
          0 = Extract branch indices
          1 = Extract item indices within branches
          2 = Extract both (branch, item) as separate outputs
          3 = Flatten with indices
          4 = Graft (each item gets its own branch)

Outputs:
    branch_indices: Branch indices from the tree (Type: int, Access: Tree)
    item_indices: Item indices within each branch (Type: int, Access: Tree)
    paths: Full path information (Type: Text, Access: List)
    data_out: Reorganized data (Type: Generic, Access: Tree)
"""

import Grasshopper as gh
from Grasshopper import DataTree
from Grasshopper.Kernel.Data import GH_Path
import System

# Get the input tree
tree = input_data

# Default mode
if "mode" not in globals() or mode is None:
    mode = 0

print("="*60)
print("TREE REORGANIZATION SCRIPT")
print("="*60)
print(f"Mode: {mode}")
print(f"Input tree branch count: {tree.BranchCount if tree else 0}")
print(f"Input tree total item count: {tree.DataCount if tree else 0}")

# Initialize output trees
branch_indices = DataTree[System.Object]()
item_indices = DataTree[System.Object]()
paths = []
data_out = DataTree[System.Object]()

if tree:
    # Iterate through all branches in the input tree
    for i, path in enumerate(tree.Paths):
        # Get items in this branch
        branch_items = tree.Branch(path)

        # Get path components (e.g., {0;1;2} becomes [0, 1, 2])
        path_components = [path.Indices[j] for j in range(path.Length)]

        # Store full path as text
        path_text = "{" + ";".join(str(p) for p in path_components) + "}"
        paths.append(path_text)

        print(f"\nBranch {path_text}: {len(branch_items)} items")

        # Process based on mode
        if mode == 0:
            # Mode 0: Extract branch indices (first component of path)
            branch_idx = path_components[0] if len(path_components) > 0 else 0

            for item in branch_items:
                branch_indices.Add(branch_idx, path)

        elif mode == 1:
            # Mode 1: Extract item indices within branches
            for item_idx, item in enumerate(branch_items):
                item_indices.Add(item_idx, path)

        elif mode == 2:
            # Mode 2: Extract both branch and item indices
            branch_idx = path_components[0] if len(path_components) > 0 else 0

            for item_idx, item in enumerate(branch_items):
                branch_indices.Add(branch_idx, path)
                item_indices.Add(item_idx, path)

        elif mode == 3:
            # Mode 3: Flatten with sequential indices
            flat_path = GH_Path(0)
            for item_idx, item in enumerate(branch_items):
                global_idx = sum(len(tree.Branch(p)) for p in tree.Paths[:i]) + item_idx
                branch_indices.Add(path_components[0], flat_path)
                item_indices.Add(item_idx, flat_path)
                data_out.Add(item, flat_path)

        elif mode == 4:
            # Mode 4: Graft (each item gets its own branch)
            for item_idx, item in enumerate(branch_items):
                new_path = GH_Path(i, item_idx)
                branch_indices.Add(path_components[0], new_path)
                item_indices.Add(item_idx, new_path)
                data_out.Add(item, new_path)

    print(f"\n" + "="*60)
    print(f"Output branch_indices: {branch_indices.BranchCount} branches")
    print(f"Output item_indices: {item_indices.BranchCount} branches")
    print(f"Output paths: {len(paths)} items")
    print("="*60)
# ---------- end py3_2 ----------
cull_11 = CullPattern(List=_2801_placement.result_room_full, CullPattern=invert(null_16.NullFlags))
cull_12 = CullPattern(List=_2801_placement.result_room_rdc, CullPattern=invert(null_16.NullFlags))
cull_13 = CullPattern(List=_2801_placement.result_initial, CullPattern=invert(null_16.NullFlags))
cull_14 = CullPattern(List=_2801_placement.result_index_furn, CullPattern=invert(null_16.NullFlags))
cull_15 = CullPattern(List=_2801_placement.result_transformation_data, CullPattern=invert(null_16.NullFlags))
graft_7 = GraftTree(Tree=flatten(cull_12), IncludeEmptyLists=True, IncludeNullItems=True)  # -> simplify(Tree)
inp2_4 = Data(graft_7)
graft_8 = GraftTree(Tree=flatten(cull_11), IncludeEmptyLists=True, IncludeNullItems=True)  # -> simplify(Tree)
inp1_5 = Data(graft_8)
# One Placement
_2801_placement_3 = Python3Script(
    room_full=inp1_5,
    room_rdc=inp2_4,
    walls=inp3_4,
    walls_must=Toggle(True),
    wall_crv=wall_crv_4,
    furn_index=series_4,
    big_bb_input=big_bb_4,
    small_bb_input=small_bb_4,
    subdivs=20,
    multiplier=1.4,
    offset_distance=0.3)  # -> out, simplify(result_room_full), simplify(result_room_rdc), simplify(result_initial), simplify(result_index_furn), simplify(result_transformation_data), final_fitting_curve_out, new_plane_startpoint; inputs room_full: list of Curve, room_rdc: list of Curve, walls: list of Curve, walls_must: Boolean, wall_crv: list of Curve, furn_index: list of Int32, big_bb_input: list of Curve, small_bb_input: list of Curve, subdivs: Int32, multiplier: Double, offset_distance: Double; same code as _2801_placement
null_17 = NullItem(Item=_2801_placement_3.result_room_rdc)  # -> NullFlags, InvalidFlags, Description
py3_3 = Python3Script(input_data=_2801_placement_3.result_room_full, mode=0)  # -> out, branch_indices, item_indices, paths, data_out; inputs input_data: tree, mode: Int32; same code as py3_2
cull_16 = CullPattern(List=_2801_placement_3.result_room_full, CullPattern=invert(null_17.NullFlags))
cull_17 = CullPattern(List=_2801_placement_3.result_room_rdc, CullPattern=invert(null_17.NullFlags))
cull_18 = CullPattern(List=_2801_placement_3.result_initial, CullPattern=invert(null_17.NullFlags))
cull_19 = CullPattern(List=_2801_placement_3.result_index_furn, CullPattern=invert(null_17.NullFlags))
cull_20 = CullPattern(List=_2801_placement_3.result_transformation_data, CullPattern=invert(null_17.NullFlags))
graft_9 = GraftTree(Tree=flatten(cull_16), IncludeEmptyLists=True, IncludeNullItems=True)  # -> simplify(Tree)
graft_10 = GraftTree(Tree=flatten(cull_17), IncludeEmptyLists=True, IncludeNullItems=True)  # -> simplify(Tree)
graft_11 = GraftTree(Tree=flatten(cull_18), IncludeEmptyLists=True, IncludeNullItems=True)  # -> simplify(Tree)
graft_12 = GraftTree(Tree=flatten(cull_19), IncludeEmptyLists=True, IncludeNullItems=True)  # -> simplify(Tree)
graft_13 = GraftTree(Tree=flatten(cull_20), IncludeEmptyLists=True, IncludeNullItems=True)  # -> simplify(Tree)
graft_14 = GraftTree(Tree=flatten(cull_13), IncludeEmptyLists=True, IncludeNullItems=True)  # -> simplify(Tree)
graft_15 = GraftTree(Tree=flatten(cull_14), IncludeEmptyLists=True, IncludeNullItems=True)  # -> simplify(Tree)
graft_16 = GraftTree(Tree=flatten(cull_15), IncludeEmptyLists=True, IncludeNullItems=True)  # -> simplify(Tree)
graft_17 = GraftTree(Tree=flatten(py3_3.branch_indices), IncludeEmptyLists=True, IncludeNullItems=True)  # -> simplify(Tree)
_6_option_count = Python3Script(var_index_1=graft_15, vars_count_1=lng_15, init_branch_2=graft_17, var_index_2=graft_12, vars_count_2=lng_16)  # -> out, tree_1, tree_2; inputs var_index_1: tree of Int32, vars_count_1: Int32, init_branch_2: tree of Int32, var_index_2: tree of Int32, vars_count_2: Int32
# ---------- _6_option_count: Python ----------
"""
OPTION COUNTS SCRIPT
====================
Computes per-variant option counts from two-stage placement data.

For each variant v1 of furniture 1, counts how many stage-1 branches
used that variant (tree_1). For each combination (v1, v2), counts
how many stage-2 branches correspond to that pairing (tree_2).

Inputs:
    var_index_1:  Variant index for furniture 1 (Type: Generic, Access: Tree)
                  Each branch {i} has one item: which variant was placed
    vars_count_1: Total variant count for furniture 1 (Type: int, Access: Item)
    init_branch_2: Init branches for furniture 2 (Type: Generic, Access: Tree)
                   Each branch {i} has one item: which stage-1 branch it continues from
    var_index_2:  Variant index for furniture 2 (Type: Generic, Access: Tree)
                  Each branch {i} has one item: which variant was placed
    vars_count_2: Total variant count for furniture 2 (Type: int, Access: Item)

Outputs:
    tree_1: Per variant v1 (branches {0}..{vars_count_1-1}), count of
            stage-1 branches that used variant v1
    tree_2: Per variant v1 (branches {0}..{vars_count_1-1}), list of
            vars_count_2 counts for each v2
"""

import Grasshopper as gh
from Grasshopper import DataTree
from Grasshopper.Kernel.Data import GH_Path
import System

# =============================================================================
# HELPER FUNCTIONS
# =============================================================================

def safe_int(val):
    """Safely convert a value to int, handling GH wrapped types."""
    try:
        return int(val)
    except:
        return 0

def tree_to_flat_dict(tree):
    """
    Convert a DataTree where each branch {i} has one item
    into a dict: { branch_index: value }.
    """
    result = {}
    if tree is None:
        return result
    for i in range(tree.BranchCount):
        path = tree.Path(i)
        branch_items = tree.Branch(i)
        branch_idx = path.Indices[path.Length - 1]
        if branch_items.Count > 0:
            result[branch_idx] = safe_int(branch_items[0])
    return result

# =============================================================================
# INPUT VALIDATION
# =============================================================================

print("=" * 60)
print("OPTION COUNTS SCRIPT")
print("=" * 60)

if "vars_count_1" not in globals() or vars_count_1 is None:
    vars_count_1 = 0
if "vars_count_2" not in globals() or vars_count_2 is None:
    vars_count_2 = 0

vars_count_1 = safe_int(vars_count_1)
vars_count_2 = safe_int(vars_count_2)

print("vars_count_1: {}".format(vars_count_1))
print("vars_count_2: {}".format(vars_count_2))

vi1_dict = tree_to_flat_dict(var_index_1)
ib2_dict = tree_to_flat_dict(init_branch_2)
vi2_dict = tree_to_flat_dict(var_index_2)

print("var_index_1 branches: {}".format(len(vi1_dict)))
print("init_branch_2 branches: {}".format(len(ib2_dict)))
print("var_index_2 branches: {}".format(len(vi2_dict)))

# =============================================================================
# TREE_1: HISTOGRAM OF STAGE-1 VARIANT USAGE
# =============================================================================

print("")
print("-" * 40)
print("Computing tree_1 (stage-1 histogram)")
print("-" * 40)

counts_1 = [0] * vars_count_1

for branch_idx, v1 in vi1_dict.items():
    if 0 <= v1 < vars_count_1:
        counts_1[v1] += 1
    else:
        print("WARNING: var_index_1[{}] = {} out of range [0, {})".format(
            branch_idx, v1, vars_count_1))

tree_1 = DataTree[System.Object]()

for v1 in range(vars_count_1):
    path = GH_Path(v1)
    tree_1.Add(counts_1[v1], path)
    print("  tree_1 branch {{{}}}: count = {}".format(v1, counts_1[v1]))

# =============================================================================
# TREE_2: CROSS-TABULATION OF (v1, v2) COUNTS
# =============================================================================

print("")
print("-" * 40)
print("Computing tree_2 (cross-tabulation)")
print("-" * 40)

counts_2 = [[0] * vars_count_2 for _ in range(vars_count_1)]

for s2_branch, s1_branch in ib2_dict.items():
    if s1_branch not in vi1_dict:
        print("WARNING: stage-2 branch {} references stage-1 branch {} "
              "which has no var_index_1".format(s2_branch, s1_branch))
        continue

    v1 = vi1_dict[s1_branch]

    if s2_branch not in vi2_dict:
        print("WARNING: stage-2 branch {} has no var_index_2".format(s2_branch))
        continue

    v2 = vi2_dict[s2_branch]

    if v1 < 0 or v1 >= vars_count_1:
        print("WARNING: v1={} out of range for stage-2 branch {}".format(v1, s2_branch))
        continue
    if v2 < 0 or v2 >= vars_count_2:
        print("WARNING: v2={} out of range for stage-2 branch {}".format(v2, s2_branch))
        continue

    counts_2[v1][v2] += 1

tree_2 = DataTree[System.Object]()

for v1 in range(vars_count_1):
    path = GH_Path(v1)
    row_str = []
    for v2 in range(vars_count_2):
        tree_2.Add(counts_2[v1][v2], path)
        row_str.append(str(counts_2[v1][v2]))
    print("  tree_2 branch {{{}}}: [{}]".format(v1, ", ".join(row_str)))

# =============================================================================
# SUMMARY
# =============================================================================

print("")
print("=" * 60)
print("SUMMARY")
print("=" * 60)
print("tree_1: {} branches, {} items".format(tree_1.BranchCount, tree_1.DataCount))
print("tree_2: {} branches, {} items".format(tree_2.BranchCount, tree_2.DataCount))

total_s1 = sum(counts_1)
total_s2 = sum(sum(row) for row in counts_2)
print("Total stage-1 placements counted: {}".format(total_s1))
print("Total stage-2 placements counted: {}".format(total_s2))
print("=" * 60)
# ---------- end _6_option_count ----------
num_var_liv_1 = Data(_6_option_count.tree_1)
num_var_liv_2 = Data(_6_option_count.tree_2)
num_var_liv_1_2 = Data(num_var_liv_1)
num_var_liv_2_2 = Data(num_var_liv_2)
panel_52 = Panel(num_var_liv_1)
panel_53 = Panel(num_var_liv_2)
# LIVING ROOM
graft_18 = GraftTree(Tree=flatten(py3_2.branch_indices), IncludeEmptyLists=True, IncludeNullItems=True)  # -> simplify(Tree)
_2801_placement_4 = Python3Script(
    room_full=inp1_4,
    room_rdc=inp2_3,
    walls=inp3_8,
    walls_must=Toggle(True),
    wall_crv=wall_crv_16,
    furn_index=series_16,
    big_bb_input=big_bb_16,
    small_bb_input=small_bb_16,
    subdivs=20,
    multiplier=1.4,
    offset_distance=0.3)  # -> out, result_room_full, result_room_rdc, result_initial, result_index_furn, result_transformation_data, final_fitting_curve_out, new_plane_startpoint; inputs room_full: list of Curve, room_rdc: list of Curve, walls: list of Curve, walls_must: Boolean, wall_crv: list of Curve, furn_index: list of Int32, big_bb_input: list of Curve, small_bb_input: list of Curve, subdivs: Int32, multiplier: Double, offset_distance: Double; same code as _2801_placement
panel_54 = Panel(graft_18)
null_18 = NullItem(Item=_2801_placement_2.result_room_rdc)  # -> NullFlags, InvalidFlags, Description
results_1_indexes_furniture_var = Data(_2801_placement.result_index_furn)
results_1_indexes_furniture_var_2 = Data(_2801_placement_3.result_index_furn)
results_transformation_data = Data(_2801_placement.result_transformation_data)
results_transformation_data_2 = Data(_2801_placement_3.result_transformation_data)
py3_4 = Python3Script(input_data=_2801_placement_2.result_room_full, mode=0)  # -> out, branch_indices, item_indices, paths, data_out; inputs input_data: tree, mode: Int32; same code as py3_2
cull_21 = CullPattern(List=_2801_placement_2.result_room_full, CullPattern=invert(null_18.NullFlags))
cull_22 = CullPattern(List=_2801_placement_2.result_room_rdc, CullPattern=invert(null_18.NullFlags))
cull_23 = CullPattern(List=_2801_placement_2.result_initial, CullPattern=invert(null_18.NullFlags))
cull_24 = CullPattern(List=_2801_placement_2.result_index_furn, CullPattern=invert(null_18.NullFlags))
cull_25 = CullPattern(List=_2801_placement_2.result_transformation_data, CullPattern=invert(null_18.NullFlags))
clean_9 = CleanTree(RemoveNulls=True, RemoveInvalid=True, RemoveEmpty=False, Tree=flatten(_2801_placement_3.result_room_full))
item_31 = ListItem(List=result_details_3, Index=results_1_indexes_furniture_var, Wrap=True)
item_32 = ListItem(List=result_details_4, Index=results_1_indexes_furniture_var_2, Wrap=True)
panel_55 = Panel(_2801_placement_3.result_index_furn)
null_19 = NullItem(Item=clean_9)  # -> NullFlags, InvalidFlags, Description
graft_19 = GraftTree(Tree=flatten(cull_22), IncludeEmptyLists=True, IncludeNullItems=True)  # -> simplify(Tree)
inp2_5 = Data(graft_19)
graft_20 = GraftTree(Tree=flatten(cull_24), IncludeEmptyLists=True, IncludeNullItems=True)  # -> simplify(Tree)
graft_21 = GraftTree(Tree=flatten(cull_21), IncludeEmptyLists=True, IncludeNullItems=True)  # -> simplify(Tree)
inp1_6 = Data(graft_21)
_2801_placement_5 = Python3Script(
    room_full=inp1_6,
    room_rdc=inp2_5,
    walls=inp3_6,
    walls_must=Toggle(True),
    wall_crv=wall_crv_6,
    furn_index=series_6,
    big_bb_input=big_bb_6,
    small_bb_input=small_bb_6,
    subdivs=20,
    multiplier=1.4,
    offset_distance=0.3)  # -> out, result_room_full, result_room_rdc, result_initial, result_index_furn, result_transformation_data, final_fitting_curve_out, new_plane_startpoint; inputs room_full: list of Curve, room_rdc: list of Curve, walls: list of Curve, walls_must: Boolean, wall_crv: list of Curve, furn_index: list of Int32, big_bb_input: list of Curve, small_bb_input: list of Curve, subdivs: Int32, multiplier: Double, offset_distance: Double; same code as _2801_placement
null_20 = NullItem(Item=_2801_placement_5.result_room_rdc)  # -> NullFlags, InvalidFlags, Description
py3_5 = Python3Script(input_data=_2801_placement_5.result_room_full, mode=0)  # -> out, branch_indices, item_indices, paths, data_out; inputs input_data: tree, mode: Int32; same code as py3_2
cull_26 = CullPattern(List=_2801_placement_5.result_room_full, CullPattern=invert(null_20.NullFlags))
cull_27 = CullPattern(List=_2801_placement_5.result_room_rdc, CullPattern=invert(null_20.NullFlags))
cull_28 = CullPattern(List=_2801_placement_5.result_initial, CullPattern=invert(null_20.NullFlags))
cull_29 = CullPattern(List=_2801_placement_5.result_index_furn, CullPattern=invert(null_20.NullFlags))
cull_30 = CullPattern(List=_2801_placement_5.result_transformation_data, CullPattern=invert(null_20.NullFlags))
graft_22 = GraftTree(Tree=flatten(cull_28), IncludeEmptyLists=True, IncludeNullItems=True)  # -> simplify(Tree)
graft_23 = GraftTree(Tree=flatten(cull_26), IncludeEmptyLists=True, IncludeNullItems=True)  # -> simplify(Tree)
inp1_7 = Data(graft_23)
graft_24 = GraftTree(Tree=flatten(cull_27), IncludeEmptyLists=True, IncludeNullItems=True)  # -> simplify(Tree)
inp2_6 = Data(graft_24)
_2801_placement_6 = Python3Script(
    room_full=inp1_7,
    room_rdc=inp2_6,
    walls=inp3_5,
    walls_must=Toggle(True),
    wall_crv=wall_crv_5,
    furn_index=series_5,
    big_bb_input=big_bb_5,
    small_bb_input=small_bb_5,
    subdivs=20,
    multiplier=1.4,
    offset_distance=0.3)  # -> out, result_room_full, result_room_rdc, result_initial, result_index_furn, result_transformation_data, final_fitting_curve_out, new_plane_startpoint; inputs room_full: list of Curve, room_rdc: list of Curve, walls: list of Curve, walls_must: Boolean, wall_crv: list of Curve, furn_index: list of Int32, big_bb_input: list of Curve, small_bb_input: list of Curve, subdivs: Int32, multiplier: Double, offset_distance: Double; same code as _2801_placement
null_21 = NullItem(Item=_2801_placement_6.result_room_rdc)  # -> NullFlags, InvalidFlags, Description
py3_6 = Python3Script(input_data=_2801_placement_6.result_room_full, mode=0)  # -> out, branch_indices, item_indices, paths, data_out; inputs input_data: tree, mode: Int32; same code as py3_2
cull_31 = CullPattern(List=_2801_placement_6.result_room_full, CullPattern=invert(null_21.NullFlags))
cull_32 = CullPattern(List=_2801_placement_6.result_room_rdc, CullPattern=invert(null_21.NullFlags))
cull_33 = CullPattern(List=_2801_placement_6.result_initial, CullPattern=invert(null_21.NullFlags))
cull_34 = CullPattern(List=_2801_placement_6.result_index_furn, CullPattern=invert(null_21.NullFlags))
cull_35 = CullPattern(List=_2801_placement_6.result_transformation_data, CullPattern=invert(null_21.NullFlags))
graft_25 = GraftTree(Tree=flatten(cull_31), IncludeEmptyLists=True, IncludeNullItems=True)  # -> simplify(Tree)
graft_26 = GraftTree(Tree=flatten(cull_32), IncludeEmptyLists=True, IncludeNullItems=True)  # -> simplify(Tree)
graft_27 = GraftTree(Tree=flatten(cull_33), IncludeEmptyLists=True, IncludeNullItems=True)  # -> simplify(Tree)
graft_28 = GraftTree(Tree=flatten(cull_34), IncludeEmptyLists=True, IncludeNullItems=True)  # -> simplify(Tree)
graft_29 = GraftTree(Tree=flatten(cull_35), IncludeEmptyLists=True, IncludeNullItems=True)  # -> simplify(Tree)
graft_30 = GraftTree(Tree=flatten(cull_29), IncludeEmptyLists=True, IncludeNullItems=True)  # -> simplify(Tree)
graft_31 = GraftTree(Tree=flatten(cull_30), IncludeEmptyLists=True, IncludeNullItems=True)  # -> simplify(Tree)
graft_32 = GraftTree(Tree=flatten(py3_6.branch_indices), IncludeEmptyLists=True, IncludeNullItems=True)  # -> simplify(Tree)
graft_33 = GraftTree(Tree=flatten(py3_5.branch_indices), IncludeEmptyLists=True, IncludeNullItems=True)  # -> simplify(Tree)
_6_option_count_2 = Python3Script(
    var_index_1=graft_20,
    vars_count_1=lng_22,
    init_branch_2=graft_33,
    var_index_2=graft_30,
    vars_count_2=lng_21,
    init_branch_3=graft_32,
    var_index_3=graft_28,
    vars_count_3=lng_20)  # -> out, tree_1, tree_2, tree_3; inputs var_index_1: tree of Int32, vars_count_1: Int32, init_branch_2: tree of Int32, var_index_2: tree of Int32, vars_count_2: Int32, init_branch_3: tree of Int32, var_index_3: tree of Int32, vars_count_3: Int32
# ---------- _6_option_count_2: Python ----------
"""
OPTION COUNTS SCRIPT (THREE STAGES)
=====================================
Computes per-variant option counts from three-stage placement data.

For each variant v1 of furniture 1, counts how many stage-1 branches
used that variant (tree_1). For each combination (v1, v2), counts
how many stage-2 branches correspond (tree_2). For each combination
(v1, v3), counts how many stage-3 branches correspond (tree_3),
tracing back through stage 2 to stage 1.

Inputs:
    var_index_1:   Variant index for furniture 1 (Type: Generic, Access: Tree)
    vars_count_1:  Total variant count for furniture 1 (Type: int, Access: Item)
    init_branch_2: Init branches for furniture 2 (Type: Generic, Access: Tree)
    var_index_2:   Variant index for furniture 2 (Type: Generic, Access: Tree)
    vars_count_2:  Total variant count for furniture 2 (Type: int, Access: Item)
    init_branch_3: Init branches for furniture 3 (Type: Generic, Access: Tree)
    var_index_3:   Variant index for furniture 3 (Type: Generic, Access: Tree)
    vars_count_3:  Total variant count for furniture 3 (Type: int, Access: Item)

Outputs:
    tree_1: Per variant v1, count of stage-1 branches that used v1
    tree_2: Per variant v1, list of vars_count_2 counts for each v2
    tree_3: Per variant v1, list of vars_count_3 counts for each v3
"""

import Grasshopper as gh
from Grasshopper import DataTree
from Grasshopper.Kernel.Data import GH_Path
import System

# =============================================================================
# HELPER FUNCTIONS
# =============================================================================

def safe_int(val):
    """Safely convert a value to int, handling GH wrapped types."""
    try:
        return int(val)
    except:
        return 0

def tree_to_flat_dict(tree):
    """
    Convert a DataTree where each branch {i} has one item
    into a dict: { branch_index: value }.
    """
    result = {}
    if tree is None:
        return result
    for i in range(tree.BranchCount):
        path = tree.Path(i)
        branch_items = tree.Branch(i)
        branch_idx = path.Indices[path.Length - 1]
        if branch_items.Count > 0:
            result[branch_idx] = safe_int(branch_items[0])
    return result

# =============================================================================
# INPUT VALIDATION
# =============================================================================

print("=" * 60)
print("OPTION COUNTS SCRIPT (THREE STAGES)")
print("=" * 60)

if "vars_count_1" not in globals() or vars_count_1 is None:
    vars_count_1 = 0
if "vars_count_2" not in globals() or vars_count_2 is None:
    vars_count_2 = 0
if "vars_count_3" not in globals() or vars_count_3 is None:
    vars_count_3 = 0

vars_count_1 = safe_int(vars_count_1)
vars_count_2 = safe_int(vars_count_2)
vars_count_3 = safe_int(vars_count_3)

print("vars_count_1: {}".format(vars_count_1))
print("vars_count_2: {}".format(vars_count_2))
print("vars_count_3: {}".format(vars_count_3))

vi1_dict = tree_to_flat_dict(var_index_1)
ib2_dict = tree_to_flat_dict(init_branch_2)
vi2_dict = tree_to_flat_dict(var_index_2)
ib3_dict = tree_to_flat_dict(init_branch_3)
vi3_dict = tree_to_flat_dict(var_index_3)

print("var_index_1 branches: {}".format(len(vi1_dict)))
print("init_branch_2 branches: {}".format(len(ib2_dict)))
print("var_index_2 branches: {}".format(len(vi2_dict)))
print("init_branch_3 branches: {}".format(len(ib3_dict)))
print("var_index_3 branches: {}".format(len(vi3_dict)))

# =============================================================================
# TREE_1: HISTOGRAM OF STAGE-1 VARIANT USAGE
# =============================================================================

print("")
print("-" * 40)
print("Computing tree_1 (stage-1 histogram)")
print("-" * 40)

counts_1 = [0] * vars_count_1

for branch_idx, v1 in vi1_dict.items():
    if 0 <= v1 < vars_count_1:
        counts_1[v1] += 1
    else:
        print("WARNING: var_index_1[{}] = {} out of range [0, {})".format(
            branch_idx, v1, vars_count_1))

tree_1 = DataTree[System.Object]()

for v1 in range(vars_count_1):
    path = GH_Path(v1)
    tree_1.Add(counts_1[v1], path)
    print("  tree_1 branch {{{}}}: count = {}".format(v1, counts_1[v1]))

# =============================================================================
# TREE_2: CROSS-TABULATION OF (v1, v2) COUNTS
# =============================================================================

print("")
print("-" * 40)
print("Computing tree_2 (stage-2 cross-tabulation)")
print("-" * 40)

counts_2 = [[0] * vars_count_2 for _ in range(vars_count_1)]

for s2_branch, s1_branch in ib2_dict.items():
    if s1_branch not in vi1_dict:
        print("WARNING: stage-2 branch {} references stage-1 branch {} "
              "which has no var_index_1".format(s2_branch, s1_branch))
        continue

    v1 = vi1_dict[s1_branch]

    if s2_branch not in vi2_dict:
        print("WARNING: stage-2 branch {} has no var_index_2".format(s2_branch))
        continue

    v2 = vi2_dict[s2_branch]

    if v1 < 0 or v1 >= vars_count_1:
        print("WARNING: v1={} out of range for stage-2 branch {}".format(v1, s2_branch))
        continue
    if v2 < 0 or v2 >= vars_count_2:
        print("WARNING: v2={} out of range for stage-2 branch {}".format(v2, s2_branch))
        continue

    counts_2[v1][v2] += 1

tree_2 = DataTree[System.Object]()

for v1 in range(vars_count_1):
    path = GH_Path(v1)
    row_str = []
    for v2 in range(vars_count_2):
        tree_2.Add(counts_2[v1][v2], path)
        row_str.append(str(counts_2[v1][v2]))
    print("  tree_2 branch {{{}}}: [{}]".format(v1, ", ".join(row_str)))

# =============================================================================
# TREE_3: CROSS-TABULATION OF (v1, v3) COUNTS
# Traces stage-3 branches back through stage-2 to stage-1 variant
# =============================================================================

print("")
print("-" * 40)
print("Computing tree_3 (stage-3 cross-tabulation)")
print("-" * 40)

counts_3 = [[0] * vars_count_3 for _ in range(vars_count_1)]

for s3_branch, s2_branch in ib3_dict.items():
    # Trace back: stage-3 -> stage-2 -> stage-1
    if s2_branch not in ib2_dict:
        print("WARNING: stage-3 branch {} references stage-2 branch {} "
              "which has no init_branch_2".format(s3_branch, s2_branch))
        continue

    s1_branch = ib2_dict[s2_branch]

    if s1_branch not in vi1_dict:
        print("WARNING: stage-3 branch {} traces back to stage-1 branch {} "
              "which has no var_index_1".format(s3_branch, s1_branch))
        continue

    v1 = vi1_dict[s1_branch]

    if s3_branch not in vi3_dict:
        print("WARNING: stage-3 branch {} has no var_index_3".format(s3_branch))
        continue

    v3 = vi3_dict[s3_branch]

    if v1 < 0 or v1 >= vars_count_1:
        print("WARNING: v1={} out of range for stage-3 branch {}".format(v1, s3_branch))
        continue
    if v3 < 0 or v3 >= vars_count_3:
        print("WARNING: v3={} out of range for stage-3 branch {}".format(v3, s3_branch))
        continue

    counts_3[v1][v3] += 1

tree_3 = DataTree[System.Object]()

for v1 in range(vars_count_1):
    path = GH_Path(v1)
    row_str = []
    for v3 in range(vars_count_3):
        tree_3.Add(counts_3[v1][v3], path)
        row_str.append(str(counts_3[v1][v3]))
    print("  tree_3 branch {{{}}}: [{}]".format(v1, ", ".join(row_str)))

# =============================================================================
# SUMMARY
# =============================================================================

print("")
print("=" * 60)
print("SUMMARY")
print("=" * 60)
print("tree_1: {} branches, {} items".format(tree_1.BranchCount, tree_1.DataCount))
print("tree_2: {} branches, {} items".format(tree_2.BranchCount, tree_2.DataCount))
print("tree_3: {} branches, {} items".format(tree_3.BranchCount, tree_3.DataCount))

total_s1 = sum(counts_1)
total_s2 = sum(sum(row) for row in counts_2)
total_s3 = sum(sum(row) for row in counts_3)
print("Total stage-1 placements counted: {}".format(total_s1))
print("Total stage-2 placements counted: {}".format(total_s2))
print("Total stage-3 placements counted: {}".format(total_s3))
print("=" * 60)
# ---------- end _6_option_count_2 ----------
num_var_bat_1 = Data(_6_option_count_2.tree_1)
number_7 = Number(num_var_bat_1)
num_var_chi_1 = Integer(number_7)
equality = Equality(FirstNumber=num_var_chi_1, SecondNumber="0")  # -> Equality, Inequality
dispatch_17 = Dispatch(List=num_var_chi_1, DispatchPattern=equality.Equality)  # -> ListA, ListB
dispatch_18 = Dispatch(List=graft_tree_2, DispatchPattern=equality.Equality)  # -> ListA, ListB
integer = Integer(dispatch_17.ListB)
integer_2 = Integer(dispatch_17.ListA)
point_57 = Point(dispatch_18.ListB)
point_58 = Point(dispatch_18.ListA)
square_root = SquareRoot(Value=integer)
gradient = Gradient(
    LowerLimit="8",
    UpperLimit="1",
    Parameter=integer,
    stops=[0: RGB(234, 38, 0), 0.5: RGB(254, 244, 84), 1: RGB(75, 107, 169)])
division_7 = Division(A=square_root, B="5")
circle = Circle(Plane=point_57, Radius=division_7)
surface_31 = Surface(circle)
move_48 = Move(Geometry=point_57, Motion=unit_z_15)  # -> Geometry, Transform
justifiedtext3d_6 = JustifiedText3d(
    Location=move_48.Geometry,
    Text=integer,
    Size="0.5",
    Color=ColourSwatch(SwatchColor=RGB(0, 0, 0)),
    HorizontalAlignment=1,
    VerticalAlginment=1,
    UseMeshes=False,
    Bake=False)
custom_preview_32 = CustomPreview(Geometry=surface_31, Material=gradient)
symbol_display = SymbolDisplay(Location=point_58, Display=symbol_simple_2)
num_var_bat_2 = Data(_6_option_count_2.tree_2)
number_8 = Number(num_var_bat_2)
num_var_chi_2 = Integer(number_8)
equality_2 = Equality(FirstNumber=num_var_chi_2, SecondNumber="0")  # -> Equality, Inequality
panel_56 = Panel(equality_2.Equality)
dispatch_19 = Dispatch(List=num_var_chi_2, DispatchPattern=equality_2.Equality)  # -> ListA, ListB
dispatch_20 = Dispatch(List=point_31, DispatchPattern=equality_2.Equality)  # -> ListA, ListB
integer_3 = Integer(dispatch_19.ListB)
integer_4 = Integer(dispatch_19.ListA)
point_59 = Point(dispatch_20.ListB)
point_60 = Point(dispatch_20.ListA)
square_root_2 = SquareRoot(Value=integer_3)
gradient_2 = Gradient(
    LowerLimit="30",
    UpperLimit="1",
    Parameter=integer_3,
    stops=[0: RGB(234, 38, 0), 0.5: RGB(254, 244, 84), 1: RGB(75, 107, 169)])
division_8 = Division(A=square_root_2, B="15")
circle_2 = Circle(Plane=point_59, Radius=division_8)
surface_32 = Surface(circle_2)
move_49 = Move(Geometry=point_59, Motion=unit_z_16)  # -> Geometry, Transform
justifiedtext3d_7 = JustifiedText3d(
    Location=move_49.Geometry,
    Text=integer_3,
    Size="0.5",
    Color=ColourSwatch(SwatchColor=RGB(0, 0, 0)),
    HorizontalAlignment=1,
    VerticalAlginment=1,
    UseMeshes=False,
    Bake=False)
symbol_display_2 = SymbolDisplay(Location=point_60, Display=symbol_simple_5)
custom_preview_33 = CustomPreview(Geometry=surface_32, Material=gradient_2)
num_var_bat_3 = Data(_6_option_count_2.tree_3)
number_9 = Number(num_var_bat_3)
num_var_chi_2_2 = Integer(number_9)
equality_3 = Equality(FirstNumber=num_var_chi_2_2, SecondNumber="0")  # -> Equality, Inequality
panel_57 = Panel(equality_3.Equality)
dispatch_21 = Dispatch(List=num_var_chi_2_2, DispatchPattern=equality_3.Equality)  # -> ListA, ListB
dispatch_22 = Dispatch(List=point_33, DispatchPattern=equality_3.Equality)  # -> ListA, ListB
integer_5 = Integer(dispatch_21.ListB)
integer_6 = Integer(dispatch_21.ListA)
point_61 = Point(dispatch_22.ListB)
point_62 = Point(dispatch_22.ListA)
square_root_3 = SquareRoot(Value=integer_5)
gradient_3 = Gradient(
    LowerLimit="30",
    UpperLimit="1",
    Parameter=integer_5,
    stops=[0: RGB(234, 38, 0), 0.5: RGB(254, 244, 84), 1: RGB(75, 107, 169)])
division_9 = Division(A=square_root_3, B="15")
circle_3 = Circle(Plane=point_61, Radius=division_9)
surface_33 = Surface(circle_3)
move_50 = Move(Geometry=point_61, Motion=unit_z_17)  # -> Geometry, Transform
justifiedtext3d_8 = JustifiedText3d(
    Location=move_50.Geometry,
    Text=integer_5,
    Size="0.5",
    Color=ColourSwatch(SwatchColor=RGB(0, 0, 0)),
    HorizontalAlignment=1,
    VerticalAlginment=1,
    UseMeshes=False,
    Bake=False)
symbol_display_3 = SymbolDisplay(Location=point_62, Display=symbol_simple_6)
custom_preview_34 = CustomPreview(Geometry=surface_33, Material=gradient_3)
num_var_bat_3_2 = Data(num_var_bat_3)
num_var_bat_1_2 = Data(num_var_bat_1)
num_var_bat_2_2 = Data(num_var_bat_2)
graft_34 = GraftTree(Tree=flatten(cull_23), IncludeEmptyLists=True, IncludeNullItems=True)  # -> simplify(Tree)
graft_35 = GraftTree(Tree=flatten(cull_25), IncludeEmptyLists=True, IncludeNullItems=True)  # -> simplify(Tree)
transform = Transform(Geometry=item_31, Transform=results_transformation_data)
transform_2 = Transform(Geometry=item_32, Transform=results_transformation_data_2)
graft_36 = GraftTree(Tree=flatten(py3_4.branch_indices), IncludeEmptyLists=True, IncludeNullItems=True)  # -> simplify(Tree)
lng_63 = ListLength(List=_2801_placement_3.result_room_full)
item_33 = ListItem(List=item_31, Index=0, Wrap=True)
null_22 = NullItem(Item=_2801_placement_4.result_room_rdc)  # -> NullFlags, InvalidFlags, Description
graft_37 = GraftTree(Tree=transform, IncludeEmptyLists=True, IncludeNullItems=True)
repeat_7 = RepeatData(Data=graft_37, Length=lng_63)
cull_36 = CullPattern(List=_2801_placement_4.result_room_full, CullPattern=invert(null_22.NullFlags))
cull_37 = CullPattern(List=_2801_placement_4.result_room_rdc, CullPattern=invert(null_22.NullFlags))
cull_38 = CullPattern(List=_2801_placement_4.result_initial, CullPattern=invert(null_22.NullFlags))
cull_39 = CullPattern(List=_2801_placement_4.result_index_furn, CullPattern=invert(null_22.NullFlags))
cull_40 = CullPattern(List=_2801_placement_4.result_transformation_data, CullPattern=invert(null_22.NullFlags))
cull_41 = CullPattern(CullPattern=invert(null_22.NullFlags))
py3_7 = Python3Script(input_data=_2801_placement_4.result_room_full, mode=0)  # -> out, branch_indices, item_indices, paths, data_out; inputs input_data: tree, mode: Int32; same code as py3_2
results_1_indexes_furniture_var_3 = Data(_2801_placement_2.result_index_furn)
results_transformation_data_3 = Data(_2801_placement_2.result_transformation_data)
graft_38 = GraftTree(Tree=flatten(cull_37), IncludeEmptyLists=True, IncludeNullItems=True)  # -> simplify(Tree)
graft_39 = GraftTree(Tree=flatten(cull_39), IncludeEmptyLists=True, IncludeNullItems=True)  # -> simplify(Tree)
data = Data(graft_39)
_6a_option_count = Python3Script(var_index=data, vars_count=lng_50)  # -> out, tree_1; inputs var_index: tree of Int32, vars_count: Int32
# ---------- _6a_option_count: Python ----------
"""
OPTION COUNTS SCRIPT (SINGLE STAGE)
====================================
Computes per-variant option counts from a single placement stage.

For each variant v, counts how many branches used that variant.

Inputs:
    var_index:  Variant index for furniture (Type: Generic, Access: Tree)
                Each branch {i} has one item: which variant was placed
    vars_count: Total variant count (Type: int, Access: Item)

Outputs:
    tree_1: Per variant v (branches {0}..{vars_count-1}), count of
            branches that used variant v
"""

import Grasshopper as gh
from Grasshopper import DataTree
from Grasshopper.Kernel.Data import GH_Path
import System

# =============================================================================
# HELPER FUNCTIONS
# =============================================================================

def safe_int(val):
    """Safely convert a value to int, handling GH wrapped types."""
    try:
        return int(val)
    except:
        return 0

def tree_to_flat_dict(tree):
    """
    Convert a DataTree where each branch {i} has one item
    into a dict: { branch_index: value }.
    """
    result = {}
    if tree is None:
        return result
    for i in range(tree.BranchCount):
        path = tree.Path(i)
        branch_items = tree.Branch(i)
        branch_idx = path.Indices[path.Length - 1]
        if branch_items.Count > 0:
            result[branch_idx] = safe_int(branch_items[0])
    return result

# =============================================================================
# INPUT VALIDATION
# =============================================================================

print("=" * 60)
print("OPTION COUNTS SCRIPT (SINGLE STAGE)")
print("=" * 60)

if "vars_count" not in globals() or vars_count is None:
    vars_count = 0

vars_count = safe_int(vars_count)

print("vars_count: {}".format(vars_count))

vi_dict = tree_to_flat_dict(var_index)

print("var_index branches: {}".format(len(vi_dict)))

# =============================================================================
# TREE_1: HISTOGRAM OF VARIANT USAGE
# =============================================================================

print("")
print("-" * 40)
print("Computing tree_1 (variant histogram)")
print("-" * 40)

counts = [0] * vars_count

for branch_idx, v in vi_dict.items():
    if 0 <= v < vars_count:
        counts[v] += 1
    else:
        print("WARNING: var_index[{}] = {} out of range [0, {})".format(
            branch_idx, v, vars_count))

tree_1 = DataTree[System.Object]()

for v in range(vars_count):
    path = GH_Path(v)
    tree_1.Add(counts[v], path)
    print("  tree_1 branch {{{}}}: count = {}".format(v, counts[v]))

# =============================================================================
# SUMMARY
# =============================================================================

print("")
print("=" * 60)
print("SUMMARY")
print("=" * 60)
print("tree_1: {} branches, {} items".format(tree_1.BranchCount, tree_1.DataCount))
print("Total placements counted: {}".format(sum(counts)))
print("=" * 60)
# ---------- end _6a_option_count ----------
num_var_kit_1 = Data(_6a_option_count.tree_1)
graft_40 = GraftTree(Tree=flatten(cull_36), IncludeEmptyLists=True, IncludeNullItems=True)  # -> simplify(Tree)
graft_41 = GraftTree(Tree=flatten(cull_38), IncludeEmptyLists=True, IncludeNullItems=True)  # -> simplify(Tree)
graft_42 = GraftTree(Tree=flatten(cull_40), IncludeEmptyLists=True, IncludeNullItems=True)  # -> simplify(Tree)
graft_43 = GraftTree(Tree=flatten(cull_41), IncludeEmptyLists=True, IncludeNullItems=True)  # -> simplify(Tree)
results_1_indexes_furniture_var_4 = Data(_2801_placement_5.result_index_furn)
results_transformation_data_4 = Data(_2801_placement_5.result_transformation_data)
results_1_indexes_furniture_var_5 = Data(_2801_placement_6.result_index_furn)
flatten_9 = FlattenTree(Tree=repeat_7, Path="{0}")
flatten_10 = FlattenTree(Tree=transform_2, Path="{0}")
results_transformation_data_5 = Data(_2801_placement_6.result_transformation_data)
filter_24 = StreamFilter(Gate=null_19.NullFlags, Stream0=flatten_9, Stream1=transform)
graft_44 = GraftTree(Tree=flatten(py3_7.branch_indices), IncludeEmptyLists=True, IncludeNullItems=True)  # -> simplify(Tree)
item_34 = ListItem(List=result_details_5, Index=results_1_indexes_furniture_var_3, Wrap=True)
item_35 = ListItem(List=result_details_6, Index=results_1_indexes_furniture_var_4, Wrap=True)
item_36 = ListItem(List=filter_24, Index=number_slider_22, Wrap=True)
item_37 = ListItem(List=result_details_7, Index=results_1_indexes_furniture_var_5, Wrap=True)
transform_3 = Transform(Geometry=item_34, Transform=results_transformation_data_3)
item_38 = ListItem(List=transform_3, Index=Slider(0, range=0..5), Wrap=True)
item_39 = ListItem(List=flatten_10, Index=number_slider_22, Wrap=True)
lng_64 = ListLength(List=_2801_placement_5.result_room_full)
clean_10 = CleanTree(RemoveNulls=True, RemoveInvalid=True, RemoveEmpty=False, Tree=flatten(_2801_placement_5.result_room_full))
transform_4 = Transform(Geometry=item_35, Transform=results_transformation_data_4)
transform_5 = Transform(Geometry=item_37, Transform=results_transformation_data_5)
graft_45 = GraftTree(Tree=transform_3, IncludeEmptyLists=True, IncludeNullItems=True)
clean_11 = CleanTree(RemoveNulls=True, RemoveInvalid=True, RemoveEmpty=False, Tree=flatten(_2801_placement_6.result_room_full))
item_40 = ListItem(List=item_35, Index=0, Wrap=True)
lng_65 = ListLength(List=_2801_placement_6.result_room_full)
null_23 = NullItem(Item=clean_10)  # -> NullFlags, InvalidFlags, Description
repeat_8 = RepeatData(Data=graft_45, Length=lng_64)
graft_46 = GraftTree(Tree=transform_4, IncludeEmptyLists=True, IncludeNullItems=True)
null_24 = NullItem(Item=clean_11)  # -> NullFlags, InvalidFlags, Description
repeat_9 = RepeatData(Data=graft_46, Length=lng_65)
filter_25 = StreamFilter(Gate=null_23.NullFlags, Stream0=repeat_8, Stream1=graft_45)
tbranch_5 = TreeBranch(Tree=transform_5, Path=number_slider_24, MaintainPaths=True, SplitTree=False)
filter_26 = StreamFilter(Gate=null_24.NullFlags, Stream0=repeat_9, Stream1=graft_46)
graft_47 = GraftTree(Tree=filter_25, IncludeEmptyLists=True, IncludeNullItems=True)
flatten_11 = FlattenTree(Tree=graft_47, Path="{0}")
flatten_12 = FlattenTree(Tree=graft_46, Path="{0}")
clean_12 = CleanTree(RemoveNulls=True, RemoveInvalid=True, RemoveEmpty=False, Tree=flatten(filter_26))
lng_66 = ListLength(List=filter_26)
panel_58 = Panel(null_24.NullFlags)
item_41 = ListItem(List=flatten_11, Index=number_slider_24, Wrap=True)
item_42 = ListItem(List=flatten_12, Index=number_slider_24, Wrap=True)
repeat_10 = RepeatData(Data=graft_47, Length=lng_66)
null_25 = NullItem(Item=clean_12)  # -> NullFlags, InvalidFlags, Description
panel_59 = Panel(graft_47)
filter_27 = StreamFilter(Gate=null_25.NullFlags, Stream0=repeat_10, Stream1=graft_47)
branch = TreeBranch(Tree=graft_47, MaintainPaths=True)
results_1_indexes_furniture_var_6 = Data(_2801_placement_4.result_index_furn)
results_transformation_data_6 = Data(_2801_placement_4.result_transformation_data)
item_43 = ListItem(List=result_details_16, Index=results_1_indexes_furniture_var_6, Wrap=True)
transform_6 = Transform(Geometry=item_43, Transform=results_transformation_data_6)
flatten_13 = FlattenTree(Tree=transform_5, Path="{0}")
flatten_14 = FlattenTree(Tree=repeat_9, Path="{0}")
graft_48 = GraftTree(Tree=transform_6, IncludeEmptyLists=True, IncludeNullItems=True)
flatten_15 = FlattenTree(Tree=filter_27, Path="{0}")

room_10 = Curve(simplify_5)
item_44 = ListItem(List=room_10, Index=Slider(0, range=0..4), Wrap=True)
polyoffset_15 = PolylineOffset(
    Polylines=item_44,
    Distance="0.05",
    Plane=Plane(origin=(0, 0, 0), x=(0, 0, 0), y=(0, 0, 0)),
    Tolerance=0.01,
    ClosedFillet=1,
    OpenFillet=1,
    Miter=2)  # -> Contour, Holes
inner_walls_contour_6 = Curve(graft(polyoffset_15.Holes))
rdiff_5 = RegionDifference(CurvesA=inner_walls_contour_6, CurvesB=flatten(total_door_area))
sort_12 = SortList(Keys=rdiff_5, ValuesA=rdiff_5)  # -> Keys, reverse(ValuesA)
item_45 = ListItem(List=sort_12.ValuesA, Index=0, Wrap=True)
room_diff_5 = Curve(item_45)
room_diff_6 = Curve(room_diff_5)
room_11 = Curve(inner_walls_contour_6)

crv_11 = Curve(room_11)
null_26 = NullItem(Item=crv_11)  # -> NullFlags, InvalidFlags, Description
not_6 = GateNot(A=null_26.NullFlags)
merge_26 = Merge(Data1=flatten("Children 1"), Data2=flatten(not_6))
inp1_8 = Data(room_11)
inp2_7 = Data(room_diff_6)
inp3_9 = Data(inp1_8)
inp3_10 = Data(inp1_8)
_2801_placement_7 = Python3Script(
    room_full=inp1_8,
    room_rdc=inp2_7,
    walls=inp3_9,
    walls_must=Toggle(True),
    wall_crv=wall_crv_8,
    furn_index=series_8,
    big_bb_input=big_bb_8,
    small_bb_input=small_bb_8,
    subdivs=20,
    multiplier=1.4,
    offset_distance=0.3)  # -> out, result_room_full, result_room_rdc, result_initial, result_index_furn, result_transformation_data, final_fitting_curve_out, new_plane_startpoint; inputs room_full: list of Curve, room_rdc: list of Curve, walls: list of Curve, walls_must: Boolean, wall_crv: list of Curve, furn_index: list of Int32, big_bb_input: list of Curve, small_bb_input: list of Curve, subdivs: Int32, multiplier: Double, offset_distance: Double; same code as _2801_placement
null_27 = NullItem(Item=_2801_placement_7.result_room_rdc)  # -> NullFlags, InvalidFlags, Description
py3_8 = Python3Script(input_data=_2801_placement_7.result_room_full, mode=0)  # -> out, branch_indices, item_indices, paths, data_out; inputs input_data: tree, mode: Int32; same code as py3_2
cull_42 = CullPattern(List=_2801_placement_7.result_room_full, CullPattern=invert(null_27.NullFlags))
cull_43 = CullPattern(List=_2801_placement_7.result_room_rdc, CullPattern=invert(null_27.NullFlags))
cull_44 = CullPattern(List=_2801_placement_7.result_initial, CullPattern=invert(null_27.NullFlags))
cull_45 = CullPattern(List=_2801_placement_7.result_index_furn, CullPattern=invert(null_27.NullFlags))
cull_46 = CullPattern(List=_2801_placement_7.result_transformation_data, CullPattern=invert(null_27.NullFlags))
graft_49 = GraftTree(Tree=flatten(cull_43), IncludeEmptyLists=True, IncludeNullItems=True)  # -> simplify(Tree)
inp2_8 = Data(graft_49)
graft_50 = GraftTree(Tree=flatten(cull_42), IncludeEmptyLists=True, IncludeNullItems=True)  # -> simplify(Tree)
inp1_9 = Data(graft_50)
_2801_placement_8 = Python3Script(
    room_full=inp1_9,
    room_rdc=inp2_8,
    walls=inp3_10,
    walls_must=Toggle(True),
    wall_crv=wall_crv_9,
    furn_index=series_9,
    big_bb_input=big_bb_9,
    small_bb_input=small_bb_9,
    subdivs=20,
    multiplier=1.4,
    offset_distance=0.3)  # -> out, result_room_full, result_room_rdc, result_initial, result_index_furn, result_transformation_data, final_fitting_curve_out, new_plane_startpoint; inputs room_full: list of Curve, room_rdc: list of Curve, walls: list of Curve, walls_must: Boolean, wall_crv: list of Curve, furn_index: list of Int32, big_bb_input: list of Curve, small_bb_input: list of Curve, subdivs: Int32, multiplier: Double, offset_distance: Double; same code as _2801_placement
null_28 = NullItem(Item=_2801_placement_8.result_room_rdc)  # -> NullFlags, InvalidFlags, Description
cull_47 = CullPattern(List=_2801_placement_8.result_room_full, CullPattern=invert(null_28.NullFlags))
cull_48 = CullPattern(List=_2801_placement_8.result_room_rdc, CullPattern=invert(null_28.NullFlags))
cull_49 = CullPattern(List=_2801_placement_8.result_initial, CullPattern=invert(null_28.NullFlags))
cull_50 = CullPattern(List=_2801_placement_8.result_index_furn, CullPattern=invert(null_28.NullFlags))
cull_51 = CullPattern(List=_2801_placement_8.result_transformation_data, CullPattern=invert(null_28.NullFlags))
py3_9 = Python3Script(input_data=_2801_placement_8.result_room_full, mode=0)  # -> out, branch_indices, item_indices, paths, data_out; inputs input_data: tree, mode: Int32; same code as py3_2
graft_51 = GraftTree(Tree=flatten(cull_44), IncludeEmptyLists=True, IncludeNullItems=True)  # -> simplify(Tree)
graft_52 = GraftTree(Tree=flatten(cull_46), IncludeEmptyLists=True, IncludeNullItems=True)  # -> simplify(Tree)
# CHILDREN
graft_53 = GraftTree(Tree=flatten(py3_8.branch_indices), IncludeEmptyLists=True, IncludeNullItems=True)  # -> simplify(Tree)
graft_54 = GraftTree(Tree=flatten(cull_47), IncludeEmptyLists=True, IncludeNullItems=True)  # -> simplify(Tree)
graft_55 = GraftTree(Tree=flatten(cull_48), IncludeEmptyLists=True, IncludeNullItems=True)  # -> simplify(Tree)
graft_56 = GraftTree(Tree=flatten(cull_49), IncludeEmptyLists=True, IncludeNullItems=True)  # -> simplify(Tree)
graft_57 = GraftTree(Tree=flatten(cull_50), IncludeEmptyLists=True, IncludeNullItems=True)  # -> simplify(Tree)
graft_58 = GraftTree(Tree=flatten(cull_51), IncludeEmptyLists=True, IncludeNullItems=True)  # -> simplify(Tree)
graft_59 = GraftTree(Tree=flatten(cull_45), IncludeEmptyLists=True, IncludeNullItems=True)  # -> simplify(Tree)
graft_60 = GraftTree(Tree=flatten(py3_9.branch_indices), IncludeEmptyLists=True, IncludeNullItems=True)  # -> simplify(Tree)
_6_option_count_3 = Python3Script(var_index_1=graft_59, vars_count_1=lng_27, init_branch_2=graft_60, var_index_2=graft_57, vars_count_2=lng_28)  # -> out, tree_1, tree_2; inputs var_index_1: tree of Int32, vars_count_1: Int32, init_branch_2: tree of Int32, var_index_2: tree of Int32, vars_count_2: Int32; same code as _6_option_count
num_var_chi_1_2 = Data(_6_option_count_3.tree_2)
number_10 = Number(num_var_chi_1_2)
num_var_chi_2_3 = Integer(number_10)
panel_60 = Panel(num_var_chi_2_3)
equality_4 = Equality(FirstNumber=num_var_chi_2_3, SecondNumber="0")  # -> Equality, Inequality
panel_61 = Panel(equality_4.Equality)
dispatch_23 = Dispatch(List=num_var_chi_2_3, DispatchPattern=equality_4.Equality)  # -> ListA, ListB
dispatch_24 = Dispatch(List=point_52, DispatchPattern=equality_4.Equality)  # -> ListA, ListB
integer_7 = Integer(dispatch_23.ListB)
integer_8 = Integer(dispatch_23.ListA)
point_63 = Point(dispatch_24.ListB)
point_64 = Point(dispatch_24.ListA)
square_root_4 = SquareRoot(Value=integer_7)
gradient_4 = Gradient(
    LowerLimit="30",
    UpperLimit="1",
    Parameter=integer_7,
    stops=[0: RGB(234, 38, 0), 0.5: RGB(254, 244, 84), 1: RGB(75, 107, 169)])
division_10 = Division(A=square_root_4, B="15")
circle_4 = Circle(Plane=point_63, Radius=division_10)
surface_34 = Surface(circle_4)
move_51 = Move(Geometry=point_63, Motion=unit_z_23)  # -> Geometry, Transform
justifiedtext3d_9 = JustifiedText3d(
    Location=move_51.Geometry,
    Text=integer_7,
    Size="0.5",
    Color=ColourSwatch(SwatchColor=RGB(0, 0, 0)),
    HorizontalAlignment=1,
    VerticalAlginment=1,
    UseMeshes=False,
    Bake=False)
symbol_display_4 = SymbolDisplay(Location=point_64, Display=symbol_simple_9)
custom_preview_35 = CustomPreview(Geometry=surface_34, Material=gradient_4)
num_var_chi_1_1 = Data(_6_option_count_3.tree_1)
number_11 = Number(num_var_chi_1_1)
num_var_chi_1_3 = Integer(number_11)
equality_5 = Equality(FirstNumber=num_var_chi_1_3, SecondNumber="0")  # -> Equality, Inequality
dispatch_25 = Dispatch(List=num_var_chi_1_3, DispatchPattern=equality_5.Equality)  # -> ListA, ListB
dispatch_26 = Dispatch(List=graft_tree_4, DispatchPattern=equality_5.Equality)  # -> ListA, ListB
integer_9 = Integer(dispatch_25.ListB)
integer_10 = Integer(dispatch_25.ListA)
point_65 = Point(dispatch_26.ListB)
point_66 = Point(dispatch_26.ListA)
square_root_5 = SquareRoot(Value=integer_9)
gradient_5 = Gradient(
    LowerLimit="8",
    UpperLimit="1",
    Parameter=integer_9,
    stops=[0: RGB(234, 38, 0), 0.5: RGB(254, 244, 84), 1: RGB(75, 107, 169)])
division_11 = Division(A=square_root_5, B="5")
circle_5 = Circle(Plane=point_65, Radius=division_11)
surface_35 = Surface(circle_5)
move_52 = Move(Geometry=point_65, Motion=unit_z_22)  # -> Geometry, Transform
justifiedtext3d_10 = JustifiedText3d(
    Location=move_52.Geometry,
    Text=integer_9,
    Size="0.5",
    Color=ColourSwatch(SwatchColor=RGB(0, 0, 0)),
    HorizontalAlignment=1,
    VerticalAlginment=1,
    UseMeshes=False,
    Bake=False)
custom_preview_36 = CustomPreview(Geometry=surface_35, Material=gradient_5)
symbol_display_5 = SymbolDisplay(Location=point_66, Display=symbol_simple_8)
num_var_chi_1_1_2 = Data(num_var_chi_1_1)
num_var_chi_1_2_2 = Data(num_var_chi_1_2)
panel_62 = Panel(num_var_chi_1_1)
panel_63 = Panel(num_var_chi_1_2)
clean_13 = CleanTree(RemoveNulls=True, RemoveInvalid=True, RemoveEmpty=False, Tree=flatten(_2801_placement_8.result_room_full))
results_1_indexes_furniture_var_7 = Data(_2801_placement_7.result_index_furn)
results_1_indexes_furniture_var_8 = Data(_2801_placement_8.result_index_furn)
null_29 = NullItem(Item=clean_13)  # -> NullFlags, InvalidFlags, Description
results_transformation_data_7 = Data(_2801_placement_7.result_transformation_data)
results_transformation_data_8 = Data(_2801_placement_8.result_transformation_data)
item_46 = ListItem(List=result_details_8, Index=results_1_indexes_furniture_var_7, Wrap=True)
item_47 = ListItem(List=result_details_9, Index=results_1_indexes_furniture_var_8, Wrap=True)
transform_7 = Transform(Geometry=item_46, Transform=results_transformation_data_7)
transform_8 = Transform(Geometry=item_47, Transform=results_transformation_data_8)
item_48 = ListItem(List=item_46, Index=0, Wrap=True)
lng_67 = ListLength(List=_2801_placement_8.result_room_full)
graft_61 = GraftTree(Tree=transform_7, IncludeEmptyLists=True, IncludeNullItems=True)
repeat_11 = RepeatData(Data=graft_61, Length=lng_67)
flatten_16 = FlattenTree(Tree=transform_8, Path="{0}")
flatten_17 = FlattenTree(Tree=repeat_11, Path="{0}")
filter_28 = StreamFilter(Gate=null_29.NullFlags, Stream0=flatten_17, Stream1=transform_7)

room_12 = Curve(simplify_5)
branch_2 = TreeBranch(Tree=simplify(graft(room_12)), Path=Slider(1, range=0..4), MaintainPaths=True)
polyoffset_16 = PolylineOffset(
    Polylines=branch_2,
    Distance="0.05",
    Plane=Plane(origin=(0, 0, 0), x=(0, 0, 0), y=(0, 0, 0)),
    Tolerance=0.01,
    ClosedFillet=1,
    OpenFillet=1,
    Miter=2)  # -> Contour, Holes
inner_walls_contour_7 = Curve(graft(polyoffset_16.Holes))
rdiff_6 = RegionDifference(CurvesA=inner_walls_contour_7, CurvesB=flatten(total_door_area))
sort_13 = SortList(Keys=rdiff_6, ValuesA=rdiff_6)  # -> Keys, reverse(ValuesA)
item_49 = ListItem(List=sort_13.ValuesA, Index=0, Wrap=True)
room_diff_7 = Curve(item_49)
room_diff_8 = Curve(room_diff_7)
room_13 = Curve(inner_walls_contour_7)

crv_12 = Curve(room_13)
null_30 = NullItem(Item=crv_12)  # -> NullFlags, InvalidFlags, Description
not_7 = GateNot(A=null_30.NullFlags)
merge_27 = Merge(Data1=flatten("Children 2"), Data2=flatten(not_7))
num_var_liv_2_3 = Data(num_var_liv_2)
number_12 = Number(num_var_liv_2_3)
num_var_chi_2_4 = Integer(number_12)
equality_6 = Equality(FirstNumber=num_var_chi_2_4, SecondNumber="0")  # -> Equality, Inequality
panel_64 = Panel(equality_6.Equality)
dispatch_27 = Dispatch(List=num_var_chi_2_4, DispatchPattern=equality_6.Equality)  # -> ListA, ListB
dispatch_28 = Dispatch(List=point_35, DispatchPattern=equality_6.Equality)  # -> ListA, ListB
integer_11 = Integer(dispatch_27.ListB)
integer_12 = Integer(dispatch_27.ListA)
point_67 = Point(dispatch_28.ListB)
point_68 = Point(dispatch_28.ListA)
square_root_6 = SquareRoot(Value=integer_11)
gradient_6 = Gradient(
    LowerLimit="30",
    UpperLimit="1",
    Parameter=integer_11,
    stops=[0: RGB(234, 38, 0), 0.5: RGB(254, 244, 84), 1: RGB(75, 107, 169)])
division_12 = Division(A=square_root_6, B="15")
circle_6 = Circle(Plane=point_67, Radius=division_12)
surface_36 = Surface(circle_6)
move_53 = Move(Geometry=point_67, Motion=unit_z_14)  # -> Geometry, Transform
justifiedtext3d_11 = JustifiedText3d(
    Location=move_53.Geometry,
    Text=integer_11,
    Size="0.5",
    Color=ColourSwatch(SwatchColor=RGB(0, 0, 0)),
    HorizontalAlignment=1,
    VerticalAlginment=1,
    UseMeshes=False,
    Bake=False)
symbol_display_6 = SymbolDisplay(Location=point_68, Display=symbol_simple_7)
custom_preview_37 = CustomPreview(Geometry=surface_36, Material=gradient_6)
num_var_liv_1_3 = Data(num_var_liv_1)
number_13 = Number(num_var_liv_1_3)
num_var_chi_1_4 = Integer(number_13)
equality_7 = Equality(FirstNumber=num_var_chi_1_4, SecondNumber="0")  # -> Equality, Inequality
dispatch_29 = Dispatch(List=num_var_chi_1_4, DispatchPattern=equality_7.Equality)  # -> ListA, ListB
dispatch_30 = Dispatch(List=graft_tree_3, DispatchPattern=equality_7.Equality)  # -> ListA, ListB
integer_13 = Integer(dispatch_29.ListB)
integer_14 = Integer(dispatch_29.ListA)
point_69 = Point(dispatch_30.ListB)
point_70 = Point(dispatch_30.ListA)
square_root_7 = SquareRoot(Value=integer_13)
gradient_7 = Gradient(
    LowerLimit="8",
    UpperLimit="1",
    Parameter=integer_13,
    stops=[0: RGB(234, 38, 0), 0.5: RGB(254, 244, 84), 1: RGB(75, 107, 169)])
division_13 = Division(A=square_root_7, B="5")
circle_7 = Circle(Plane=point_69, Radius=division_13)
surface_37 = Surface(circle_7)
move_54 = Move(Geometry=point_69, Motion=unit_z_13)  # -> Geometry, Transform
justifiedtext3d_12 = JustifiedText3d(
    Location=move_54.Geometry,
    Text=integer_13,
    Size="0.5",
    Color=ColourSwatch(SwatchColor=RGB(0, 0, 0)),
    HorizontalAlignment=1,
    VerticalAlginment=1,
    UseMeshes=False,
    Bake=False)
custom_preview_38 = CustomPreview(Geometry=surface_37, Material=gradient_7)
symbol_display_7 = SymbolDisplay(Location=point_70, Display=symbol_simple_3)
inp1_10 = Data(room_13)
inp2_9 = Data(room_diff_8)
inp3_11 = Data(inp1_10)
inp3_12 = Data(inp1_10)
_2801_placement_9 = Python3Script(
    room_full=inp1_10,
    room_rdc=inp2_9,
    walls=inp3_11,
    walls_must=Toggle(True),
    wall_crv=wall_crv_11,
    furn_index=series_11,
    big_bb_input=big_bb_11,
    small_bb_input=small_bb_11,
    subdivs=20,
    multiplier=1.4,
    offset_distance=0.3)  # -> out, result_room_full, result_room_rdc, result_initial, result_index_furn, result_transformation_data, final_fitting_curve_out, new_plane_startpoint; inputs room_full: list of Curve, room_rdc: list of Curve, walls: list of Curve, walls_must: Boolean, wall_crv: list of Curve, furn_index: list of Int32, big_bb_input: list of Curve, small_bb_input: list of Curve, subdivs: Int32, multiplier: Double, offset_distance: Double; same code as _2801_placement
null_31 = NullItem(Item=_2801_placement_9.result_room_rdc)  # -> NullFlags, InvalidFlags, Description
py3_10 = Python3Script(input_data=_2801_placement_9.result_room_full, mode=0)  # -> out, branch_indices, item_indices, paths, data_out; inputs input_data: tree, mode: Int32; same code as py3_2
cull_52 = CullPattern(List=_2801_placement_9.result_room_full, CullPattern=invert(null_31.NullFlags))
cull_53 = CullPattern(List=_2801_placement_9.result_room_rdc, CullPattern=invert(null_31.NullFlags))
cull_54 = CullPattern(List=_2801_placement_9.result_initial, CullPattern=invert(null_31.NullFlags))
cull_55 = CullPattern(List=_2801_placement_9.result_index_furn, CullPattern=invert(null_31.NullFlags))
cull_56 = CullPattern(List=_2801_placement_9.result_transformation_data, CullPattern=invert(null_31.NullFlags))
graft_62 = GraftTree(Tree=flatten(cull_53), IncludeEmptyLists=True, IncludeNullItems=True)  # -> simplify(Tree)
inp2_10 = Data(graft_62)
graft_63 = GraftTree(Tree=flatten(cull_52), IncludeEmptyLists=True, IncludeNullItems=True)  # -> simplify(Tree)
inp1_11 = Data(graft_63)
_2801_placement_10 = Python3Script(
    room_full=inp1_11,
    room_rdc=inp2_10,
    walls=inp3_12,
    walls_must=Toggle(True),
    wall_crv=wall_crv_10,
    furn_index=series_10,
    big_bb_input=big_bb_10,
    small_bb_input=small_bb_10,
    subdivs=20,
    multiplier=1.4,
    offset_distance=0.3)  # -> out, result_room_full, result_room_rdc, result_initial, result_index_furn, result_transformation_data, final_fitting_curve_out, new_plane_startpoint; inputs room_full: list of Curve, room_rdc: list of Curve, walls: list of Curve, walls_must: Boolean, wall_crv: list of Curve, furn_index: list of Int32, big_bb_input: list of Curve, small_bb_input: list of Curve, subdivs: Int32, multiplier: Double, offset_distance: Double; same code as _2801_placement
null_32 = NullItem(Item=_2801_placement_10.result_room_rdc)  # -> NullFlags, InvalidFlags, Description
py3_11 = Python3Script(input_data=_2801_placement_10.result_room_full, mode=0)  # -> out, branch_indices, item_indices, paths, data_out; inputs input_data: tree, mode: Int32; same code as py3_2
cull_57 = CullPattern(List=_2801_placement_10.result_room_rdc, CullPattern=invert(null_32.NullFlags))
cull_58 = CullPattern(List=_2801_placement_10.result_initial, CullPattern=invert(null_32.NullFlags))
cull_59 = CullPattern(List=_2801_placement_10.result_index_furn, CullPattern=invert(null_32.NullFlags))
cull_60 = CullPattern(List=_2801_placement_10.result_transformation_data, CullPattern=invert(null_32.NullFlags))
graft_64 = GraftTree(Tree=flatten(cull_54), IncludeEmptyLists=True, IncludeNullItems=True)  # -> simplify(Tree)
graft_65 = GraftTree(Tree=flatten(cull_55), IncludeEmptyLists=True, IncludeNullItems=True)  # -> simplify(Tree)
graft_66 = GraftTree(Tree=flatten(cull_56), IncludeEmptyLists=True, IncludeNullItems=True)  # -> simplify(Tree)
graft_67 = GraftTree(Tree=flatten(cull_57), IncludeEmptyLists=True, IncludeNullItems=True)  # -> simplify(Tree)
graft_68 = GraftTree(Tree=flatten(cull_58), IncludeEmptyLists=True, IncludeNullItems=True)  # -> simplify(Tree)
graft_69 = GraftTree(Tree=flatten(cull_59), IncludeEmptyLists=True, IncludeNullItems=True)  # -> simplify(Tree)
graft_70 = GraftTree(Tree=flatten(cull_60), IncludeEmptyLists=True, IncludeNullItems=True)  # -> simplify(Tree)
graft_71 = GraftTree(Tree=flatten(py3_11.branch_indices), IncludeEmptyLists=True, IncludeNullItems=True)  # -> simplify(Tree)
_6_option_count_4 = Python3Script(var_index_1=graft_65, vars_count_1=lng_34, init_branch_2=graft_71, var_index_2=graft_69, vars_count_2=lng_33)  # -> out, tree_1, tree_2; inputs var_index_1: tree of Int32, vars_count_1: Int32, init_branch_2: tree of Int32, var_index_2: tree of Int32, vars_count_2: Int32; same code as _6_option_count
num_var_chi_2_2_2 = Data(_6_option_count_4.tree_2)
chi1_2 = Panel(num_var_chi_2_2_2)
num_var_chi_2_1 = Data(_6_option_count_4.tree_1)
chi1_2_2 = Panel(num_var_chi_2_1)
num_var_chi_2_1_2 = Data(num_var_chi_2_1)
num_var_chi_2_2_3 = Data(num_var_chi_2_2_2)
graft_72 = GraftTree(Tree=flatten(py3_10.branch_indices), IncludeEmptyLists=True, IncludeNullItems=True)  # -> simplify(Tree)
cull_61 = CullPattern(List=_2801_placement_10.result_room_full, CullPattern=invert(null_32.NullFlags))
crv_13 = Curve(branch_2)
graft_73 = GraftTree(Tree=flatten(cull_61), IncludeEmptyLists=True, IncludeNullItems=True)  # -> simplify(Tree)
nulls_in_empty_8 = NullsInEmptyBranches(DataWithEmptyBranches=crv_13)
clean_14 = CleanTree(RemoveNulls=True, RemoveInvalid=True, RemoveEmpty=False, Tree=flatten(_2801_placement_10.result_room_full))
null_33 = NullItem(Item=clean_14)  # -> NullFlags, InvalidFlags, Description
results_1_indexes_furniture_var_9 = Data(_2801_placement_9.result_index_furn)
results_1_indexes_furniture_var_10 = Data(_2801_placement_10.result_index_furn)
children_1_2_2 = Data(flatten_16)
children_1_1 = Data(filter_28)
results_transformation_data_9 = Data(_2801_placement_9.result_transformation_data)
results_transformation_data_10 = Data(_2801_placement_10.result_transformation_data)
bathroom_1_3 = Data(flatten_15)
nulls_in_empty_9 = NullsInEmptyBranches(DataWithEmptyBranches=item_44)
bathroom_2_2 = Data(flatten_14)
living_1 = Data(filter_24)
wc_4 = Data(transform_6)
bathroom_3_2 = Data(flatten_13)
living_2_2 = Data(flatten_10)
item_50 = ListItem(List=result_details_10, Index=results_1_indexes_furniture_var_9, Wrap=True)
item_51 = ListItem(List=result_details_11, Index=results_1_indexes_furniture_var_10, Wrap=True)
wrap_14 = WrapList(Data=wc_4)
wrap_15 = WrapList(Data=bathroom_1_3)
wrap_16 = WrapList(Data=bathroom_2_2)
wrap_17 = WrapList(Data=bathroom_3_2)
wrap_18 = WrapList(Data=living_1)
wrap_19 = WrapList(Data=living_2_2)
wrap_20 = WrapList(Data=children_1_1)
wrap_21 = WrapList(Data=children_1_2_2)
transform_9 = Transform(Geometry=item_50, Transform=results_transformation_data_9)
transform_10 = Transform(Geometry=item_51, Transform=results_transformation_data_10)
item_52 = ListItem(List=item_50, Index=0, Wrap=True)
lng_68 = ListLength(List=_2801_placement_10.result_room_full)
graft_74 = GraftTree(Tree=transform_9, IncludeEmptyLists=True, IncludeNullItems=True)
bath_2 = Data([wrap_15, wrap_16, wrap_17])
wc_5 = Data(wrap_14)
repeat_12 = RepeatData(Data=graft_74, Length=lng_68)
liv5 = Data([wrap_18, wrap_19])
chi1 = Data([wrap_20, wrap_21])
flatten_18 = FlattenTree(Tree=transform_10, Path="{0}")
children_2_2_2 = Data(flatten_18)
wrap_22 = WrapList(Data=children_2_2_2)
flatten_19 = FlattenTree(Tree=repeat_12, Path="{0}")
filter_29 = StreamFilter(Gate=null_33.NullFlags, Stream0=flatten_19, Stream1=transform_9)
children_2_1 = Data(filter_29)
wrap_23 = WrapList(Data=children_2_1)
chi2 = Data([wrap_23, wrap_22])

chi1_3 = Data(chi1)
chi2_2 = Data(chi2)
liv5_2 = Data(liv5)
bath_3 = Data(bath_2)
wc_6 = Data(wc_5)
unwrap_list_3 = UnwrapList(WrappedData=chi1_3)
unwrap_list_4 = UnwrapList(WrappedData=chi2_2)
unwrap_list_5 = UnwrapList(WrappedData=liv5_2)
unwrap_list_6 = UnwrapList(WrappedData=wc_6)
unwrap_list_7 = UnwrapList(WrappedData=bath_3)
item_53 = ListItem(List=unwrap_list_3, Index=addition_24, Wrap=True)
item_54 = ListItem(List=unwrap_list_4, Index=addition_19, Wrap=True)
item_55 = ListItem(List=unwrap_list_5, Index=addition_22, Wrap=True)
item_56 = ListItem(List=unwrap_list_6, Index=addition_20, Wrap=True)
item_57 = ListItem(List=unwrap_list_7, Index=addition_21, Wrap=True)
ungroup_3 = Ungroup(Group=item_53)
ungroup_4 = Ungroup(Group=item_54)
ungroup_5 = Ungroup(Group=item_55)
ungroup_6 = Ungroup(Group=item_56)
ungroup_7 = Ungroup(Group=item_57)

rdiff_7 = RegionDifference(CurvesA=inner_walls_contour, CurvesB=flatten(total_door_area))

sort_14 = SortList(Keys=rdiff_7, ValuesA=rdiff_7)  # -> Keys, reverse(ValuesA)
item_58 = ListItem(List=sort_14.ValuesA, Index=0, Wrap=True)

room_diff_9 = Curve(item_58)

inp2_11 = Data(room_diff_9)
_2801_placement_11 = Python3Script(
    room_full=inp1,
    room_rdc=inp2_11,
    walls=inp3_2,
    walls_must=Toggle(True),
    wall_crv=wall_crv_2,
    furn_index=series_2,
    big_bb_input=big_bb_2,
    small_bb_input=small_bb_2,
    subdivs=20,
    multiplier=1.4,
    offset_distance=0.3)  # -> out, result_room_full, result_room_rdc, result_initial, result_index_furn, result_transformation_data, final_fitting_curve_out, new_plane_startpoint; inputs room_full: list of Curve, room_rdc: list of Curve, walls: list of Curve, walls_must: Boolean, wall_crv: list of Curve, furn_index: list of Int32, big_bb_input: list of Curve, small_bb_input: list of Curve, subdivs: Int32, multiplier: Double, offset_distance: Double; same code as _2801_placement
crv_14 = Curve(_2801_placement_11.result_room_rdc)
crv_15 = Curve(_2801_placement_11.final_fitting_curve_out)
null_34 = NullItem(Item=_2801_placement_11.result_room_rdc)  # -> NullFlags, InvalidFlags, Description
# BEDROOM
py3_12 = Python3Script(input_data=_2801_placement_11.result_room_full, mode=0)  # -> out, branch_indices, item_indices, paths, data_out; inputs input_data: tree, mode: Int32; same code as py3_2
cull_62 = CullPattern(List=_2801_placement_11.result_room_full, CullPattern=invert(null_34.NullFlags))
cull_63 = CullPattern(List=_2801_placement_11.result_room_rdc, CullPattern=invert(null_34.NullFlags))
cull_64 = CullPattern(List=_2801_placement_11.result_initial, CullPattern=invert(null_34.NullFlags))
cull_65 = CullPattern(List=_2801_placement_11.result_index_furn, CullPattern=invert(null_34.NullFlags))
cull_66 = CullPattern(List=_2801_placement_11.result_transformation_data, CullPattern=invert(null_34.NullFlags))
graft_75 = GraftTree(Tree=flatten(cull_63), IncludeEmptyLists=True, IncludeNullItems=True)  # -> simplify(Tree)
inp2_12 = Data(graft_75)
graft_76 = GraftTree(Tree=flatten(py3_12.branch_indices), IncludeEmptyLists=True, IncludeNullItems=True)  # -> simplify(Tree)
graft_77 = GraftTree(Tree=flatten(cull_62), IncludeEmptyLists=True, IncludeNullItems=True)  # -> simplify(Tree)
inp1_12 = Data(graft_77)
# One Placement
_2801_placement_12 = Python3Script(
    room_full=inp1_12,
    room_rdc=inp2_12,
    walls=inp3,
    walls_must=Toggle(True),
    wall_crv=wall_crv,
    furn_index=series,
    big_bb_input=big_bb,
    small_bb_input=small_bb,
    subdivs=20,
    multiplier=1.4,
    offset_distance=0.3)  # -> out, simplify(result_room_full), simplify(result_room_rdc), simplify(result_initial), simplify(result_index_furn), simplify(result_transformation_data), final_fitting_curve_out, new_plane_startpoint; inputs room_full: list of Curve, room_rdc: list of Curve, walls: list of Curve, walls_must: Boolean, wall_crv: list of Curve, furn_index: list of Int32, big_bb_input: list of Curve, small_bb_input: list of Curve, subdivs: Int32, multiplier: Double, offset_distance: Double; same code as _2801_placement
null_35 = NullItem(Item=_2801_placement_12.result_room_rdc)  # -> NullFlags, InvalidFlags, Description
py3_13 = Python3Script(input_data=_2801_placement_12.result_room_full, mode=0)  # -> out, branch_indices, item_indices, paths, data_out; inputs input_data: tree, mode: Int32; same code as py3_2
cull_67 = CullPattern(List=_2801_placement_12.result_index_furn, CullPattern=invert(null_35.NullFlags))
cull_68 = CullPattern(List=_2801_placement_12.result_room_full, CullPattern=invert(null_35.NullFlags))
cull_69 = CullPattern(List=_2801_placement_12.result_room_rdc, CullPattern=invert(null_35.NullFlags))
cull_70 = CullPattern(List=_2801_placement_12.result_initial, CullPattern=invert(null_35.NullFlags))
cull_71 = CullPattern(List=_2801_placement_12.result_transformation_data, CullPattern=invert(null_35.NullFlags))
graft_78 = GraftTree(Tree=flatten(cull_64), IncludeEmptyLists=True, IncludeNullItems=True)  # -> simplify(Tree)
graft_79 = GraftTree(Tree=flatten(cull_65), IncludeEmptyLists=True, IncludeNullItems=True)  # -> simplify(Tree)
graft_80 = GraftTree(Tree=flatten(cull_66), IncludeEmptyLists=True, IncludeNullItems=True)  # -> simplify(Tree)
graft_81 = GraftTree(Tree=flatten(cull_68), IncludeEmptyLists=True, IncludeNullItems=True)  # -> simplify(Tree)
graft_82 = GraftTree(Tree=flatten(cull_69), IncludeEmptyLists=True, IncludeNullItems=True)  # -> simplify(Tree)
graft_83 = GraftTree(Tree=flatten(cull_70), IncludeEmptyLists=True, IncludeNullItems=True)  # -> simplify(Tree)
graft_84 = GraftTree(Tree=flatten(cull_67), IncludeEmptyLists=True, IncludeNullItems=True)  # -> simplify(Tree)
graft_85 = GraftTree(Tree=flatten(cull_71), IncludeEmptyLists=True, IncludeNullItems=True)  # -> simplify(Tree)
graft_86 = GraftTree(Tree=flatten(py3_13.branch_indices), IncludeEmptyLists=True, IncludeNullItems=True)  # -> simplify(Tree)
_6_option_count_5 = Python3Script(var_index_1=graft_79, vars_count_1=lng_12, init_branch_2=graft_86, var_index_2=graft_84, vars_count_2=lng_11)  # -> out, tree_1, tree_2; inputs var_index_1: tree of Int32, vars_count_1: Int32, init_branch_2: tree of Int32, var_index_2: tree of Int32, vars_count_2: Int32; same code as _6_option_count
num_var_bed_2_2 = Data(_6_option_count_5.tree_2)
number_14 = Number(num_var_bed_2_2)
panel_69 = Panel(number_14)
num_var_bed_2_3 = Integer(simplify(number_14))
equality_8 = Equality(FirstNumber=num_var_bed_2_3, SecondNumber="0")  # -> Equality, Inequality
panel_70 = Panel(equality_8.Equality)
dispatch_31 = Dispatch(List=num_var_bed_2_3, DispatchPattern=equality_8.Equality)  # -> ListA, ListB
dispatch_32 = Dispatch(List=point_29, DispatchPattern=equality_8.Equality)  # -> ListA, ListB
integer_15 = Integer(dispatch_31.ListB)
integer_16 = Integer(dispatch_31.ListA)
point_71 = Point(dispatch_32.ListB)
point_72 = Point(dispatch_32.ListA)
square_root_8 = SquareRoot(Value=integer_15)
gradient_8 = Gradient(
    LowerLimit="30",
    UpperLimit="1",
    Parameter=integer_15,
    stops=[0: RGB(234, 38, 0), 0.5: RGB(254, 244, 84), 1: RGB(75, 107, 169)])
division_14 = Division(A=square_root_8, B="15")
circle_8 = Circle(Plane=point_71, Radius=division_14)
surface_38 = Surface(circle_8)
move_55 = Move(Geometry=point_71, Motion=unit_z_12)  # -> Geometry, Transform
justifiedtext3d_13 = JustifiedText3d(
    Location=move_55.Geometry,
    Text=integer_15,
    Size="0.5",
    Color=ColourSwatch(SwatchColor=RGB(0, 0, 0)),
    HorizontalAlignment=1,
    VerticalAlginment=1,
    UseMeshes=False,
    Bake=False)
symbol_display_8 = SymbolDisplay(Location=point_72, Display=symbol_simple_4)
custom_preview_39 = CustomPreview(Geometry=surface_38, Material=gradient_8)
num_var_bed_1_2 = Data(_6_option_count_5.tree_1)
number_15 = Number(num_var_bed_1_2)
panel_71 = Panel(number_15)
num_var_bed_1_3 = Integer(number_15)
equality_9 = Equality(FirstNumber=num_var_bed_1_3, SecondNumber="0")  # -> Equality, Inequality
dispatch_33 = Dispatch(List=num_var_bed_1_3, DispatchPattern=equality_9.Equality)  # -> ListA, ListB
dispatch_34 = Dispatch(List=graft_tree, DispatchPattern=equality_9.Equality)  # -> ListA, ListB
integer_17 = Integer(dispatch_33.ListB)
integer_18 = Integer(dispatch_33.ListA)
point_73 = Point(dispatch_34.ListB)
point_74 = Point(dispatch_34.ListA)
square_root_9 = SquareRoot(Value=integer_17)
gradient_9 = Gradient(
    LowerLimit="8",
    UpperLimit="1",
    Parameter=integer_17,
    stops=[0: RGB(234, 38, 0), 0.5: RGB(254, 244, 84), 1: RGB(75, 107, 169)])
division_15 = Division(A=square_root_9, B="5")
circle_9 = Circle(Plane=point_73, Radius=division_15)
surface_39 = Surface(circle_9)
move_56 = Move(Geometry=point_73, Motion=unit_z_11)  # -> Geometry, Transform
justifiedtext3d_14 = JustifiedText3d(
    Location=move_56.Geometry,
    Text=integer_17,
    Size="0.5",
    Color=ColourSwatch(SwatchColor=RGB(0, 0, 0)),
    HorizontalAlignment=1,
    VerticalAlginment=1,
    UseMeshes=False,
    Bake=False)
custom_preview_40 = CustomPreview(Geometry=surface_39, Material=gradient_9)
symbol_display_9 = SymbolDisplay(Location=point_74, Display=symbol_simple)
panel_72 = Panel(num_var_bed_2_2)
panel_73 = Panel(num_var_bed_1_2)
results_1_indexes_furniture_var_11 = Data(_2801_placement_11.result_index_furn)
results_1_indexes_furniture_var_12 = Data(_2801_placement_12.result_index_furn)
results_transformation_data_11 = Data(_2801_placement_11.result_transformation_data)
results_transformation_data_12 = Data(_2801_placement_12.result_transformation_data)
item_59 = ListItem(List=_2801_placement_11.result_room_rdc, Index=number_slider_20, Wrap=True)
item_60 = ListItem(List=_2801_placement_11.result_room_full, Index=number_slider_20, Wrap=True)
null_36 = NullItem(Item=flatten(_2801_placement_12.result_room_full))  # -> NullFlags, InvalidFlags, Description
item_61 = ListItem(List=result_details, Index=results_1_indexes_furniture_var_11, Wrap=True)
item_62 = ListItem(List=result_details_2, Index=results_1_indexes_furniture_var_12, Wrap=True)
transform_11 = Transform(Geometry=item_61, Transform=results_transformation_data_11)
transform_12 = Transform(Geometry=item_62, Transform=results_transformation_data_12)
lng_69 = ListLength(List=_2801_placement_12.result_room_full)
tbranch_6 = TreeBranch(Tree=transform_12, Path=number_slider_19, MaintainPaths=True, SplitTree=False)
panel_74 = Panel(_2801_placement_12.result_room_full)
graft_87 = GraftTree(Tree=transform_11, IncludeEmptyLists=True, IncludeNullItems=True)
item_63 = ListItem(List=transform_11, Index=number_slider_19, Wrap=True)
item_64 = ListItem(List=tbranch_6, Index=Slider(2, range=0..10), Wrap=True)
repeat_13 = RepeatData(Data=graft_87, Length=lng_69)
flatten_20 = FlattenTree(Tree=transform_12, Path="{0}")
flatten_21 = FlattenTree(Tree=repeat_13, Path="{0}")
branch_3 = TreeBranch(Tree=simplify(transform_11), Path=number_slider_20, MaintainPaths=True)
item_65 = ListItem(List=transform_11, Index=number_slider_20, Wrap=True)
tbranch_7 = TreeBranch(Tree=transform_12, Path=number_slider_20, MaintainPaths=True, SplitTree=False)
filter_30 = StreamFilter(Gate=null_36.NullFlags, Stream0=flatten_21, Stream1=transform_11)
data_2 = Data(graft_79)

room_diff_10 = Curve(room_diff_9)
room_diff_11 = Curve(room_diff)
room_14 = Curve(room_8)
explode_15 = Explode(Curve=room_diff_11, Recursive=True)  # -> Segments, Vertices
cullpt = CullDuplicates(Points=explode_15.Vertices, Tolerance=0.1, CullMode=1)  # -> Points, Indices, Valence
pline_3 = PolyLine(Vertices=cullpt.Points, Closed=True)
explode_16 = Explode(Curve=pline_3, Recursive=True)  # -> Segments, Vertices
curvepoint_3 = PointOnCurve(explode_16.Segments, parameter=0.5)
scale_3 = Scale(Geometry=explode_16.Segments, Center=curvepoint_3, Factor=1.2)  # -> Geometry, Transform
srfsplit = SurfaceSplit(Surface=room_diff_11, Curves=scale_3.Geometry)
sort_15 = SortList(Keys=srfsplit, ValuesA=srfsplit)  # -> Keys, reverse(ValuesA)
item_66 = ListItem(List=sort_15.ValuesA, Index=0, Wrap=True)
wires = BrepWireframe(Brep=item_66, Density=-1)
# KITCHEN
project_2 = Project(Geometry=item_66, Plane=PlaneXY(0, 0, 0))  # -> Geometry, Transform
join_3 = JoinCurves(Curves=wires, Preserve=False)
reb_2 = RebuildCurve(Curve=item_66, Count=10, Tangents=False)
cls = Closed(Curve=join_3)  # -> Closed, Periodic
dispatch_35 = Dispatch(List=join_3, DispatchPattern=cls.Closed)  # -> ListA, ListB
room_cleaned_shape = Curve(dispatch_35.ListA)

panel_75 = Panel(explode_15.Vertices)
explode_17 = Explode(Curve=room_cleaned_shape, Recursive=True)  # -> Segments, Vertices
srf_3 = Surface(join_3)
item_67 = ListItem(List=explode_17.Segments, Index=Slider(7, range=0..10), Wrap=True)
lng_70 = ListLength(List=explode_17.Segments)
series_18 = Series(Start=0, Step=1, Count=lng_70)
shift_7 = ShiftList(List=explode_17.Segments, Shift=series_18, Wrap=True)
item_68 = ListItem(List=shift_7, Index=0, Wrap=True)  # -> Item, Item1
len_3 = Length(Curve=item_68.Item)  # -> simplify(Length)
len_4 = Length(Curve=item_68.Item1)  # -> simplify(Length)
larger_2 = LargerThan(FirstNumber=len_3, SecondNumber=subtraction)  # -> LargerThan, simplify(OrEqualTo)
larger_3 = LargerThan(FirstNumber=len_4, SecondNumber=subtraction_2)  # -> LargerThan, OrEqualTo
panel_76 = Panel(larger_3.OrEqualTo)
panel_77 = Panel(len_4)
and = GateAnd(A=larger_2.OrEqualTo, B=larger_3.OrEqualTo)  # -> simplify(Result)
panel_78 = Panel(and)
repeat_14 = RepeatData(Data=item_68.Item, Length=lng_60)
repeat_15 = RepeatData(Data=item_68.Item1, Length=lng_60)
dispatch_36 = Dispatch(List=series_17, DispatchPattern=and)  # -> ListA, ListB
dispatch_37 = Dispatch(List=repeat_14, DispatchPattern=and)  # -> ListA, ListB
dispatch_38 = Dispatch(List=repeat_15, DispatchPattern=and)  # -> ListA, ListB
panel_79 = Panel(dispatch_36.ListA)
crv_16 = Curve(dispatch_38.ListA)
crv_17 = Curve(dispatch_37.ListA)
flatten_22 = FlattenTree(Tree=dispatch_36.ListA, Path="{0}")
flatten_23 = FlattenTree(Tree=crv_16, Path="{0}")
flatten_24 = FlattenTree(Tree=crv_17, Path="{0}")
ccx_2 = CurveCurve(CurveA=flatten_24, CurveB=flatten_23)  # -> Points, ParamsA, ParamsB
rev_4 = Reverse(Vector=flatten_24)
flatten_25 = FlattenTree(Tree=ccx_2.Points, Path="{0}")
item_69 = ListItem(List=plane, Index=flatten_22, Wrap=True)
panel_80 = Panel(flatten_22)
pl_3 = ConstructPlane(Origin=flatten_25, XAxis=rev_4, YAxis=flatten_23)
item_70 = ListItem(List=score_2, Index=flatten_22, Wrap=True)
item_71 = ListItem(List=details_2, Index=flatten_22, Wrap=True)
var_plane = Data(item_69)
data_3 = Data(dispatch_36.ListA)
placement_plane = Data(pl_3)
_6a_option_count_2 = Python3Script(var_index=data_3, vars_count=lng_62)  # -> out, tree_1; inputs var_index: tree of Int32, vars_count: Int32; same code as _6a_option_count
orient = Orient(Geometry=item_71, Source=var_plane, Target=placement_plane)  # -> Geometry, Transform

index_furniture = Number(flatten_22)
transform_data = Data(orient.Transform)
details_3 = Data(item_71)
result_score = Data(item_70)

num_var_kit_1_2 = Data(_6a_option_count_2.tree_1)
number_16 = Number(num_var_kit_1_2)
number_17 = Number(num_var_kit_1_2)
num_var_chi_1_5 = Integer(number_17)
num_var_chi_2_5 = Integer(number_16)
equality_10 = Equality(FirstNumber=num_var_chi_1_5, SecondNumber="0")  # -> Equality, Inequality
equality_11 = Equality(FirstNumber=num_var_chi_2_5, SecondNumber="0")  # -> Equality, Inequality
panel_81 = Panel(equality_11.Equality)
dispatch_39 = Dispatch(List=num_var_chi_1_5, DispatchPattern=equality_10.Equality)  # -> ListA, ListB
dispatch_40 = Dispatch(List=graft_tree_5, DispatchPattern=equality_10.Equality)  # -> ListA, ListB
dispatch_41 = Dispatch(List=num_var_chi_2_5, DispatchPattern=equality_11.Equality)  # -> ListA, ListB
dispatch_42 = Dispatch(List=point_55, DispatchPattern=equality_11.Equality)  # -> ListA, ListB
integer_19 = Integer(dispatch_39.ListB)
integer_20 = Integer(dispatch_39.ListA)
point_75 = Point(dispatch_40.ListB)
point_76 = Point(dispatch_40.ListA)
square_root_10 = SquareRoot(Value=integer_19)
gradient_10 = Gradient(
    LowerLimit="8",
    UpperLimit="1",
    Parameter=integer_19,
    stops=[0: RGB(234, 38, 0), 0.5: RGB(254, 244, 84), 1: RGB(75, 107, 169)])
integer_21 = Integer(dispatch_41.ListB)
integer_22 = Integer(dispatch_41.ListA)
point_77 = Point(dispatch_42.ListB)
point_78 = Point(dispatch_42.ListA)
division_16 = Division(A=square_root_10, B="5")
square_root_11 = SquareRoot(Value=integer_21)
gradient_11 = Gradient(
    LowerLimit="30",
    UpperLimit="1",
    Parameter=integer_21,
    stops=[0: RGB(234, 38, 0), 0.5: RGB(254, 244, 84), 1: RGB(75, 107, 169)])
circle_10 = Circle(Plane=point_75, Radius=division_16)
division_17 = Division(A=square_root_11, B="15")
surface_40 = Surface(circle_10)
circle_11 = Circle(Plane=point_77, Radius=division_17)
move_57 = Move(Geometry=point_75, Motion=unit_z_24)  # -> Geometry, Transform
surface_41 = Surface(circle_11)
move_58 = Move(Geometry=point_77, Motion=unit_z_25)  # -> Geometry, Transform
justifiedtext3d_15 = JustifiedText3d(
    Location=move_57.Geometry,
    Text=integer_19,
    Size="0.5",
    Color=ColourSwatch(SwatchColor=RGB(0, 0, 0)),
    HorizontalAlignment=1,
    VerticalAlginment=1,
    UseMeshes=False,
    Bake=False)
custom_preview_41 = CustomPreview(Geometry=surface_40, Material=gradient_10)
symbol_display_10 = SymbolDisplay(Location=point_76, Display=symbol_simple_10)
justifiedtext3d_16 = JustifiedText3d(
    Location=move_58.Geometry,
    Text=integer_21,
    Size="0.5",
    Color=ColourSwatch(SwatchColor=RGB(0, 0, 0)),
    HorizontalAlignment=1,
    VerticalAlginment=1,
    UseMeshes=False,
    Bake=False)
symbol_display_11 = SymbolDisplay(Location=point_78, Display=symbol_simple_11)
custom_preview_42 = CustomPreview(Geometry=surface_41, Material=gradient_11)

# ----
# Preview
number_slider_33 = Slider(2, range=0..5)
item_72 = ListItem(List=orient.Geometry, Index=number_slider_33, Wrap=True)
previewlw = CustomPreviewLineweights(
    Geometry=item_72,
    Shader=ColourSwatch(SwatchColor=RGB(255, 255, 255)),
    Thickness=Slider(5.4, range=0..10),
    Absolute=False)

score_wish = Number(item_27.Item1)
is_score = Number(result_score)
score_min = Number(item_27.Item)
larger_4 = LargerThan(FirstNumber=is_score, SecondNumber=score_min)  # -> LargerThan, OrEqualTo
larger_5 = LargerThan(FirstNumber=is_score, SecondNumber=score_wish)  # -> LargerThan, OrEqualTo
ma = MassAddition(Input=larger_5.OrEqualTo)  # -> Result, PartialResults
ma_2 = MassAddition(Input=larger_4.OrEqualTo)  # -> Result, PartialResults
larger_6 = LargerThan(FirstNumber=ma.Result, SecondNumber=0)  # -> LargerThan, OrEqualTo
larger_7 = LargerThan(FirstNumber=ma.Result, SecondNumber=Slider(1, range=0..1))  # -> LargerThan, OrEqualTo
larger_8 = LargerThan(FirstNumber=ma_2.Result, SecondNumber=0)  # -> LargerThan, OrEqualTo
cull_72 = CullPattern(List=Slider(10, range=0..10), CullPattern=larger_7.LargerThan)
cull_73 = CullPattern(List=Slider(10, range=0..10), CullPattern=larger_6.LargerThan)
cull_74 = CullPattern(List=Slider(80, range=0..100), CullPattern=larger_8.LargerThan)
merge_28 = Merge(Data1=cull_72, Data2=cull_73, Data3=cull_74)
ma_3 = MassAddition(Input=merge_28)  # -> Result, PartialResults
score_3 = Panel(ma_3.Result)

panel_82 = Panel(num_var_kit_1_2)
num_var_kit_1_3 = Data(num_var_kit_1_2)

merge_29 = Merge(Data1=num_var_bat_1, Data2=num_var_bat_2, Data3=num_var_bat_3)  # -> graft(Result)
entwine_6 = Entwine(
    Branch0X=flatten(num_var_bed_1_2),
    Branch1X=num_var_bed_2_2,
    Branch2X=flatten(num_var_chi_1_1),
    Branch3X=num_var_chi_1_2,
    Branch4X=flatten(num_var_chi_2_1),
    Branch5X=num_var_chi_2_2_2,
    Branch6X=flatten(num_var_liv_1_3),
    Branch7X=num_var_liv_2_3,
    Branch8X=flatten(num_var_kit_1_2),
    Branch9X=merge_29,
    FlattenInputs=False)  # -> simplify(Result)

data_4 = Data(entwine_6)
panel_84 = Panel(data_4)
data_5 = Data(entwine_6)
match_3 = MatchTree(Tree=entwine_2, Guide=data_5)
makereport = Python3Script(
    aptId=number_slider_26,
    testTree=match_3,
    furnTree=data_5,
    outFolder=panel_2,
    write=Toggle(False),
    reset=Button(),
    finalize_on_last=Toggle(False),
    lastAptId=Slider(13, range=0..100))  # -> out, OKTree, FailList, SummarySoFar, WrittenPaths; inputs aptId: Int32, testTree: tree, furnTree: tree, write: Boolean, finalize_on_last: Boolean, lastAptId: Int32
# ---------- makereport: Python ----------
# MakeReportIter: accumulate per-apartment compare results across GH solutions,
# then write a CSV + JSON snapshot on demand.
# Works great with "Animate Slider" feeding aptId.

from Grasshopper import DataTree
from Grasshopper.Kernel.Data import GH_Path
from System import Object
import scriptcontext as sc
import json, os, datetime

# ---------- helpers ----------
def to_py_number(x):
    try: return int(round(float(x)))
    except: return 0

def tree_to_list_dict(tree):
    """DataTree -> dict{path_tuple: [ints...]}"""
    d = {}
    for i in range(tree.BranchCount):
        path = tuple(tree.Path(i).Indices)
        d[path] = [to_py_number(v) for v in tree.Branch(i)]
    return d

def compare_rule(test_val, furn_val):
    if test_val == 0:
        return (furn_val == 0)
    return (furn_val >= test_val)

def label_branch_short(local_path):
    """
    local_path = path starting from your domain index (e.g., {0;0}, {1;2}, {9;0;1} ...),
    i.e., exactly what you feed per-apartment (no global apt prefix).
    """
    p0 = local_path[0] if len(local_path) > 0 else None
    p1 = local_path[1] if len(local_path) > 1 else None
    room, block = "Room", "Block"
    if p0 == 0: room, block = "Master Bedroom", "Bed"
    elif p0 == 1: room, block = "Master Bedroom", "Wardrobe"
    elif p0 == 2: room, block = "Children Bedroom 1", "Bed"
    elif p0 == 3: room, block = "Children Bedroom 1", "Wardrobe"
    elif p0 == 4: room, block = "Children Bedroom 2", "Bed"
    elif p0 == 5: room, block = "Children Bedroom 2", "Wardrobe"
    elif p0 == 6: room, block = "Living Room", "Sofa"
    elif p0 == 7: room, block = "Living Room", "Table"
    elif p0 == 8: room, block = "Kitchen", "Kitchen furniture"
    elif p0 == 9:
        room = "Bathroom"
        if p1 == 0: block = "Bathtub"
        elif p1 == 1: block = "Toilet"
        elif p1 == 2: block = "Sink"
        else: block = "Fixture"
    # Wardrobe/Table variants show 1-based index
    variant = ""
    if p0 in (1,3,5,7) and p1 is not None:
        variant = " {}".format(p1+1)
    if p0 == 8 or p0 == 9:
        return "{} – {}".format(room, block)
    return "{} – {}{}".format(room, block, variant)

def ensure_dir(d):
    try:
        if d and not os.path.isdir(d):
            os.makedirs(d)
    except: pass

def now_stamp():
    return datetime.datetime.now().strftime("%Y-%m-%d_%H-%M-%S")

def to_csv(table):
    return "\n".join([",".join(map(str,row)) for row in table])

# ---------- persistent store ----------
key = "furn_report_store_v1"
if reset or (key not in sc.sticky):
    sc.sticky[key] = {
        # per aptId:
        #   "name": str,
        #   "branches": int,
        #   "fail_branches": int,
        #   "pass_rate": float,
        #   "failing_labels": [str, ...]
    }

store = sc.sticky[key]

# ---------- read current inputs ----------
test_dict = tree_to_list_dict(testTree)
furn_dict = tree_to_list_dict(furnTree)

# Compute OKTree + condensed FailList for CURRENT apartment
OKTree = DataTree[Object]()
FailList = []

# We assume your per-apartment inputs use local paths like {0;0}, {1;2}, {9;0;1}, ...
# So we compare exactly matching paths between test_dict and furn_dict.
failing_paths = []
total_branches = 0

for path in sorted(test_dict.keys()):
    test_vals = test_dict.get(path, [])
    furn_vals = furn_dict.get(path, [])
    gh_path = GH_Path(*path)

    total_branches += 1
    branch_ok = True
    for i, tv in enumerate(test_vals):
        fv = furn_vals[i] if i < len(furn_vals) else 0
        ok = compare_rule(tv, fv)
        OKTree.Add(bool(ok), gh_path)
        if not ok:
            branch_ok = False

    if not branch_ok:
        failing_paths.append(path)

# Build condensed FailList lines
for idx, p in enumerate(failing_paths):
    FailList.append("{}. {}".format(idx, label_branch_short(p)))

# Summarize current apt
fb = len(failing_paths)
pass_rate = 0.0 if total_branches == 0 else float(total_branches - fb) / float(total_branches)
apt_label = aptName if (aptName and str(aptName).strip()) else "Apt {}".format(aptId)

# Update persistent store
store[int(aptId)] = {
    "name": str(apt_label),
    "branches": int(total_branches),
    "fail_branches": int(fb),
    "pass_rate": float(round(pass_rate, 3)),
    "failing_labels": [label_branch_short(p) for p in failing_paths],
}

# ---------- emit SummarySoFar as CSV text preview ----------
apt_ids_sorted = sorted(store.keys())
rows = [["apartment","branches","fail_branches","pass_rate"]]
for aid in apt_ids_sorted:
    rec = store[aid]
    rows.append([rec["name"], rec["branches"], rec["fail_branches"], rec["pass_rate"]])
SummarySoFar = to_csv(rows)

# ---------- writing ----------
WrittenPaths = []
should_write = bool(write) or (bool(finalize_on_last) and int(aptId) == int(lastAptId))

if should_write and outFolder:
    ensure_dir(outFolder)
    ts = now_stamp()

    # summary CSV
    csv_path = os.path.join(outFolder, "furnisher_summary_{}.csv".format(ts))
    with open(csv_path, "w", encoding="utf-8") as f:
        f.write(SummarySoFar)

    # detailed JSON
    details = {
        "timestamp": ts,
        "apartments": [
            {
                "apartment": store[aid]["name"],
                "branches": store[aid]["branches"],
                "fail_branches": store[aid]["fail_branches"],
                "pass_rate": store[aid]["pass_rate"],
                "failing_branches": store[aid]["failing_labels"],
                "aptId": int(aid),
            } for aid in apt_ids_sorted
        ]
    }
    json_path = os.path.join(outFolder, "furnisher_details_{}.json".format(ts))
    with open(json_path, "w", encoding="utf-8") as f:
        f.write(json.dumps(details, indent=2, ensure_ascii=False))

    WrittenPaths = [csv_path, json_path]
# ---------- end makereport ----------
compare = Python3Script(testTree=match_3, furnTree=data_5)  # -> out, OKTree, FailList; inputs testTree: tree, furnTree: tree
# ---------- compare: Python ----------
"""Compare two Grasshopper DataTrees and produce:
- OKTree: bool tree mirroring the *testTree* structure (True/False per item)
- FailList: condensed, human-readable list with ONE line per *failing branch*

Rules:
  If test == 0  -> furnisher must be 0
  If test > 0   -> furnisher >= test
"""

from Grasshopper import DataTree
from Grasshopper.Kernel.Data import GH_Path
from System import Object

# ---------------- utils ----------------
def to_py_number(x):
    try:
        return int(round(float(x)))
    except:
        return 0

def tree_to_dict(tree):
    d = {}
    for i in range(tree.BranchCount):
        path = tree.Path(i)
        key = tuple(path.Indices)
        vals = [to_py_number(v) for v in tree.Branch(i)]
        d[key] = vals
    return d

def compare_values(test_val, furn_val):
    if test_val == 0:
        return (furn_val == 0)
    else:
        return (furn_val >= test_val)

def label_branch_short(path_tuple):
    """Short, branch-level label (no per-item index)."""
    p0 = path_tuple[0] if len(path_tuple) > 0 else None
    p1 = path_tuple[1] if len(path_tuple) > 1 else None
    room, block = "Room", None

    if p0 == 0:
        room, block = "Master Bedroom", "Bed"
    elif p0 == 1:
        room, block = "Master Bedroom", "Wardrobe"
    elif p0 == 2:
        room, block = "Children Bedroom 1", "Bed"
    elif p0 == 3:
        room, block = "Children Bedroom 1", "Wardrobe"
    elif p0 == 4:
        room, block = "Children Bedroom 2", "Bed"
    elif p0 == 5:
        room, block = "Children Bedroom 2", "Wardrobe"
    elif p0 == 6:
        room, block = "Living Room", "Sofa"
    elif p0 == 7:
        room, block = "Living Room", "Table"
    elif p0 == 8:
        room, block = "Kitchen", "Kitchen furniture"
    elif p0 == 9:
        room = "Bathroom"
        # bathroom second index encodes fixture
        if p1 == 0: block = "Bathtub"
        elif p1 == 1: block = "Toilet"
        elif p1 == 2: block = "Sink"
        else: block = "Fixture"
    else:
        room = "Branch {}".format(p0)
        block = "Block"

    # If this branch has a meaningful variant index (like wardrobe variants),
    # show it as 1-based: "Wardrobe 1", "Wardrobe 2", ...
    variant_text = ""
    if p0 in (1, 3, 5, 7) and p1 is not None:
        # wardrobes/tables have sub-variants
        variant_text = " {}".format(p1 + 1)

    # Kitchen usually has p1==0 only; keep it simple: "Kitchen"
    if p0 == 8:
        return "{}".format(room)

    # Bathroom branches list specific fixtures without variant numbers
    if p0 == 9:
        return "{} – {}".format(room, block)

    # Default: "Room – Block [variant]"
    return "{} – {}{}".format(room, block, variant_text)

# --------------- main ------------------
test_dict = tree_to_dict(testTree)
furn_dict = tree_to_dict(furnTree)

OKTree = DataTree[Object]()
FailList = []

# We’ll also collect a set of failing branch paths to avoid duplicates
failing_paths = []

for path, test_vals in test_dict.items():
    furn_vals = furn_dict.get(path, [])
    gh_path = GH_Path(*path) if len(path) > 0 else GH_Path(0)

    branch_ok = True
    # compare element-wise only across the test length (mirrors shape)
    for i, tv in enumerate(test_vals):
        fv = furn_vals[i] if i < len(furn_vals) else 0
        ok = compare_values(tv, fv)
        OKTree.Add(bool(ok), gh_path)
        if not ok:
            branch_ok = False

    # mark branch as failing once (for FailList)
    if not branch_ok:
        failing_paths.append(path)

# Build the condensed FailList with numbering the way you want
for idx, path in enumerate(failing_paths):
    FailList.append("{}. {}".format(idx, label_branch_short(path)))
# ---------- end compare ----------
panel_85 = Panel(match_3)
panel_86 = Panel(makereport.OKTree)
panel_87 = Panel(data_5)
panel_88 = Panel(makereport.SummarySoFar)
panel_89 = Panel(makereport.FailList)

panel_90 = Panel(entwine_6)
wrap_24 = WrapList(Data=orient.Geometry)
bedroom_1 = Data(filter_30)
bedroom_2_2 = Data(flatten_20)
preview_kitchen = Data(wrap_24)
wrap_25 = WrapList(Data=bedroom_1)  # -> flatten(WrappedData)
wrap_26 = WrapList(Data=bedroom_2_2)  # -> flatten(WrappedData)
bed1 = Data([wrap_25, wrap_26])

bed1_2 = Data(bed1)
preview_kitchen_2 = Data(preview_kitchen)
unwrap_list_8 = UnwrapList(WrappedData=bed1_2)
unwrap_list_9 = UnwrapList(WrappedData=preview_kitchen_2)
item_73 = ListItem(List=unwrap_list_8, Index=addition_25, Wrap=True)
item_74 = ListItem(List=unwrap_list_9, Index=addition_23, Wrap=True)
ungroup_8 = Ungroup(Group=item_73)
ungroup_9 = Ungroup(Group=item_74)

# ----
# DOOR
crv_18 = Curve(merge_22)
door_area_3 = Curve(door_area_2)
area_5 = Area(Geometry=door_area_3)  # -> Area, Centroid
explode_18 = Explode(Curve=door_area_3, Recursive=True)  # -> Segments, Vertices
incurve = PointInCurve(Point=area_5.Centroid, Curve=crv_18)  # -> Relationship, Point
item_75 = ListItem(List=explode_18.Segments, Index=0, Wrap=True)
cull_75 = CullPattern(List=crv_18, CullPattern=incurve.Relationship)
cull_76 = CullPattern(List=merge_23, CullPattern=incurve.Relationship)
explode_19 = Explode(Curve=item_75, Recursive=True)  # -> Segments, Vertices
rooms_according_to_the_doors = Curve(cull_75)
width_for_the_doors = Number(cull_76)
crv_cp_8 = CurveClosestPoint(Point=explode_19.Vertices, Curve=rooms_according_to_the_doors)  # -> Point, Parameter, Distance
multiplication_7 = Multiplication(A=width_for_the_doors, B=2)
multiplication_8 = Multiplication(A=item_25, B=2)

curvepoint_4 = PointOnCurve(item_75, parameter=0.5)
explode_20 = Explode(Curve=cull_75, Recursive=True)  # -> Segments, Vertices
dist_5 = Distance(PointA=curvepoint_4, PointB=explode_20.Vertices)
sort_16 = SortList(Keys=dist_5, ValuesA=explode_20.Vertices)  # -> Keys, ValuesA
item_76 = ListItem(List=sort_16.ValuesA, Index=0, Wrap=True)
dist_6 = Distance(PointA=explode_19.Vertices, PointB=item_76)

sort_17 = SortList(Keys=dist_6, ValuesA=explode_19.Vertices)  # -> Keys, ValuesA
item_77 = ListItem(List=sort_17.ValuesA, Index=0, Wrap=True)  # -> Item, Item1
line_12 = LineSDL(Start=item_77.Item, Direction=rev_3, Length=multiplication_8)

ln_2 = Line(StartPoint=item_77.Item, EndPoint=item_77.Item1)

pl_4 = ConstructPlane(Origin=item_77.Item, XAxis=ln_2, YAxis=rev_3)
arc = Arc(Plane=pl_4, Radius=multiplication_7, Angle=Domain(0, 1.570796327))  # -> Arc, Length
doors_3 = Curve(simplify([arc.Arc, line_12]))

crv_19 = Curve(doors_3)

room_15 = Curve(simplify_5)

branch_4 = TreeBranch(Tree=simplify(graft(room_15)), Path=Slider(2, range=0..4), MaintainPaths=True)
crv_20 = Curve(branch_4)
nulls_in_empty_10 = NullsInEmptyBranches(DataWithEmptyBranches=crv_20)
merge_30 = Merge(
    Data1=flatten(nulls_in_empty_3),
    Data2=flatten(nulls_in_empty_9),
    Data3=flatten(nulls_in_empty_8),
    Data4=flatten(nulls_in_empty_10),
    Data5=flatten(nulls_in_empty),
    Data6=flatten(nulls_in_empty_2),
    Data7=flatten(nulls_in_empty_4),
    Data8=flatten(nulls_in_empty_7),
    Data9=flatten(nulls_in_empty_5),
    Data10=flatten(nulls_in_empty_6))
rooms_outlines = Data(merge_30)

polyoffset_17 = PolylineOffset(
    Polylines=branch_4,
    Distance="0.05",
    Plane=Plane(origin=(0, 0, 0), x=(0, 0, 0), y=(0, 0, 0)),
    Tolerance=0.01,
    ClosedFillet=1,
    OpenFillet=1,
    Miter=2)  # -> Contour, Holes
inner_walls_contour_8 = Curve(graft(polyoffset_17.Holes))
room_16 = Curve(inner_walls_contour_8)

crv_21 = Curve(room_16)
null_37 = NullItem(Item=crv_21)  # -> NullFlags, InvalidFlags, Description
not_8 = GateNot(A=null_37.NullFlags)
merge_31 = Merge(Data1=flatten("Children 3"), Data2=flatten(not_8))
rdiff_8 = RegionDifference(CurvesA=inner_walls_contour_8, CurvesB=flatten(total_door_area))
sort_18 = SortList(Keys=rdiff_8, ValuesA=rdiff_8)  # -> Keys, reverse(ValuesA)
item_78 = ListItem(List=sort_18.ValuesA, Index=0, Wrap=True)
room_diff_12 = Curve(item_78)

room_diff_13 = Curve(room_diff_12)

inp1_13 = Data(room_16)
inp3_13 = Data(inp1_13)
inp2_13 = Data(room_diff_13)
inp3_14 = Data(inp1_13)
_2801_placement_13 = Python3Script(
    room_full=inp1_13,
    room_rdc=inp2_13,
    walls=inp3_14,
    walls_must=Toggle(True),
    wall_crv=wall_crv_13,
    furn_index=series_13,
    big_bb_input=big_bb_13,
    small_bb_input=small_bb_13,
    subdivs=20,
    multiplier=1.4,
    offset_distance=0.3)  # -> out, result_room_full, result_room_rdc, result_initial, result_index_furn, result_transformation_data, final_fitting_curve_out, new_plane_startpoint; inputs room_full: list of Curve, room_rdc: list of Curve, walls: list of Curve, walls_must: Boolean, wall_crv: list of Curve, furn_index: list of Int32, big_bb_input: list of Curve, small_bb_input: list of Curve, subdivs: Int32, multiplier: Double, offset_distance: Double; same code as _2801_placement
null_38 = NullItem(Item=_2801_placement_13.result_room_rdc)  # -> NullFlags, InvalidFlags, Description
# CHILDREN
py3_14 = Python3Script(input_data=_2801_placement_13.result_room_full, mode=0)  # -> out, branch_indices, item_indices, paths, data_out; inputs input_data: tree, mode: Int32; same code as py3_2
cull_77 = CullPattern(List=_2801_placement_13.result_room_full, CullPattern=invert(null_38.NullFlags))
cull_78 = CullPattern(List=_2801_placement_13.result_room_rdc, CullPattern=invert(null_38.NullFlags))
cull_79 = CullPattern(List=_2801_placement_13.result_initial, CullPattern=invert(null_38.NullFlags))
cull_80 = CullPattern(List=_2801_placement_13.result_index_furn, CullPattern=invert(null_38.NullFlags))
cull_81 = CullPattern(List=_2801_placement_13.result_transformation_data, CullPattern=invert(null_38.NullFlags))
graft_88 = GraftTree(Tree=flatten(py3_14.branch_indices), IncludeEmptyLists=True, IncludeNullItems=True)  # -> simplify(Tree)
graft_89 = GraftTree(Tree=flatten(cull_78), IncludeEmptyLists=True, IncludeNullItems=True)  # -> simplify(Tree)
inp2_14 = Data(graft_89)
graft_90 = GraftTree(Tree=flatten(cull_77), IncludeEmptyLists=True, IncludeNullItems=True)  # -> simplify(Tree)
inp1_14 = Data(graft_90)
_2801_placement_14 = Python3Script(
    room_full=inp1_14,
    room_rdc=inp2_14,
    walls=inp3_13,
    walls_must=Toggle(True),
    wall_crv=wall_crv_12,
    furn_index=series_12,
    big_bb_input=big_bb_12,
    small_bb_input=small_bb_12,
    subdivs=20,
    multiplier=1.4,
    offset_distance=0.3)  # -> out, result_room_full, result_room_rdc, result_initial, result_index_furn, result_transformation_data, final_fitting_curve_out, new_plane_startpoint; inputs room_full: list of Curve, room_rdc: list of Curve, walls: list of Curve, walls_must: Boolean, wall_crv: list of Curve, furn_index: list of Int32, big_bb_input: list of Curve, small_bb_input: list of Curve, subdivs: Int32, multiplier: Double, offset_distance: Double; same code as _2801_placement
null_39 = NullItem(Item=_2801_placement_14.result_room_rdc)  # -> NullFlags, InvalidFlags, Description
py3_15 = Python3Script(input_data=_2801_placement_14.result_room_full, mode=0)  # -> out, branch_indices, item_indices, paths, data_out; inputs input_data: tree, mode: Int32; same code as py3_2
cull_82 = CullPattern(List=_2801_placement_14.result_room_full, CullPattern=invert(null_39.NullFlags))
cull_83 = CullPattern(List=_2801_placement_14.result_room_rdc, CullPattern=invert(null_39.NullFlags))
cull_84 = CullPattern(List=_2801_placement_14.result_initial, CullPattern=invert(null_39.NullFlags))
cull_85 = CullPattern(List=_2801_placement_14.result_index_furn, CullPattern=invert(null_39.NullFlags))
cull_86 = CullPattern(List=_2801_placement_14.result_transformation_data, CullPattern=invert(null_39.NullFlags))
graft_91 = GraftTree(Tree=flatten(cull_79), IncludeEmptyLists=True, IncludeNullItems=True)  # -> simplify(Tree)
graft_92 = GraftTree(Tree=flatten(cull_80), IncludeEmptyLists=True, IncludeNullItems=True)  # -> simplify(Tree)
graft_93 = GraftTree(Tree=flatten(cull_81), IncludeEmptyLists=True, IncludeNullItems=True)  # -> simplify(Tree)
graft_94 = GraftTree(Tree=flatten(cull_82), IncludeEmptyLists=True, IncludeNullItems=True)  # -> simplify(Tree)
graft_95 = GraftTree(Tree=flatten(cull_83), IncludeEmptyLists=True, IncludeNullItems=True)  # -> simplify(Tree)
graft_96 = GraftTree(Tree=flatten(cull_84), IncludeEmptyLists=True, IncludeNullItems=True)  # -> simplify(Tree)
graft_97 = GraftTree(Tree=flatten(cull_85), IncludeEmptyLists=True, IncludeNullItems=True)  # -> simplify(Tree)
graft_98 = GraftTree(Tree=flatten(cull_86), IncludeEmptyLists=True, IncludeNullItems=True)  # -> simplify(Tree)
graft_99 = GraftTree(Tree=flatten(py3_15.branch_indices), IncludeEmptyLists=True, IncludeNullItems=True)  # -> simplify(Tree)
_6_option_count_6 = Python3Script(var_index_1=graft_92, vars_count_1=lng_40, init_branch_2=graft_99, var_index_2=graft_97, vars_count_2=lng_39)  # -> out, tree_1, tree_2; inputs var_index_1: tree of Int32, vars_count_1: Int32, init_branch_2: tree of Int32, var_index_2: tree of Int32, vars_count_2: Int32; same code as _6_option_count
num_var_chi_3_2 = Data(_6_option_count_6.tree_2)
num_var_chi_3_1 = Data(_6_option_count_6.tree_1)
num_var_chi_3_1_2 = Data(num_var_chi_3_1)
num_var_chi_3_2_2 = Data(num_var_chi_3_2)
results_1_indexes_furniture_var_13 = Data(_2801_placement_13.result_index_furn)
results_1_indexes_furniture_var_14 = Data(_2801_placement_14.result_index_furn)
results_transformation_data_13 = Data(_2801_placement_13.result_transformation_data)
results_transformation_data_14 = Data(_2801_placement_14.result_transformation_data)
item_79 = ListItem(List=result_details_12, Index=results_1_indexes_furniture_var_13, Wrap=True)
item_80 = ListItem(List=result_details_13, Index=results_1_indexes_furniture_var_14, Wrap=True)
transform_13 = Transform(Geometry=item_79, Transform=results_transformation_data_13)
transform_14 = Transform(Geometry=item_80, Transform=results_transformation_data_14)
item_81 = ListItem(List=item_79, Index=0, Wrap=True)
lng_71 = ListLength(List=_2801_placement_14.result_room_full)
graft_100 = GraftTree(Tree=transform_13, IncludeEmptyLists=True, IncludeNullItems=True)
repeat_16 = RepeatData(Data=graft_100, Length=lng_71)
flatten_26 = FlattenTree(Tree=transform_14, Path="{0}")
children_3_2_2 = Data(flatten_26)
wrap_27 = WrapList(Data=children_3_2_2)
flatten_27 = FlattenTree(Tree=repeat_16, Path="{0}")
children_3_1 = Data(flatten_27)
wrap_28 = WrapList(Data=children_3_1)
chi3 = Data([wrap_28, wrap_27])

chi3_2 = Data(chi3)
unwrap_list_10 = UnwrapList(WrappedData=chi3_2)
item_82 = ListItem(List=unwrap_list_10, Index=addition_19, Wrap=True)
ungroup_10 = Ungroup(Group=item_82)
custom_preview_lineweights_17 = CustomPreviewLineweights(
    Geometry=[ungroup_9, ungroup_8, ungroup_3, ungroup_4, ungroup_10, ungroup, ungroup_5, ungroup_2, ungroup_7, ungroup_6],
    Shader=ColourSwatch(SwatchColor=RGB(92, 91, 91)),
    Thickness="1",
    Absolute=False)

room_17 = Curve(simplify_5)

branch_5 = TreeBranch(Tree=simplify(graft(room_17)), Path=Slider(3, range=0..4), MaintainPaths=True)

polyoffset_18 = PolylineOffset(
    Polylines=branch_5,
    Distance="0.05",
    Plane=Plane(origin=(0, 0, 0), x=(0, 0, 0), y=(0, 0, 0)),
    Tolerance=0.01,
    ClosedFillet=1,
    OpenFillet=1,
    Miter=2)  # -> Contour, Holes
inner_walls_contour_9 = Curve(graft(polyoffset_18.Holes))
room_18 = Curve(inner_walls_contour_9)

crv_22 = Curve(room_18)
null_40 = NullItem(Item=crv_22)  # -> NullFlags, InvalidFlags, Description
not_9 = GateNot(A=null_40.NullFlags)
merge_32 = Merge(Data1=flatten("Children 4"), Data2=flatten(not_9))
rdiff_9 = RegionDifference(CurvesA=inner_walls_contour_9, CurvesB=flatten(total_door_area))
sort_19 = SortList(Keys=rdiff_9, ValuesA=rdiff_9)  # -> Keys, reverse(ValuesA)
item_83 = ListItem(List=sort_19.ValuesA, Index=0, Wrap=True)
room_diff_14 = Curve(item_83)

room_diff_15 = Curve(room_diff_14)

inp1_15 = Data(room_18)
inp3_15 = Data(inp1_15)
inp2_15 = Data(room_diff_15)
inp3_16 = Data(inp1_15)
_2801_placement_15 = Python3Script(
    room_full=inp1_15,
    room_rdc=inp2_15,
    walls=inp3_16,
    walls_must=Toggle(True),
    wall_crv=wall_crv_15,
    furn_index=series_15,
    big_bb_input=big_bb_15,
    small_bb_input=small_bb_15,
    subdivs=20,
    multiplier=1.4,
    offset_distance=0.3)  # -> out, result_room_full, result_room_rdc, result_initial, result_index_furn, result_transformation_data, final_fitting_curve_out, new_plane_startpoint; inputs room_full: list of Curve, room_rdc: list of Curve, walls: list of Curve, walls_must: Boolean, wall_crv: list of Curve, furn_index: list of Int32, big_bb_input: list of Curve, small_bb_input: list of Curve, subdivs: Int32, multiplier: Double, offset_distance: Double; same code as _2801_placement
null_41 = NullItem(Item=_2801_placement_15.result_room_rdc)  # -> NullFlags, InvalidFlags, Description
# CHILDREN
py3_16 = Python3Script(input_data=_2801_placement_15.result_room_full, mode=0)  # -> out, branch_indices, item_indices, paths, data_out; inputs input_data: tree, mode: Int32; same code as py3_2
cull_87 = CullPattern(List=_2801_placement_15.result_room_full, CullPattern=invert(null_41.NullFlags))
cull_88 = CullPattern(List=_2801_placement_15.result_room_rdc, CullPattern=invert(null_41.NullFlags))
cull_89 = CullPattern(List=_2801_placement_15.result_initial, CullPattern=invert(null_41.NullFlags))
cull_90 = CullPattern(List=_2801_placement_15.result_index_furn, CullPattern=invert(null_41.NullFlags))
cull_91 = CullPattern(List=_2801_placement_15.result_transformation_data, CullPattern=invert(null_41.NullFlags))
graft_101 = GraftTree(Tree=flatten(py3_16.branch_indices), IncludeEmptyLists=True, IncludeNullItems=True)  # -> simplify(Tree)
graft_102 = GraftTree(Tree=flatten(cull_88), IncludeEmptyLists=True, IncludeNullItems=True)  # -> simplify(Tree)
inp2_16 = Data(graft_102)
graft_103 = GraftTree(Tree=flatten(cull_87), IncludeEmptyLists=True, IncludeNullItems=True)  # -> simplify(Tree)
inp1_16 = Data(graft_103)
_2801_placement_16 = Python3Script(
    room_full=inp1_16,
    room_rdc=inp2_16,
    walls=inp3_15,
    walls_must=Toggle(True),
    wall_crv=wall_crv_14,
    furn_index=series_14,
    big_bb_input=big_bb_14,
    small_bb_input=small_bb_14,
    subdivs=20,
    multiplier=1.4,
    offset_distance=0.3)  # -> out, result_room_full, result_room_rdc, result_initial, result_index_furn, result_transformation_data, final_fitting_curve_out, new_plane_startpoint; inputs room_full: list of Curve, room_rdc: list of Curve, walls: list of Curve, walls_must: Boolean, wall_crv: list of Curve, furn_index: list of Int32, big_bb_input: list of Curve, small_bb_input: list of Curve, subdivs: Int32, multiplier: Double, offset_distance: Double; same code as _2801_placement
null_42 = NullItem(Item=_2801_placement_16.result_room_rdc)  # -> NullFlags, InvalidFlags, Description
py3_17 = Python3Script(input_data=_2801_placement_16.result_room_full, mode=0)  # -> out, branch_indices, item_indices, paths, data_out; inputs input_data: tree, mode: Int32; same code as py3_2
cull_92 = CullPattern(List=_2801_placement_16.result_room_full, CullPattern=invert(null_42.NullFlags))
cull_93 = CullPattern(List=_2801_placement_16.result_room_rdc, CullPattern=invert(null_42.NullFlags))
cull_94 = CullPattern(List=_2801_placement_16.result_initial, CullPattern=invert(null_42.NullFlags))
cull_95 = CullPattern(List=_2801_placement_16.result_index_furn, CullPattern=invert(null_42.NullFlags))
cull_96 = CullPattern(List=_2801_placement_16.result_transformation_data, CullPattern=invert(null_42.NullFlags))
graft_104 = GraftTree(Tree=flatten(cull_89), IncludeEmptyLists=True, IncludeNullItems=True)  # -> simplify(Tree)
graft_105 = GraftTree(Tree=flatten(cull_90), IncludeEmptyLists=True, IncludeNullItems=True)  # -> simplify(Tree)
graft_106 = GraftTree(Tree=flatten(cull_91), IncludeEmptyLists=True, IncludeNullItems=True)  # -> simplify(Tree)
graft_107 = GraftTree(Tree=flatten(cull_92), IncludeEmptyLists=True, IncludeNullItems=True)  # -> simplify(Tree)
graft_108 = GraftTree(Tree=flatten(cull_93), IncludeEmptyLists=True, IncludeNullItems=True)  # -> simplify(Tree)
graft_109 = GraftTree(Tree=flatten(cull_94), IncludeEmptyLists=True, IncludeNullItems=True)  # -> simplify(Tree)
graft_110 = GraftTree(Tree=flatten(cull_95), IncludeEmptyLists=True, IncludeNullItems=True)  # -> simplify(Tree)
graft_111 = GraftTree(Tree=flatten(cull_96), IncludeEmptyLists=True, IncludeNullItems=True)  # -> simplify(Tree)
graft_112 = GraftTree(Tree=flatten(py3_17.branch_indices), IncludeEmptyLists=True, IncludeNullItems=True)  # -> simplify(Tree)
_6_option_count_7 = Python3Script(var_index_1=graft_105, vars_count_1=lng_46, init_branch_2=graft_112, var_index_2=graft_110, vars_count_2=lng_45)  # -> out, tree_1, tree_2; inputs var_index_1: tree of Int32, vars_count_1: Int32, init_branch_2: tree of Int32, var_index_2: tree of Int32, vars_count_2: Int32; same code as _6_option_count
num_var_chi_3_2_3 = Data(_6_option_count_7.tree_2)
num_var_chi_3_1_3 = Data(_6_option_count_7.tree_1)
entwine_7 = Entwine(
    Branch0X=merge_12,
    Branch1X=flatten(num_var_bed_1_2),
    Branch2X=num_var_bed_2_2,
    Branch3X=merge_13,
    Branch4X=flatten(num_var_liv_1),
    Branch5X=num_var_liv_2,
    Branch6X=merge_14,
    Branch7X=num_var_bat_1,
    Branch8X=num_var_bat_2,
    Branch9X=num_var_bat_3,
    Branch10X=merge_15,
    Branch11X=flatten(num_var_kit_1),
    Branch12X=merge_24,
    Branch13X=flatten(num_var_kit_1_2),
    Branch14X=merge_26,
    Branch15X=flatten(num_var_chi_1_1),
    Branch16X=num_var_chi_1_2,
    Branch17X=merge_27,
    Branch18X=flatten(num_var_chi_2_1),
    Branch19X=num_var_chi_2_2_2,
    Branch20X=merge_31,
    Branch21X=flatten(num_var_chi_3_1),
    Branch22X=num_var_chi_3_2,
    Branch23X=merge_32,
    Branch24X=flatten(num_var_chi_3_1_3),
    Branch25X=num_var_chi_3_2_3,
    FlattenInputs=False)

# ----
# Score
data_6 = Data(entwine_7)
scorer = Python3Script(tree=data_6)  # -> out, scores, names; inputs tree: tree
# ---------- scorer: Python ----------
"""
Room Quality Score Calculator for Grasshopper
===============================================
Input:  tree  - DataTree (set input to Tree Access in GhPython)
Output: scores - list of scores per room (0-100 or None)
        names  - list of room names

Scoring rules:
- 0 variants  -> 0.0
- 1 variant   -> 0.75
- 2+ variants -> 1.0
Weighted by option importance and level importance per room.
"""

# ============ CONFIGURATION ============

def get_room_config(room_name):
    """Return level weights and option weights for a given room type."""
    name = room_name.strip()

    if name == "Bedroom":
        return {
            "level_weights": [0.6, 0.4],
            "option_weights_per_level": {
                0: [0.4, 0.3, 0.3],   # level 1: option 1 slightly better
                1: [0.5, 0.3, 0.2],   # level 2: clear ranking
            }
        }
    elif name.startswith("Children"):
        return {
            "level_weights": [0.7, 0.3],
            "option_weights_per_level": {
                0: [0.5, 0.5],         # level 1: equal
                1: [0.6, 0.4],         # level 2: first better
            }
        }
    else:
        # Living room, Bathroom, WC, Kitchen, etc.
        # Equal weights everywhere
        return {
            "level_weights": None,
            "option_weights_per_level": {}
        }


# ============ SCORING HELPERS ============

def node_score(variants):
    """Score a single node: 0 -> 0, 1 -> 0.75, 2+ -> 1.0"""
    v = int(round(float(variants)))
    if v <= 0:
        return 0.0
    elif v == 1:
        return 0.75
    else:
        return 1.0


def equal_weights(n):
    """Return a list of n equal weights summing to 1."""
    if n == 0:
        return []
    return [1.0 / n] * n


def get_weights(option_weights_dict, level_idx, count):
    """Get configured weights or fall back to equal weights."""
    w = option_weights_dict.get(level_idx)
    if w and len(w) == count:
        return w
    return equal_weights(count)


# ============ ROOM SCORE CALCULATION ============

def compute_room_score(levels_data, config):
    """
    Compute score for a single room.

    levels_data: list of levels, where each level is a list of branches,
                 and each branch is a list of variant counts.
        Level 1: [[2, 6, 5]]              -> 1 branch, 3 options
        Level 2: [[0,0,0],[3,9,28],[2,7,26]] -> 3 branches (per L1 option)
    """
    num_levels = len(levels_data)
    if num_levels == 0:
        return 0.0

    # Level weights
    lw = config.get("level_weights")
    if not lw or len(lw) != num_levels:
        lw = equal_weights(num_levels)

    owpl = config.get("option_weights_per_level", {})
    level_scores = []

    for lvl_idx, level_branches in enumerate(levels_data):

        if lvl_idx == 0:
            # Level 1: always a single branch with N options
            options = level_branches[0]
            weights = get_weights(owpl, 0, len(options))
            score = sum(node_score(v) * w for v, w in zip(options, weights))

        else:
            # Level 2+: one branch per parent option at previous level
            # Weight branches by PARENT option weights
            parent_weights = get_weights(owpl, lvl_idx - 1, len(level_branches))

            # Get child option weights for this level
            child_cfg = owpl.get(lvl_idx)

            branch_scores = []
            for branch in level_branches:
                cw = child_cfg if (child_cfg and len(child_cfg) == len(branch)) \
                    else equal_weights(len(branch))
                b_score = sum(node_score(v) * w for v, w in zip(branch, cw))
                branch_scores.append(b_score)

            score = sum(bs * pw for bs, pw in zip(branch_scores, parent_weights))

        level_scores.append(score)

    total = sum(ls * w for ls, w in zip(level_scores, lw))
    return round(total * 100, 1)


# ============ PARSE GRASSHOPPER DATA TREE ============

def is_header(branch_items):
    """Check if a branch is a room header (first item is a string, not a number)."""
    if len(branch_items) < 2:
        return False
    try:
        float(str(branch_items[0]))
        return False
    except (ValueError, TypeError):
        return True


# Read all branches grouped by first path index
paths = tree.Paths
branches = tree.Branches

groups = {}
for i in range(len(paths)):
    p = paths[i]
    first = p[0]
    second = p[1] if p.Length > 1 else 0
    if first not in groups:
        groups[first] = {}
    groups[first][second] = [item for item in branches[i]]

# Walk through groups to find rooms and their data
rooms = []
first_indices = sorted(groups.keys())

i = 0
while i < len(first_indices):
    idx = first_indices[i]
    branch_0 = groups[idx].get(0, [])

    if is_header(branch_0):
        room_name = str(branch_0[0]).strip()
        room_active = str(branch_0[1]).strip().lower() == "true"

        # Collect data groups until next header
        data_groups = []
        j = i + 1
        while j < len(first_indices):
            next_idx = first_indices[j]
            next_branch_0 = groups[next_idx].get(0, [])

            if is_header(next_branch_0):
                break

            # Collect all sub-branches for this group
            sub_branches = []
            for sec_idx in sorted(groups[next_idx].keys()):
                vals = [float(str(v)) for v in groups[next_idx][sec_idx]]
                sub_branches.append(vals)
            data_groups.append(sub_branches)
            j += 1

        rooms.append({
            "name": room_name,
            "active": room_active,
            "levels": data_groups
        })
        i = j
    else:
        i += 1


# ============ COMPUTE AND OUTPUT ============

scores = []
names = []

for room in rooms:
    names.append(room["name"])
    if not room["active"]:
        scores.append(None)
    else:
        config = get_room_config(room["name"])
        score = compute_room_score(room["levels"], config)
        scores.append(score)
# ---------- end scorer ----------
panel_91 = Panel(scorer.scores)
panel_92 = Panel(scorer.names)
panel_93 = Panel(data_6)

apt_recorder = Python3Script(
    seed=number_slider_7,
    apt_type=py3.apt_type,
    names=py3.names,
    active=py3.active,
    polygons=py3.polygons,
    doors=py3.doors,
    scores=scorer.scores,
    file_path=panel_33)  # -> out, status; inputs seed: Int32, apt_type: list, names: list, active: list, polygons: list of Polyline, doors: list of Point3d, scores: list
# ---------- apt_recorder: Python ----------
"""
Apartment Data Recorder for Grasshopper
=========================================
Appends one apartment per run to a JSONL file.
Each line is a complete apartment record that can reconstruct geometry.

Inputs (all Item Access except polygons/doors/scores which are List Access):
    seed      (int)    - current seed value
    apt_type  (str)    - apartment type label
    names     (list)   - room names, List Access
    active    (list)   - booleans, List Access
    polygons  (list)   - polyline curves, List Access
    doors     (list)   - door points, List Access
    scores    (list)   - score values, List Access
    file_path (str)    - full path to output .jsonl file
    reset     (bool)   - True to clear file and start fresh

Output:
    status   (str)     - confirmation message
"""

import json
import os

# Handle reset: clear file
if reset:
    if os.path.exists(file_path):
        os.remove(file_path)

# Build room data
rooms = []
for i in range(len(names)):
    room = {
        "name": str(names[i]),
        "active": str(active[i]).lower() == "true",
    }

    # Score: None for inactive rooms
    s = scores[i] if i < len(scores) else None
    if s is None or str(s).lower() == "none":
        room["score"] = None
    else:
        room["score"] = float(str(s))

    # Polyline points
    if polygons[i] is not None and str(polygons[i]) != "None":
        obj = polygons[i]
        pl = None
        # Handle both Polyline and PolylineCurve
        if hasattr(obj, 'TryGetPolyline'):
            rc, pl = obj.TryGetPolyline()
            if not rc:
                pl = None
        elif hasattr(obj, 'Count'):
            pl = obj  # already a Polyline
        if pl is not None:
            room["points"] = [[round(pl[j].X, 4),
                                round(pl[j].Y, 4),
                                round(pl[j].Z, 4)]
                               for j in range(pl.Count)]
        else:
            room["points"] = None
    else:
        room["points"] = None

    # Door point
    if doors[i] is not None and str(doors[i]) != "None":
        pt = doors[i]
        room["door"] = [round(pt.X, 4), round(pt.Y, 4), round(pt.Z, 4)]
    else:
        room["door"] = None

    rooms.append(room)

# Build record
record = {
    "seed": int(seed),
    "apt_type": str(apt_type),
    "rooms": rooms,
}

# Append to file
with open(file_path, "a") as f:
    f.write(json.dumps(record) + "\n")

# Count total lines
with open(file_path, "r") as f:
    count = sum(1 for _ in f)

status = "Recorded seed {} ({} total)".format(seed, count)
# ---------- end apt_recorder ----------
panel_94 = Panel(apt_recorder.status)

panel_95 = Panel(entwine_7)
num_var_chi_3_1_4 = Data(num_var_chi_3_1_3)
num_var_chi_3_2_4 = Data(num_var_chi_3_2_3)
results_1_indexes_furniture_var_15 = Data(_2801_placement_15.result_index_furn)
results_1_indexes_furniture_var_16 = Data(_2801_placement_16.result_index_furn)
results_transformation_data_15 = Data(_2801_placement_15.result_transformation_data)
results_transformation_data_16 = Data(_2801_placement_16.result_transformation_data)
item_84 = ListItem(List=result_details_14, Index=results_1_indexes_furniture_var_15, Wrap=True)
item_85 = ListItem(List=result_details_15, Index=results_1_indexes_furniture_var_16, Wrap=True)
transform_15 = Transform(Geometry=item_84, Transform=results_transformation_data_15)
transform_16 = Transform(Geometry=item_85, Transform=results_transformation_data_16)
item_86 = ListItem(List=item_84, Index=0, Wrap=True)
lng_72 = ListLength(List=_2801_placement_16.result_room_full)
graft_113 = GraftTree(Tree=transform_15, IncludeEmptyLists=True, IncludeNullItems=True)
repeat_17 = RepeatData(Data=graft_113, Length=lng_72)
flatten_28 = FlattenTree(Tree=transform_16, Path="{0}")
flatten_29 = FlattenTree(Tree=repeat_17, Path="{0}")

# ==== cluster Cluster
apartment_outlines = ClusterInput()
room_grids = ClusterInput()
room_grids_2 = Curve(room_grids)
apartment_outlines_2 = Curve(apartment_outlines)
area = Area(Geometry=room_grids_2)  # -> Area, Centroid
point_in_curve = PointInCurve(Point=flatten(area.Centroid), Curve=graft(apartment_outlines_2))  # -> simplify(Relationship), Point
dispatch = Dispatch(List=room_grids_2, DispatchPattern=point_in_curve.Relationship)  # -> ListA, ListB
curve = Curve(dispatch.ListA)
region_union = RegionUnion(Curves=curve)
room_outlines = Curve(region_union)
room_grids_3 = Curve(curve)
room_outlines_2 = ClusterOutput(room_outlines)
room_grids_4 = ClusterOutput(room_grids_3)

# ==== cluster Cluster_2
floor_outline = ClusterInput()
floor_outline_2 = Curve(floor_outline)
explode = Explode(Curve=floor_outline_2, Recursive=True)  # -> Segments, Vertices
minimum_bounding_box_2d = MinimumBoundingBox2D(Points=explode.Vertices, Plane=PlaneXY(0, 0, 0))
explode_2 = Explode(Curve=minimum_bounding_box_2d, Recursive=True)  # -> Segments, Vertices
deconstruct = Deconstruct(Point=explode_2.Vertices)  # -> XComponent, YComponent, ZComponent
addition = Addition(A=deconstruct.XComponent, B=deconstruct.YComponent)
sort_list = SortList(Keys=addition, ValuesValuesA=explode_2.Vertices)  # -> Keys, reverse(ValuesValuesA)
list_item = ListItem(List=sort_list.ValuesValuesA, Index=0, Wrap=True)
basic_point = Point(list_item)
basic_point_2 = ClusterOutput(basic_point)

# ==== cluster Children

curve = Curve(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)
point = Point(Point(3.825560696, 3.269031512, 0))

point_2 = Point(Point(6.853477753, 3.431307474, 0))
curve_2 = Curve(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)

curve_3 = Curve(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)
point_3 = Point(Point(-11.73690413, -3.567426641, 0))

point_4 = Point(Point(-14.37573941, 4.793852101, 0))
curve_4 = Curve(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)

curve_5 = Curve(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)
point_5 = Point(Point(-4.368733009, 4.799215653, 0))

point_6 = Point(Point(-10.97850404, -0.8850161118, 0))
curve_6 = Curve(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)

curve_7 = Curve(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)
point_7 = Point(Point(-5.592306131, 0.875585635, 0))

point_8 = Point(Point(-11.2500664, -2.579079201, 0))
curve_8 = Curve(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)

point_9 = Point(Point(-8.69866408, -3.561810688, 0))
curve_9 = Curve(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)

point_10 = Point(Point(5.026964879, -2.907820585, 0))
curve_10 = Curve(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)

curve_11 = Curve(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)
point_11 = Point(Point(-1.832217313, -1.668926075, 0))

curve_12 = Curve(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)
point_12 = Point(Point(-7.023614999, 14.8080267, 0))

point_13 = Point(Point(-6.812925461, 0.1975952166, 0))
curve_13 = Curve(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)

point_14 = Point(Point(4.559232005, 0.8553321268, 0))
curve_14 = Curve(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)

curve_15 = Curve(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)
point_15 = Point(Point(-2.462001993, 3.322277723, 0))

curve_16 = Curve(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)
point_16 = Point(Point(-5.163688564, 14.17851314, 0))

curve_17 = Curve(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)
point_17 = Point(Point(-8.916431475, -5.855000212, 0))

point_18 = Point(Point(-7.658293458, 3.569474743, 0))
curve_18 = Curve(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)

point_19 = Point(Point(-8.121097849, -3.251228001, 0))
curve_19 = Curve(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)

curve_20 = Curve(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)
point_20 = Point(Point(-5.83506245, 2.543095474, 0))

merge = Merge(
    Data1=flatten(point_6),
    Data2=flatten(point_4),
    Data3=flatten(point_5),
    Data4=flatten(point_16),
    Data5=flatten(point_12),
    Data6=flatten(point_17),
    Data7=flatten(point_18),
    Data8=flatten(point_14),
    Data9=flatten(point_3),
    Data10=flatten(point_7),
    Data11=flatten(point_2),
    Data12=flatten(point),
    Data13=flatten(point_8),
    Data14=flatten(point_19),
    Data15=flatten(point_20),
    Data16=flatten(point_13),
    Data17=flatten(point_9),
    Data18=flatten(point_11),
    Data19=flatten(point_15),
    Data20=flatten(point_10))
merge_2 = Merge(
    Data1=flatten(curve_6),
    Data2=flatten(curve_4),
    Data3=flatten(curve_5),
    Data4=flatten(curve_16),
    Data5=flatten(curve_12),
    Data6=flatten(curve_17),
    Data7=flatten(curve_18),
    Data8=flatten(curve_14),
    Data9=flatten(curve_3),
    Data10=flatten(curve_7),
    Data11=flatten(curve_2),
    Data12=flatten(curve),
    Data13=flatten(curve_8),
    Data14=flatten(curve_19),
    Data15=flatten(curve_20),
    Data16=flatten(curve_13),
    Data17=flatten(curve_9),
    Data18=flatten(curve_11),
    Data19=flatten(curve_15),
    Data20=flatten(curve_10))
point_21 = Point(merge)
curve_21 = Curve(merge_2)
point_22 = ClusterOutput(point_21)
curve_22 = ClusterOutput(curve_21)

# ==== cluster Bathroom

curve = Curve(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)
point = Point(Point(-2.502285027, 3.507707674, 0))

point_2 = Point(Point(-15.0140925, 4.162682276, 0))
curve_2 = Curve(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)

curve_3 = Curve(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)
point_3 = Point(Point(-9.377389917, -0.86685105, 0))

point_4 = Point(Point(-12.23689166, -0.8630287735, 0))
curve_4 = Curve(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)

point_5 = Point(Point(9.355802389, -2.07178324, 0))
curve_5 = Curve(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)

point_6 = Point(Point(-7.464475603, -4.168199429, 0))
curve_6 = Curve(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)

curve_7 = Curve(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)
point_7 = Point(Point(17.35206244, -5.230762857, 0))

curve_8 = Curve(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)
point_8 = Point(Point(-5.767816913, -1.440481649, 0))

curve_9 = Curve(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)
point_9 = Point(Point(-5.802385571, 15.42232493, 0))

curve_10 = Curve(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)
point_10 = Point(Point(-6.07544228, 4.726941841, 0))

point_11 = Point(Point(-16.12202765, -1.643855577, 0))
curve_11 = Curve(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)

point_12 = Point(Point(-3.556802937, -2.013596718, 0))
curve_12 = Curve(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)

point_13 = Point(Point(-2.978230266, -1.643346748, 0))
curve_13 = Curve(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)

curve_14 = Curve(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)
point_14 = Point(Point(1.428364672, -2.902373873, 0))

curve_15 = Curve(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)
point_15 = Point(Point(4.962567558, -4.134444535, 0))

curve_16 = Curve(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)
point_16 = Point(Point(-14.99497283, -1.641128397, 0))

curve_17 = Curve(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)
point_17 = Point(Point(2.118857187, -0.1359423835, 0))

curve_18 = Curve(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)
point_18 = Point(Point(-1.859038756, -2.739670734, 0))

curve_19 = Curve(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)
point_19 = Point(Point(-3.091398566, 0.3330297653, 0))

curve_20 = Curve(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)
point_20 = Point(Point(13.7361898, -3.530583891, 0))

merge = Merge(
    Data1=flatten(curve_2),
    Data2=flatten(curve_3),
    Data3=flatten(curve),
    Data4=flatten(curve_5),
    Data5=flatten(curve_4),
    Data6=flatten(curve_7),
    Data7=flatten(curve_8),
    Data8=flatten(curve_9),
    Data9=flatten(curve_11),
    Data10=flatten(curve_13),
    Data11=flatten(curve_14),
    Data12=flatten(curve_15),
    Data13=flatten(curve_12),
    Data14=flatten(curve_17),
    Data15=flatten(curve_20),
    Data16=flatten(curve_16),
    Data17=flatten(curve_18),
    Data18=flatten(curve_19),
    Data19=flatten(curve_10),
    Data20=flatten(curve_6))
merge_2 = Merge(
    Data1=flatten(point_2),
    Data2=flatten(point_3),
    Data3=flatten(point),
    Data4=flatten(point_5),
    Data5=flatten(point_4),
    Data6=flatten(point_7),
    Data7=flatten(point_8),
    Data8=flatten(point_9),
    Data9=flatten(point_11),
    Data10=flatten(point_13),
    Data11=flatten(point_14),
    Data12=flatten(point_15),
    Data13=flatten(point_12),
    Data14=flatten(point_17),
    Data15=flatten(point_20),
    Data16=flatten(point_16),
    Data17=flatten(point_18),
    Data18=flatten(point_19),
    Data19=flatten(point_10),
    Data20=flatten(point_6))
point_21 = Point(merge_2)
curve_21 = Curve(merge)
point_22 = ClusterOutput(point_21)
curve_22 = ClusterOutput(curve_21)

# ==== cluster Toilet

point = Point(Point(-2.230261079, 0.3994009136, 0))
curve = Curve(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)

curve_2 = Curve(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)
point_2 = Point(Point(-15.01398438, 2.285083848, 0))

curve_3 = Curve(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)
point_3 = Point(Point(-12.18780565, 0.3957097767, 0))

curve_4 = Curve(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)
point_4 = Point(Point(-13.61195831, -0.3946090074, 0))

curve_5 = Curve(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)
point_5 = Point(Point(-5.138877321, -3.328149752, 0))

point_6 = Point(Point(-4.835646224, -0.4087179418, 0))
curve_6 = Curve(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)

curve_7 = Curve(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)
point_7 = Point(Point(3.924103056, -1.021564223, 0))

curve_8 = Curve(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)
point_8 = Point(Point(3.726068883, -4.141255886, 0))

point_9 = Point(Point(-3.148911993, 2.034028909, 0))
curve_9 = Curve(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)

curve_10 = Curve(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)
point_10 = Point(Point(6.470582728, 1.766688902, 0))

point_11 = Point(Point(3.11752286, 5.778865863, 0))
curve_11 = Curve(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)

curve_12 = Curve(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)
point_12 = Point(Point(12.36886895, 0.1300430439, 0))

point_13 = Point(Point(-5.605394455, -0.4363654149, 0))
curve_13 = Curve(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)

curve_14 = Curve(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)
point_14 = Point(Point(-16.31058705, -17.8167162, 0))

point_15 = Point(Point(5.676217863, -0.4140450475, 0))
curve_15 = Curve(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)

point_16 = Point(Point(-5.587480201, 2.061086081, 0))
curve_16 = Curve(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)

point_17 = Point(Point(-19.46373718, 0.2769992418, 0))
curve_17 = Curve(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)

point_18 = Point(Point(20.75975773, -1.816278919, 0))
curve_18 = Curve(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)

curve_19 = Curve(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)
point_19 = Point(Point(1.966645242, 3.91022232, 0))

point_20 = Point(Point(6.902344427, 2.050541199, 0))
curve_20 = Curve(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)

merge = Merge(
    Data1=flatten(curve_3),
    Data2=flatten(curve),
    Data3=flatten(curve_2),
    Data4=flatten(curve_5),
    Data5=flatten(curve_4),
    Data6=flatten(curve_6),
    Data7=flatten(curve_7),
    Data8=flatten(curve_8),
    Data9=flatten(curve_10),
    Data10=flatten(curve_9),
    Data11=flatten(curve_11),
    Data12=flatten(curve_13),
    Data13=flatten(curve_15),
    Data14=flatten(curve_16),
    Data15=flatten(curve_20),
    Data16=flatten(curve_19),
    Data17=flatten(curve_17),
    Data18=flatten(curve_14),
    Data19=flatten(curve_12),
    Data20=flatten(curve_18))
merge_2 = Merge(
    Data1=flatten(point_3),
    Data2=flatten(point),
    Data3=flatten(point_2),
    Data4=flatten(point_5),
    Data5=flatten(point_4),
    Data6=flatten(point_6),
    Data7=flatten(point_7),
    Data8=flatten(point_8),
    Data9=flatten(point_10),
    Data10=flatten(point_9),
    Data11=flatten(point_11),
    Data12=flatten(point_13),
    Data13=flatten(point_15),
    Data14=flatten(point_16),
    Data15=flatten(point_20),
    Data16=flatten(point_19),
    Data17=flatten(point_17),
    Data18=flatten(point_14),
    Data19=flatten(point_12),
    Data20=flatten(point_18))
point_21 = Point(merge_2)
curve_21 = Curve(merge)
point_22 = ClusterOutput(point_21)
curve_22 = ClusterOutput(curve_21)

# ==== cluster Kitchen

point = Point(Point(-7.63405146, 4.785165823, 0))
curve = Curve(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)

point_2 = Point(Point(-7.840005681, 1.02469166, 0))
curve_2 = Curve(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)

point_3 = Point(Point(7.968904363, -6.49033743, 0))
curve_3 = Curve(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)

point_4 = Point(Point(-7.329474147, 2.122537476, 0))
curve_4 = Curve(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)

point_5 = Point(Point(-2.662784884, -3.311816958, 0))
curve_5 = Curve(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)

point_6 = Point(Point(9.344060811, -2.087405724, 0))
curve_6 = Curve(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)

curve_7 = Curve(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)
point_7 = Point(Point(-7.076105412, 11.0560027, 0))

point_8 = Point(Point(-15.02405076, -0.2031441189, 0))
curve_8 = Curve(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)

curve_9 = Curve(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)
point_9 = Point(Point(-2.500295786, -0.2366015991, 0))

curve_10 = Curve(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)
point_10 = Point(Point(-11.05405511, 2.114081486, 0))

curve_11 = Curve(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)
point_11 = Point(Point(10.0801765, -1.05300198, 0))

curve_12 = Curve(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)
point_12 = Point(Point(-10.38885149, -2.015277365, 0))

point_13 = Point(Point(-3.7346405, 0.937643768, 0))
curve_13 = Curve(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)

point_14 = Point(Point(4.455625431, -4.26397263, 0))
curve_14 = Curve(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)

point_15 = Point(Point(-4.890961427, -2.357756708, 0))
curve_15 = Curve(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)

point_16 = Point(Point(-3.109858497, 1.426414522, 0))
curve_16 = Curve(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)

point_17 = Point(Point(-14.96021532, 0.8559968614, 0))
curve_17 = Curve(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)

point_18 = Point(Point(0.05321842336, -2.78546543, 0))
curve_18 = Curve(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)

curve_19 = Curve(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)
point_19 = Point(Point(-10.47282816, -0.3686759433, 0))

curve_20 = Curve(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)
point_20 = Point(Point(-9.307739087, -2.290457517, 0))

merge = Merge(
    Data1=flatten(point_2),
    Data2=flatten(point_8),
    Data3=flatten(point_6),
    Data4=flatten(point_9),
    Data5=flatten(point),
    Data6=flatten(point_5),
    Data7=flatten(point_3),
    Data8=flatten(point_7),
    Data9=flatten(point_10),
    Data10=flatten(point_4),
    Data11=flatten(point_12),
    Data12=flatten(point_17),
    Data13=flatten(point_13),
    Data14=flatten(point_18),
    Data15=flatten(point_20),
    Data16=flatten(point_16),
    Data17=flatten(point_11),
    Data18=flatten(point_15),
    Data19=flatten(point_14),
    Data20=flatten(point_19))
merge_2 = Merge(
    Data1=flatten(curve_2),
    Data2=flatten(curve_8),
    Data3=flatten(curve_6),
    Data4=flatten(curve_9),
    Data5=flatten(curve),
    Data6=flatten(curve_5),
    Data7=flatten(curve_3),
    Data8=flatten(curve_7),
    Data9=flatten(curve_10),
    Data10=flatten(curve_4),
    Data11=flatten(curve_12),
    Data12=flatten(curve_17),
    Data13=flatten(curve_13),
    Data14=flatten(curve_18),
    Data15=flatten(curve_20),
    Data16=flatten(curve_16),
    Data17=flatten(curve_11),
    Data18=flatten(curve_15),
    Data19=flatten(curve_14),
    Data20=flatten(curve_19))
point_21 = Point(merge)
curve_21 = Curve(merge_2)
point_22 = ClusterOutput(point_21)
curve_22 = ClusterOutput(curve_21)

# ==== cluster Livingroom

point = Point([Point(3.728042356, -0.8693234614, 0), Point(2.491624023, -2.706287842, 0)])
curve = Curve(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)

point_2 = Point([Point(-12.51961814, -1.464943977, 0), Point(-10.63397653, -2.08842225, 0)])
curve_2 = Curve(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)

point_3 = Point([Point(12.47143827, -2.088362347, 0), Point(10.59914765, -3.395433156, 0)])
curve_3 = Curve(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)

point_4 = Point(Point(-13.79469838, -0.8444001561, 0))
curve_4 = Curve(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)

curve_5 = Curve(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)
point_5 = Point(Point(-6.255319752, 2.11179379, 0))

point_6 = Point([Point(-3.749995886, 0.3945822174, 0), Point(-2.475230922, -0.8338276574, 0)])
curve_6 = Curve(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)

curve_7 = Curve(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)
point_7 = Point(Point(-14.34722404, 2.08670121, 0))

point_8 = Point([Point(13.7078566, -2.688908394, 0), Point(16.21601951, -2.724234632, 0)])
curve_8 = Curve(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)

curve_9 = Curve(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)
point_9 = Point(Point(-7.056297922, 13.6208372, 0))

curve_10 = Curve(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)
point_10 = Point(Point(-11.66419614, 0.4618549469, 0))

point_11 = Point([Point(2.475985463, 0.1562525087, 0), Point(-0.06750367884, -2.946864133, 0), Point(6.821112748, -2.351910395, 0)])
curve_11 = Curve(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)

curve_12 = Curve(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)
point_12 = Point(Point(4.400916142, 0.2181685737, 0))

curve_13 = Curve(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)
point_13 = Point(Point(-3.736466662, 0.9496003192, 0))

curve_14 = Curve(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)
point_14 = Point(Point(13.18427389, 0.2708940659, 0))

point_15 = Point(Point(-0.009101270714, -2.856619766, 0))
curve_15 = Curve(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)

point_16 = Point(Point(3.17067385, -1.55786186, 0))
curve_16 = Curve(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)

point_17 = Point([Point(-3.783260017, 0.7740878179, 0), Point(-8.144523979, -1.756522135, 0), Point(-3.137146838, -0.464295776, 0)])
curve_17 = Curve(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)

curve_18 = Curve(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)
point_18 = Point([Point(-11.87993862, 2.440394982, 0), Point(-13.75222924, 0.5327781254, 0)])

point_19 = Point([Point(1.909765766, 0.8203567558, 0), Point(-3.062075149, 1.43093371, 0)])
curve_19 = Curve(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)

curve_20 = Curve(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)
point_20 = Point([Point(-8.121694209, -1.020432875, 0), Point(-11.82876858, -1.064045514, 0)])

entwine = Entwine(
    Branch00=curve_4,
    Branch01=curve_2,
    Branch02=curve_6,
    Branch03=curve,
    Branch04=curve_3,
    Branch05=curve_8,
    Branch06=curve_9,
    Branch07=curve_10,
    Branch08=curve_7,
    Branch09=curve_5,
    Branch010=curve_12,
    Branch011=curve_14,
    Branch012=curve_15,
    Branch013=curve_13,
    Branch014=curve_16,
    Branch015=curve_17,
    Branch016=curve_11,
    Branch017=curve_20,
    Branch018=curve_19,
    Branch019=curve_18,
    FlattenInputs=True)  # -> simplify(Result)
entwine_2 = Entwine(
    Branch00=point_4,
    Branch01=point_2,
    Branch02=point_6,
    Branch03=point,
    Branch04=point_3,
    Branch05=point_8,
    Branch06=point_9,
    Branch07=point_10,
    Branch08=point_7,
    Branch09=point_5,
    Branch010=point_12,
    Branch011=point_14,
    Branch012=point_15,
    Branch013=point_13,
    Branch014=point_16,
    Branch015=point_17,
    Branch016=point_11,
    Branch017=point_20,
    Branch018=point_19,
    Branch019=point_18,
    FlattenInputs=True)  # -> simplify(Result)
curve_21 = Curve(entwine)
point_21 = Point(entwine_2)
curve_22 = ClusterOutput(curve_21)
point_22 = ClusterOutput(point_21)

# ==== cluster Bedroom

curve = Curve(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)
point = Point(Point(-9.392946519, -4.5827672, 0))

curve_2 = Curve(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)
point_2 = Point(Point(-9.524545189, -3.326681872, 0))

curve_3 = Curve(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)
point_3 = Point(Point(4.027256033, 1.007936333, 0))

curve_4 = Curve(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)
point_4 = Point(Point(-4.843881014, 0.8705632127, 0))

point_5 = Point(Point(6.128221786, 15.28346675, 0))
curve_5 = Curve(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)

curve_6 = Curve(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)
point_6 = Point(Point(-5.674665082, -1.624565804, 0))

point_7 = Point(Point(26.82363431, 2.170116788, 0))
curve_7 = Curve(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)

curve_8 = Curve(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)
point_8 = Point(Point(-4.294125225, 4.515201425, 0))

curve_9 = Curve(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)
point_9 = Point(Point(19.89947704, 11.56360191, 0))

curve_10 = Curve(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)
point_10 = Point(Point(-13.09997609, -1.645718172, 0))

curve_11 = Curve(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)
point_11 = Point(Point(-4.386949208, 4.532570744, 0))

curve_12 = Curve(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)
point_12 = Point(Point(-0.4124642669, 3.566283984, 0))

curve_13 = Curve(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)
point_13 = Point(Point(17.6206904, -2.429387487, 0))

point_14 = Point(Point(-14.46176898, -17.85013558, 0))
curve_14 = Curve(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)

point_15 = Point(Point(-6.214376191, -2.929442567, 0))
curve_15 = Curve(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)

point_16 = Point(Point(-21.52507612, -3.593566933, 0))
curve_16 = Curve(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)

curve_17 = Curve(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)
point_17 = Point(Point(-3.709987683, -4.791894647, 0))

point_18 = Point(Point(-15.70652345, -5.349797573, 0))
curve_18 = Curve(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)

curve_19 = Curve(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)
point_19 = Point(Point(5.501799113, 1.380649213, 0))

curve_20 = Curve(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)
point_20 = Point(Point(-5.44353817, 5.324236579, 0))

merge = Merge(
    Data1=flatten(curve_3),
    Data2=flatten(curve),
    Data3=flatten(curve_2),
    Data4=flatten(curve_4),
    Data5=flatten(curve_6),
    Data6=flatten(curve_10),
    Data7=flatten(curve_11),
    Data8=flatten(curve_8),
    Data9=flatten(curve_12),
    Data10=flatten(curve_20),
    Data11=flatten(curve_15),
    Data12=flatten(curve_17),
    Data13=flatten(curve_14),
    Data14=flatten(curve_18),
    Data15=flatten(curve_5),
    Data16=flatten(curve_7),
    Data17=flatten(curve_9),
    Data18=flatten(curve_19),
    Data19=flatten(curve_16),
    Data20=flatten(curve_13))
merge_2 = Merge(
    Data1=flatten(point_3),
    Data2=flatten(point),
    Data3=flatten(point_2),
    Data4=flatten(point_4),
    Data5=flatten(point_6),
    Data6=flatten(point_10),
    Data7=flatten(point_11),
    Data8=flatten(point_8),
    Data9=flatten(point_12),
    Data10=flatten(point_20),
    Data11=flatten(point_15),
    Data12=flatten(point_17),
    Data13=flatten(point_14),
    Data14=flatten(point_18),
    Data15=flatten(point_5),
    Data16=flatten(point_7),
    Data17=flatten(point_9),
    Data18=flatten(point_19),
    Data19=flatten(point_16),
    Data20=flatten(point_13))
point_21 = Point(merge_2)
curve_21 = Curve(merge)
point_22 = ClusterOutput(point_21)
curve_22 = ClusterOutput(curve_21)

# ==== cluster InternalizedApartments

apartment = Curve(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)
master_bedroom = Curve(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)
bedrooms = Curve(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)
bathroom_1 = Curve(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)
bathrooms_rest = Curve(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)
kitchen = Curve(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)
livingroom = Curve(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)
corridor = Curve(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)
staircase = Curve(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)
balcony = Curve()

apartment_2 = Curve(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)
master_bedroom_2 = Curve(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)
bedrooms_2 = Curve(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)
bathroom_1_2 = Curve(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)
bathrooms_rest_2 = Curve(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)
kitchen_2 = Curve(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)
livingroom_2 = Curve(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)
corridor_2 = Curve(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)
staircase_2 = Curve([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])
balcony_2 = Curve()

apartment_3 = Curve(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)
master_bedroom_3 = Curve(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)
bedrooms_3 = Curve(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)
bathroom_1_3 = Curve(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)
bathrooms_rest_3 = Curve(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)
kitchen_3 = Curve(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)
livingroom_3 = Curve(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)
corridor_3 = Curve(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)
staircase_3 = Curve([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])
balcony_3 = Curve()

master_bedroom_4 = Curve(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)
bedrooms_4 = Curve([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])
item = ListItem(List=bedrooms_4, Index=0, Wrap=True)  # -> Item, Item1

apartment_4 = Curve(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)
master_bedroom_5 = Curve(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)
bedrooms_5 = Curve([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])
bathroom_1_4 = Curve(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)
bathrooms_rest_4 = Curve(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)
kitchen_4 = Curve(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)
livingroom_4 = Curve(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)
corridor_4 = Curve(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)
staircase_4 = Curve(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)
balcony_4 = Curve()

apartment_5 = Curve(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)
master_bedroom_6 = Curve(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)
bedrooms_6 = Curve()
bathroom_1_5 = Curve(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)
bathrooms_rest_5 = Curve()
kitchen_5 = Curve(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)
livingroom_5 = Curve(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)
corridor_5 = Curve(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)
staircase_5 = Curve([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])
balcony_5 = Curve(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)

apartment_6 = Curve(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)
master_bedroom_7 = Curve(item.Item)
bedrooms_7 = Curve(item.Item1)
bathroom_1_6 = Curve(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)
bathrooms_rest_6 = Curve(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)
kitchen_6 = Curve(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)
livingroom_6 = Curve(master_bedroom_4)
corridor_6 = Curve(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)
staircase_6 = Curve([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])
balcony_6 = Curve()

master_bedroom_8 = Curve(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)
master_bedroom_9 = Curve(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)
bedrooms_8 = Curve([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])
item_2 = ListItem(List=bedrooms_8, Index=0, Wrap=True)  # -> Item, Item1
bedrooms_9 = Curve([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])
item_3 = ListItem(List=bedrooms_9, Index=0, Wrap=True)  # -> Item, Item1

apartment_7 = Curve(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)
master_bedroom_10 = Curve(item_2.Item)
bedrooms_10 = Curve(item_2.Item1)
bathroom_1_7 = Curve(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)
bathrooms_rest_7 = Curve(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)
kitchen_7 = Curve(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)
livingroom_7 = Curve(master_bedroom_8)
corridor_7 = Curve(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)
staircase_7 = Curve([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])
balcony_7 = Curve()

apartment_8 = Curve(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)
master_bedroom_11 = Curve(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)
bedrooms_11 = Curve([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])
bathroom_1_8 = Curve(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)
bathrooms_rest_8 = Curve(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)
kitchen_8 = Curve(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)
livingroom_8 = Curve(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)
corridor_8 = Curve(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)
staircase_8 = Curve([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])
balcony_8 = Curve(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)

apartment_9 = Curve(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)
master_bedroom_12 = Curve(item_3.Item)
bedrooms_12 = Curve(item_3.Item1)
bathroom_1_9 = Curve(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)
bathrooms_rest_9 = Curve()
kitchen_9 = Curve(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)
livingroom_9 = Curve(master_bedroom_9)
corridor_9 = Curve(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)
staircase_9 = Curve([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])
balcony_9 = Curve()

master_bedroom_13 = Curve(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)
master_bedroom_14 = Curve(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)
bedrooms_13 = Curve([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])
item_4 = ListItem(List=bedrooms_13, Index=0, Wrap=True)  # -> Item, Item1
bedrooms_14 = Curve([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])
item_5 = ListItem(List=bedrooms_14, Index=0, Wrap=True)  # -> Item, Item1

balcony_10 = Curve()
apartment_10 = Curve(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)
master_bedroom_15 = Curve(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)
bedrooms_15 = Curve([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])
bathroom_1_10 = Curve(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)
bathrooms_rest_10 = Curve(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)
kitchen_10 = Curve(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)
livingroom_10 = Curve(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)
corridor_10 = Curve(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)
staircase_10 = Curve([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])

# ----
# Test Set Apartments
apartment_11 = Curve(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)
master_bedroom_16 = Curve(item_5.Item)
bedrooms_16 = Curve(item_5.Item1)
bathroom_1_11 = Curve(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)
bathrooms_rest_11 = Curve(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)
kitchen_11 = Curve(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)
livingroom_11 = Curve(master_bedroom_13)
corridor_11 = Curve(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)
staircase_11 = Curve([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])
balcony_11 = Curve()

apartment_12 = Curve(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)
master_bedroom_17 = Curve(item_4.Item)
bedrooms_17 = Curve(item_4.Item1)
bathroom_1_12 = Curve(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)
bathrooms_rest_12 = Curve()
kitchen_12 = Curve(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)
livingroom_12 = Curve(master_bedroom_14)
corridor_12 = Curve(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)
staircase_12 = Curve([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])
balcony_12 = Curve()

master_bedroom_18 = Curve(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)
bedrooms_18 = Curve([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])
item_6 = ListItem(List=bedrooms_18, Index=0, Wrap=True)  # -> Item, Item1

balcony_13 = Curve()
apartment_13 = Curve(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)
master_bedroom_19 = Curve(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)
bedrooms_19 = Curve()
bathroom_1_13 = Curve(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)
bathrooms_rest_13 = Curve()
kitchen_13 = Curve(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)
livingroom_13 = Curve(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)
corridor_13 = Curve(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)
staircase_13 = Curve([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])

apartment_14 = Curve(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)
master_bedroom_20 = Curve(item_6.Item)
bedrooms_20 = Curve(item_6.Item1)
bathroom_1_14 = Curve(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)
bathrooms_rest_14 = Curve()
kitchen_14 = Curve(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)
livingroom_14 = Curve(master_bedroom_18)
corridor_14 = Curve(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)
staircase_14 = Curve([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])
balcony_14 = Curve()

entwine = Entwine(
    Branch00=apartment,
    Branch01=apartment_4,
    Branch02=apartment_7,
    Branch03=apartment_11,
    Branch04=apartment_2,
    Branch05=apartment_5,
    Branch06=apartment_8,
    Branch07=apartment_10,
    Branch08=apartment_13,
    Branch09=apartment_3,
    Branch010=apartment_6,
    Branch011=apartment_9,
    Branch012=apartment_12,
    Branch013=apartment_14,
    FlattenInputs=True)  # -> simplify(Result)
entwine_2 = Entwine(
    Branch00=master_bedroom,
    Branch01=master_bedroom_5,
    Branch02=master_bedroom_10,
    Branch03=master_bedroom_16,
    Branch04=master_bedroom_2,
    Branch05=master_bedroom_6,
    Branch06=master_bedroom_11,
    Branch07=master_bedroom_15,
    Branch08=master_bedroom_19,
    Branch09=master_bedroom_3,
    Branch010=master_bedroom_7,
    Branch011=master_bedroom_12,
    Branch012=master_bedroom_17,
    Branch013=master_bedroom_20,
    FlattenInputs=True)  # -> simplify(Result)
entwine_3 = Entwine(
    Branch00=bedrooms,
    Branch01=bedrooms_5,
    Branch02=bedrooms_10,
    Branch03=bedrooms_16,
    Branch04=bedrooms_2,
    Branch05=bedrooms_6,
    Branch06=bedrooms_11,
    Branch07=bedrooms_15,
    Branch08=bedrooms_19,
    Branch09=bedrooms_3,
    Branch010=bedrooms_7,
    Branch011=bedrooms_12,
    Branch012=bedrooms_17,
    Branch013=bedrooms_20,
    FlattenInputs=True)  # -> simplify(Result)
entwine_4 = Entwine(
    Branch00=bathroom_1,
    Branch01=bathroom_1_4,
    Branch02=bathroom_1_7,
    Branch03=bathroom_1_11,
    Branch04=bathroom_1_2,
    Branch05=bathroom_1_5,
    Branch06=bathroom_1_8,
    Branch07=bathroom_1_10,
    Branch08=bathroom_1_13,
    Branch09=bathroom_1_3,
    Branch010=bathroom_1_6,
    Branch011=bathroom_1_9,
    Branch012=bathroom_1_12,
    Branch013=bathroom_1_14,
    FlattenInputs=True)  # -> simplify(Result)
entwine_5 = Entwine(
    Branch00=kitchen,
    Branch01=kitchen_4,
    Branch02=kitchen_7,
    Branch03=kitchen_11,
    Branch04=kitchen_2,
    Branch05=kitchen_5,
    Branch06=kitchen_8,
    Branch07=kitchen_10,
    Branch08=kitchen_13,
    Branch09=kitchen_3,
    Branch010=kitchen_6,
    Branch011=kitchen_9,
    Branch012=kitchen_12,
    Branch013=kitchen_14,
    FlattenInputs=True)  # -> simplify(Result)
entwine_6 = Entwine(
    Branch00=bathrooms_rest,
    Branch01=bathrooms_rest_4,
    Branch02=bathrooms_rest_7,
    Branch03=bathrooms_rest_11,
    Branch04=bathrooms_rest_2,
    Branch05=bathrooms_rest_5,
    Branch06=bathrooms_rest_8,
    Branch07=bathrooms_rest_10,
    Branch08=bathrooms_rest_13,
    Branch09=bathrooms_rest_3,
    Branch010=bathrooms_rest_6,
    Branch011=bathrooms_rest_9,
    Branch012=bathrooms_rest_12,
    Branch013=bathrooms_rest_14,
    FlattenInputs=True)  # -> simplify(Result)
entwine_7 = Entwine(
    Branch00=livingroom,
    Branch01=livingroom_4,
    Branch02=livingroom_7,
    Branch03=livingroom_11,
    Branch04=livingroom_2,
    Branch05=livingroom_5,
    Branch06=livingroom_8,
    Branch07=livingroom_10,
    Branch08=livingroom_13,
    Branch09=livingroom_3,
    Branch010=livingroom_6,
    Branch011=livingroom_9,
    Branch012=livingroom_12,
    Branch013=livingroom_14,
    FlattenInputs=True)  # -> simplify(Result)
entwine_8 = Entwine(
    Branch00=corridor,
    Branch01=corridor_4,
    Branch02=corridor_7,
    Branch03=corridor_11,
    Branch04=corridor_2,
    Branch05=corridor_5,
    Branch06=corridor_8,
    Branch07=corridor_10,
    Branch08=corridor_13,
    Branch09=corridor_3,
    Branch010=corridor_6,
    Branch011=corridor_9,
    Branch012=corridor_12,
    Branch013=corridor_14,
    FlattenInputs=True)  # -> simplify(Result)
entwine_9 = Entwine(
    Branch00=staircase,
    Branch01=staircase_4,
    Branch02=staircase_7,
    Branch03=staircase_11,
    Branch04=staircase_2,
    Branch05=staircase_5,
    Branch06=staircase_8,
    Branch07=staircase_10,
    Branch08=staircase_13,
    Branch09=staircase_3,
    Branch010=staircase_6,
    Branch011=staircase_9,
    Branch012=staircase_12,
    Branch013=staircase_14,
    FlattenInputs=True)  # -> simplify(Result)
number_slider = Slider(0, range=0..14)
num = ClusterInput()
num_2 = Number(num)
branch = TreeBranch(Tree=entwine, Path=num_2, MaintainPaths=True)
branch_2 = TreeBranch(Tree=entwine_2, Path=num_2, MaintainPaths=True)
branch_3 = TreeBranch(Tree=entwine_3, Path=num_2, MaintainPaths=True)
branch_4 = TreeBranch(Tree=entwine_4, Path=num_2, MaintainPaths=True)
branch_5 = TreeBranch(Tree=entwine_6, Path=num_2, MaintainPaths=True)
branch_6 = TreeBranch(Tree=entwine_5, Path=num_2, MaintainPaths=True)
branch_7 = TreeBranch(Tree=entwine_7, Path=num_2, MaintainPaths=True)
branch_8 = TreeBranch(Tree=entwine_8, Path=num_2, MaintainPaths=True)
branch_9 = TreeBranch(Tree=entwine_9, Path=num_2, MaintainPaths=True)
apartment_15 = Curve(branch)
master_bedroom_21 = Curve(branch_2)
bedrooms_21 = Curve(branch_3)
bathroom_1_15 = Curve(branch_4)
bathrooms_rest_15 = Curve(branch_5)
kitchen_15 = Curve(branch_6)
livingroom_15 = Curve(branch_7)
corridor_15 = Curve(branch_8)
apartment_16 = Curve(branch)
master_bedroom_22 = Curve(branch_2)
bedrooms_22 = Curve(branch_3)
bathroom_1_16 = Curve(branch_4)
bathrooms_rest_16 = Curve(branch_5)
kitchen_16 = Curve(branch_6)
livingroom_16 = Curve(branch_7)
corridor_16 = Curve(branch_8)
stairs = Curve(branch_9)
apartment_17 = ClusterOutput(apartment_16)
master_bedroom_23 = ClusterOutput(master_bedroom_22)
bedrooms_23 = ClusterOutput(bedrooms_22)
bathroom_1_17 = ClusterOutput(bathroom_1_16)
bathrooms_rest_17 = ClusterOutput(bathrooms_rest_16)
kitchen_17 = ClusterOutput(kitchen_16)
livingroom_17 = ClusterOutput(livingroom_16)
corridor_17 = ClusterOutput(corridor_16)
stairs_2 = ClusterOutput(stairs)

# ==== cluster TestSet
option_num = ClusterInput()
option_num_2 = Number(option_num)

# ---- group: apt 1
# master bedroom
# bedroom
# living
# kitchen
# bathroom
panel = Panel("""2
2""")
panel_2 = Panel("""2
2
2""")
panel_3 = Panel("""2
2
2""")
panel_4 = Panel("""1
0
0""")
panel_5 = Panel("""2
2""")
panel_6 = Panel("""2
2""")
panel_7 = Panel("""1
2
2""")
panel_8 = Panel("""1
2
2""")
panel_9 = Panel("""1
2
2""")
entwine = Entwine(Branch0X="2", Branch1X="2", Branch2X="2", FlattenInputs=False)
entwine_2 = Entwine(Branch0X=panel_6, Branch1X=panel_5, FlattenInputs=False)
entwine_3 = Entwine(Branch0X=panel_8, Branch1X=panel_7, Branch2X=panel_9, FlattenInputs=False)
entwine_4 = Entwine(Branch0X="2", Branch1X="2", Branch2X="2", FlattenInputs=False)
panel_10 = Panel(panel)
panel_11 = Panel(panel_2)
panel_12 = Panel(panel_3)
panel_13 = Panel(entwine)
panel_14 = Panel(entwine_2)
panel_15 = Panel(entwine_3)
panel_16 = Panel(entwine_4)

# ---- group: apt 11
# master bedroom
# bedroom
# living
# super interesting case, would be cool to actually make it work
# kitchen
# bathroom
panel_17 = Panel("""0
1
2""")
panel_18 = Panel("""1
1""")
panel_19 = Panel("""1
1
1""")
panel_20 = Panel("""1
1
0""")
panel_21 = Panel("""0
2
2""")
panel_22 = Panel("""0
0
0""")
panel_23 = Panel("""0
2
2""")
entwine_5 = Entwine(Branch0X="2", Branch1X="1", Branch2X="2", FlattenInputs=False)
entwine_6 = Entwine(Branch0X="1", Branch1X="1", FlattenInputs=False)
entwine_7 = Entwine(Branch0X=panel_22, Branch1X=panel_21, Branch2X=panel_23, FlattenInputs=False)
entwine_8 = Entwine(Branch0X="0", Branch1X="0", Branch2X="0", FlattenInputs=False)
panel_24 = Panel(panel_18)
panel_25 = Panel(panel_17)
panel_26 = Panel(panel_19)
panel_27 = Panel(entwine_5)
panel_28 = Panel(entwine_6)
panel_29 = Panel(entwine_7)
panel_30 = Panel(entwine_8)

# ---- group: apt 6
# master bedroom
# bedroom
# living
# kitchen
# bathroom
panel_31 = Panel("""0
2
2""")
panel_32 = Panel("""0
0""")
panel_33 = Panel("1")
panel_34 = Panel("""2
2
0""")
panel_35 = Panel("""0
0""")
panel_36 = Panel("""0
0""")
panel_37 = Panel("""0
1
2""")
panel_38 = Panel("""0
0
0""")
panel_39 = Panel("""0
1
2""")
entwine_9 = Entwine(Branch0X="2", Branch1X="2", Branch2X="2", FlattenInputs=False)
entwine_10 = Entwine(Branch0X=panel_36, Branch1X=panel_35, FlattenInputs=False)
entwine_11 = Entwine(Branch0X=panel_38, Branch1X=panel_37, Branch2X=panel_39, FlattenInputs=False)
entwine_12 = Entwine(Branch0X="0", FlattenInputs=False)
panel_40 = Panel(panel_32)
panel_41 = Panel(panel_31)
panel_42 = Panel(panel_33)
panel_43 = Panel(entwine_9)
panel_44 = Panel(entwine_10)
panel_45 = Panel(entwine_11)
panel_46 = Panel(entwine_12)

# ----
graft = GraftTree(Tree=panel_2, IncludeEmptyLists=True, IncludeNullItems=True)
panel_47 = Panel("""0
0""")
panel_48 = Panel("""0
0""")
panel_49 = Panel("""0
0""")

# ---- group: apt 12
# master bedroom
# bedroom
# living
# kitchen
# bathroom
panel_50 = Panel("""1
2
2""")
panel_51 = Panel("""1
2""")
panel_52 = Panel("""2
2
2""")
panel_53 = Panel("""1
2
0""")
panel_54 = Panel("""1
2""")
panel_55 = Panel("""0
1""")
panel_56 = Panel("""1
2
2""")
panel_57 = Panel("""0
1
2""")
panel_58 = Panel("""0
0
1""")
entwine_13 = Entwine(Branch0X="2", Branch1X="2", Branch2X="0", FlattenInputs=False)
entwine_14 = Entwine(Branch0X=panel_55, Branch1X=panel_54, FlattenInputs=False)
entwine_15 = Entwine(Branch0X=panel_58, Branch1X=panel_56, Branch2X=panel_57, FlattenInputs=False)
entwine_16 = Entwine(Branch0X="0", Branch1X="0", Branch2X="0", FlattenInputs=False)
panel_59 = Panel(panel_51)
panel_60 = Panel(panel_50)
panel_61 = Panel(panel_52)
panel_62 = Panel(entwine_13)
panel_63 = Panel(entwine_14)
panel_64 = Panel(entwine_15)
panel_65 = Panel(entwine_16)

# ----
entwine_17 = Entwine(Branch0X=panel_49, Branch1X=panel_48, FlattenInputs=False)

# ---- group: apt 7
# master bedroom
# bedroom
# bedroom
# living
# kitchen
# bathroom
panel_66 = Panel("""2
2
2""")
panel_67 = Panel("""2
2""")
panel_68 = Panel("""0
1""")
panel_69 = Panel("""1
0
0""")
panel_70 = Panel("""2
2""")
panel_71 = Panel("""2
2""")
panel_72 = Panel("""2
2
2""")
panel_73 = Panel("""2
2
2""")
panel_74 = Panel("""2
2
2""")
entwine_18 = Entwine(Branch0X="2", Branch1X="2", Branch2X="2", FlattenInputs=False)
entwine_19 = Entwine(Branch0X=panel_71, Branch1X=panel_70, FlattenInputs=False)
entwine_20 = Entwine(Branch0X=panel_73, Branch1X=panel_72, Branch2X=panel_74, FlattenInputs=False)
entwine_21 = Entwine(Branch0X="0", Branch1X="1", FlattenInputs=False)
panel_75 = Panel(panel_67)
panel_76 = Panel(panel_66)
panel_77 = Panel(panel_68)
panel_78 = Panel(entwine_18)
panel_79 = Panel(entwine_19)
panel_80 = Panel(entwine_20)
panel_81 = Panel(entwine_21)
panel_82 = Panel("""1
1""")
panel_83 = Panel("""0
0""")
panel_84 = Panel("""0
0""")
entwine_22 = Entwine(Branch0X=panel_84, Branch1X=panel_83, FlattenInputs=False)
panel_85 = Panel(panel_82)
panel_86 = Panel(entwine_22)

# ---- group: apt 2
# master bedroom
# bedroom
# bedroom
# living
# kitchen
# bathroom
panel_87 = Panel("""1
2
2""")
panel_88 = Panel("""2
2""")
panel_89 = Panel("""2
2""")
panel_90 = Panel("""1
1
0""")
panel_91 = Panel("""2
2""")
panel_92 = Panel("""2
2""")
panel_93 = Panel("""1
2
2""")
panel_94 = Panel("""0
0
0""")
panel_95 = Panel("""1
2
2""")
entwine_23 = Entwine(Branch0X="2", Branch1X="2", Branch2X="2", FlattenInputs=False)
entwine_24 = Entwine(Branch0X=panel_92, Branch1X=panel_91, FlattenInputs=False)
entwine_25 = Entwine(Branch0X=panel_94, Branch1X=panel_93, Branch2X=panel_95, FlattenInputs=False)
entwine_26 = Entwine(Branch0X="2", Branch1X="2", FlattenInputs=False)
panel_96 = Panel(panel_88)
panel_97 = Panel(panel_87)
panel_98 = Panel(panel_89)
panel_99 = Panel(entwine_23)
panel_100 = Panel(entwine_24)
panel_101 = Panel(entwine_25)
panel_102 = Panel(entwine_26)
panel_103 = Panel("""2
2""")
panel_104 = Panel("""2
2""")
panel_105 = Panel("""2
2""")
entwine_27 = Entwine(Branch0X=panel_105, Branch1X=panel_104, FlattenInputs=False)
panel_106 = Panel(panel_103)
panel_107 = Panel(entwine_27)

# ---- group: apt 13
# master bedroom
# bedroom
# living
# kitchen
# bathroom
panel_108 = Panel("""1
2
2""")
panel_109 = Panel("""2
2""")
panel_110 = Panel("""2
2
2""")
panel_111 = Panel("""0
0
0""")
panel_112 = Panel("""1
2""")
panel_113 = Panel("""1
2""")
panel_114 = Panel("""2
2
2""")
panel_115 = Panel("""1
1
1""")
panel_116 = Panel("""2
2
2""")
entwine_28 = Entwine(Branch0X="1", Branch1X="1", Branch2X="1", FlattenInputs=False)
entwine_29 = Entwine(Branch0X=panel_113, Branch1X=panel_112, FlattenInputs=False)
entwine_30 = Entwine(Branch0X=panel_115, Branch1X=panel_114, Branch2X=panel_116, FlattenInputs=False)
entwine_31 = Entwine(Branch0X="0", Branch1X="0", Branch2X="0", FlattenInputs=False)
panel_117 = Panel(panel_109)
panel_118 = Panel(panel_108)
panel_119 = Panel(panel_110)
panel_120 = Panel(entwine_28)
panel_121 = Panel(entwine_29)
panel_122 = Panel(entwine_30)
panel_123 = Panel(entwine_31)

# ---- group: apt 8
# master bedroom
# bedroom
# bedroom
# living
# kitchen
# bathroom
panel_124 = Panel("""2
2""")
panel_125 = Panel("""0
2""")
panel_126 = Panel("""0
1
0""")
panel_127 = Panel("""2
2""")
panel_128 = Panel("""2
2""")
panel_129 = Panel("""2
2
2""")
panel_130 = Panel("""2
2
2""")
panel_131 = Panel("""2
2
2""")
entwine_32 = Entwine(Branch0X="2", Branch1X="2", Branch2X="2", FlattenInputs=False)
entwine_33 = Entwine(Branch0X=panel_128, Branch1X=panel_127, FlattenInputs=False)
entwine_34 = Entwine(Branch0X=panel_131, Branch1X=panel_129, Branch2X=panel_130, FlattenInputs=False)
entwine_35 = Entwine(Branch0X="0", Branch1X="1", FlattenInputs=False)
panel_132 = Panel(panel_124)
panel_133 = Panel(panel_125)
panel_134 = Panel(entwine_32)
panel_135 = Panel(entwine_33)
panel_136 = Panel(entwine_34)
panel_137 = Panel(entwine_35)
panel_138 = Panel("""1
1""")
panel_139 = Panel("""2
2
2""")
panel_140 = Panel(panel_139)
panel_141 = Panel("""0
0""")
panel_142 = Panel("""0
0""")
entwine_36 = Entwine(Branch0X=panel_142, Branch1X=panel_141, FlattenInputs=False)
panel_143 = Panel(panel_138)
panel_144 = Panel(entwine_36)

# ---- group: apt 14
# master bedroom
# bedroom
# bedroom
# living
# kitchen
# bathroom
panel_145 = Panel("""2
2
2""")
panel_146 = Panel("""2
2""")
panel_147 = Panel("""2
2
1""")
panel_148 = Panel("""2
2
1""")
panel_149 = Panel("""2
2""")
panel_150 = Panel("""2
2""")
panel_151 = Panel("""2
2
2""")
panel_152 = Panel("""2
2
2""")
panel_153 = Panel("""2
2
2""")
entwine_37 = Entwine(Branch0X="2", Branch1X="2", Branch2X="2", FlattenInputs=False)
entwine_38 = Entwine(Branch0X=panel_150, Branch1X=panel_149, FlattenInputs=False)
entwine_39 = Entwine(Branch0X=panel_153, Branch1X=panel_151, Branch2X=panel_152, FlattenInputs=False)
entwine_40 = Entwine(Branch0X="1", Branch1X="1", Branch2X="1", FlattenInputs=False)
panel_154 = Panel(panel_146)
panel_155 = Panel(panel_145)
panel_156 = Panel(panel_147)
panel_157 = Panel(entwine_37)
panel_158 = Panel(entwine_38)
panel_159 = Panel(entwine_39)
panel_160 = Panel(entwine_40)
panel_161 = Panel("""1
1""")
panel_162 = Panel("""1
1""")
panel_163 = Panel("""0
1""")
entwine_41 = Entwine(Branch0X=panel_163, Branch1X=panel_162, FlattenInputs=False)
panel_164 = Panel(panel_161)
panel_165 = Panel(entwine_41)

# ---- group: apt 3
# master bedroom
# bedroom
# living
# kitchen
# bathroom
panel_166 = Panel("""2
2
2""")
panel_167 = Panel("""2
2""")
panel_168 = Panel("""2
2
2""")
panel_169 = Panel("""2
2
2""")
panel_170 = Panel("""2
2
2""")
panel_171 = Panel("""2
2""")
panel_172 = Panel("""2
2""")
panel_173 = Panel("""2
2
2""")
panel_174 = Panel("""0
0
0""")
entwine_42 = Entwine(Branch0X="0", Branch1X="0", Branch2X="0", FlattenInputs=False)
entwine_43 = Entwine(Branch0X=panel_172, Branch1X=panel_171, FlattenInputs=False)
entwine_44 = Entwine(Branch0X=panel_174, Branch1X=panel_169, Branch2X=panel_169, FlattenInputs=False)
entwine_45 = Entwine(Branch0X="2", Branch1X="2", Branch2X="2", FlattenInputs=False)
panel_175 = Panel(panel_167)
panel_176 = Panel(panel_166)
panel_177 = Panel(panel_168)
panel_178 = Panel(entwine_42)
panel_179 = Panel(entwine_43)
panel_180 = Panel(entwine_44)
panel_181 = Panel(entwine_45)

# ---- group: apt 4
# master bedroom
# bedroom
# living
# kitchen
# bathroom
panel_182 = Panel("""1
2
2""")
panel_183 = Panel("""1
1""")
panel_184 = Panel("""2
2
2""")
panel_185 = Panel("""2
2
2""")
panel_186 = Panel("""1
2""")
panel_187 = Panel("""1
2""")
panel_188 = Panel("""1
2
2""")
panel_189 = Panel("""2
2
2""")
entwine_46 = Entwine(Branch0X="1", Branch1X="0", Branch2X="0", FlattenInputs=False)
entwine_47 = Entwine(Branch0X=panel_187, Branch1X=panel_186, FlattenInputs=False)
entwine_48 = Entwine(Branch0X=panel_189, Branch1X=panel_189, Branch2X=panel_189, FlattenInputs=False)
entwine_49 = Entwine(Branch0X="2", Branch1X="2", Branch2X="2", FlattenInputs=False)
panel_191 = Panel(panel_183)
panel_192 = Panel(panel_182)
panel_193 = Panel(panel_184)
panel_194 = Panel(entwine_46)
panel_195 = Panel(entwine_47)
panel_196 = Panel(entwine_48)
panel_197 = Panel(entwine_49)

# ---- group: apt 9
# master bedroom
# bedroom
# living
# kitchen
# bathroom
panel_198 = Panel("""1
2
2""")
panel_199 = Panel("""0
0""")
panel_200 = Panel("2")
panel_201 = Panel("""1
1
0""")
panel_202 = Panel("""0
0""")
panel_203 = Panel("""0
0""")
panel_204 = Panel("""1
2
2""")
panel_205 = Panel("""1
2
2""")
panel_206 = Panel("""0
0
1""")
entwine_50 = Entwine(Branch0X="1", Branch1X="1", Branch2X="0", FlattenInputs=False)
entwine_51 = Entwine(Branch0X=panel_203, Branch1X=panel_202, FlattenInputs=False)
entwine_52 = Entwine(Branch0X=panel_206, Branch1X=panel_204, Branch2X=panel_205, FlattenInputs=False)
entwine_53 = Entwine(Branch0X="2", FlattenInputs=False)
panel_207 = Panel(panel_199)
panel_208 = Panel(panel_198)
panel_209 = Panel(panel_200)
panel_210 = Panel(entwine_50)
panel_211 = Panel(entwine_51)
panel_212 = Panel(entwine_52)
panel_213 = Panel(entwine_53)

# ---- group: apt 5
# master bedroom
# bedroom
# living
# kitchen
# bathroom
panel_214 = Panel("""1
2
2""")
panel_215 = Panel("""2
2""")
panel_216 = Panel("""2
2
2""")
panel_217 = Panel("""1
1
0""")
panel_218 = Panel("""2
2""")
panel_219 = Panel("""2
2""")
panel_220 = Panel("""1
2
2""")
panel_221 = Panel("""1
2
2""")
panel_222 = Panel("""0
0
1""")
entwine_54 = Entwine(Branch0X="1", Branch1X="2", Branch2X="2", FlattenInputs=False)
entwine_55 = Entwine(Branch0X=panel_219, Branch1X=panel_218, FlattenInputs=False)
entwine_56 = Entwine(Branch0X=panel_222, Branch1X=panel_220, Branch2X=panel_221, FlattenInputs=False)
entwine_57 = Entwine(Branch0X="2", Branch1X="2", Branch2X="2", FlattenInputs=False)
panel_223 = Panel(panel_215)
panel_224 = Panel(panel_214)
panel_225 = Panel(panel_216)
panel_226 = Panel(entwine_54)
panel_227 = Panel(entwine_55)
panel_228 = Panel(entwine_56)
panel_229 = Panel(entwine_57)

# ---- group: apt 10
# master bedroom
# bedroom
panel_230 = Panel("""1
2
2""")
panel_231 = Panel("""2
2""")
panel_232 = Panel("""2
2
1""")
panel_233 = Panel("""1
0
0""")
panel_234 = Panel("""2
2""")
panel_235 = Panel("""2
2""")
panel_236 = Panel("""1
2
2""")
panel_237 = Panel("""1
2
2""")
panel_238 = Panel("""0
0
1""")
entwine_58 = Entwine(Branch0X="0", Branch1X="0", Branch2X="0", FlattenInputs=False)
entwine_59 = Entwine(Branch0X=panel_235, Branch1X=panel_234, FlattenInputs=False)
entwine_60 = Entwine(Branch0X=panel_238, Branch1X=panel_236, Branch2X=panel_237, FlattenInputs=False)
entwine_61 = Entwine(Branch0X="2", Branch1X="2", Branch2X="2", FlattenInputs=False)
panel_239 = Panel(panel_231)
panel_240 = Panel(panel_230)
panel_241 = Panel(panel_232)
panel_242 = Panel(entwine_58)
panel_243 = Panel(entwine_59)
panel_244 = Panel(entwine_60)
panel_245 = Panel(entwine_61)

# ----
data = Data(panel_47)
null = NullObject()
nulls_in_empty = NullsInEmptyBranches(DataWithEmptyBranches=data)
null_2 = NullObject()
chi_2_1 = Entwine(
    Branch0X=panel_47,
    Branch1X=panel_103,
    Branch2X=panel_47,
    Branch3X=panel_47,
    Branch4X=panel_47,
    Branch5X=data,
    Branch6X=panel_82,
    Branch7X=panel_138,
    Branch8X=panel_47,
    Branch9X=panel_47,
    Branch10X=panel_47,
    Branch11X=panel_47,
    Branch12X=panel_47,
    Branch13X=panel_161,
    FlattenInputs=False)
liv1 = Entwine(
    Branch0X=panel_3,
    Branch1X=panel_89,
    Branch2X=panel_168,
    Branch3X=panel_184,
    Branch4X=panel_216,
    Branch5X=panel_33,
    Branch6X=panel_68,
    Branch7X=panel_125,
    Branch8X=panel_200,
    Branch9X=panel_232,
    Branch10X=panel_19,
    Branch11X=panel_52,
    Branch12X=panel_110,
    Branch13X=panel_147,
    FlattenInputs=False)
kit_1 = Entwine(
    Branch0X=panel_4,
    Branch1X=panel_90,
    Branch2X=panel_170,
    Branch3X=panel_185,
    Branch4X=panel_217,
    Branch5X=panel_34,
    Branch6X=panel_69,
    Branch7X=panel_126,
    Branch8X=panel_201,
    Branch9X=panel_233,
    Branch10X=panel_20,
    Branch11X=panel_53,
    Branch12X=panel_111,
    Branch13X=panel_148,
    FlattenInputs=False)
bed_1 = Entwine(
    Branch0X=panel_2,
    Branch1X=panel_87,
    Branch2X=panel_166,
    Branch3X=panel_182,
    Branch4X=panel_214,
    Branch5X=panel_31,
    Branch6X=panel_66,
    Branch7X=panel_139,
    Branch8X=panel_198,
    Branch9X=panel_230,
    Branch10X=panel_17,
    Branch11X=panel_50,
    Branch12X=panel_108,
    Branch13X=panel_145,
    FlattenInputs=False)
chi_1 = Entwine(
    Branch0X=panel,
    Branch1X=panel_88,
    Branch2X=panel_167,
    Branch3X=panel_183,
    Branch4X=panel_215,
    Branch5X=panel_32,
    Branch6X=panel_67,
    Branch7X=panel_124,
    Branch8X=panel_199,
    Branch9X=panel_231,
    Branch10X=panel_18,
    Branch11X=panel_51,
    Branch12X=panel_109,
    Branch13X=panel_146,
    FlattenInputs=False)
wrap = WrapList(Data=entwine_3)  # -> flatten(WrappedData)
wrap_2 = WrapList(Data=entwine_25)  # -> flatten(WrappedData)
wrap_3 = WrapList(Data=entwine_44)  # -> flatten(WrappedData)
wrap_4 = WrapList(Data=entwine_48)  # -> flatten(WrappedData)
wrap_5 = WrapList(Data=entwine_56)  # -> flatten(WrappedData)
wrap_6 = WrapList(Data=entwine_2)  # -> flatten(WrappedData)
wrap_7 = WrapList(Data=entwine_24)  # -> flatten(WrappedData)
wrap_8 = WrapList(Data=entwine_43)  # -> flatten(WrappedData)
wrap_9 = WrapList(Data=entwine_47)  # -> flatten(WrappedData)
wrap_10 = WrapList(Data=entwine_55)  # -> flatten(WrappedData)
wrap_11 = WrapList(Data=entwine_4)  # -> flatten(WrappedData)
wrap_12 = WrapList(Data=entwine_26)  # -> flatten(WrappedData)
wrap_13 = WrapList(Data=entwine_45)  # -> flatten(WrappedData)
wrap_14 = WrapList(Data=entwine_49)  # -> flatten(WrappedData)
wrap_15 = WrapList(Data=entwine_57)  # -> flatten(WrappedData)
wrap_16 = WrapList(Data=entwine_17)  # -> flatten(WrappedData)
wrap_17 = WrapList(Data=entwine_27)  # -> flatten(WrappedData)
wrap_18 = WrapList(Data=entwine_17)  # -> flatten(WrappedData)
wrap_19 = WrapList(Data=entwine_17)  # -> flatten(WrappedData)
wrap_20 = WrapList(Data=entwine_17)  # -> flatten(WrappedData)
wrap_21 = WrapList(Data=entwine)  # -> flatten(WrappedData)
wrap_22 = WrapList(Data=entwine_23)  # -> flatten(WrappedData)
wrap_23 = WrapList(Data=entwine_42)  # -> flatten(WrappedData)
wrap_24 = WrapList(Data=entwine_46)  # -> flatten(WrappedData)
wrap_25 = WrapList(Data=entwine_54)  # -> flatten(WrappedData)
wrap_26 = WrapList(Data=entwine_10)  # -> flatten(WrappedData)
wrap_27 = WrapList(Data=entwine_19)  # -> flatten(WrappedData)
wrap_28 = WrapList(Data=entwine_33)  # -> flatten(WrappedData)
wrap_29 = WrapList(Data=entwine_51)  # -> flatten(WrappedData)
wrap_30 = WrapList(Data=entwine_59)  # -> flatten(WrappedData)
wrap_31 = WrapList(Data=entwine_12)  # -> flatten(WrappedData)
wrap_32 = WrapList(Data=entwine_21)  # -> flatten(WrappedData)
wrap_33 = WrapList(Data=entwine_35)  # -> flatten(WrappedData)
wrap_34 = WrapList(Data=entwine_53)  # -> flatten(WrappedData)
wrap_35 = WrapList(Data=entwine_61)  # -> flatten(WrappedData)
wrap_36 = WrapList(Data=entwine_11)  # -> flatten(WrappedData)
wrap_37 = WrapList(Data=entwine_20)  # -> flatten(WrappedData)
wrap_38 = WrapList(Data=entwine_34)  # -> flatten(WrappedData)
wrap_39 = WrapList(Data=entwine_52)  # -> flatten(WrappedData)
wrap_40 = WrapList(Data=entwine_60)  # -> flatten(WrappedData)
wrap_41 = WrapList(Data=entwine_9)  # -> flatten(WrappedData)
wrap_42 = WrapList(Data=entwine_18)  # -> flatten(WrappedData)
wrap_43 = WrapList(Data=entwine_32)  # -> flatten(WrappedData)
wrap_44 = WrapList(Data=entwine_50)  # -> flatten(WrappedData)
wrap_45 = WrapList(Data=entwine_58)  # -> flatten(WrappedData)
wrap_46 = WrapList(Data=entwine_17)  # -> flatten(WrappedData)
wrap_47 = WrapList(Data=entwine_22)  # -> flatten(WrappedData)
wrap_48 = WrapList(Data=entwine_33)  # -> flatten(WrappedData)
wrap_49 = WrapList(Data=entwine_17)  # -> flatten(WrappedData)
wrap_50 = WrapList(Data=entwine_17)  # -> flatten(WrappedData)
wrap_51 = WrapList(Data=entwine_6)  # -> flatten(WrappedData)
wrap_52 = WrapList(Data=entwine_14)  # -> flatten(WrappedData)
wrap_53 = WrapList(Data=entwine_29)  # -> flatten(WrappedData)
wrap_54 = WrapList(Data=entwine_38)  # -> flatten(WrappedData)
wrap_55 = WrapList(Data=entwine_5)  # -> flatten(WrappedData)
wrap_56 = WrapList(Data=entwine_13)  # -> flatten(WrappedData)
wrap_57 = WrapList(Data=entwine_28)  # -> flatten(WrappedData)
wrap_58 = WrapList(Data=entwine_37)  # -> flatten(WrappedData)
wrap_59 = WrapList(Data=entwine_8)  # -> flatten(WrappedData)
wrap_60 = WrapList(Data=entwine_16)  # -> flatten(WrappedData)
wrap_61 = WrapList(Data=entwine_31)  # -> flatten(WrappedData)
wrap_62 = WrapList(Data=entwine_40)  # -> flatten(WrappedData)
wrap_63 = WrapList(Data=entwine_7)  # -> flatten(WrappedData)
wrap_64 = WrapList(Data=entwine_15)  # -> flatten(WrappedData)
wrap_65 = WrapList(Data=entwine_30)  # -> flatten(WrappedData)
wrap_66 = WrapList(Data=entwine_39)  # -> flatten(WrappedData)
wrap_67 = WrapList(Data=entwine_17)  # -> flatten(WrappedData)
wrap_68 = WrapList(Data=entwine_17)  # -> flatten(WrappedData)
wrap_69 = WrapList(Data=entwine_17)  # -> flatten(WrappedData)
wrap_70 = WrapList(Data=entwine_41)  # -> flatten(WrappedData)
null_3 = NullObject()
option_num_3 = Number(option_num_2)
data_2 = Data(wrap_46)
nulls_in_empty_2 = NullsInEmptyBranches(DataWithEmptyBranches=data_2)
bed_2 = Entwine(
    Branch0X=wrap,
    Branch1X=wrap_2,
    Branch2X=wrap_3,
    Branch3X=wrap_4,
    Branch4X=wrap_5,
    Branch5X=wrap_36,
    Branch6X=wrap_37,
    Branch7X=wrap_38,
    Branch8X=wrap_39,
    Branch9X=wrap_40,
    Branch10X=wrap_63,
    Branch11X=wrap_64,
    Branch12X=wrap_65,
    Branch13X=wrap_66,
    FlattenInputs=False)  # -> simplify(Result)
chi_2 = Entwine(
    Branch0X=wrap_6,
    Branch1X=wrap_7,
    Branch2X=wrap_8,
    Branch3X=wrap_9,
    Branch4X=wrap_10,
    Branch5X=wrap_26,
    Branch6X=wrap_27,
    Branch7X=wrap_28,
    Branch8X=wrap_29,
    Branch9X=wrap_30,
    Branch10X=wrap_51,
    Branch11X=wrap_52,
    Branch12X=wrap_53,
    Branch13X=wrap_54,
    FlattenInputs=False)  # -> simplify(Result)
liv_2 = Entwine(
    Branch0X=wrap_11,
    Branch1X=wrap_12,
    Branch2X=wrap_13,
    Branch3X=wrap_14,
    Branch4X=wrap_15,
    Branch5X=wrap_31,
    Branch6X=wrap_32,
    Branch7X=wrap_33,
    Branch8X=wrap_34,
    Branch9X=wrap_35,
    Branch10X=wrap_59,
    Branch11X=wrap_60,
    Branch12X=wrap_61,
    Branch13X=wrap_62,
    FlattenInputs=False)  # -> simplify(Result)
bath_2 = Entwine(
    Branch0X=wrap_21,
    Branch1X=wrap_22,
    Branch2X=wrap_23,
    Branch3X=wrap_24,
    Branch4X=wrap_25,
    Branch5X=wrap_41,
    Branch6X=wrap_42,
    Branch7X=wrap_43,
    Branch8X=wrap_44,
    Branch9X=wrap_45,
    Branch10X=wrap_55,
    Branch11X=wrap_56,
    Branch12X=wrap_57,
    Branch13X=wrap_58,
    FlattenInputs=False)  # -> simplify(Result)
null_4 = NullObject()
chi_2_2 = Entwine(
    Branch0X=wrap_16,
    Branch1X=wrap_17,
    Branch2X=wrap_18,
    Branch3X=wrap_19,
    Branch4X=wrap_20,
    Branch5X=data_2,
    Branch6X=wrap_47,
    Branch7X=wrap_48,
    Branch8X=wrap_49,
    Branch9X=wrap_50,
    Branch10X=wrap_67,
    Branch11X=wrap_68,
    Branch12X=wrap_69,
    Branch13X=wrap_70,
    FlattenInputs=False)  # -> simplify(Result)
tbranch = TreeBranch(Tree=simplify(kit_1), Path=option_num_3, MaintainPaths=True, SplitTree=False)
tbranch_2 = TreeBranch(Tree=simplify(liv1), Path=option_num_3, MaintainPaths=True, SplitTree=False)
tbranch_3 = TreeBranch(Tree=simplify(liv_2), Path=option_num_3, MaintainPaths=True, SplitTree=False)
tbranch_4 = TreeBranch(Tree=simplify(bath_2), Path=option_num_3, MaintainPaths=True, SplitTree=False)
tbranch_5 = TreeBranch(Tree=simplify(chi_1), Path=option_num_3, MaintainPaths=True, SplitTree=False)
tbranch_6 = TreeBranch(Tree=simplify(chi_2), Path=option_num_3, MaintainPaths=True, SplitTree=False)
tbranch_7 = TreeBranch(Tree=simplify(chi_2_1), Path=option_num_3, MaintainPaths=True, SplitTree=False)
tbranch_8 = TreeBranch(Tree=simplify(chi_2_2), Path=option_num_3, MaintainPaths=True, SplitTree=False)
unwrap = UnwrapList(WrappedData=tbranch_3)
unwrap_2 = UnwrapList(WrappedData=tbranch_4)
tbranch_9 = TreeBranch(Tree=simplify(bed_1), Path=option_num_3, MaintainPaths=True, SplitTree=False)
tbranch_10 = TreeBranch(Tree=simplify(bed_2), Path=option_num_3, MaintainPaths=True, SplitTree=False)
unwrap_3 = UnwrapList(WrappedData=tbranch_6)
unwrap_4 = UnwrapList(WrappedData=tbranch_8)
unwrap_5 = UnwrapList(WrappedData=tbranch_10)
kit_1_2 = Data(tbranch)
bed_1_2 = Data(tbranch_9)
chi_1_2 = Data(tbranch_5)
chi_2_1_2 = Data(tbranch_7)
bed_2_2 = Data(unwrap_5)
chi_2_3 = Data(unwrap_3)
chi_2_2_2 = Data(unwrap_4)
liv_1 = Data(tbranch_2)
bath_2_2 = Data(unwrap_2)
liv_2_2 = Data(unwrap)
bed_1_3 = ClusterOutput(bed_1_2)
bed_2_3 = ClusterOutput(bed_2_2)
chi_1_3 = ClusterOutput(chi_1_2)
chi_2_4 = ClusterOutput(chi_2_3)
chi_2_1_3 = ClusterOutput(chi_2_1_2)
chi_2_2_3 = ClusterOutput(chi_2_2_2)
liv_1_2 = ClusterOutput(liv_1)
liv_2_3 = ClusterOutput(liv_2_2)
kit_1_3 = ClusterOutput(kit_1_2)
bath_2_3 = ClusterOutput(bath_2_2)
panel_246 = Panel(chi_2_3)
panel_247 = Panel(chi_2_1_2)

# ==== cluster FurnitureCluster
apartment_type = ClusterInput()
apartment_type_2 = Data(apartment_type)
equals = Equality(FirstNumber=apartment_type_2, SecondNumber="1")  # -> Equality, Inequality
equals_2 = Equality(FirstNumber=apartment_type_2, SecondNumber="3")  # -> Equality, Inequality
equals_3 = Equality(FirstNumber=apartment_type_2, SecondNumber="2")  # -> Equality, Inequality
larger = LargerThan(FirstNumber=apartment_type_2, SecondNumber="4")  # -> LargerThan, OrEqualTo
placementint = Panel("""0
2
3""")
program = Panel("Kitchen")
placementint_2 = Panel("""2
3""")
importance = Panel("1")
score = Panel("20")
placementint_3 = Panel("2")
program_2 = Panel("Dining")
placementint_4 = Panel("""1
2
3""")
importance_2 = Panel("1")
score_2 = Panel("20")
program_3 = Panel("Bed_StorageThree")
importance_3 = Panel("2")
score_3 = Panel("3")
program_4 = Panel("Bed_StorageTwo")
placementint_5 = Panel("2")
placementint_6 = Panel("2")
importance_4 = Panel("2")
program_5 = Panel("Kitchen")
placementint_7 = Panel("3")
importance_5 = Panel("1")
importance_6 = Panel("2")
score_4 = Panel("2")
program_6 = Panel("Bed_StorageOne")
score_5 = Panel("1")
score_6 = Panel("20")
program_7 = Panel("Kitchen")
placementint_8 = Panel("""0
1""")
importance_7 = Panel("1")
score_7 = Panel("20")
program_8 = Panel("Kitchen")
placementint_9 = Panel("""2
3""")
importance_8 = Panel("1")
score_8 = Panel("20")
geo = Geometry(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)
program_9 = Panel("Bed")
placementint_10 = Panel("""2
3""")
importance_9 = Panel("1")
score_9 = Panel("20")
placementint_11 = Panel("2")
program_10 = Panel("Bed_StorageThree")
importance_10 = Panel("2")
score_10 = Panel("3")
program_11 = Panel("Bed_StorageTwo")
placementint_12 = Panel("2")
placementint_13 = Panel("2")
importance_11 = Panel("2")
importance_12 = Panel("2")
score_11 = Panel("2")
program_12 = Panel("Bed_StorageOne")
score_12 = Panel("1")
program_13 = Panel("Bath")
placementint_14 = Panel("2")
importance_13 = Panel("1")
program_14 = Panel("Bed")
placementint_15 = Panel("""1
2
3""")
importance_14 = Panel("1")
program_15 = Panel("Bed")
placementint_16 = Panel("""2
3""")
importance_15 = Panel("1")
score_13 = Panel("20")
program_16 = Panel("Bath")
placementint_17 = Panel("2")
importance_16 = Panel("1")
score_14 = Panel("20")
score_15 = Panel("20")
score_16 = Panel("20")
program_17 = Panel("Bath")
placementint_18 = Panel("2")
importance_17 = Panel("1")
program_18 = Panel("Kitchen")
placementint_19 = Panel("""2
3""")
importance_18 = Panel("1")
score_17 = Panel("20")
program_19 = Panel("Bed")
placementint_20 = Panel("""2
3""")
importance_19 = Panel("1")
score_18 = Panel("20")
placementint_21 = Panel("2")
program_20 = Panel("Living")
placementint_22 = Panel("""1
2
3""")
importance_20 = Panel("1")
score_19 = Panel("20")
score_20 = Panel("20")
program_21 = Panel("Kitchen")
placementint_23 = Panel("""0
1""")
importance_21 = Panel("1")
score_21 = Panel("20")
program_22 = Panel("Kitchen")
placementint_24 = Panel("""1
2""")
importance_22 = Panel("1")
program_23 = Panel("Bed_StorageThree")
importance_23 = Panel("2")
score_22 = Panel("3")
area = Area(Geometry=geo)  # -> Area, Centroid
score_23 = Panel("20")
program_24 = Panel("Bed_StorageTwo")
placementint_25 = Panel("2")
placementint_26 = Panel("2")
importance_24 = Panel("2")
program_25 = Panel("Bed_StorageTwo")
placementint_27 = Panel("2")
placementint_28 = Panel("2")
importance_25 = Panel("2")
importance_26 = Panel("2")
score_24 = Panel("2")
program_26 = Panel("Bed_StorageOne")
score_25 = Panel("1")
importance_27 = Panel("2")
score_26 = Panel("2")
program_27 = Panel("Bed_StorageOne")
score_27 = Panel("1")
program_28 = Panel("Bath")
placementint_29 = Panel("2")
importance_28 = Panel("1")
program_29 = Panel("Bed")
placementint_30 = Panel("""1
2
3""")
importance_29 = Panel("1")
score_28 = Panel("20")
program_30 = Panel("Bath")
placementint_31 = Panel("2")
importance_30 = Panel("1")
score_29 = Panel("20")
score_30 = Panel("20")
program_31 = Panel("Bed")
placementint_32 = Panel("""2
3""")
importance_31 = Panel("1")
score_31 = Panel("20")
program_32 = Panel("Bath")
placementint_33 = Panel("2")
importance_32 = Panel("1")
program_33 = Panel("Bed")
placementint_34 = Panel("""2
3""")
importance_33 = Panel("1")
score_32 = Panel("20")
score_33 = Panel("20")
program_34 = Panel("Living")
placementint_35 = Panel("0")
importance_34 = Panel("1")
score_34 = Panel("20")
program_35 = Panel("Bed_StorageTwo")
placementint_36 = Panel("2")
placementint_37 = Panel("2")
importance_35 = Panel("2")
program_36 = Panel("Dining")
placementint_38 = Panel("""1
2
3""")
importance_36 = Panel("1")
importance_37 = Panel("2")
score_35 = Panel("2")
program_37 = Panel("Bed_StorageOne")
score_36 = Panel("1")
score_37 = Panel("20")
program_38 = Panel("Bath")
placementint_39 = Panel("2")
importance_38 = Panel("1")
program_39 = Panel("Bed")
placementint_40 = Panel("""1
2
3""")
importance_39 = Panel("1")
program_40 = Panel("Bed")
placementint_41 = Panel("""2
3""")
importance_40 = Panel("1")
score_38 = Panel("20")
program_41 = Panel("Bath")
placementint_42 = Panel("2")
importance_41 = Panel("1")
score_39 = Panel("20")
score_40 = Panel("20")
score_41 = Panel("20")
program_42 = Panel("Bath")
placementint_43 = Panel("2")
importance_42 = Panel("1")
program_43 = Panel("Living")
program_44 = Panel("Living")
placementint_44 = Panel("""0
1
2
3""")
importance_43 = Panel("1")
score_42 = Panel("20")
program_45 = Panel("Living")
placementint_45 = Panel("""0
1
2
3""")
importance_44 = Panel("1")
score_43 = Panel("20")
placementint_46 = Panel("""0
1
2
3""")
importance_45 = Panel("1")
score_44 = Panel("20")
score_45 = Panel("20")
program_46 = Panel("Bath")
placementint_47 = Panel("2")
importance_46 = Panel("1")
program_47 = Panel("Bed")
placementint_48 = Panel("""1
2
3""")
importance_47 = Panel("1")
program_48 = Panel("Bed")
placementint_49 = Panel("""1
2
3""")
importance_48 = Panel("1")
score_46 = Panel("20")
program_49 = Panel("Bed")
placementint_50 = Panel("""0
1
2
3""")
importance_49 = Panel("1")
program_50 = Panel("Bed")
placementint_51 = Panel("2")
importance_50 = Panel("1")
score_47 = Panel("20")
score_48 = Panel("20")
program_51 = Panel("Bath")
placementint_52 = Panel("2")
importance_51 = Panel("1")
score_49 = Panel("20")
score_50 = Panel("20")
score_51 = Panel("20")
program_52 = Panel("Dining")
placementint_53 = Panel("""0
1
2
3""")
importance_52 = Panel("1")
score_52 = Panel("20")
program_53 = Panel("Bath")
placementint_54 = Panel("2")
importance_53 = Panel("1")
program_54 = Panel("Bed")
score_53 = Panel("20")
placementint_55 = Panel("2")
importance_54 = Panel("1")
score_54 = Panel("20")
program_55 = Panel("Living")
placementint_56 = Panel("""0
1
2
3""")
importance_55 = Panel("1")
score_55 = Panel("20")
program_56 = Panel("Living")
placementint_57 = Panel("""0
1
2
3""")
importance_56 = Panel("1")
score_56 = Panel("20")
program_57 = Panel("Bed")
placementint_58 = Panel("""0
3""")
importance_57 = Panel("1")
program_58 = Panel("Bed")
placementint_59 = Panel("""0
3""")
importance_58 = Panel("1")
score_57 = Panel("20")
score_58 = Panel("20")
program_59 = Panel("Dining")
placementint_60 = Panel("""1
2
3""")
importance_59 = Panel("1")
score_59 = Panel("20")
program_60 = Panel("Kitchen")
placementint_61 = Panel("""0
1""")
importance_60 = Panel("1")
score_60 = Panel("20")
program_61 = Panel("Kitchen")
placementint_62 = Panel("""2
3""")
importance_61 = Panel("1")
score_61 = Panel("20")
program_62 = Panel("Kitchen")
placementint_63 = Panel("""1
2""")
importance_62 = Panel("1")
score_62 = Panel("20")
scale = Scale(Geometry=geo, Center=area.Centroid, Factor=Slider(0.97, range=0..1))  # -> Geometry, Transform

# ---- group: Prepare and Sort
txt_name = Text(program)
int_placement = Integer(placementint_2)
geo_2 = Geometry(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)
geo_3 = Geometry([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])
geo_4 = Geometry(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)

# ----
int_importance = Integer(importance)
num_score = Number(score)

# ---- group: Prepare and Sort
txt_name_2 = Text(program_2)
int_placement_2 = Integer(placementint_4)
geo_5 = Geometry(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)
geo_6 = Geometry(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)
geo_7 = Geometry([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])

txt_name_3 = Text(program_5)
int_placement_3 = Integer(placementint_9)
geo_8 = Geometry(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)
geo_9 = Geometry([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])
geo_10 = Geometry(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)

# ----
int_importance_2 = Integer(importance_2)

# ---- group: Prepare and Sort
txt_name_4 = Text(program_7)
int_placement_4 = Integer(placementint_8)
geo_11 = Geometry(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)
geo_12 = Geometry(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)
geo_13 = Geometry([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])

txt_name_5 = Text(program_8)
int_placement_5 = Integer(placementint_9)
geo_14 = Geometry(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)
geo_15 = Geometry(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)
geo_16 = Geometry([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])

# ----
int_importance_3 = Integer(importance_5)
int_importance_4 = Integer(importance_7)
int_importance_5 = Integer(importance_8)

# ---- group: Prepare and Sort
txt_name_6 = Text(program_9)
int_placement_6 = Integer(placementint_10)
geo_17 = Geometry(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)
geo_18 = Geometry(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)
geo_19 = Geometry([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])

# ----
int_importance_6 = Integer(importance_9)
num_score_2 = Number(score_2)

# ---- group: Prepare and Sort
txt_name_7 = Text(program_13)
int_placement_7 = Integer(placementint_14)
geo_20 = Geometry(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)
geo_21 = Geometry([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])
geo_22 = Geometry(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)

txt_name_8 = Text(program_14)
int_placement_8 = Integer(placementint_15)
geo_23 = Geometry(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)
geo_24 = Geometry([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])
geo_25 = Geometry(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)

txt_name_9 = Text(program_15)
int_placement_9 = Integer(placementint_16)
geo_26 = Geometry(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)
geo_27 = Geometry([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])
geo_28 = Geometry(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)

txt_name_10 = Text(program_16)
int_placement_10 = Integer(placementint_17)
geo_29 = Geometry(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)
geo_30 = Geometry(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)
geo_31 = Geometry([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])

# ----
num_score_3 = Number(score_6)
int_importance_7 = Integer(importance_13)
int_importance_8 = Integer(importance_14)
int_importance_9 = Integer(importance_15)
int_importance_10 = Integer(importance_16)
num_score_4 = Number(score_7)
num_score_5 = Number(score_8)

# ---- group: Prepare and Sort
txt_name_11 = Text(program_17)
int_placement_11 = Integer(placementint_18)
geo_32 = Geometry(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)
geo_33 = Geometry([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])
geo_34 = Geometry(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)

txt_name_12 = Text(program_18)
int_placement_12 = Integer(placementint_19)
geo_35 = Geometry(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)
geo_36 = Geometry([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])
geo_37 = Geometry(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)

txt_name_13 = Text(program_20)
int_placement_13 = Integer(placementint_22)
geo_38 = Geometry(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)
geo_39 = Geometry(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)
geo_40 = Geometry([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])

txt_name_14 = Text(program_19)
int_placement_14 = Integer(placementint_20)
geo_41 = Geometry(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)
geo_42 = Geometry([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])
geo_43 = Geometry(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)

txt_name_15 = Text(program_21)
int_placement_15 = Integer(placementint_23)
geo_44 = Geometry(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)
geo_45 = Geometry(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)
geo_46 = Geometry([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])

# ----
int_importance_11 = Integer(importance_17)

# ---- group: Prepare and Sort
txt_name_16 = Text(program_22)
int_placement_16 = Integer(placementint_24)
geo_47 = Geometry(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)
geo_48 = Geometry([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])
geo_49 = Geometry(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)

# ----
int_importance_12 = Integer(importance_18)
int_importance_13 = Integer(importance_19)
num_score_6 = Number(score_9)
int_importance_14 = Integer(importance_20)
int_importance_15 = Integer(importance_21)
int_importance_16 = Integer(importance_22)

# ---- group: Prepare and Sort
txt_name_17 = Text(program_28)
int_placement_17 = Integer(placementint_29)
geo_50 = Geometry(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)
geo_51 = Geometry([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])
geo_52 = Geometry(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)

txt_name_18 = Text(program_29)
int_placement_18 = Integer(placementint_30)
geo_53 = Geometry(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)
geo_54 = Geometry([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])
geo_55 = Geometry(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)

txt_name_19 = Text(program_31)
int_placement_19 = Integer(placementint_32)
geo_56 = Geometry(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)
geo_57 = Geometry(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)
geo_58 = Geometry([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])

txt_name_20 = Text(program_30)
int_placement_20 = Integer(placementint_31)
geo_59 = Geometry(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)
geo_60 = Geometry(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)
geo_61 = Geometry([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])

# ----
int_importance_17 = Integer(importance_28)
int_importance_18 = Integer(importance_29)
int_importance_19 = Integer(importance_30)
num_score_7 = Number(score_13)
num_score_8 = Number(score_14)
int_importance_20 = Integer(importance_31)
num_score_9 = Number(score_15)
num_score_10 = Number(score_16)

# ---- group: Prepare and Sort
txt_name_21 = Text(program_32)
int_placement_21 = Integer(placementint_33)
geo_62 = Geometry(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)
geo_63 = Geometry([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])
geo_64 = Geometry(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)

txt_name_22 = Text(program_33)
int_placement_22 = Integer(placementint_34)
geo_65 = Geometry(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)
geo_66 = Geometry([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])
geo_67 = Geometry(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)

txt_name_23 = Text(program_34)
int_placement_23 = Integer(placementint_35)
geo_68 = Geometry(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)
geo_69 = Geometry(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)
geo_70 = Geometry([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])

txt_name_24 = Text(program_3)
int_placement_24 = Integer(placementint_3)
geo_71 = Geometry([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])
geo_72 = Geometry(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)
geo_73 = Geometry(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)

# ----
int_importance_21 = Integer(importance_32)
int_importance_22 = Integer(importance_33)
num_score_11 = Number(score_17)
num_score_12 = Number(score_20)

# ---- group: Prepare and Sort
txt_name_25 = Text(program_4)
int_placement_25 = Integer(placementint_5)
geo_74 = Geometry([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])
geo_75 = Geometry(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)
geo_76 = Geometry(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)

# ----
int_importance_23 = Integer(importance_34)

# ---- group: Prepare and Sort
txt_name_26 = Text(program_36)
int_placement_26 = Integer(placementint_38)
geo_77 = Geometry(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)
geo_78 = Geometry([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])
geo_79 = Geometry(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)

# ----
num_score_13 = Number(score_18)
num_score_14 = Number(score_19)

# ---- group: Prepare and Sort
txt_name_27 = Text(program_6)
int_placement_27 = Integer(placementint_6)
geo_80 = Geometry(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)
geo_81 = Geometry(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)
geo_82 = Geometry([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])

# ----
importance_63 = Integer(importance_4)
num_score_15 = Number(score_5)
num_score_16 = Number(score_21)
int_importance_24 = Integer(importance_43)

# ---- group: Prepare and Sort
txt_name_28 = Text(program_38)
int_placement_28 = Integer(placementint_39)
geo_83 = Geometry(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)
geo_84 = Geometry([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])
geo_85 = Geometry(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)

txt_name_29 = Text(program_39)
int_placement_29 = Integer(placementint_40)
geo_86 = Geometry(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)
geo_87 = Geometry(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)
geo_88 = Geometry([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])

# ----
int_importance_25 = Integer(importance_39)
num_score_17 = Number(score_40)

# ---- group: Prepare and Sort
txt_name_30 = Text(program_40)
int_placement_30 = Integer(placementint_41)
geo_89 = Geometry(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)
geo_90 = Geometry([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])
geo_91 = Geometry(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)

txt_name_31 = Text(program_10)
int_placement_31 = Integer(placementint_11)
geo_92 = Geometry(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)
geo_93 = Geometry(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)
geo_94 = Geometry([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])

# ----
importance_64 = Integer(importance_10)
num_score_18 = Number(score_10)

# ---- group: Prepare and Sort
txt_name_32 = Text(program_11)
int_placement_32 = Integer(placementint_12)
geo_95 = Geometry(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)
geo_96 = Geometry(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)
geo_97 = Geometry([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])

# ----
int_importance_26 = Integer(importance_12)
num_score_19 = Number(score_11)

# ---- group: Prepare and Sort
txt_name_33 = Text(program_12)
int_placement_33 = Integer(placementint_13)
geo_98 = Geometry(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)
geo_99 = Geometry(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)
geo_100 = Geometry([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])

# ----
importance_65 = Integer(importance_11)
num_score_20 = Number(score_12)

# ---- group: Prepare and Sort
txt_name_34 = Text(program_45)
int_placement_34 = Integer(placementint_45)
geo_101 = Geometry(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)
geo_102 = Geometry(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)
geo_103 = Geometry([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])

# ----
int_importance_27 = Integer(importance_44)
num_score_21 = Number(score_43)

# ---- group: Prepare and Sort
txt_name_35 = Text(program_43)
int_placement_35 = Integer(placementint_46)
geo_104 = Geometry(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)
geo_105 = Geometry(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)
geo_106 = Geometry([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])

# ----
int_importance_28 = Integer(importance_45)
num_score_22 = Number(score_44)

# ---- group: Prepare and Sort
txt_name_36 = Text(program_44)
int_placement_36 = Integer(placementint_44)
geo_107 = Geometry(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)
geo_108 = Geometry(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)
geo_109 = Geometry([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])

# ----
num_score_23 = Number(score_45)

# ---- group: Prepare and Sort
txt_name_37 = Text(program_41)
int_placement_37 = Integer(placementint_42)
geo_110 = Geometry(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)
geo_111 = Geometry(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)
geo_112 = Geometry([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])

# ----
num_score_24 = Number(score_4)
int_importance_29 = Integer(importance_36)
int_importance_30 = Integer(importance_38)
num_score_25 = Number(score_3)
int_importance_31 = Integer(importance_40)
int_importance_32 = Integer(importance_41)
num_score_26 = Number(score_23)
num_score_27 = Number(score_28)
num_score_28 = Number(score_29)
num_score_29 = Number(score_30)
num_score_30 = Number(score_31)

# ---- group: Prepare and Sort
txt_name_38 = Text(program_42)
int_placement_38 = Integer(placementint_43)
geo_113 = Geometry(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)
geo_114 = Geometry([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])
geo_115 = Geometry(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)

# ----
int_importance_33 = Integer(importance_6)
importance_66 = Integer(importance_3)
int_importance_34 = Integer(importance_42)
num_score_31 = Number(score_32)
num_score_32 = Number(score_33)
num_score_33 = Number(score_34)
num_score_34 = Number(score_46)

# ---- group: Prepare and Sort
geo_116 = Geometry(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)
txt_name_39 = Text(program_48)
int_placement_39 = Integer(placementint_49)
geo_117 = Geometry(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)
geo_118 = Geometry([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])

txt_name_40 = Text(program_46)
int_placement_40 = Integer(placementint_47)
geo_119 = Geometry(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)
geo_120 = Geometry([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])
geo_121 = Geometry(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)

txt_name_41 = Text(program_47)
int_placement_41 = Integer(placementint_48)
geo_122 = Geometry(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)
geo_123 = Geometry(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)
geo_124 = Geometry([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])

# ----
int_importance_35 = Integer(importance_47)
num_score_35 = Number(score_50)
int_importance_36 = Integer(importance_48)

# ---- group: Prepare and Sort
txt_name_42 = Text(program_24)
int_placement_42 = Integer(placementint_25)
geo_125 = Geometry(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)
geo_126 = Geometry(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)
geo_127 = Geometry([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])

# ----
int_importance_37 = Integer(importance_26)
num_score_36 = Number(score_24)

# ---- group: Prepare and Sort
txt_name_43 = Text(program_26)
int_placement_43 = Integer(placementint_26)
geo_128 = Geometry(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)
geo_129 = Geometry(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)
geo_130 = Geometry([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])

# ----
importance_67 = Integer(importance_24)
num_score_37 = Number(score_25)

# ---- group: Prepare and Sort
txt_name_44 = Text(program_49)
int_placement_44 = Integer(placementint_50)
geo_131 = Geometry(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)
geo_132 = Geometry(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)
geo_133 = Geometry([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])

# ----
int_importance_38 = Integer(importance_49)
num_score_38 = Number(score_51)

# ---- group: Prepare and Sort
txt_name_45 = Text(program_50)
int_placement_45 = Integer(placementint_51)
geo_134 = Geometry(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)
geo_135 = Geometry(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)
geo_136 = Geometry([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])

txt_name_46 = Text(program_23)
int_placement_46 = Integer(placementint_21)
geo_137 = Geometry(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)
geo_138 = Geometry(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)
geo_139 = Geometry([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])

# ----
importance_68 = Integer(importance_23)
num_score_39 = Number(score_22)

# ---- group: Prepare and Sort
txt_name_47 = Text(program_25)
int_placement_47 = Integer(placementint_27)
geo_140 = Geometry(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)
geo_141 = Geometry(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)
geo_142 = Geometry([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])

# ----
int_importance_39 = Integer(importance_27)
num_score_40 = Number(score_26)

# ---- group: Prepare and Sort
txt_name_48 = Text(program_27)
int_placement_48 = Integer(placementint_28)
geo_143 = Geometry(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)
geo_144 = Geometry(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)
geo_145 = Geometry([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])

# ----
importance_69 = Integer(importance_25)
num_score_41 = Number(score_27)

# ---- group: Prepare and Sort
txt_name_49 = Text(program_55)
int_placement_49 = Integer(placementint_56)
geo_146 = Geometry(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)
geo_147 = Geometry(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)
geo_148 = Geometry([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])

# ----
int_importance_40 = Integer(importance_55)
num_score_42 = Number(score_55)
geo_149 = Geometry(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)
int_importance_41 = Integer(importance_56)
num_score_43 = Number(score_56)

# ---- group: Prepare and Sort
geo_150 = Geometry(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)
geo_151 = Geometry([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])
txt_name_50 = Text(program_56)
int_placement_50 = Integer(placementint_57)
geo_152 = Geometry(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)

# ----
int_importance_42 = Integer(importance_46)
num_score_44 = Number(score_37)
int_importance_43 = Integer(importance_50)
int_importance_44 = Integer(importance_51)
num_score_45 = Number(score_38)
num_score_46 = Number(score_39)

# ---- group: Prepare and Sort
txt_name_51 = Text(program_52)
int_placement_51 = Integer(placementint_53)
geo_153 = Geometry(scale.Geometry)
geo_154 = Geometry([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])
geo_155 = Geometry(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)

# ----
num_score_47 = Number(score_41)

# ---- group: Prepare and Sort
txt_name_52 = Text(program_53)
int_placement_52 = Integer(placementint_54)
geo_156 = Geometry(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)
geo_157 = Geometry([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])
geo_158 = Geometry(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)

# ----
explode = Explode(Curve=geo_156, Recursive=True)  # -> Segments, Vertices
item = ListItem(List=explode.Segments, Index=Slider(2, range=0..10), Wrap=True)
curvepoint = PointOnCurve(item, parameter=0.5)
scale_nu = ScaleNU(Geometry=geo_156, Plane=curvepoint, ScaleX=1, ScaleY=Slider(0.89, range=0..1), ScaleZ=1)  # -> Geometry, Transform

# ---- group: Prepare and Sort
txt_name_53 = Text(program_54)
int_placement_53 = Integer(placementint_55)
geo_159 = Geometry(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)
geo_160 = Geometry(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)
geo_161 = Geometry([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])

# ----
int_importance_45 = Integer(importance_52)
int_importance_46 = Integer(importance_53)
num_score_48 = Number(score_42)
int_importance_47 = Integer(importance_54)
num_score_49 = Number(score_57)

# ---- group: Prepare and Sort
geo_162 = Geometry(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)
txt_name_54 = Text(program_58)
int_placement_54 = Integer(placementint_59)
geo_163 = Geometry(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)
geo_164 = Geometry([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])

txt_name_55 = Text(program_57)
int_placement_55 = Integer(placementint_58)
geo_165 = Geometry(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)
geo_166 = Geometry(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)
geo_167 = Geometry([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])

# ----
int_importance_48 = Integer(importance_57)
num_score_50 = Number(score_58)
int_importance_49 = Integer(importance_58)

# ---- group: Prepare and Sort
txt_name_56 = Text(program_35)
int_placement_56 = Integer(placementint_36)
geo_168 = Geometry(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)
geo_169 = Geometry(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)
geo_170 = Geometry([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])

# ----
int_importance_50 = Integer(importance_37)
num_score_51 = Number(score_35)

# ---- group: Prepare and Sort
txt_name_57 = Text(program_37)
int_placement_57 = Integer(placementint_37)
geo_171 = Geometry(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)
geo_172 = Geometry(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)
geo_173 = Geometry([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])

# ----
importance_70 = Integer(importance_35)
num_score_52 = Number(score_36)
num_score_53 = Number(score_47)
num_score_54 = Number(score_48)
num_score_55 = Number(score_49)
num_score_56 = Number(score_52)
num_score_57 = Number(score_53)
num_score_58 = Number(score_54)

# ---- group: Prepare and Sort
txt_name_58 = Text(program_59)
int_placement_58 = Integer(placementint_60)
geo_174 = Geometry(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)
geo_175 = Geometry(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)
geo_176 = Geometry([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])

txt_name_59 = Text(program_60)
int_placement_59 = Integer(placementint_61)
geo_177 = Geometry(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)
geo_178 = Geometry(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)
geo_179 = Geometry([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])

# ----
int_importance_51 = Integer(importance_59)
int_importance_52 = Integer(importance_60)

# ---- group: Prepare and Sort
txt_name_60 = Text(program_61)
int_placement_60 = Integer(placementint_62)
geo_180 = Geometry(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)
geo_181 = Geometry(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)
geo_182 = Geometry([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])

txt_name_61 = Text(program_62)
int_placement_61 = Integer(placementint_63)
geo_183 = Geometry(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)
geo_184 = Geometry([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])
geo_185 = Geometry(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)

# ----
int_importance_53 = Integer(importance_61)
int_importance_54 = Integer(importance_62)
num_score_59 = Number(score_59)
num_score_60 = Number(score_60)
num_score_61 = Number(score_61)
num_score_62 = Number(score_62)
explode_2 = Explode(Curve=geo_4, Recursive=True)  # -> Segments, Vertices
explode_3 = Explode(Curve=geo_5, Recursive=True)  # -> Segments, Vertices
explode_4 = Explode(Curve=geo_8, Recursive=True)  # -> Segments, Vertices
explode_5 = Explode(Curve=geo_14, Recursive=True)  # -> Segments, Vertices

# ---- group: Prepare and Sort
explode_6 = Explode(Curve=geo_72, Recursive=True)  # -> Segments, Vertices
item_2 = ListItem(List=explode_6.Segments, Index=int_placement_24, Wrap=True)
previewlw = CustomPreviewLineweights(Geometry=item_2, Shader=ColourSwatch(SwatchColor=RGB(33, 33, 33)), Thickness=Slider(6, range=0..10), Absolute=False)

explode_7 = Explode(Curve=geo_75, Recursive=True)  # -> Segments, Vertices
item_3 = ListItem(List=explode_7.Segments, Index=int_placement_25, Wrap=True)
previewlw_2 = CustomPreviewLineweights(Geometry=item_3, Shader=ColourSwatch(SwatchColor=RGB(33, 33, 33)), Thickness=Slider(6, range=0..10), Absolute=False)

# ----
explode_8 = Explode(Curve=geo_17, Recursive=True)  # -> Segments, Vertices

# ---- group: Prepare and Sort
explode_9 = Explode(Curve=geo_80, Recursive=True)  # -> Segments, Vertices
item_4 = ListItem(List=explode_9.Segments, Index=int_placement_27, Wrap=True)
previewlw_3 = CustomPreviewLineweights(Geometry=item_4, Shader=ColourSwatch(SwatchColor=RGB(33, 33, 33)), Thickness=Slider(6, range=0..10), Absolute=False)

# ----
explode_10 = Explode(Curve=geo_20, Recursive=True)  # -> Segments, Vertices
explode_11 = Explode(Curve=geo_29, Recursive=True)  # -> Segments, Vertices
explode_12 = Explode(Curve=geo_26, Recursive=True)  # -> Segments, Vertices

# ---- group: Prepare and Sort
explode_13 = Explode(Curve=geo_92, Recursive=True)  # -> Segments, Vertices
item_5 = ListItem(List=explode_13.Segments, Index=int_placement_31, Wrap=True)
previewlw_4 = CustomPreviewLineweights(Geometry=item_5, Shader=ColourSwatch(SwatchColor=RGB(33, 33, 33)), Thickness=Slider(6, range=0..10), Absolute=False)

# ----
# Studio
explode_14 = Explode(Curve=geo_23, Recursive=True)  # -> Segments, Vertices

# ---- group: Prepare and Sort
explode_15 = Explode(Curve=geo_95, Recursive=True)  # -> Segments, Vertices
item_6 = ListItem(List=explode_15.Segments, Index=int_placement_32, Wrap=True)
previewlw_5 = CustomPreviewLineweights(Geometry=item_6, Shader=ColourSwatch(SwatchColor=RGB(33, 33, 33)), Thickness=Slider(6, range=0..10), Absolute=False)

# ----
number_slider = Slider(6, range=0..10)
explode_16 = Explode(Curve=geo_32, Recursive=True)  # -> Segments, Vertices
explode_17 = Explode(Curve=geo_35, Recursive=True)  # -> Segments, Vertices
explode_18 = Explode(Curve=geo_41, Recursive=True)  # -> Segments, Vertices
explode_19 = Explode(Curve=geo_44, Recursive=True)  # -> Segments, Vertices
explode_20 = Explode(Curve=geo_47, Recursive=True)  # -> Segments, Vertices

# ---- group: Prepare and Sort
explode_21 = Explode(Curve=geo_98, Recursive=True)  # -> Segments, Vertices
item_7 = ListItem(List=explode_21.Segments, Index=int_placement_33, Wrap=True)
previewlw_6 = CustomPreviewLineweights(Geometry=item_7, Shader=ColourSwatch(SwatchColor=RGB(33, 33, 33)), Thickness=Slider(6, range=0..10), Absolute=False)

# ----
explode_22 = Explode(Curve=geo_38, Recursive=True)  # -> Segments, Vertices
explode_23 = Explode(Curve=geo_50, Recursive=True)  # -> Segments, Vertices
explode_24 = Explode(Curve=geo_59, Recursive=True)  # -> Segments, Vertices

# ---- group: Prepare and Sort
explode_25 = Explode(Curve=geo_137, Recursive=True)  # -> Segments, Vertices
item_8 = ListItem(List=explode_25.Segments, Index=int_placement_46, Wrap=True)
previewlw_7 = CustomPreviewLineweights(Geometry=item_8, Shader=ColourSwatch(SwatchColor=RGB(33, 33, 33)), Thickness=Slider(6, range=0..10), Absolute=False)

# ----
# 1 Bed
explode_26 = Explode(Curve=geo_53, Recursive=True)  # -> Segments, Vertices
explode_27 = Explode(Curve=geo_56, Recursive=True)  # -> Segments, Vertices
explode_28 = Explode(Curve=geo_65, Recursive=True)  # -> Segments, Vertices

# ---- group: Prepare and Sort
explode_29 = Explode(Curve=geo_125, Recursive=True)  # -> Segments, Vertices
item_9 = ListItem(List=explode_29.Segments, Index=int_placement_42, Wrap=True)
previewlw_8 = CustomPreviewLineweights(Geometry=item_9, Shader=ColourSwatch(SwatchColor=RGB(33, 33, 33)), Thickness=Slider(6, range=0..10), Absolute=False)

explode_30 = Explode(Curve=geo_140, Recursive=True)  # -> Segments, Vertices
item_10 = ListItem(List=explode_30.Segments, Index=int_placement_47, Wrap=True)
previewlw_9 = CustomPreviewLineweights(Geometry=item_10, Shader=ColourSwatch(SwatchColor=RGB(33, 33, 33)), Thickness=Slider(6, range=0..10), Absolute=False)

explode_31 = Explode(Curve=geo_128, Recursive=True)  # -> Segments, Vertices
item_11 = ListItem(List=explode_31.Segments, Index=int_placement_43, Wrap=True)
previewlw_10 = CustomPreviewLineweights(Geometry=item_11, Shader=ColourSwatch(SwatchColor=RGB(33, 33, 33)), Thickness=Slider(6, range=0..10), Absolute=False)

explode_32 = Explode(Curve=geo_143, Recursive=True)  # -> Segments, Vertices
item_12 = ListItem(List=explode_32.Segments, Index=int_placement_48, Wrap=True)
previewlw_11 = CustomPreviewLineweights(Geometry=item_12, Shader=ColourSwatch(SwatchColor=RGB(33, 33, 33)), Thickness=Slider(6, range=0..10), Absolute=False)

# ----
explode_33 = Explode(Curve=geo_68, Recursive=True)  # -> Segments, Vertices
explode_34 = Explode(Curve=geo_77, Recursive=True)  # -> Segments, Vertices
explode_35 = Explode(Curve=geo_89, Recursive=True)  # -> Segments, Vertices
explode_36 = Explode(Curve=geo_83, Recursive=True)  # -> Segments, Vertices
explode_37 = Explode(Curve=geo_110, Recursive=True)  # -> Segments, Vertices
number_slider_2 = Slider(6, range=0..10)
# 2 Bed
explode_38 = Explode(Curve=geo_86, Recursive=True)  # -> Segments, Vertices

# ---- group: Prepare and Sort
explode_39 = Explode(Curve=geo_168, Recursive=True)  # -> Segments, Vertices
item_13 = ListItem(List=explode_39.Segments, Index=int_placement_56, Wrap=True)
previewlw_12 = CustomPreviewLineweights(Geometry=item_13, Shader=ColourSwatch(SwatchColor=RGB(33, 33, 33)), Thickness=Slider(6, range=0..10), Absolute=False)

# ----
explode_40 = Explode(Curve=geo_113, Recursive=True)  # -> Segments, Vertices
explode_41 = Explode(Curve=geo_107, Recursive=True)  # -> Segments, Vertices
explode_42 = Explode(Curve=geo_104, Recursive=True)  # -> Segments, Vertices

# ---- group: Prepare and Sort
explode_43 = Explode(Curve=geo_171, Recursive=True)  # -> Segments, Vertices
item_14 = ListItem(List=explode_43.Segments, Index=int_placement_57, Wrap=True)
previewlw_13 = CustomPreviewLineweights(Geometry=item_14, Shader=ColourSwatch(SwatchColor=RGB(33, 33, 33)), Thickness=Slider(6, range=0..10), Absolute=False)

# ----
explode_44 = Explode(Curve=geo_101, Recursive=True)  # -> Segments, Vertices
explode_45 = Explode(Curve=geo_134, Recursive=True)  # -> Segments, Vertices
explode_46 = Explode(Curve=geo_119, Recursive=True)  # -> Segments, Vertices
explode_47 = Explode(Curve=geo_62, Recursive=True)  # -> Segments, Vertices
explode_48 = Explode(Curve=geo_117, Recursive=True)  # -> Segments, Vertices
explode_49 = Explode(Curve=geo_122, Recursive=True)  # -> Segments, Vertices
# 3+ Bed
explode_50 = Explode(Curve=geo_131, Recursive=True)  # -> Segments, Vertices
explode_51 = Explode(Curve=geo_159, Recursive=True)  # -> Segments, Vertices
explode_52 = Explode(Curve=geo_153, Recursive=True)  # -> Segments, Vertices
explode_53 = Explode(Curve=geo_156, Recursive=True)  # -> Segments, Vertices
explode_54 = Explode(Curve=geo_146, Recursive=True)  # -> Segments, Vertices
explode_55 = Explode(Curve=geo_152, Recursive=True)  # -> Segments, Vertices
explode_56 = Explode(Curve=geo_163, Recursive=True)  # -> Segments, Vertices
item_15 = ListItem(List=explode_2.Segments, Index=int_placement, Wrap=True)
explode_57 = Explode(Curve=geo_165, Recursive=True)  # -> Segments, Vertices
explode_58 = Explode(Curve=geo_174, Recursive=True)  # -> Segments, Vertices
explode_59 = Explode(Curve=geo_177, Recursive=True)  # -> Segments, Vertices
explode_60 = Explode(Curve=geo_180, Recursive=True)  # -> Segments, Vertices
explode_61 = Explode(Curve=geo_183, Recursive=True)  # -> Segments, Vertices
item_16 = ListItem(List=explode_3.Segments, Index=int_placement_2, Wrap=True)
item_17 = ListItem(List=explode_4.Segments, Index=int_placement_3, Wrap=True)
explode_62 = Explode(Curve=geo_11, Recursive=True)  # -> Segments, Vertices
item_18 = ListItem(List=explode_5.Segments, Index=int_placement_5, Wrap=True)
item_19 = ListItem(List=explode_8.Segments, Index=int_placement_6, Wrap=True)
item_20 = ListItem(List=explode_10.Segments, Index=int_placement_7, Wrap=True)
item_21 = ListItem(List=explode_11.Segments, Index=int_placement_10, Wrap=True)
item_22 = ListItem(List=explode_12.Segments, Index=int_placement_9, Wrap=True)
item_23 = ListItem(List=explode_14.Segments, Index=int_placement_8, Wrap=True)
item_24 = ListItem(List=explode_16.Segments, Index=int_placement_11, Wrap=True)
swatch = ColourSwatch(SwatchColor=RGB(33, 33, 33))
item_25 = ListItem(List=explode_18.Segments, Index=int_placement_14, Wrap=True)
item_26 = ListItem(List=explode_19.Segments, Index=int_placement_15, Wrap=True)
item_27 = ListItem(List=explode_17.Segments, Index=int_placement_12, Wrap=True)
item_28 = ListItem(List=explode_22.Segments, Index=int_placement_13, Wrap=True)
item_29 = ListItem(List=explode_20.Segments, Index=int_placement_16, Wrap=True)
item_30 = ListItem(List=explode_23.Segments, Index=int_placement_17, Wrap=True)
item_31 = ListItem(List=explode_24.Segments, Index=int_placement_20, Wrap=True)
item_32 = ListItem(List=explode_26.Segments, Index=int_placement_18, Wrap=True)
item_33 = ListItem(List=explode_27.Segments, Index=int_placement_19, Wrap=True)
item_34 = ListItem(List=explode_28.Segments, Index=int_placement_22, Wrap=True)
item_35 = ListItem(List=explode_33.Segments, Index=int_placement_23, Wrap=True)
item_36 = ListItem(List=explode_34.Segments, Index=int_placement_26, Wrap=True)
item_37 = ListItem(List=explode_35.Segments, Index=int_placement_30, Wrap=True)
item_38 = ListItem(List=explode_36.Segments, Index=int_placement_28, Wrap=True)
item_39 = ListItem(List=explode_37.Segments, Index=int_placement_37, Wrap=True)
swatch_2 = ColourSwatch(SwatchColor=RGB(33, 33, 33))
item_40 = ListItem(List=explode_38.Segments, Index=int_placement_29, Wrap=True)
item_41 = ListItem(List=explode_40.Segments, Index=int_placement_38, Wrap=True)
item_42 = ListItem(List=explode_41.Segments, Index=int_placement_36, Wrap=True)
item_43 = ListItem(List=explode_42.Segments, Index=int_placement_35, Wrap=True)
item_44 = ListItem(List=explode_44.Segments, Index=int_placement_34, Wrap=True)
item_45 = ListItem(List=explode_45.Segments, Index=int_placement_45, Wrap=True)
scale_2 = Scale(Center=Point(0, 0, 0), Factor=0.5)  # -> Geometry, Transform
item_46 = ListItem(List=explode_46.Segments, Index=int_placement_40, Wrap=True)
item_47 = ListItem(List=explode_47.Segments, Index=int_placement_21, Wrap=True)
item_48 = ListItem(List=explode_48.Segments, Index=int_placement_39, Wrap=True)
item_49 = ListItem(List=explode_49.Segments, Index=int_placement_41, Wrap=True)
item_50 = ListItem(List=explode_50.Segments, Index=int_placement_44, Wrap=True)
item_51 = ListItem(List=explode_51.Segments, Index=int_placement_53, Wrap=True)
item_52 = ListItem(List=explode_52.Segments, Index=int_placement_51, Wrap=True)
item_53 = ListItem(List=explode_53.Segments, Index=int_placement_52, Wrap=True)
item_54 = ListItem(List=explode_54.Segments, Index=int_placement_49, Wrap=True)
item_55 = ListItem(List=explode_59.Segments, Index=int_placement_59, Wrap=True)
item_56 = ListItem(List=explode_55.Segments, Index=int_placement_50, Wrap=True)
item_57 = ListItem(List=explode_56.Segments, Index=int_placement_54, Wrap=True)
item_58 = ListItem(List=explode_57.Segments, Index=int_placement_55, Wrap=True)
item_59 = ListItem(List=explode_58.Segments, Index=int_placement_58, Wrap=True)
item_60 = ListItem(List=explode_61.Segments, Index=int_placement_61, Wrap=True)
item_61 = ListItem(List=explode_60.Segments, Index=int_placement_60, Wrap=True)
previewlw_14 = CustomPreviewLineweights(Geometry=item_15, Shader=ColourSwatch(SwatchColor=RGB(33, 33, 33)), Thickness=Slider(6, range=0..10), Absolute=False)
item_62 = ListItem(List=explode_62.Segments, Index=int_placement_4, Wrap=True)
previewlw_15 = CustomPreviewLineweights(Geometry=item_16, Shader=ColourSwatch(SwatchColor=RGB(33, 33, 33)), Thickness=Slider(6, range=0..10), Absolute=False)
previewlw_16 = CustomPreviewLineweights(Geometry=item_17, Shader=ColourSwatch(SwatchColor=RGB(33, 33, 33)), Thickness=Slider(6, range=0..10), Absolute=False)
previewlw_17 = CustomPreviewLineweights(Geometry=item_18, Shader=ColourSwatch(SwatchColor=RGB(33, 33, 33)), Thickness=Slider(6, range=0..10), Absolute=False)
previewlw_18 = CustomPreviewLineweights(Geometry=item_19, Shader=ColourSwatch(SwatchColor=RGB(33, 33, 33)), Thickness=Slider(6, range=0..10), Absolute=False)
previewlw_19 = CustomPreviewLineweights(Geometry=item_20, Shader=ColourSwatch(SwatchColor=RGB(33, 33, 33)), Thickness=Slider(6, range=0..10), Absolute=False)
previewlw_20 = CustomPreviewLineweights(Geometry=item_21, Shader=ColourSwatch(SwatchColor=RGB(33, 33, 33)), Thickness=Slider(6, range=0..10), Absolute=False)
previewlw_21 = CustomPreviewLineweights(Geometry=item_22, Shader=ColourSwatch(SwatchColor=RGB(33, 33, 33)), Thickness=Slider(6, range=0..10), Absolute=False)
previewlw_22 = CustomPreviewLineweights(Geometry=item_23, Shader=ColourSwatch(SwatchColor=RGB(33, 33, 33)), Thickness=Slider(6, range=0..10), Absolute=False)
previewlw_23 = CustomPreviewLineweights(Geometry=item_24, Shader=ColourSwatch(SwatchColor=RGB(33, 33, 33)), Thickness=Slider(6, range=0..10), Absolute=False)
previewlw_24 = CustomPreviewLineweights(Geometry=item_27, Shader=ColourSwatch(SwatchColor=RGB(33, 33, 33)), Thickness=Slider(6, range=0..10), Absolute=False)
previewlw_25 = CustomPreviewLineweights(Geometry=item_25, Shader=ColourSwatch(SwatchColor=RGB(33, 33, 33)), Thickness=Slider(6, range=0..10), Absolute=False)
previewlw_26 = CustomPreviewLineweights(Geometry=item_26, Shader=ColourSwatch(SwatchColor=RGB(33, 33, 33)), Thickness=Slider(6, range=0..10), Absolute=False)
previewlw_27 = CustomPreviewLineweights(Geometry=item_29, Shader=ColourSwatch(SwatchColor=RGB(33, 33, 33)), Thickness=Slider(6, range=0..10), Absolute=False)
previewlw_28 = CustomPreviewLineweights(Geometry=item_28, Shader=ColourSwatch(SwatchColor=RGB(33, 33, 33)), Thickness=Slider(6, range=0..10), Absolute=False)
previewlw_29 = CustomPreviewLineweights(Geometry=item_30, Shader=ColourSwatch(SwatchColor=RGB(33, 33, 33)), Thickness=Slider(6, range=0..10), Absolute=False)
previewlw_30 = CustomPreviewLineweights(Geometry=item_31, Shader=ColourSwatch(SwatchColor=RGB(33, 33, 33)), Thickness=Slider(6, range=0..10), Absolute=False)
previewlw_31 = CustomPreviewLineweights(Geometry=item_32, Shader=ColourSwatch(SwatchColor=RGB(33, 33, 33)), Thickness=Slider(6, range=0..10), Absolute=False)
previewlw_32 = CustomPreviewLineweights(Geometry=item_33, Shader=ColourSwatch(SwatchColor=RGB(33, 33, 33)), Thickness=Slider(6, range=0..10), Absolute=False)
previewlw_33 = CustomPreviewLineweights(Geometry=item_37, Shader=ColourSwatch(SwatchColor=RGB(33, 33, 33)), Thickness=Slider(6, range=0..10), Absolute=False)
previewlw_34 = CustomPreviewLineweights(Geometry=item_47, Shader=ColourSwatch(SwatchColor=RGB(33, 33, 33)), Thickness=Slider(6, range=0..10), Absolute=False)
previewlw_35 = CustomPreviewLineweights(Geometry=item_35, Shader=ColourSwatch(SwatchColor=RGB(33, 33, 33)), Thickness=Slider(6, range=0..10), Absolute=False)
previewlw_36 = CustomPreviewLineweights(Geometry=item_36, Shader=ColourSwatch(SwatchColor=RGB(33, 33, 33)), Thickness=Slider(6, range=0..10), Absolute=False)
previewlw_37 = CustomPreviewLineweights(Geometry=item_38, Shader=ColourSwatch(SwatchColor=RGB(33, 33, 33)), Thickness=Slider(6, range=0..10), Absolute=False)
previewlw_38 = CustomPreviewLineweights(Geometry=item_39, Shader=ColourSwatch(SwatchColor=RGB(33, 33, 33)), Thickness=Slider(6, range=0..10), Absolute=False)
previewlw_39 = CustomPreviewLineweights(Geometry=item_40, Shader=ColourSwatch(SwatchColor=RGB(33, 33, 33)), Thickness=Slider(6, range=0..10), Absolute=False)
previewlw_40 = CustomPreviewLineweights(Geometry=item_41, Shader=ColourSwatch(SwatchColor=RGB(33, 33, 33)), Thickness=Slider(6, range=0..10), Absolute=False)
previewlw_41 = CustomPreviewLineweights(Geometry=item_42, Shader=ColourSwatch(SwatchColor=RGB(33, 33, 33)), Thickness=Slider(6, range=0..10), Absolute=False)
previewlw_42 = CustomPreviewLineweights(Geometry=item_43, Shader=ColourSwatch(SwatchColor=RGB(33, 33, 33)), Thickness=Slider(6, range=0..10), Absolute=False)
previewlw_43 = CustomPreviewLineweights(Geometry=item_44, Shader=ColourSwatch(SwatchColor=RGB(33, 33, 33)), Thickness=Slider(6, range=0..10), Absolute=False)
previewlw_44 = CustomPreviewLineweights(
    Geometry=[item_51, item_45],
    Shader=ColourSwatch(SwatchColor=RGB(33, 33, 33)),
    Thickness=Slider(6, range=0..10),
    Absolute=False)
previewlw_45 = CustomPreviewLineweights(Geometry=item_46, Shader=ColourSwatch(SwatchColor=RGB(33, 33, 33)), Thickness=Slider(6, range=0..10), Absolute=False)
previewlw_46 = CustomPreviewLineweights(Geometry=item_48, Shader=ColourSwatch(SwatchColor=RGB(33, 33, 33)), Thickness=Slider(6, range=0..10), Absolute=False)
previewlw_47 = CustomPreviewLineweights(Geometry=item_49, Shader=ColourSwatch(SwatchColor=RGB(33, 33, 33)), Thickness=Slider(6, range=0..10), Absolute=False)
previewlw_48 = CustomPreviewLineweights(Geometry=item_50, Shader=ColourSwatch(SwatchColor=RGB(33, 33, 33)), Thickness=Slider(6, range=0..10), Absolute=False)
previewlw_49 = CustomPreviewLineweights(Geometry=item_52, Shader=ColourSwatch(SwatchColor=RGB(33, 33, 33)), Thickness=Slider(6, range=0..10), Absolute=False)
previewlw_50 = CustomPreviewLineweights(Geometry=item_53, Shader=ColourSwatch(SwatchColor=RGB(33, 33, 33)), Thickness=Slider(6, range=0..10), Absolute=False)
previewlw_51 = CustomPreviewLineweights(Geometry=item_54, Shader=ColourSwatch(SwatchColor=RGB(33, 33, 33)), Thickness=Slider(6, range=0..10), Absolute=False)
previewlw_52 = CustomPreviewLineweights(Geometry=item_56, Shader=ColourSwatch(SwatchColor=RGB(33, 33, 33)), Thickness=Slider(6, range=0..10), Absolute=False)
previewlw_53 = CustomPreviewLineweights(Geometry=item_57, Shader=ColourSwatch(SwatchColor=RGB(33, 33, 33)), Thickness=Slider(6, range=0..10), Absolute=False)
previewlw_54 = CustomPreviewLineweights(Geometry=item_58, Shader=ColourSwatch(SwatchColor=RGB(33, 33, 33)), Thickness=Slider(6, range=0..10), Absolute=False)
previewlw_55 = CustomPreviewLineweights(Geometry=item_59, Shader=ColourSwatch(SwatchColor=RGB(33, 33, 33)), Thickness=Slider(6, range=0..10), Absolute=False)
previewlw_56 = CustomPreviewLineweights(Geometry=item_55, Shader=ColourSwatch(SwatchColor=RGB(33, 33, 33)), Thickness=Slider(6, range=0..10), Absolute=False)
previewlw_57 = CustomPreviewLineweights(Geometry=item_61, Shader=ColourSwatch(SwatchColor=RGB(33, 33, 33)), Thickness=Slider(6, range=0..10), Absolute=False)
previewlw_58 = CustomPreviewLineweights(Geometry=item_60, Shader=ColourSwatch(SwatchColor=RGB(33, 33, 33)), Thickness=Slider(6, range=0..10), Absolute=False)
previewlw_59 = CustomPreviewLineweights(Geometry=item_62, Shader=ColourSwatch(SwatchColor=RGB(33, 33, 33)), Thickness=Slider(6, range=0..10), Absolute=False)
int_importance_55 = Integer(int_importance)
int_placement_62 = Integer(int_placement)
num_score_63 = Number(num_score)
txt_name_62 = Text(txt_name)
geo_186 = Geometry(geo_3)
geo_187 = Geometry(geo_4)
geo_188 = Geometry(geo_2)
int_importance_56 = Integer(int_importance_48)
int_placement_63 = Integer(int_placement_55)
num_score_64 = Number(num_score_50)
txt_name_63 = Text(txt_name_55)
geo_189 = Geometry(geo_167)
geo_190 = Geometry(geo_165)
geo_191 = Geometry(geo_166)
int_importance_57 = Integer(int_importance_45)
int_placement_64 = Integer(int_placement_51)
int_importance_58 = Integer(int_importance_14)
num_score_65 = Number(num_score_56)
int_placement_65 = Integer(int_placement_13)
txt_name_64 = Text(txt_name_51)
int_importance_59 = Integer(int_importance_45)
int_placement_66 = Integer(int_placement_51)
int_importance_60 = Integer(int_importance_2)
geo_192 = Geometry(geo_153)
geo_193 = Geometry(geo_155)
geo_194 = Geometry(geo_154)
int_placement_67 = Integer(int_placement_2)
int_importance_61 = Integer(int_importance_49)
num_score_66 = Number(num_score_14)
int_importance_62 = Integer(int_importance_50)
int_placement_68 = Integer(int_placement_54)
num_score_67 = Number(num_score_56)
txt_name_65 = Text(txt_name_13)
explode_63 = Explode(Curve=geo_188, Recursive=True)  # -> Segments, Vertices
int_placement_69 = Integer(int_placement_56)
num_score_68 = Number(num_score_2)
txt_name_66 = Text(txt_name_51)
geo_195 = Geometry(geo_40)
geo_196 = Geometry(geo_38)
geo_197 = Geometry(geo_39)
num_score_69 = Number(num_score_49)
txt_name_67 = Text(txt_name_2)
num_score_70 = Number(num_score_51)
geo_198 = Geometry(geo_154)
geo_199 = Geometry(geo_153)
geo_200 = Geometry(geo_155)
txt_name_68 = Text(txt_name_54)
txt_name_69 = Text(txt_name_56)
geo_201 = Geometry(geo_5)
geo_202 = Geometry(geo_6)
geo_203 = Geometry(geo_7)
geo_204 = Geometry(geo_164)
geo_205 = Geometry(geo_163)
geo_206 = Geometry(geo_162)
geo_207 = Geometry(geo_170)
int_importance_63 = Integer(int_importance_41)
geo_208 = Geometry(geo_168)
geo_209 = Geometry(geo_169)
int_importance_64 = Integer(int_importance_40)
int_placement_70 = Integer(int_placement_49)
int_placement_71 = Integer(int_placement_50)
int_importance_65 = Integer(int_importance_38)
int_placement_72 = Integer(int_placement_44)
merge = Merge()  # -> flatten(Result)
num_score_71 = Number(num_score_43)
num_score_72 = Number(num_score_42)
num_score_73 = Number(num_score_38)
txt_name_70 = Text(txt_name_49)
txt_name_71 = Text(txt_name_50)
txt_name_72 = Text(txt_name_44)
geo_210 = Geometry(geo_151)
int_importance_66 = Integer(int_importance_23)
geo_211 = Geometry(geo_146)
geo_212 = Geometry(geo_147)
geo_213 = Geometry(geo_148)
geo_214 = Geometry(geo_152)
geo_215 = Geometry(geo_150)
int_placement_73 = Integer(int_placement_23)
geo_216 = Geometry(geo_131)
geo_217 = Geometry(geo_132)
geo_218 = Geometry(geo_133)
int_importance_67 = Integer(int_importance_47)
int_importance_68 = Integer(int_importance_43)
int_importance_69 = Integer(importance_70)
int_importance_70 = Integer(int_importance_29)
int_placement_74 = Integer(int_placement_53)
int_placement_75 = Integer(int_placement_45)
int_placement_76 = Integer(int_placement_57)
int_placement_77 = Integer(int_placement_26)
num_score_74 = Number(num_score_33)
merge_2 = Merge()  # -> flatten(Result)
txt_name_73 = Text(txt_name_23)
num_score_75 = Number(num_score_58)
num_score_76 = Number(num_score_9)
num_score_77 = Number(num_score_52)
num_score_78 = Number(num_score_44)
txt_name_74 = Text(txt_name_53)
txt_name_75 = Text(txt_name_45)
geo_219 = Geometry(geo_70)
txt_name_76 = Text(txt_name_57)
geo_220 = Geometry(geo_68)
geo_221 = Geometry(geo_69)
txt_name_77 = Text(txt_name_26)
geo_222 = Geometry(geo_159)
geo_223 = Geometry(geo_160)
geo_224 = Geometry(geo_161)
geo_225 = Geometry(geo_134)
geo_226 = Geometry(geo_135)
geo_227 = Geometry(geo_136)
geo_228 = Geometry(geo_173)
geo_229 = Geometry(geo_78)
geo_230 = Geometry(geo_171)
geo_231 = Geometry(geo_172)
int_importance_71 = Integer(int_importance_46)
int_importance_72 = Integer(int_importance_42)
geo_232 = Geometry(geo_77)
geo_233 = Geometry(geo_79)
int_placement_78 = Integer(int_placement_52)
int_placement_79 = Integer(int_placement_40)
merge_3 = Merge()  # -> flatten(Result)
num_score_79 = Number(num_score_57)
num_score_80 = Number(num_score_54)
int_importance_73 = Integer(int_importance_44)
txt_name_78 = Text(txt_name_52)
txt_name_79 = Text(txt_name_40)
geo_234 = Geometry(geo_157)
geo_235 = Geometry(geo_120)
geo_236 = Geometry(scale_nu.Geometry)
geo_237 = Geometry(geo_158)
geo_238 = Geometry(geo_119)
geo_239 = Geometry(geo_121)
num_score_81 = Number(num_score_55)
explode_64 = Explode(Curve=geo_190, Recursive=True)  # -> Segments, Vertices
int_importance_74 = Integer(int_importance_53)
int_importance_75 = Integer(int_importance_54)
int_importance_76 = Integer(int_importance_11)
int_importance_77 = Integer(int_importance_7)
int_placement_80 = Integer(int_placement_60)
int_placement_81 = Integer(int_placement_61)
int_placement_82 = Integer(int_placement_11)
int_placement_83 = Integer(int_placement_7)
num_score_82 = Number(num_score_61)
num_score_83 = Number(num_score_62)
int_importance_78 = Integer(int_importance_52)
int_importance_79 = Integer(int_importance_10)
int_placement_84 = Integer(int_placement_59)
num_score_84 = Number(num_score_11)
num_score_85 = Number(num_score_7)
txt_name_80 = Text(txt_name_60)
txt_name_81 = Text(txt_name_61)
int_placement_85 = Integer(int_placement_10)
txt_name_82 = Text(txt_name_11)
txt_name_83 = Text(txt_name_7)
geo_240 = Geometry(geo_182)
geo_241 = Geometry(geo_184)
item_63 = ListItem(List=explode_63.Segments, Index=int_placement_62, Wrap=True)
explode_65 = Explode(Curve=geo_192, Recursive=True)  # -> Segments, Vertices
geo_242 = Geometry(geo_180)
geo_243 = Geometry(geo_181)
geo_244 = Geometry(geo_183)
geo_245 = Geometry(geo_185)
num_score_86 = Number(num_score_60)
geo_246 = Geometry(geo_33)
geo_247 = Geometry(geo_21)
geo_248 = Geometry(geo_32)
geo_249 = Geometry(geo_34)
geo_250 = Geometry(geo_20)
geo_251 = Geometry(geo_22)
num_score_87 = Number(num_score_8)
txt_name_84 = Text(txt_name_59)
txt_name_85 = Text(txt_name_10)
geo_252 = Geometry(geo_179)
geo_253 = Geometry(geo_177)
geo_254 = Geometry(geo_178)
explode_66 = Explode(Curve=geo_196, Recursive=True)  # -> Segments, Vertices
geo_255 = Geometry(geo_31)
geo_256 = Geometry(geo_29)
geo_257 = Geometry(geo_30)
explode_67 = Explode(Curve=geo_199, Recursive=True)  # -> Segments, Vertices
explode_68 = Explode(Curve=geo_201, Recursive=True)  # -> Segments, Vertices
explode_69 = Explode(Curve=geo_205, Recursive=True)  # -> Segments, Vertices
explode_70 = Explode(Curve=geo_208, Recursive=True)  # -> Segments, Vertices
number_slider_3 = Slider(3, range=0..10)
explode_71 = Explode(Curve=geo_211, Recursive=True)  # -> Segments, Vertices
explode_72 = Explode(Curve=geo_214, Recursive=True)  # -> Segments, Vertices
explode_73 = Explode(Curve=geo_216, Recursive=True)  # -> Segments, Vertices
group = Group(Geometry=geo_186)
explode_74 = Explode(Curve=geo_220, Recursive=True)  # -> Segments, Vertices
explode_75 = Explode(Curve=geo_232, Recursive=True)  # -> Segments, Vertices
explode_76 = Explode(Curve=geo_230, Recursive=True)  # -> Segments, Vertices
explode_77 = Explode(Curve=geo_222, Recursive=True)  # -> Segments, Vertices
explode_78 = Explode(Curve=geo_225, Recursive=True)  # -> Segments, Vertices
item_64 = ListItem(List=explode_64.Segments, Index=int_placement_63, Wrap=True)
explode_79 = Explode(Curve=geo_236, Recursive=True)  # -> Segments, Vertices
explode_80 = Explode(Curve=geo_238, Recursive=True)  # -> Segments, Vertices
item_65 = ListItem(List=explode_65.Segments, Index=Slider(0, range=0..3), Wrap=True)
join = JoinCurves(Curves=item_63, Preserve=False)
explode_81 = Explode(Curve=geo_242, Recursive=True)  # -> Segments, Vertices
explode_82 = Explode(Curve=geo_244, Recursive=True)  # -> Segments, Vertices
explode_83 = Explode(Curve=geo_248, Recursive=True)  # -> Segments, Vertices
explode_84 = Explode(Curve=geo_250, Recursive=True)  # -> Segments, Vertices
relay = Relay()
item_66 = ListItem(List=explode_66.Segments, Index=int_placement_65, Wrap=True)
item_67 = ListItem(List=explode_67.Segments, Index=Slider(1, range=0..3), Wrap=True)
item_68 = ListItem(List=explode_68.Segments, Index=Slider(2, range=0..10), Wrap=True)
explode_85 = Explode(Curve=geo_253, Recursive=True)  # -> Segments, Vertices
explode_86 = Explode(Curve=geo_256, Recursive=True)  # -> Segments, Vertices
explode_87 = Explode(Curve=geo_254, Recursive=True)  # -> Segments, Vertices
item_69 = ListItem(List=explode_69.Segments, Index=int_placement_68, Wrap=True)
item_70 = ListItem(List=explode_70.Segments, Index=int_placement_69, Wrap=True)
int_importance_80 = Integer(importance_68)
int_placement_86 = Integer(int_placement_46)
group_2 = Group(Geometry=geo_189)
item_71 = ListItem(List=explode_71.Segments, Index=Slider(0, range=0..3), Wrap=True)
item_72 = ListItem(List=explode_72.Segments, Index=Slider(0, range=0..3), Wrap=True)
num_score_88 = Number(num_score_39)
txt_name_86 = Text(txt_name_46)
geo_258 = Geometry(geo_137)
geo_259 = Geometry(geo_138)
geo_260 = Geometry(geo_139)
int_importance_81 = Integer(int_importance_39)
int_importance_82 = Integer(importance_69)
item_73 = ListItem(List=explode_73.Segments, Index=Slider(1, range=0..10), Wrap=True)
int_placement_87 = Integer(int_placement_47)
int_placement_88 = Integer(int_placement_48)
group_3 = Group(Geometry=geo_194)
item_74 = ListItem(List=explode_74.Segments, Index=int_placement_73, Wrap=True)
item_75 = ListItem(List=explode_75.Segments, Index=Slider(2, range=0..10), Wrap=True)
item_76 = ListItem(List=explode_77.Segments, Index=int_placement_74, Wrap=True)
num_score_89 = Number(num_score_40)
num_score_90 = Number(num_score_41)
int_importance_83 = Integer(int_importance_28)
item_77 = ListItem(List=explode_76.Segments, Index=int_placement_76, Wrap=True)
int_importance_84 = Integer(int_importance_27)
int_placement_89 = Integer(int_placement_35)
txt_name_87 = Text(txt_name_47)
txt_name_88 = Text(txt_name_48)
group_4 = Group(Geometry=geo_195)
int_placement_90 = Integer(int_placement_34)
item_78 = ListItem(List=explode_78.Segments, Index=int_placement_75, Wrap=True)
group_5 = Group(Geometry=geo_198)
group_6 = Group(Geometry=geo_203)
geo_261 = Geometry(geo_142)
geo_262 = Geometry(geo_145)
geo_263 = Geometry(geo_140)
geo_264 = Geometry(geo_141)
geo_265 = Geometry(geo_143)
geo_266 = Geometry(geo_144)
num_score_91 = Number(num_score_22)
int_importance_85 = Integer(int_importance_24)
num_score_92 = Number(num_score_21)
txt_name_89 = Text(txt_name_35)
int_placement_91 = Integer(int_placement_36)
txt_name_90 = Text(txt_name_34)
join_2 = JoinCurves(Curves=item_64, Preserve=False)
group_7 = Group(Geometry=geo_204)
group_8 = Group(Geometry=geo_207)
item_79 = ListItem(List=explode_79.Segments, Index=int_placement_78, Wrap=True)
item_80 = ListItem(List=explode_80.Segments, Index=int_placement_79, Wrap=True)
geo_267 = Geometry(geo_104)
geo_268 = Geometry(geo_105)
geo_269 = Geometry(geo_106)
geo_270 = Geometry(geo_101)
geo_271 = Geometry(geo_102)
geo_272 = Geometry(geo_103)
num_score_93 = Number(num_score_23)
txt_name_91 = Text(txt_name_36)
geo_273 = Geometry(geo_109)
geo_274 = Geometry(geo_107)
geo_275 = Geometry(geo_108)
group_9 = Group(Geometry=geo_213)
group_10 = Group(Geometry=geo_210)
join_3 = JoinCurves(Curves=item_65, Preserve=False)
item_81 = ListItem(List=explode_81.Segments, Index=int_placement_80, Wrap=True)
item_82 = ListItem(List=explode_82.Segments, Index=int_placement_81, Wrap=True)
merge_4 = Merge(
    Data1=txt_name_62,
    Data2=flatten(join),
    Data3=int_importance_55,
    Data4=num_score_63,
    Data5=geo_187,
    Data6=geo_188,
    Data7=group)
item_83 = ListItem(List=explode_83.Segments, Index=int_placement_82, Wrap=True)
item_84 = ListItem(List=explode_84.Segments, Index=int_placement_83, Wrap=True)
group_11 = Group(Geometry=geo_218)
join_4 = JoinCurves(Curves=item_66, Preserve=False)
join_5 = JoinCurves(Curves=item_67, Preserve=False)
item_85 = ListItem(List=explode_85.Segments, Index=int_placement_84, Wrap=True)
join_6 = JoinCurves(Curves=item_68, Preserve=False)
item_86 = ListItem(List=explode_86.Segments, Index=int_placement_85, Wrap=True)
item_87 = ListItem(List=explode_87.Segments, Index=int_placement_84, Wrap=True)
group_12 = Group(Geometry=geo_219)
group_13 = Group(Geometry=geo_229)
join_7 = JoinCurves(Curves=item_69, Preserve=False)
join_8 = JoinCurves(Curves=item_70, Preserve=False)
group_14 = Group(Geometry=geo_228)
group_15 = Group(Geometry=geo_224)
group_16 = Group(Geometry=geo_227)
int_importance_86 = Integer(int_importance_15)
int_importance_87 = Integer(int_importance_16)
int_placement_92 = Integer(int_placement_15)
int_placement_93 = Integer(int_placement_16)
group_17 = Group(Geometry=geo_234)
group_18 = Group(Geometry=geo_235)
join_9 = JoinCurves(Curves=item_71, Preserve=False)
join_10 = JoinCurves(Curves=item_72, Preserve=False)
int_importance_88 = Integer(int_importance_12)
num_score_94 = Number(num_score_16)
num_score_95 = Number(num_score_26)
join_11 = JoinCurves(Curves=item_73, Preserve=False)
int_placement_94 = Integer(int_placement_12)
txt_name_92 = Text(txt_name_15)
txt_name_93 = Text(txt_name_16)
geo_276 = Geometry(geo_46)
geo_277 = Geometry(geo_48)
geo_278 = Geometry(geo_44)
geo_279 = Geometry(geo_45)
geo_280 = Geometry(geo_47)
geo_281 = Geometry(geo_49)
num_score_96 = Number(num_score_13)
join_12 = JoinCurves(Curves=item_74, Preserve=False)
txt_name_94 = Text(txt_name_12)
explode_88 = Explode(Curve=geo_258, Recursive=True)  # -> Segments, Vertices
group_19 = Group(Geometry=geo_240)
group_20 = Group(Geometry=geo_241)
join_13 = JoinCurves(Curves=item_75, Preserve=False)
group_21 = Group(Geometry=geo_246)
group_22 = Group(Geometry=geo_247)
geo_282 = Geometry(geo_36)
geo_283 = Geometry(geo_35)
geo_284 = Geometry(geo_37)
join_14 = JoinCurves(Curves=item_77, Preserve=False)
join_15 = JoinCurves(Curves=item_76, Preserve=False)
join_16 = JoinCurves(Curves=item_78, Preserve=False)
group_23 = Group(Geometry=geo_252)
group_24 = Group(Geometry=geo_255)
explode_89 = Explode(Curve=geo_263, Recursive=True)  # -> Segments, Vertices
explode_90 = Explode(Curve=geo_265, Recursive=True)  # -> Segments, Vertices
join_17 = JoinCurves(Curves=item_79, Preserve=False)
join_18 = JoinCurves(Curves=item_80, Preserve=False)
merge_5 = Merge(
    Data1=txt_name_63,
    Data2=flatten(join_2),
    Data3=int_importance_56,
    Data4=num_score_64,
    Data5=geo_190,
    Data6=geo_191,
    Data7=group_2)
int_importance_89 = Integer(int_importance_4)
int_importance_90 = Integer(int_importance_5)
explode_91 = Explode(Curve=geo_270, Recursive=True)  # -> Segments, Vertices
explode_92 = Explode(Curve=geo_267, Recursive=True)  # -> Segments, Vertices
int_placement_95 = Integer(int_placement_4)
int_placement_96 = Integer(int_placement_5)
num_score_97 = Number(num_score_4)
num_score_98 = Number(num_score_5)
int_importance_91 = Integer(int_importance_3)
explode_93 = Explode(Curve=geo_274, Recursive=True)  # -> Segments, Vertices
int_placement_97 = Integer(int_placement_3)
txt_name_95 = Text(txt_name_4)
txt_name_96 = Text(txt_name_5)
merge_6 = Merge(
    Data1=txt_name_64,
    Data2=flatten(join_3),
    Data3=int_importance_57,
    Data4=num_score_65,
    Data5=geo_192,
    Data6=geo_193,
    Data7=group_3)
join_19 = JoinCurves(Curves=item_81, Preserve=False)
join_20 = JoinCurves(Curves=item_82, Preserve=False)
join_21 = JoinCurves(Curves=item_83, Preserve=False)
join_22 = JoinCurves(Curves=item_84, Preserve=False)
geo_285 = Geometry(geo_11)
geo_286 = Geometry(geo_12)
geo_287 = Geometry(geo_13)
geo_288 = Geometry(geo_14)
geo_289 = Geometry(geo_15)
geo_290 = Geometry(geo_16)
num_score_99 = Number(num_score_3)
txt_name_97 = Text(txt_name_3)
join_23 = JoinCurves(Curves=item_85, Preserve=False)
merge_7 = Merge(
    Data1=txt_name_65,
    Data2=flatten(join_4),
    Data3=int_importance_58,
    Data4=num_score_66,
    Data5=geo_196,
    Data6=geo_197,
    Data7=group_4)
join_24 = JoinCurves(Curves=item_86, Preserve=False)
join_25 = JoinCurves(Curves=item_87, Preserve=False)
geo_291 = Geometry(geo_8)
geo_292 = Geometry(geo_10)
geo_293 = Geometry(geo_9)
merge_8 = Merge(
    Data1=txt_name_66,
    Data2=flatten(join_5),
    Data3=int_importance_59,
    Data4=num_score_67,
    Data5=geo_199,
    Data6=geo_200,
    Data7=group_5)
merge_9 = Merge(
    Data1=txt_name_67,
    Data2=flatten(join_6),
    Data3=int_importance_60,
    Data4=num_score_68,
    Data5=geo_201,
    Data6=geo_202,
    Data7=group_6)
merge_10 = Merge(
    Data1=txt_name_68,
    Data2=flatten(join_7),
    Data3=int_importance_61,
    Data4=num_score_69,
    Data5=geo_205,
    Data6=geo_206,
    Data7=group_7)
merge_11 = Merge(
    Data1=txt_name_69,
    Data2=flatten(join_8),
    Data3=int_importance_62,
    Data4=num_score_70,
    Data5=geo_208,
    Data6=geo_209,
    Data7=group_8)
merge_12 = Merge(
    Data1=txt_name_70,
    Data2=flatten(join_9),
    Data3=int_importance_64,
    Data4=num_score_72,
    Data5=geo_211,
    Data6=geo_212,
    Data7=group_9)
merge_13 = Merge(
    Data1=txt_name_71,
    Data2=flatten(join_10),
    Data3=int_importance_63,
    Data4=num_score_71,
    Data5=geo_214,
    Data6=geo_215,
    Data7=group_10)
merge_14 = Merge(
    Data1=txt_name_72,
    Data2=flatten(join_11),
    Data3=int_importance_65,
    Data4=num_score_73,
    Data5=geo_216,
    Data6=geo_217,
    Data7=group_11)
explode_94 = Explode(Curve=geo_278, Recursive=True)  # -> Segments, Vertices
explode_95 = Explode(Curve=geo_280, Recursive=True)  # -> Segments, Vertices
item_88 = ListItem(List=explode_88.Segments, Index=int_placement_86, Wrap=True)
merge_15 = Merge(
    Data1=txt_name_73,
    Data2=flatten(join_12),
    Data3=int_importance_66,
    Data4=num_score_74,
    Data5=geo_220,
    Data6=geo_221,
    Data7=group_12)
merge_16 = Merge(
    Data1=txt_name_77,
    Data2=flatten(join_13),
    Data3=int_importance_70,
    Data4=num_score_78,
    Data5=geo_232,
    Data6=geo_233,
    Data7=group_13)
explode_96 = Explode(Curve=geo_284, Recursive=True)  # -> Segments, Vertices
merge_17 = Merge(
    Data1=txt_name_76,
    Data2=flatten(join_14),
    Data3=int_importance_69,
    Data4=num_score_77,
    Data5=geo_230,
    Data6=geo_231,
    Data7=group_14)
merge_18 = Merge(
    Data1=txt_name_74,
    Data2=flatten(join_15),
    Data3=int_importance_67,
    Data4=num_score_75,
    Data5=geo_222,
    Data6=geo_223,
    Data7=group_15)
merge_19 = Merge(
    Data1=txt_name_75,
    Data2=flatten(join_16),
    Data3=int_importance_68,
    Data4=num_score_76,
    Data5=geo_225,
    Data6=geo_226,
    Data7=group_16)
item_89 = ListItem(List=explode_89.Segments, Index=int_placement_87, Wrap=True)
item_90 = ListItem(List=explode_90.Segments, Index=int_placement_88, Wrap=True)
merge_20 = Merge(
    Data1=flatten(txt_name_78),
    Data2=flatten(join_17),
    Data3=flatten(int_importance_71),
    Data4=flatten(num_score_79),
    Data5=flatten(geo_236),
    Data6=flatten(geo_237),
    Data7=flatten(group_17))
merge_21 = Merge(
    Data1=txt_name_79,
    Data2=flatten(join_18),
    Data3=int_importance_72,
    Data4=num_score_80,
    Data5=geo_238,
    Data6=geo_239,
    Data7=group_18)
item_91 = ListItem(List=explode_91.Segments, Index=int_placement_90, Wrap=True)
item_92 = ListItem(List=explode_92.Segments, Index=int_placement_89, Wrap=True)
item_93 = ListItem(List=explode_93.Segments, Index=int_placement_91, Wrap=True)
merge_22 = Merge(
    Data1=txt_name_80,
    Data2=flatten(join_19),
    Data3=int_importance_74,
    Data4=num_score_82,
    Data5=geo_242,
    Data6=geo_243,
    Data7=group_19)
merge_23 = Merge(
    Data1=txt_name_81,
    Data2=flatten(join_20),
    Data3=int_importance_75,
    Data4=num_score_83,
    Data5=geo_244,
    Data6=geo_245,
    Data7=group_20)
merge_24 = Merge(
    Data1=txt_name_82,
    Data2=flatten(join_21),
    Data3=int_importance_76,
    Data4=num_score_84,
    Data5=geo_248,
    Data6=geo_249,
    Data7=group_21)
merge_25 = Merge(
    Data1=txt_name_83,
    Data2=flatten(join_22),
    Data3=int_importance_77,
    Data4=num_score_85,
    Data5=geo_250,
    Data6=geo_251,
    Data7=group_22)
explode_97 = Explode(Curve=geo_285, Recursive=True)  # -> Segments, Vertices
explode_98 = Explode(Curve=geo_288, Recursive=True)  # -> Segments, Vertices
merge_26 = Merge(
    Data1=txt_name_84,
    Data2=flatten(join_25),
    Data3=int_importance_78,
    Data4=num_score_86,
    Data5=geo_253,
    Data6=geo_254,
    Data7=group_23)
group_25 = Group(Geometry=geo_260)
merge_27 = Merge(
    Data1=txt_name_85,
    Data2=flatten(join_24),
    Data3=int_importance_79,
    Data4=num_score_87,
    Data5=geo_256,
    Data6=geo_257,
    Data7=group_24)
explode_99 = Explode(Curve=geo_292, Recursive=True)  # -> Segments, Vertices
int_importance_92 = Integer(int_importance_51)
int_placement_98 = Integer(int_placement_58)
num_score_100 = Number(num_score_59)
txt_name_98 = Text(txt_name_58)
group_26 = Group(Geometry=geo_261)
group_27 = Group(Geometry=geo_262)
entwine = Entwine(Branch00=merge_6, FlattenInputs=True)
geo_294 = Geometry(geo_176)
geo_295 = Geometry(geo_174)
geo_296 = Geometry(geo_175)
group_28 = Group(Geometry=geo_272)
group_29 = Group(Geometry=geo_269)
entwine_2 = Entwine(Branch00=merge_8, FlattenInputs=True)
entwine_3 = Entwine(Branch00=merge_9, FlattenInputs=True)
item_94 = ListItem(List=explode_94.Segments, Index=int_placement_92, Wrap=True)
item_95 = ListItem(List=explode_95.Segments, Index=int_placement_93, Wrap=True)
group_30 = Group(Geometry=geo_273)
join_26 = JoinCurves(Curves=item_88, Preserve=False)
entwine_4 = Entwine(Branch00=merge_4, FlattenInputs=True)
item_96 = ListItem(List=explode_96.Segments, Index=int_placement_94, Wrap=True)
join_27 = JoinCurves(Curves=item_89, Preserve=False)
join_28 = JoinCurves(Curves=item_90, Preserve=False)
join_29 = JoinCurves(Curves=item_91, Preserve=False)
join_30 = JoinCurves(Curves=item_92, Preserve=False)
join_31 = JoinCurves(Curves=item_93, Preserve=False)
entwine_5 = Entwine(Branch00=merge_16, FlattenInputs=True)
item_97 = ListItem(List=explode_97.Segments, Index=int_placement_95, Wrap=True)
item_98 = ListItem(List=explode_98.Segments, Index=int_placement_96, Wrap=True)
group_31 = Group(Geometry=geo_276)
group_32 = Group(Geometry=geo_277)
item_99 = ListItem(List=explode_99.Segments, Index=int_placement_97, Wrap=True)
group_33 = Group(Geometry=geo_282)
explode_100 = Explode(Curve=geo_295, Recursive=True)  # -> Segments, Vertices
join_32 = JoinCurves(Curves=item_94, Preserve=False)
join_33 = JoinCurves(Curves=item_95, Preserve=False)
merge_28 = Merge(
    Data1=txt_name_86,
    Data2=flatten(join_26),
    Data3=int_importance_80,
    Data4=num_score_88,
    Data5=geo_258,
    Data6=geo_259,
    Data7=group_25)
join_34 = JoinCurves(Curves=item_96, Preserve=False)
group_34 = Group(Geometry=geo_287)
group_35 = Group(Geometry=geo_290)
group_36 = Group(Geometry=geo_293)
entwine_6 = Entwine(Branch00=merge_7, FlattenInputs=True)
merge_29 = Merge(
    Data1=txt_name_87,
    Data2=flatten(join_27),
    Data3=int_importance_81,
    Data4=num_score_89,
    Data5=geo_263,
    Data6=geo_264,
    Data7=group_26)
merge_30 = Merge(
    Data1=txt_name_88,
    Data2=flatten(join_28),
    Data3=int_importance_82,
    Data4=num_score_90,
    Data5=geo_265,
    Data6=geo_266,
    Data7=group_27)
entwine_7 = Entwine(Branch00=merge_5, Branch01=merge_10, FlattenInputs=True)
merge_31 = Merge(
    Data1=txt_name_90,
    Data2=flatten(join_29),
    Data3=int_importance_84,
    Data4=num_score_92,
    Data5=geo_270,
    Data6=geo_271,
    Data7=group_28)
merge_32 = Merge(
    Data1=txt_name_89,
    Data2=flatten(join_30),
    Data3=int_importance_83,
    Data4=num_score_91,
    Data5=geo_267,
    Data6=geo_268,
    Data7=group_29)
merge_33 = Merge(
    Data1=txt_name_91,
    Data2=flatten(join_31),
    Data3=int_importance_85,
    Data4=num_score_93,
    Data5=geo_274,
    Data6=geo_275,
    Data7=group_30)
join_35 = JoinCurves(Curves=item_97, Preserve=False)
join_36 = JoinCurves(Curves=item_98, Preserve=False)
entwine_8 = Entwine(Branch00=merge_12, Branch01=merge_13, FlattenInputs=True)
join_37 = JoinCurves(Curves=item_99, Preserve=False)
entwine_9 = Entwine(Branch00=merge_11, Branch01=merge_17, FlattenInputs=True)
entwine_10 = Entwine(Branch00=merge_15, FlattenInputs=True)
entwine_11 = Entwine(Branch00=merge_21, FlattenInputs=True)  # -> simplify(Result)
item_100 = ListItem(List=explode_100.Segments, Index=Slider(2, range=0..10), Wrap=True)
entwine_12 = Entwine(Branch00=merge_20, FlattenInputs=True)  # -> simplify(Result)
_1_kitchen = Data(entwine_4)
merge_34 = Merge(
    Data1=txt_name_92,
    Data2=flatten(join_32),
    Data3=int_importance_86,
    Data4=num_score_94,
    Data5=geo_278,
    Data6=geo_279,
    Data7=group_31)
merge_35 = Merge(
    Data1=txt_name_93,
    Data2=flatten(join_33),
    Data3=int_importance_87,
    Data4=num_score_95,
    Data5=geo_280,
    Data6=geo_281,
    Data7=group_32)
entwine_13 = Entwine(Branch00=merge_6, FlattenInputs=True)
entwine_14 = Entwine(Branch00=merge_25, FlattenInputs=True)  # -> simplify(Result)
entwine_15 = Entwine(Branch00=merge_27, FlattenInputs=True)  # -> simplify(Result)
merge_36 = Merge(
    Data1=txt_name_94,
    Data2=flatten(join_34),
    Data3=int_importance_88,
    Data4=num_score_96,
    Data5=geo_283,
    Data6=geo_284,
    Data7=group_33)
entwine_16 = Entwine(Branch00=merge_24, FlattenInputs=True)  # -> simplify(Result)
group_37 = Group(Geometry=geo_294)
entwine_17 = Entwine(Branch00=merge_14, Branch01=merge_18, Branch02=merge_19, FlattenInputs=True)
merge_37 = Merge(
    Data1=txt_name_95,
    Data2=flatten(join_35),
    Data3=int_importance_89,
    Data4=num_score_97,
    Data5=geo_285,
    Data6=geo_286,
    Data7=group_34)
merge_38 = Merge(
    Data1=txt_name_96,
    Data2=flatten(join_36),
    Data3=int_importance_90,
    Data4=num_score_98,
    Data5=geo_288,
    Data6=geo_289,
    Data7=group_35)
entwine_18 = Entwine(Branch00=merge_22, Branch01=merge_23, Branch02=merge_26, FlattenInputs=True)
merge_39 = Merge(
    Data1=txt_name_97,
    Data2=flatten(join_37),
    Data3=int_importance_91,
    Data4=num_score_99,
    Data5=geo_291,
    Data6=geo_292,
    Data7=group_36)
join_38 = JoinCurves(Curves=item_100, Preserve=False)
dispatch = Dispatch(List=_1_kitchen, DispatchPattern=equals.Equality)  # -> ListA, ListB
merge_40 = Merge(
    Data1=txt_name_98,
    Data2=flatten(join_38),
    Data3=int_importance_92,
    Data4=num_score_100,
    Data5=geo_295,
    Data6=geo_296,
    Data7=group_37)
entwine_19 = Entwine(Branch00=merge_28, Branch01=merge_29, Branch02=merge_30, FlattenInputs=True)
entwine_20 = Entwine(Branch0X=entwine_6, Branch1X=entwine_3, FlattenInputs=False)  # -> simplify(Result)
entwine_21 = Entwine(Branch0X=entwine_16, Branch1X=entwine_14, Branch2X=entwine_15, FlattenInputs=False)
entwine_22 = Entwine(Branch0X=entwine_8, Branch1X=entwine_13, FlattenInputs=False)  # -> simplify(Result)
entwine_23 = Entwine(Branch0X=entwine_10, Branch1X=entwine_5, FlattenInputs=False)  # -> simplify(Result)
entwine_24 = Entwine(Branch00=merge_31, Branch01=merge_32, Branch02=merge_33, FlattenInputs=True)
entwine_25 = Entwine(Branch0X=entwine_17, Branch1X=entwine_19, FlattenInputs=False)  # -> simplify(Result)
entwine_26 = Entwine(Branch0X=entwine_7, Branch1X=entwine_9, FlattenInputs=False)  # -> simplify(Result)
entwine_27 = Entwine(Branch00=merge_34, Branch01=merge_35, Branch02=merge_36, FlattenInputs=True)
entwine_28 = Entwine(Branch00=merge_40, FlattenInputs=True)
entwine_29 = Entwine(Branch00=entwine_12, FlattenInputs=True)
entwine_30 = Entwine(Branch00=merge_37, Branch01=merge_38, Branch02=merge_39, FlattenInputs=True)
_1_living = Data(entwine_20)
_2_living = Data(entwine_23)
dispatch_2 = Dispatch(List=_1_living, DispatchPattern=equals.Equality)  # -> ListA, ListB
_2_kitchen = Data(entwine_27)
entwine_31 = Entwine(Branch0X=entwine_24, Branch1X=entwine_28, FlattenInputs=False)  # -> simplify(Result)
dispatch_3 = Dispatch(List=_2_living, DispatchPattern=equals_3.Equality)  # -> ListA, ListB
_3_kitchen = Data(entwine_30)
_1_bath = Data(entwine_21)
dispatch_4 = Dispatch(List=_2_kitchen, DispatchPattern=equals_3.Equality)  # -> ListA, ListB
dispatch_5 = Dispatch(List=_1_bath, DispatchPattern=equals.Equality)  # -> ListA, ListB
_3_living = Data(entwine_31)
dispatch_6 = Dispatch(List=_3_kitchen, DispatchPattern=equals_2.Equality)  # -> ListA, ListB
_3_bed_storage_secondary = Data()  # disabled
_3_bed_bed_secondary = Data()  # disabled
dispatch_7 = Dispatch(List=_3_living, DispatchPattern=equals_2.Equality)  # -> ListA, ListB
_4_children = Data(entwine_26)
_4_bedroom = Data(entwine_25)
_4_kitchen = Data(entwine_18)
studio_kitchen = Data()  # disabled
_1_bed_storage = Data(merge_2)  # disabled
_3_bed_storage = Data()  # disabled
_1_bed_kitchen = Data(merge_3)  # disabled
_4_living = Data(entwine_22)
_4_wc = Data(entwine_29)
_3_bed_kitchen = Data()  # disabled
studio_dining = Data()  # disabled
studio_bath_1 = Data()  # disabled
studio_bath_2 = Data()  # disabled
studio_bath_3 = Data()  # disabled
studio_living = Data()  # disabled
_1_bed_dining = Data()  # disabled
_3_bed_dining = Data()  # disabled
_1_bed_living = Data()  # disabled
_1_bed_bath_1 = Data()  # disabled
_1_bed_bath_2 = Data()  # disabled
_1_bed_bath_3 = Data()  # disabled
_3_bed_bath_1 = Data()  # disabled
_3_bed_bath_2 = Data()  # disabled
_3_bed_bath_3 = Data()  # disabled
_3_bed_living = Data()  # disabled
studio_bed = Data()  # disabled
_1_bed_bed = Data(relay)  # disabled
_3_bed_bed = Data()  # disabled
dispatch_8 = Dispatch(List=_4_living, DispatchPattern=larger.OrEqualTo)  # -> ListA, ListB
dispatch_9 = Dispatch(List=_4_kitchen, DispatchPattern=larger.OrEqualTo)  # -> ListA, ListB
merge_41 = Merge(Data1=dispatch_9.ListA, Data2=dispatch_6.ListA, Data3=dispatch_4.ListA, Data4=dispatch.ListA)
merge_42 = Merge(Data1=dispatch_8.ListA, Data2=dispatch_7.ListA, Data3=dispatch_3.ListA, Data4=dispatch_2.ListA)
clean = CleanTree(RemoveNulls=True, RemoveInvalid=True, RemoveEmpty=True, Tree=merge_42)
clean_2 = CleanTree(RemoveNulls=True, RemoveInvalid=True, RemoveEmpty=True, Tree=merge_41)
children = Data(_4_children)
bedroom = Data(_4_bedroom)
living = Data(clean)
kitchen = Data(clean_2)
wc = Data(_4_wc)
bedroom_2 = ClusterOutput(bedroom)
kitchen_2 = ClusterOutput(kitchen)
wc_2 = ClusterOutput(wc)
living_2 = ClusterOutput(living)
children_2 = ClusterOutput(children)

# ---- group: Prepare and Sort
txt_name_99 = Text(program_51)
int_placement_99 = Integer(placementint_52)
geo_297 = Geometry(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)
geo_298 = Geometry([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])

# ----
explode_101 = Explode(Curve=geo_297, Recursive=True)  # -> Segments, Vertices
item_101 = ListItem(List=explode_101.Segments, Index=Slider(2, range=0..10), Wrap=True)
curvepoint_2 = PointOnCurve(item_101, parameter=0.5)
scale_nu_2 = ScaleNU(Geometry=geo_297, Plane=curvepoint_2, ScaleX=1, ScaleY=Slider(1.2, range=0..10), ScaleZ=1)  # -> Geometry, Transform

# ---- group: Prepare and Sort (continued)
geo_299 = Geometry(scale_nu_2.Geometry)

# ----
explode_102 = Explode(Curve=geo_299, Recursive=True)  # -> Segments, Vertices
item_102 = ListItem(List=explode_102.Segments, Index=int_placement_99, Wrap=True)
previewlw_60 = CustomPreviewLineweights(Geometry=item_102, Shader=ColourSwatch(SwatchColor=RGB(33, 33, 33)), Thickness=Slider(6, range=0..10), Absolute=False)
int_placement_100 = Integer(int_placement_99)
txt_name_100 = Text(txt_name_99)
geo_300 = Geometry(geo_298)
geo_301 = Geometry(geo_299)
geo_302 = Geometry(geo_297)
explode_103 = Explode(Curve=geo_301, Recursive=True)  # -> Segments, Vertices
item_103 = ListItem(List=explode_103.Segments, Index=int_placement_100, Wrap=True)
group_38 = Group(Geometry=geo_300)
join_39 = JoinCurves(Curves=item_103, Preserve=False)
merge_43 = Merge(
    Data1=flatten(txt_name_100),
    Data2=flatten(join_39),
    Data3=flatten(int_importance_73),
    Data4=flatten(num_score_81),
    Data5=flatten(geo_301),
    Data6=flatten(geo_302),
    Data7=flatten(group_38))
entwine_32 = Entwine(Branch00=merge_43, FlattenInputs=True)  # -> simplify(Result)
entwine_33 = Entwine(Branch0X=entwine_12, Branch1X=entwine_11, Branch2X=entwine_32, FlattenInputs=False)
_2_bath = Data(entwine_33)
dispatch_10 = Dispatch(List=_2_bath, DispatchPattern=equals_3.Equality)  # -> ListA, ListB
_3_bath = Data(entwine_33)
dispatch_11 = Dispatch(List=_3_bath, DispatchPattern=equals_2.Equality)  # -> ListA, ListB
_4_bath = Data(entwine_33)
dispatch_12 = Dispatch(List=_4_bath, DispatchPattern=larger.OrEqualTo)  # -> ListA, ListB
merge_44 = Merge(Data1=dispatch_12.ListA, Data2=dispatch_11.ListA, Data3=dispatch_10.ListA, Data4=dispatch_5.ListA)
clean_3 = CleanTree(RemoveNulls=True, RemoveInvalid=True, RemoveEmpty=True, Tree=merge_44)
panel = Panel(clean_3)
bath = Data(clean_3)
bath_2 = ClusterOutput(bath)

# ==== cluster Cluster_3
door_width = ClusterInput()
pt_door = ClusterInput()
room = ClusterInput()
door_width_2 = Number(door_width)
pt_door_2 = Point(pt_door)
room_2 = Curve(room)
flatten = FlattenTree(Tree=pt_door_2, Path="{0}")
neg = Negative(Value=door_width_2)
dom = ConstructDomain(DomainStart=neg, DomainEnd=door_width_2)
crv_cp = CurveClosestPoint(Point=flatten, Curve=room_2)  # -> Point, Parameter, Distance
explode = Explode(Curve=room_2, Recursive=True)  # -> Segments, Vertices
panel = Panel("-0.4 To 0.4")
smaller = SmallerThan(FirstNumber=crv_cp.Distance, SecondNumber=0.12)  # -> SmallerThan, OrEqualTo
cull = CullPattern(List=flatten, CullPattern=smaller.SmallerThan)
crv_cp_2 = CurveClosestPoint(Point=cull, Curve=explode.Segments)  # -> Point, Parameter, Distance
area = Area(Geometry=room_2)  # -> Area, Centroid
sort = SortList(Keys=crv_cp_2.Distance, ValuesA=explode.Segments)  # -> Keys, ValuesA
item = ListItem(List=sort.ValuesA, Index=0, Wrap=True)
curvepoint = PointOnCurve(item, parameter=0.5)
scale = Scale(Geometry=item, Center=curvepoint, Factor=5)  # -> Geometry, Transform
crv_cp_3 = CurveClosestPoint(Point=area.Centroid, Curve=scale.Geometry)  # -> Point, Parameter, Distance
ln = Line(StartPoint=area.Centroid, EndPoint=crv_cp_3.Point)
amp = Amplitude(Vector=ln, Amplitude=Slider(0.45, range=0..1))
rev = Reverse(Vector=amp)
pl = ConstructPlane(Origin=cull, XAxis=item, YAxis=rev)
rectangle = Rectangle(Plane=pl, XSize=dom, YSize=dom, Radius=0)  # -> Rectangle, Length
move = Move(Geometry=rectangle.Rectangle, Motion=rev)  # -> Geometry, Transform
door_area = Curve(move.Geometry)
door_area_2 = ClusterOutput(door_area)

# ==== cluster Simplify
crv = ClusterInput()
crv_2 = Curve(crv)
graft = GraftTree(Tree=crv_2, IncludeEmptyLists=True, IncludeNullItems=True)

# ----
# Simplify
explode = Explode(Curve=graft, Recursive=True)  # -> Segments, Vertices
crv_cp = CurveClosestPoint(Point=explode.Vertices, Curve=graft)  # -> Point, Parameter, Distance
eval = EvaluateCurve(Curve=graft, Parameter=crv_cp.Parameter)  # -> Point, Tangent, Angle
deg = Degrees(Radians=eval.Angle)
smaller = SmallerThan(FirstNumber=deg, SecondNumber="45")  # -> SmallerThan, OrEqualTo
panel = Panel(deg)
dispatch = Dispatch(List=explode.Vertices, DispatchPattern=smaller.SmallerThan)  # -> ListA, ListB
pline = PolyLine(Vertices=dispatch.ListB, Closed=True)

explode_2 = Explode(Curve=pline, Recursive=True)  # -> Segments, Vertices
crv_3 = Curve(pline)
crv_4 = ClusterOutput(crv_3)
